# Grasshopper definition Curves.gh (Grasshopper 1.0.7)
# Copyright: Wickerson Studios
# plug-ins: Bifocals

number_slider = Slider(4.071, range=0..10)
circle = Circle(Plane=PlaneXY(0, 0, 0), Radius=1)
point_a = PointA(Point(0, 0, 0))
point_b = PointB(Point(10, 5, 0))
circle_2 = Circle(Plane=PlaneXY(0, 0, 0), Radius=1)
polygon = Polygon(Plane=PlaneXY(0, 0, 0), Radius=3, Segments=6, FilletRadius=0)  # -> Polygon, Length
number_slider_2 = Slider(12, range=0..100)
rectangle = Rectangle(Plane=PlaneXY(0, 0, 0), XSize=Domain(-1, 1), YSize=Domain(-2, 2), Radius=0)  # -> Rectangle, Length
number_slider_3 = Slider(12, range=0..100)
rectangle_2pt = Rectangle2Pt(Plane=PlaneXY(0, 0, 0), PointA=point_a, PointB=point_b, Radius=0)  # -> Rectangle, Length
populate_2d = Populate2D(
    Region={Plane=PlaneXY(0, 0, 0), Size=Domain2(u=0..20, v=0..10)},
    Count=Slider(12, range=0..100),
    Seed=Slider(52, range=0..100))
explode = Explode(Curve=polygon.Polygon, Recursive=True)  # -> Segments, Vertices
unit_z = UnitZ(Factor=1)
unit_x = UnitX(Factor=1)
populate_2d_2 = Populate2D(Region={Plane=PlaneXY(0, 0, 0), Size=Domain2(u=0..20, v=0..10)}, Count=number_slider_2, Seed=Slider(52, range=0..100))
list_item = ListItem(List=populate_2d_2, Index=0, Wrap=True)  # -> Item, Item1, Item2, Item3
list_item_2 = ListItem(List=populate_2d_2, Index=0, Wrap=True)  # -> Item, Item1, Item2, Item3
list_item_3 = ListItem(List=populate_2d_2, Index=0, Wrap=True)  # -> Item, Item1, Item2
vector_2pt = Vector2Pt(PointA=list_item_3.Item1, PointB=list_item_3.Item2, Unitize=False)  # -> Vector, Length
rectangle_3pt = Rectangle3Pt(PointA=list_item.Item, PointB=list_item.Item1, PointC=list_item.Item3)  # -> Rectangle, Length
list_item_4 = ListItem(List=populate_2d, Index=0, Wrap=True)  # -> Item, Item1, Item2
point = Point(list_item_4.Item2)
tangent_lines = TangentLines(Point=point, Circle=circle_2)  # -> Tangent1, Tangent2
fit_line = FitLine(Points=populate_2d)
arc = Arc(Plane=PlaneXY(0, 0, 0), Radius=1, Angle=Domain(0, 3.141592654))  # -> Arc, Length
arc_sed = ArcSED(Start=list_item_3.Item, End=list_item_3.Item1, Direction=vector_2pt.Vector)  # -> Arc, Plane, Radius
curve_a = CurveA(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)
curve_c = CurveC(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)
curve_b = CurveB(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)
biarc = BiArc(
    StartPoint=list_item_2.Item3,
    StartTangent=list_item_2.Item,
    EndPoint=list_item_2.Item1,
    EndTangent=list_item_2.Item2,
    Ratio=0.5)  # -> FirstArc, SecondArc, BiArc
arc_3pt = Arc3Pt(PointA=list_item_3.Item, PointB=list_item_3.Item1, PointC=list_item_3.Item2)  # -> Arc, Plane, Radius
ellipse = Ellipse(Plane=PlaneXY(0, 0, 0), Radius1=Slider(12, range=0..100), Radius2=1)  # -> Ellipse, Focus1, Focus2
inellipse = InEllipse(CornerA=list_item_3.Item, CornerB=list_item_3.Item1, CornerC=list_item_3.Item2)  # -> Ellipse, Plane
incircle = InCircle(CornerA=list_item_3.Item, CornerB=list_item_3.Item1, CornerC=list_item_3.Item2)  # -> Circle, Plane, Radius
normal = Normal(Vector(0, 0, 1))
circle_3 = Circle(Plane=PlaneXY(0, 0, 0), Radius=1)
point_on_curve = PointOnCurve(curve_b, parameter=0.502)
list_item_5 = ListItem(List=explode.Vertices, Index=0, Wrap=True)  # -> Item, Item1
number_slider_4 = Slider(14, range=0..100)
list_item_6 = ListItem(List=populate_2d_2, Index=0, Wrap=True)  # -> Item, Item1, Item2
construct_plane = ConstructPlane(Origin=list_item_4.Item, XAxis=unit_x, YAxis=unit_z)
construct_plane_2 = ConstructPlane(Origin=list_item_4.Item2, XAxis=unit_x, YAxis=unit_z)
line = Line(StartPoint=list_item_4.Item, EndPoint=list_item_4.Item2)
pi = Pi(Factor=Slider(0.63, range=0..2))
deconstruct_plane = DeconstructPlane(Plane=construct_plane_2)  # -> Origin, XAxis, YAxis, ZAxis
circle_4 = Circle(Plane=deconstruct_plane.Origin, Radius=number_slider)
tangent_lines_ex = TangentLinesEx(CircleA=circle_2, CircleB=circle_4)  # -> Tangent1, Tangent2
tangent_lines_in = TangentLinesIn(CircleA=circle_2, CircleB=circle_4)  # -> Tangent1, Tangent2
circle_5 = Circle(Plane=deconstruct_plane.Origin, Radius=number_slider)
curve = Curve(biarc.FirstArc)
curve_2 = Curve(biarc.SecondArc)
curve_3 = Curve(biarc.BiArc)
circle_tantan = CircleTanTan(CurveA=reparameterize(curve_a), CurveB=reparameterize(curve_b), Point=point_on_curve)
circle_tantantan = CircleTanTanTan(CurveA=reparameterize(curve_a), CurveB=reparameterize(curve_b), CurveC=reparameterize(curve_c), Point=point_on_curve)
circle_fit = CircleFit(Points=populate_2d_2)  # -> Circle, Radius, Deviation
circle_3pt = Circle3Pt(PointA=list_item_6.Item, PointB=list_item_6.Item1, PointC=list_item_6.Item2)  # -> Circle, Plane, Radius
polygon_edge = PolygonEdge(EdgeStart=list_item_5.Item, EdgeEnd=list_item_5.Item1, PlanePoint=Point(-3, -1, 0), Segments=Slider(12, range=0..100))  # -> Polygon, Centre, CornerRadius, EdgeRadius
circle_cnr = CircleCNR(Center=list_item_6.Item, Normal=normal, Radius=number_slider_2)
tangent_arcs = TangentArcs(CircleA=circle_3, CircleB=circle_5, Radius=number_slider_4)  # -> ArcA, ArcB
modified_arc = ModifiedArc(Arc=curve, Radius=number_slider_4, Angle=pi)
line_2plane = Line2Plane(Line=line, PlaneA=construct_plane, PlaneB=construct_plane_2)
line_sdl = LineSDL(Start=list_item_4.Item, Direction=deconstruct_plane.YAxis, Length=Slider(12, range=0..100))
line_4pt = Line4Pt(Line=line, PointA=list_item_4.Item, PointB=list_item_4.Item1)
