# Grasshopper definition Curves003.gh (Grasshopper 1.0.7)
# Copyright: Wickerson Studios
# plug-ins: Bifocals

number_slider = Slider(36, range=0..100)  # disabled
populate_2d = Populate2D(Region={Plane=PlaneXY(0, 0, 0), Size=Domain2(u=0..20, v=0..10)}, Count=100, Seed=number_slider)  # disabled

number_slider_2 = Slider(7.819, range=0..10)  # disabled
number_slider_3 = Slider(12, range=0..100)  # disabled
number_slider_4 = Slider(70, range=0..100)  # disabled
point_a = PointA(Point(0, 0, 0))  # disabled
point_b = PointB(Point(10, 5, 0))  # disabled
circle = Circle(Plane=PlaneXY(0, 0, 0), Radius=number_slider_2)  # disabled
circle_2 = Circle(Plane=PlaneXY(0, 0, 0), Radius=1)  # disabled
polygon = Polygon(Plane=PlaneXY(0, 0, 0), Radius=3, Segments=6, FilletRadius=0)  # -> Polygon, Length; disabled
number_slider_5 = Slider(12, range=0..100)  # disabled
number_slider_6 = Slider(41, range=0..100)  # disabled
rectangle = Rectangle(Plane=PlaneXY(0, 0, 0), XSize=Domain(-1, 1), YSize=Domain(-2, 2), Radius=0)  # -> Rectangle, Length; disabled
number_slider_7 = Slider(10, range=0..100)  # disabled
number_slider_8 = Slider(24, range=0..100)  # disabled
rectangle_2pt = Rectangle2Pt(Plane=PlaneXY(0, 0, 0), PointA=point_a, PointB=point_b, Radius=0)  # -> Rectangle, Length; disabled
list_item = ListItem(List=populate_2d, Index=0, Wrap=True)  # -> Item, Item1, Item2, Item3; disabled
populate_2d_2 = Populate2D(Region={Plane=PlaneXY(0, 0, 0), Size=Domain2(u=0..20, v=0..10)}, Count=number_slider_3, Seed=number_slider_4)  # disabled
explode = Explode(Curve=polygon.Polygon, Recursive=True)  # -> Segments, Vertices; disabled
unit_z = UnitZ(Factor=1)  # disabled
unit_x = UnitX(Factor=1)  # disabled
rectangle_3pt = Rectangle3Pt(PointA=list_item.Item, PointB=list_item.Item1, PointC=list_item.Item3)  # -> Rectangle, Length; disabled
populate_2d_3 = Populate2D(Region={Plane=PlaneXY(0, 0, 0), Size=Domain2(u=0..20, v=0..10)}, Count=number_slider_5, Seed=number_slider_6)  # disabled
list_item_2 = ListItem(List=populate_2d_3, Index=0, Wrap=True)  # -> Item, Item1, Item2, Item3; disabled
list_item_3 = ListItem(List=populate_2d_3, Index=0, Wrap=True)  # -> Item, Item1, Item2; disabled
vector_2pt = Vector2Pt(PointA=list_item_3.Item1, PointB=list_item_3.Item2, Unitize=False)  # -> Vector, Length; disabled
fit_line = FitLine(Points=populate_2d_2)  # disabled
list_item_4 = ListItem(List=populate_2d_2, Index=0, Wrap=True)  # -> Item, Item1, Item2; disabled
point = Point(list_item_4.Item2)  # disabled
tangent_lines = TangentLines(Point=point, Circle=circle_2)  # -> Tangent1, Tangent2; disabled
number_slider_9 = Slider(1.09, range=0..2)  # disabled
biarc = BiArc(
    StartPoint=list_item_2.Item,
    StartTangent=list_item_2.Item1,
    EndPoint=list_item_2.Item3,
    EndTangent=list_item_2.Item2,
    Ratio=0.5)  # -> FirstArc, SecondArc, BiArc; disabled
curve_a = CurveA(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)  # disabled
curve_c = CurveC(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)  # disabled
curve_b = CurveB(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)  # disabled
arc = Arc(Plane=PlaneXY(0, 0, 0), Radius=1, Angle=Domain(0, 3.141592654))  # -> Arc, Length; disabled
number_slider_10 = Slider(11, range=0..100)  # disabled
ellipse = Ellipse(Plane=PlaneXY(0, 0, 0), Radius1=number_slider_7, Radius2=number_slider_8)  # -> Ellipse, Focus1, Focus2; disabled
inellipse = InEllipse(CornerA=list_item_3.Item, CornerB=list_item_3.Item1, CornerC=list_item_3.Item2)  # -> Ellipse, Plane; disabled
incircle = InCircle(CornerA=list_item_3.Item, CornerB=list_item_3.Item1, CornerC=list_item_3.Item2)  # -> Circle, Plane, Radius; disabled
arc_sed = ArcSED(Start=list_item_3.Item, End=list_item_3.Item1, Direction=vector_2pt.Vector)  # -> Arc, Plane, Radius; disabled
arc_3pt = Arc3Pt(PointA=list_item_3.Item, PointB=list_item_3.Item1, PointC=list_item_3.Item2)  # -> Arc, Plane, Radius; disabled
normal = Normal(Vector(0, 0, 1))  # disabled
circle_3 = Circle(Plane=PlaneXY(0, 0, 0), Radius=1)  # disabled
list_item_5 = ListItem(List=explode.Vertices, Index=0, Wrap=True)  # -> Item, Item1; disabled
point_on_curve = PointOnCurve(curve_a, parameter=0.478)  # disabled
number_slider_11 = Slider(10, range=0..100)  # disabled
number_slider_12 = Slider(17, range=0..100)  # disabled
list_item_6 = ListItem(List=populate_2d_3, Index=0, Wrap=True)  # -> Item, Item1, Item2; disabled
construct_plane = ConstructPlane(Origin=list_item_4.Item, XAxis=unit_x, YAxis=unit_z)  # disabled
construct_plane_2 = ConstructPlane(Origin=list_item_4.Item2, XAxis=unit_x, YAxis=unit_z)  # disabled
line = Line(StartPoint=list_item_4.Item, EndPoint=list_item_4.Item2)  # disabled
pi = Pi(Factor=number_slider_9)  # disabled
deconstruct_plane = DeconstructPlane(Plane=construct_plane_2)  # -> Origin, XAxis, YAxis, ZAxis; disabled
circle_4 = Circle(Plane=deconstruct_plane.Origin, Radius=number_slider_2)  # disabled
tangent_lines_ex = TangentLinesEx(CircleA=circle_2, CircleB=circle_4)  # -> Tangent1, Tangent2; disabled
tangent_lines_in = TangentLinesIn(CircleA=circle_2, CircleB=circle_4)  # -> Tangent1, Tangent2; disabled
circle_5 = Circle(Plane=deconstruct_plane.Origin, Radius=number_slider_2)  # disabled
curve = Curve(biarc.FirstArc)  # disabled
curve_2 = Curve(biarc.SecondArc)  # disabled
curve_3 = Curve(biarc.BiArc)  # disabled
circle_tantan = CircleTanTan(CurveA=reparameterize(curve_a), CurveB=reparameterize(curve_b), Point=point_on_curve)  # disabled
circle_tantantan = CircleTanTanTan(CurveA=reparameterize(curve_a), CurveB=reparameterize(curve_b), CurveC=reparameterize(curve_c), Point=point_on_curve)  # disabled
circle_fit = CircleFit(Points=populate_2d_3)  # -> Circle, Radius, Deviation; disabled
polygon_edge = PolygonEdge(EdgeStart=list_item_5.Item, EdgeEnd=list_item_5.Item1, PlanePoint=Point(-3, -1, 0), Segments=number_slider_10)  # -> Polygon, Centre, CornerRadius, EdgeRadius; disabled
circle_3pt = Circle3Pt(PointA=list_item_6.Item, PointB=list_item_6.Item1, PointC=list_item_6.Item2)  # -> Circle, Plane, Radius; disabled
circle_cnr = CircleCNR(Center=list_item_6.Item, Normal=normal, Radius=number_slider_5)  # disabled
tangent_arcs = TangentArcs(CircleA=circle_3, CircleB=circle_5, Radius=number_slider_11)  # -> ArcA, ArcB; disabled
modified_arc = ModifiedArc(Arc=curve, Radius=number_slider_11, Angle=pi)  # disabled
line_2plane = Line2Plane(Line=line, PlaneA=construct_plane, PlaneB=construct_plane_2)  # disabled
line_4pt = Line4Pt(Line=line, PointA=list_item_4.Item, PointB=list_item_4.Item1)  # disabled
line_sdl = LineSDL(Start=list_item_4.Item, Direction=deconstruct_plane.YAxis, Length=number_slider_12)  # disabled

line_2 = Line(StartPoint=list_item_3.Item, EndPoint=list_item_3.Item1)  # disabled
line_3 = Line(StartPoint=list_item_3.Item1, EndPoint=list_item_3.Item2)  # disabled
line_4 = Line(StartPoint=list_item_3.Item, EndPoint=list_item_3.Item2)  # disabled

number_slider_13 = Slider(12, range=0..100)  # disabled
number_slider_14 = Slider(12, range=0..100)  # disabled
graph_mapper = GraphMapper(
    x0=0,
    x1=1,
    y0=0,
    y1=1,
    container_name="Bezier",
    cpx=[0, 0.6144931316, 0.4753621519, 1],
    cpy=[0, 0.06521737576, 0.9057971239, 1])  # disabled
number_slider_15 = Slider(5, range=0..100)  # disabled
number_slider_16 = Slider(12, range=0..100)  # disabled
populate_2d_4 = Populate2D(Region={Plane=PlaneXY(0, 0, 0), Size=Domain2(u=0..20, v=0..10)}, Count=number_slider_13, Seed=number_slider_14)  # disabled
number_slider_17 = Slider(12, range=0..100)  # disabled
number_slider_18 = Slider(63, range=0..100)  # disabled
number_slider_19 = Slider(0.86, range=0..1)  # disabled
list_item_7 = ListItem(List=populate_2d_4, Index=0, Wrap=True)  # -> Item, Item1, Item2, Item3, Item4, Item5, Item6, Item7, Item8; disabled
point_2 = Point([list_item_7.Item, list_item_7.Item1, list_item_7.Item2, list_item_7.Item3])  # disabled
point_3 = Point([list_item_7.Item, list_item_7.Item1, list_item_7.Item2, list_item_7.Item3])  # disabled
point_4 = Point(populate_2d_4)  # disabled
populate_2d_5 = Populate2D(Region={Plane=PlaneXY(0, 0, 0), Size=Domain2(u=0..20, v=0..10)}, Count=number_slider_15, Seed=number_slider_16)  # disabled
number_slider_20 = Slider(2, range=0..2)  # disabled
number_slider_21 = Slider(1.44, range=0..10)  # disabled
number_slider_22 = Slider(1.6, range=0..10)  # disabled
number_slider_23 = Slider(4, range=0..100)  # disabled
number_slider_24 = Slider(1, range=0..1)  # disabled
number_slider_25 = Slider(0.71, range=0..1)  # disabled
plane_normal = PlaneNormal(Origin=point_2, ZAxis=Vector(0, 0, 1))  # disabled
populate_3d = Populate3D(
    Region={Plane=PlaneXY(0, 0, 0), X=Domain(0, 10), Y=Domain(0, 10), Z=Domain(0, 2)},
    Count=number_slider_17,
    Seed=number_slider_18)  # disabled
number_slider_26 = Slider(68, range=0..100)  # disabled
number_slider_27 = Slider(1.374, range=0..10)  # disabled
interpolate_t = InterpolateT(Vertices=point_3, TangentStart=list_item_7.Item4, TangentEnd=list_item_7.Item6, KnotStyle=1)  # -> Curve, Length, Domain; disabled
bezier_span = BezierSpan(StartPoint=list_item_7.Item3, StartTangent=list_item_7.Item3, EndPoint=list_item_7.Item1, EndTangent=list_item_7.Item)  # -> Curve, Length, Domain; disabled
nurbs_curve = NurbsCurve(Vertices=populate_2d_4, Degree=3, Periodic=False)  # -> Curve, Length, Domain; disabled
interpolate = Interpolate(Vertices=point_2, Degree=3, Periodic=False, KnotStyle=1)  # -> Curve, Length, Domain; disabled
kinky_curve = KinkyCurve(Vertices=populate_2d_4, Degree=3, Angle=number_slider_19)  # -> Curve, Length, Domain; disabled
polyline = PolyLine(Vertices=point_4, Closed=False)  # disabled
polyarc = PolyArc(Vertices=point_2, Tangent=[Vector(26, 157, 0), Vector(444, 176, 0), Vector(380, -377, 0)], Closed=False)  # disabled
list_item_8 = ListItem(List=populate_2d_5, Index=0, Wrap=True)  # -> Item, Item1, Item2, Item3, Item4, Item5, Item6, Item7, Item8; disabled
point_5 = Point([list_item_8.Item4, list_item_8.Item5, list_item_8.Item6])  # disabled
md_slider = MDSlider(
    SliderMode=0,
    slider_value=Point(0.2222788741, 0.2728866949, 0.5),
    x_domain=Domain(0, 1),
    y_domain=Domain(0, 1),
    z_domain=Domain(0, 1))  # disabled
md_slider_2 = MDSlider(
    SliderMode=0,
    slider_value=Point(1, 0.5725626131, 0.5),
    x_domain=Domain(0, 1),
    y_domain=Domain(0, 1),
    z_domain=Domain(0, 1))  # disabled
interpolate_2 = Interpolate(Vertices=point_5, Degree=3, Periodic=False, KnotStyle=1)  # -> Curve, Length, Domain; disabled
number_slider_28 = Slider(0.58, range=0..1)  # disabled
sort_points = SortPoints(Points=populate_3d)  # -> Points, Indices; disabled
interpolate_3 = Interpolate(Vertices=[list_item_8.Item, list_item_8.Item1, list_item_8.Item2], Degree=3, Periodic=False, KnotStyle=1)  # -> Curve, Length, Domain; disabled
tangent_curve = TangentCurve(Vertices=point_2, Tangents=plane_normal, Blend=number_slider_25, Degree=3)  # -> Curve, Length, Domain; disabled
construct_domain = ConstructDomain(DomainStart=0, DomainEnd=number_slider_24)  # disabled
blend_curve = BlendCurve(
    CurveA=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,
    CurveB=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,
    BulgeA=number_slider_21,
    BulgeB=number_slider_22,
    Continuity=number_slider_20)  # disabled
surface = Surface(reparameterize(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))  # disabled
blend_curve_pt = BlendCurvePt(CurveA=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, CurveB=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, Point=Point(15, 21, 0), Continuity=number_slider_20)  # disabled
catenary = Catenary(PointB=Point(-23, 21, 0), Length=number_slider_26, Gravity=Vector(0, -277, 0))  # disabled
connect_curves = ConnectCurves(Curves=[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], Continuity=2, Close=True, Bulge=number_slider_27)  # disabled
md_slider_3 = MDSlider(
    SliderMode=0,
    slider_value=Point(0.8713393793, 0.8173269877, 0.5),
    x_domain=Domain(0, 1),
    y_domain=Domain(0, 1),
    z_domain=Domain(0, 1))  # disabled
md_slider_4 = MDSlider(
    SliderMode=0,
    slider_value=Point(0.5877707877, 0.8240780714, 0.5),
    x_domain=Domain(0, 1),
    y_domain=Domain(0, 1),
    z_domain=Domain(0, 1))  # disabled
md_slider_5 = MDSlider(
    SliderMode=0,
    slider_value=Point(0.2512028392, 0.2582918493, 0.5),
    x_domain=Domain(0, 1),
    y_domain=Domain(0, 1),
    z_domain=Domain(0, 1))  # disabled
sub_curve = SubCurve(BaseCurve=reparameterize(interpolate_3.Curve), Domain=construct_domain)  # disabled
surface_from_points = SurfaceFromPoints(Points=flatten(sort_points.Points), UCount=number_slider_23, Interpolate=False)  # disabled
iso_curve = IsoCurve(Surface=reparameterize(surface), UVPoint=[md_slider_2, md_slider])  # -> UIsocurve, VIsocurve; disabled
tween_curve = TweenCurve(CurveA=interpolate_3.Curve, CurveB=interpolate_2.Curve, Factor=number_slider_28, BlendType=0)  # disabled
start = Start(<start referenced from the Rhino model>)  # disabled
end = End(Point(6.909821222, -5.585234356, 12.5042373))  # disabled
curve_curve = CurveCurve(CurveA=iso_curve.UIsocurve, CurveB=iso_curve.VIsocurve)  # -> flatten(Points), ParamsA, ParamsB; disabled
dispatch = Dispatch(List=iso_curve.VIsocurve, DispatchPattern=[True, False])  # -> flatten(ListA), flatten(ListB); disabled
dispatch_2 = Dispatch(List=iso_curve.UIsocurve, DispatchPattern=[True, False])  # -> flatten(ListA), flatten(ListB); disabled
curve_on_surface = CurveOnSurface(Surface=reparameterize(surface_from_points), UVCoordinates=[md_slider_4, md_slider_5, md_slider_3], Closed=False)  # -> Curve, Length, Domain; disabled
geodesic = Geodesic(Surface=reparameterize(surface), Start=start, End=end)  # disabled
dispatch_3 = Dispatch(List=curve_curve.Points, DispatchPattern=[True, False])  # -> ListA, ListB; disabled
curve_4 = Curve(geodesic)  # disabled
line_5 = Line(StartPoint=dispatch_3.ListA, EndPoint=dispatch_3.ListB)  # disabled
loft = Loft(Curves=dispatch.ListA, Options={Adjust=False, Closed=False, LoftEnds=0, LoftSimp=0, LoftType=0, Rebuild=10, Refit=0.01})  # disabled
pipe = Pipe(Curve=iso_curve.VIsocurve, Radius=1, Caps=0)  # disabled
loft_2 = Loft(
    Curves=dispatch_2.ListA,
    Options={Adjust=False, Closed=False, LoftEnds=0, LoftSimp=0, LoftType=0, Rebuild=10, Refit=0.01})  # disabled
pipe_2 = Pipe(Curve=iso_curve.UIsocurve, Radius=1, Caps=0)  # disabled

number_slider_29 = Slider(2, range=0..10)  # disabled
number_slider_30 = Slider(8, range=0..10)  # disabled
points = Points([Point(-194, -36, 0), Point(-135, 17, 57.98615711), Point(-79.66769086, -35, 0), Point(31, -102, 0), Point(68, -47, 0), Point(110, 39, 78.74231503), Point(163, 16, 0), Point(211, 6, -77.86635679)])  # disabled
boolean_toggle = BooleanToggle(True)  # disabled
panel = Panel(points)  # disabled
knot_vector = KnotVector(Count=number_slider_30, Degree=number_slider_29, Periodic=boolean_toggle)  # disabled
panel_2 = Panel("""2
3
4
5
4
3
2
3""")  # disabled
panel_3 = Panel(knot_vector)  # disabled
nurbs_curve_pwk = NurbsCurvePWK(Points=points, Weights=panel_2, Knots=knot_vector)  # -> Curve, Length, Domain; disabled

point_6 = Point(Point(-62, -11, 0))
curve_5 = Curve(<curve referenced from the Rhino model>)
curve_6 = Curve([<curve referenced from the Rhino model> x4])
unit_z_2 = UnitZ(Factor=1)
unit_y = UnitY(Factor=1)
unit_x_2 = UnitX(Factor=1)
point_on_curve_2 = PointOnCurve(curve_5, parameter=0.384)
shatter = Shatter()
contour_ex = ContourEx(Plane=PlaneXY(0, 0, 0))  # -> Contours, Parameters
divide_distance = DivideDistance()  # -> Points, Tangents, Parameters
divide_length = DivideLength()  # -> Points, Tangents, Parameters
divide_curve = DivideCurve(Count=10, Kinks=False)  # -> Points, Tangents, Parameters
curve_frames = CurveFrames(Count=10)  # -> Frames, Parameters
horizontal_frames = HorizontalFrames(Count=10)  # -> Frames, Parameters
perp_frames = PerpFrames(Count=10, Align=True)  # -> Frames, Parameters
dash_pattern = DashPattern()  # -> Dashes, Gaps
contour = Contour(Curve=reparameterize(curve_6), Point=point_6, Direction=unit_y, Distance=Slider(30, range=0..30))  # -> Contours, Parameters
point_7 = Point(flatten(contour.Contours))
panel_4 = Panel(contour.Parameters)
interpolate_4 = Interpolate(Vertices=point_7, Degree=3, Periodic=False, KnotStyle=1)  # -> Curve, Length, Domain
