# Grasshopper definition Curves009.gh (Grasshopper 1.0.7)
# Copyright: Wickerson Studios
# plug-ins: Pufferfish, Bifocals

number_slider = Slider(36, range=0..100)  # disabled
populate_2d = Populate2D(Region={Plane=PlaneXY(0, 0, 0), Size=Domain2(u=0..20, v=0..10)}, Count=100, Seed=number_slider)  # disabled

number_slider_2 = Slider(7.819, range=0..10)  # disabled
number_slider_3 = Slider(12, range=0..100)  # disabled
number_slider_4 = Slider(70, range=0..100)  # disabled
point_a = PointA(Point(0, 0, 0))  # disabled
point_b = PointB(Point(10, 5, 0))  # disabled
circle = Circle(Plane=PlaneXY(0, 0, 0), Radius=number_slider_2)  # disabled
circle_2 = Circle(Plane=PlaneXY(0, 0, 0), Radius=1)  # disabled
polygon = Polygon(Plane=PlaneXY(0, 0, 0), Radius=3, Segments=6, FilletRadius=0)  # -> Polygon, Length; disabled
number_slider_5 = Slider(12, range=0..100)  # disabled
number_slider_6 = Slider(41, range=0..100)  # disabled
rectangle = Rectangle(Plane=PlaneXY(0, 0, 0), XSize=Domain(-1, 1), YSize=Domain(-2, 2), Radius=0)  # -> Rectangle, Length; disabled
number_slider_7 = Slider(10, range=0..100)  # disabled
number_slider_8 = Slider(24, range=0..100)  # disabled
rectangle_2pt = Rectangle2Pt(Plane=PlaneXY(0, 0, 0), PointA=point_a, PointB=point_b, Radius=0)  # -> Rectangle, Length; disabled
list_item = ListItem(List=populate_2d, Index=0, Wrap=True)  # -> Item, Item1, Item2, Item3; disabled
populate_2d_2 = Populate2D(Region={Plane=PlaneXY(0, 0, 0), Size=Domain2(u=0..20, v=0..10)}, Count=number_slider_3, Seed=number_slider_4)  # disabled
explode = Explode(Curve=polygon.Polygon, Recursive=True)  # -> Segments, Vertices; disabled
unit_z = UnitZ(Factor=1)  # disabled
unit_x = UnitX(Factor=1)  # disabled
rectangle_3pt = Rectangle3Pt(PointA=list_item.Item, PointB=list_item.Item1, PointC=list_item.Item3)  # -> Rectangle, Length; disabled
populate_2d_3 = Populate2D(Region={Plane=PlaneXY(0, 0, 0), Size=Domain2(u=0..20, v=0..10)}, Count=number_slider_5, Seed=number_slider_6)  # disabled
list_item_2 = ListItem(List=populate_2d_3, Index=0, Wrap=True)  # -> Item, Item1, Item2, Item3; disabled
list_item_3 = ListItem(List=populate_2d_3, Index=0, Wrap=True)  # -> Item, Item1, Item2; disabled
vector_2pt = Vector2Pt(PointA=list_item_3.Item1, PointB=list_item_3.Item2, Unitize=False)  # -> Vector, Length; disabled
fit_line = FitLine(Points=populate_2d_2)  # disabled
list_item_4 = ListItem(List=populate_2d_2, Index=0, Wrap=True)  # -> Item, Item1, Item2; disabled
point = Point(list_item_4.Item2)  # disabled
tangent_lines = TangentLines(Point=point, Circle=circle_2)  # -> Tangent1, Tangent2; disabled
number_slider_9 = Slider(1.09, range=0..2)  # disabled
biarc = BiArc(
    StartPoint=list_item_2.Item,
    StartTangent=list_item_2.Item1,
    EndPoint=list_item_2.Item3,
    EndTangent=list_item_2.Item2,
    Ratio=0.5)  # -> FirstArc, SecondArc, BiArc; disabled
curve_a = CurveA(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)  # disabled
curve_c = CurveC(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)  # disabled
curve_b = CurveB(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)  # disabled
arc = Arc(Plane=PlaneXY(0, 0, 0), Radius=1, Angle=Domain(0, 3.141592654))  # -> Arc, Length; disabled
number_slider_10 = Slider(11, range=0..100)  # disabled
ellipse = Ellipse(Plane=PlaneXY(0, 0, 0), Radius1=number_slider_7, Radius2=number_slider_8)  # -> Ellipse, Focus1, Focus2; disabled
inellipse = InEllipse(CornerA=list_item_3.Item, CornerB=list_item_3.Item1, CornerC=list_item_3.Item2)  # -> Ellipse, Plane; disabled
incircle = InCircle(CornerA=list_item_3.Item, CornerB=list_item_3.Item1, CornerC=list_item_3.Item2)  # -> Circle, Plane, Radius; disabled
arc_sed = ArcSED(Start=list_item_3.Item, End=list_item_3.Item1, Direction=vector_2pt.Vector)  # -> Arc, Plane, Radius; disabled
arc_3pt = Arc3Pt(PointA=list_item_3.Item, PointB=list_item_3.Item1, PointC=list_item_3.Item2)  # -> Arc, Plane, Radius; disabled
normal = Normal(Vector(0, 0, 1))  # disabled
circle_3 = Circle(Plane=PlaneXY(0, 0, 0), Radius=1)  # disabled
list_item_5 = ListItem(List=explode.Vertices, Index=0, Wrap=True)  # -> Item, Item1; disabled
point_on_curve = PointOnCurve(curve_a, parameter=0.478)  # disabled
number_slider_11 = Slider(10, range=0..100)  # disabled
number_slider_12 = Slider(17, range=0..100)  # disabled
list_item_6 = ListItem(List=populate_2d_3, Index=0, Wrap=True)  # -> Item, Item1, Item2; disabled
construct_plane = ConstructPlane(Origin=list_item_4.Item, XAxis=unit_x, YAxis=unit_z)  # disabled
construct_plane_2 = ConstructPlane(Origin=list_item_4.Item2, XAxis=unit_x, YAxis=unit_z)  # disabled
line = Line(StartPoint=list_item_4.Item, EndPoint=list_item_4.Item2)  # disabled
pi = Pi(Factor=number_slider_9)  # disabled
deconstruct_plane = DeconstructPlane(Plane=construct_plane_2)  # -> Origin, XAxis, YAxis, ZAxis; disabled
circle_4 = Circle(Plane=deconstruct_plane.Origin, Radius=number_slider_2)  # disabled
tangent_lines_ex = TangentLinesEx(CircleA=circle_2, CircleB=circle_4)  # -> Tangent1, Tangent2; disabled
tangent_lines_in = TangentLinesIn(CircleA=circle_2, CircleB=circle_4)  # -> Tangent1, Tangent2; disabled
circle_5 = Circle(Plane=deconstruct_plane.Origin, Radius=number_slider_2)  # disabled
curve = Curve(biarc.FirstArc)  # disabled
curve_2 = Curve(biarc.SecondArc)  # disabled
curve_3 = Curve(biarc.BiArc)  # disabled
circle_tantan = CircleTanTan(CurveA=reparameterize(curve_a), CurveB=reparameterize(curve_b), Point=point_on_curve)  # disabled
circle_tantantan = CircleTanTanTan(CurveA=reparameterize(curve_a), CurveB=reparameterize(curve_b), CurveC=reparameterize(curve_c), Point=point_on_curve)  # disabled
circle_fit = CircleFit(Points=populate_2d_3)  # -> Circle, Radius, Deviation; disabled
polygon_edge = PolygonEdge(EdgeStart=list_item_5.Item, EdgeEnd=list_item_5.Item1, PlanePoint=Point(-3, -1, 0), Segments=number_slider_10)  # -> Polygon, Centre, CornerRadius, EdgeRadius; disabled
circle_3pt = Circle3Pt(PointA=list_item_6.Item, PointB=list_item_6.Item1, PointC=list_item_6.Item2)  # -> Circle, Plane, Radius; disabled
circle_cnr = CircleCNR(Center=list_item_6.Item, Normal=normal, Radius=number_slider_5)  # disabled
tangent_arcs = TangentArcs(CircleA=circle_3, CircleB=circle_5, Radius=number_slider_11)  # -> ArcA, ArcB; disabled
modified_arc = ModifiedArc(Arc=curve, Radius=number_slider_11, Angle=pi)  # disabled
line_2plane = Line2Plane(Line=line, PlaneA=construct_plane, PlaneB=construct_plane_2)  # disabled
line_4pt = Line4Pt(Line=line, PointA=list_item_4.Item, PointB=list_item_4.Item1)  # disabled
line_sdl = LineSDL(Start=list_item_4.Item, Direction=deconstruct_plane.YAxis, Length=number_slider_12)  # disabled

line_2 = Line(StartPoint=list_item_3.Item, EndPoint=list_item_3.Item1)  # disabled
line_3 = Line(StartPoint=list_item_3.Item1, EndPoint=list_item_3.Item2)  # disabled
line_4 = Line(StartPoint=list_item_3.Item, EndPoint=list_item_3.Item2)  # disabled

number_slider_13 = Slider(12, range=0..100)  # disabled
number_slider_14 = Slider(12, range=0..100)  # disabled
graph_mapper = GraphMapper(
    x0=0,
    x1=1,
    y0=0,
    y1=1,
    container_name="Bezier",
    cpx=[0, 0.6144931316, 0.4753621519, 1],
    cpy=[0, 0.06521737576, 0.9057971239, 1])  # disabled
number_slider_15 = Slider(5, range=0..100)  # disabled
number_slider_16 = Slider(12, range=0..100)  # disabled
populate_2d_4 = Populate2D(Region={Plane=PlaneXY(0, 0, 0), Size=Domain2(u=0..20, v=0..10)}, Count=number_slider_13, Seed=number_slider_14)  # disabled
number_slider_17 = Slider(12, range=0..100)  # disabled
number_slider_18 = Slider(63, range=0..100)  # disabled
number_slider_19 = Slider(0.86, range=0..1)  # disabled
list_item_7 = ListItem(List=populate_2d_4, Index=0, Wrap=True)  # -> Item, Item1, Item2, Item3, Item4, Item5, Item6, Item7, Item8; disabled
point_2 = Point([list_item_7.Item, list_item_7.Item1, list_item_7.Item2, list_item_7.Item3])  # disabled
point_3 = Point([list_item_7.Item, list_item_7.Item1, list_item_7.Item2, list_item_7.Item3])  # disabled
point_4 = Point(populate_2d_4)  # disabled
populate_2d_5 = Populate2D(Region={Plane=PlaneXY(0, 0, 0), Size=Domain2(u=0..20, v=0..10)}, Count=number_slider_15, Seed=number_slider_16)  # disabled
number_slider_20 = Slider(2, range=0..2)  # disabled
number_slider_21 = Slider(1.44, range=0..10)  # disabled
number_slider_22 = Slider(1.6, range=0..10)  # disabled
number_slider_23 = Slider(4, range=0..100)  # disabled
number_slider_24 = Slider(1, range=0..1)  # disabled
number_slider_25 = Slider(0.71, range=0..1)  # disabled
plane_normal = PlaneNormal(Origin=point_2, ZAxis=Vector(0, 0, 1))  # disabled
populate_3d = Populate3D(
    Region={Plane=PlaneXY(0, 0, 0), X=Domain(0, 10), Y=Domain(0, 10), Z=Domain(0, 2)},
    Count=number_slider_17,
    Seed=number_slider_18)  # disabled
number_slider_26 = Slider(68, range=0..100)  # disabled
number_slider_27 = Slider(1.374, range=0..10)  # disabled
interpolate_t = InterpolateT(Vertices=point_3, TangentStart=list_item_7.Item4, TangentEnd=list_item_7.Item6, KnotStyle=1)  # -> Curve, Length, Domain; disabled
bezier_span = BezierSpan(StartPoint=list_item_7.Item3, StartTangent=list_item_7.Item3, EndPoint=list_item_7.Item1, EndTangent=list_item_7.Item)  # -> Curve, Length, Domain; disabled
nurbs_curve = NurbsCurve(Vertices=populate_2d_4, Degree=3, Periodic=False)  # -> Curve, Length, Domain; disabled
interpolate = Interpolate(Vertices=point_2, Degree=3, Periodic=False, KnotStyle=1)  # -> Curve, Length, Domain; disabled
kinky_curve = KinkyCurve(Vertices=populate_2d_4, Degree=3, Angle=number_slider_19)  # -> Curve, Length, Domain; disabled
polyline = PolyLine(Vertices=point_4, Closed=False)  # disabled
polyarc = PolyArc(Vertices=point_2, Tangent=[Vector(26, 157, 0), Vector(444, 176, 0), Vector(380, -377, 0)], Closed=False)  # disabled
list_item_8 = ListItem(List=populate_2d_5, Index=0, Wrap=True)  # -> Item, Item1, Item2, Item3, Item4, Item5, Item6, Item7, Item8; disabled
point_5 = Point([list_item_8.Item4, list_item_8.Item5, list_item_8.Item6])  # disabled
md_slider = MDSlider(
    SliderMode=0,
    slider_value=Point(0.2222788741, 0.2728866949, 0.5),
    x_domain=Domain(0, 1),
    y_domain=Domain(0, 1),
    z_domain=Domain(0, 1))  # disabled
md_slider_2 = MDSlider(
    SliderMode=0,
    slider_value=Point(1, 0.5725626131, 0.5),
    x_domain=Domain(0, 1),
    y_domain=Domain(0, 1),
    z_domain=Domain(0, 1))  # disabled
interpolate_2 = Interpolate(Vertices=point_5, Degree=3, Periodic=False, KnotStyle=1)  # -> Curve, Length, Domain; disabled
number_slider_28 = Slider(0.58, range=0..1)  # disabled
sort_points = SortPoints(Points=populate_3d)  # -> Points, Indices; disabled
interpolate_3 = Interpolate(Vertices=[list_item_8.Item, list_item_8.Item1, list_item_8.Item2], Degree=3, Periodic=False, KnotStyle=1)  # -> Curve, Length, Domain; disabled
tangent_curve = TangentCurve(Vertices=point_2, Tangents=plane_normal, Blend=number_slider_25, Degree=3)  # -> Curve, Length, Domain; disabled
construct_domain = ConstructDomain(DomainStart=0, DomainEnd=number_slider_24)  # disabled
blend_curve = BlendCurve(
    CurveA=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,
    CurveB=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,
    BulgeA=number_slider_21,
    BulgeB=number_slider_22,
    Continuity=number_slider_20)  # disabled
surface = Surface(reparameterize(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))  # disabled
blend_curve_pt = BlendCurvePt(CurveA=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, CurveB=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, Point=Point(15, 21, 0), Continuity=number_slider_20)  # disabled
catenary = Catenary(PointB=Point(-23, 21, 0), Length=number_slider_26, Gravity=Vector(0, -277, 0))  # disabled
connect_curves = ConnectCurves(Curves=[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], Continuity=2, Close=True, Bulge=number_slider_27)  # disabled
md_slider_3 = MDSlider(
    SliderMode=0,
    slider_value=Point(0.8713393793, 0.8173269877, 0.5),
    x_domain=Domain(0, 1),
    y_domain=Domain(0, 1),
    z_domain=Domain(0, 1))  # disabled
md_slider_4 = MDSlider(
    SliderMode=0,
    slider_value=Point(0.5877707877, 0.8240780714, 0.5),
    x_domain=Domain(0, 1),
    y_domain=Domain(0, 1),
    z_domain=Domain(0, 1))  # disabled
md_slider_5 = MDSlider(
    SliderMode=0,
    slider_value=Point(0.2512028392, 0.2582918493, 0.5),
    x_domain=Domain(0, 1),
    y_domain=Domain(0, 1),
    z_domain=Domain(0, 1))  # disabled
sub_curve = SubCurve(BaseCurve=reparameterize(interpolate_3.Curve), Domain=construct_domain)  # disabled
surface_from_points = SurfaceFromPoints(Points=flatten(sort_points.Points), UCount=number_slider_23, Interpolate=False)  # disabled
iso_curve = IsoCurve(Surface=reparameterize(surface), UVPoint=[md_slider_2, md_slider])  # -> UIsocurve, VIsocurve; disabled
tween_curve = TweenCurve(CurveA=interpolate_3.Curve, CurveB=interpolate_2.Curve, Factor=number_slider_28, BlendType=0)  # disabled
start = Start(<start referenced from the Rhino model>)  # disabled
end = End(Point(6.909821222, -5.585234356, 12.5042373))  # disabled
curve_curve = CurveCurve(CurveA=iso_curve.UIsocurve, CurveB=iso_curve.VIsocurve)  # -> flatten(Points), ParamsA, ParamsB; disabled
dispatch = Dispatch(List=iso_curve.VIsocurve, DispatchPattern=[True, False])  # -> flatten(ListA), flatten(ListB); disabled
dispatch_2 = Dispatch(List=iso_curve.UIsocurve, DispatchPattern=[True, False])  # -> flatten(ListA), flatten(ListB); disabled
curve_on_surface = CurveOnSurface(Surface=reparameterize(surface_from_points), UVCoordinates=[md_slider_4, md_slider_5, md_slider_3], Closed=False)  # -> Curve, Length, Domain; disabled
geodesic = Geodesic(Surface=reparameterize(surface), Start=start, End=end)  # disabled
dispatch_3 = Dispatch(List=curve_curve.Points, DispatchPattern=[True, False])  # -> ListA, ListB; disabled
curve_4 = Curve(geodesic)  # disabled
line_5 = Line(StartPoint=dispatch_3.ListA, EndPoint=dispatch_3.ListB)  # disabled
loft = Loft(Curves=dispatch.ListA, Options={Adjust=False, Closed=False, LoftEnds=0, LoftSimp=0, LoftType=0, Rebuild=10, Refit=0.01})  # disabled
pipe = Pipe(Curve=iso_curve.VIsocurve, Radius=1, Caps=0)  # disabled
loft_2 = Loft(
    Curves=dispatch_2.ListA,
    Options={Adjust=False, Closed=False, LoftEnds=0, LoftSimp=0, LoftType=0, Rebuild=10, Refit=0.01})  # disabled
pipe_2 = Pipe(Curve=iso_curve.UIsocurve, Radius=1, Caps=0)  # disabled

number_slider_29 = Slider(2, range=0..10)  # disabled
number_slider_30 = Slider(8, range=0..10)  # disabled
points = Points([Point(-194, -36, 0), Point(-135, 17, 57.98615711), Point(-79.66769086, -35, 0), Point(31, -102, 0), Point(68, -47, 0), Point(110, 39, 78.74231503), Point(163, 16, 0), Point(211, 6, -77.86635679)])  # disabled
boolean_toggle = BooleanToggle(True)  # disabled
panel = Panel(points)  # disabled
knot_vector = KnotVector(Count=number_slider_30, Degree=number_slider_29, Periodic=boolean_toggle)  # disabled
panel_2 = Panel("""2
3
4
5
4
3
2
3""")  # disabled
panel_3 = Panel(knot_vector)  # disabled
nurbs_curve_pwk = NurbsCurvePWK(Points=points, Weights=panel_2, Knots=knot_vector)  # -> Curve, Length, Domain; disabled

number_slider_31 = Slider(7, range=0..30)  # disabled
number_slider_32 = Slider(10, range=0..10)  # disabled
point_6 = Point(Point(-62, -11, 0))  # disabled
curve_5 = Curve(<curve referenced from the Rhino model>)  # disabled
curve_6 = Curve([<curve referenced from the Rhino model> x4])  # disabled
number_slider_33 = Slider(16.72, range=0..30)  # disabled
unit_z_2 = UnitZ(Factor=1)  # disabled
unit_y = UnitY(Factor=1)  # disabled
unit_x_2 = UnitX(Factor=1)  # disabled
curve_7 = Curve(<curve referenced from the Rhino model>)  # disabled
number_slider_34 = Slider(0.54, range=0..1)  # disabled
curve_8 = Curve([<curve referenced from the Rhino model> x4])  # disabled
gene_pool = GenePool(
    Decimals=2,
    Maximum=1,
    Minimum=0,
    Value=[0.7450718133, 0.5308148705, 0.9001635448, 0.517696345, 0.100366971, 0.9594679917, 0.8693810449, 0.9116381029, 0.8098899344, 0.8725413596])  # disabled
number_slider_35 = Slider(7, range=0..10)  # disabled
number_slider_36 = Slider(12, range=0..100)  # disabled
number_slider_37 = Slider(4, range=0..10)  # disabled
curve_9 = Curve([<curve referenced from the Rhino model> x4])  # disabled
point_on_curve_2 = PointOnCurve(curve_5, parameter=0.179)  # disabled
boolean_toggle_2 = BooleanToggle(True)  # disabled
number_slider_38 = Slider(7, range=0..10)  # disabled
number_slider_39 = Slider(2, range=0..10)  # disabled
curve_10 = Curve([<curve referenced from the Rhino model> x4])  # disabled
contour = Contour(Curve=reparameterize(curve_5), Point=point_on_curve_2, Direction=unit_y, Distance=number_slider_31)  # -> Contours, Parameters; disabled
contour_ex = ContourEx(Curve=reparameterize(curve_5), Plane=unit_y, Distances=number_slider_33)  # -> Contours, Parameters; disabled
dash_pattern = DashPattern(Curve=reparameterize(curve_6), Pattern=number_slider_32)  # -> flatten(Dashes), Gaps; disabled
shatter = Shatter(Curve=reparameterize(curve_9), Parameters=gene_pool)  # disabled
divide_curve = DivideCurve(Curve=curve_8, Count=number_slider_35, Kinks=boolean_toggle_2)  # -> Points, Tangents, Parameters; disabled
divide_distance = DivideDistance(Curve=curve_8, Distance=number_slider_36)  # -> Points, Tangents, Parameters; disabled
divide_length = DivideLength(Curve=curve_8, Length=number_slider_36)  # -> Points, Tangents, Parameters; disabled
number_slider_40 = Slider(5, range=0..10)  # disabled
curve_frames = CurveFrames(Curve=curve_9, Count=number_slider_37)  # -> Frames, Parameters; disabled
horizontal_frames = HorizontalFrames(Curve=curve_10, Count=number_slider_39)  # -> Frames, Parameters; disabled
perp_frames = PerpFrames(Curve=curve_10, Count=number_slider_39, Align=True)  # -> Frames, Parameters; disabled
mesh_box = MeshBox(
    Base={Plane=PlaneXY(0, 0, 0), X=Domain(-10, 10), Y=Domain(-10, 10), Z=Domain(-10, 10)},
    XCount=number_slider_39,
    YCount=number_slider_38,
    ZCount=number_slider_38)  # disabled
number_slider_41 = Slider(0, range=0..2)  # disabled
boolean_toggle_3 = BooleanToggle(True)  # disabled
point_7 = Point(flatten(contour.Contours))  # disabled
flip_matrix = FlipMatrix(Data=divide_curve.Points)  # disabled
geometry = Geometry(dash_pattern.Gaps)  # disabled
panel_4 = Panel(contour.Parameters)  # disabled
list_item_9 = ListItem(List=shatter, Index=number_slider_40, Wrap=True)  # disabled
orient = Orient(Geometry=mesh_box, Source=PlaneXY(0, 0, 0), Target=curve_frames.Frames)  # -> Geometry, Transform; disabled
orient_2 = Orient(Geometry=mesh_box, Source=PlaneXY(0, 0, 0), Target=horizontal_frames.Frames)  # -> Geometry, Transform; disabled
orient_3 = Orient(Geometry=mesh_box, Source=PlaneXY(0, 0, 0), Target=perp_frames.Frames)  # -> Geometry, Transform; disabled
interpolate_4 = Interpolate(Vertices=flip_matrix, Degree=3, Periodic=boolean_toggle_3, KnotStyle=1)  # -> Curve, Length, Domain; disabled
interpolate_5 = Interpolate(Vertices=divide_length.Points, Degree=3, Periodic=boolean_toggle_3, KnotStyle=number_slider_41)  # -> flatten(Curve), Length, Domain; disabled
interpolate_6 = Interpolate(Vertices=divide_distance.Points, Degree=3, Periodic=boolean_toggle_3, KnotStyle=number_slider_41)  # -> flatten(Curve), Length, Domain; disabled
interpolate_7 = Interpolate(Vertices=point_7, Degree=3, Periodic=False, KnotStyle=1)  # -> Curve, Length, Domain; disabled
loft_3 = Loft(
    Curves=interpolate_6.Curve,
    Options={Adjust=False, Closed=False, LoftEnds=0, LoftSimp=0, LoftType=0, Rebuild=10, Refit=0.01})  # disabled

number_slider_42 = Slider(7.18, range=0..10)  # disabled
number_slider_43 = Slider(0.82, range=0..2)  # disabled
curve_11 = Curve([<curve referenced from the Rhino model> x4])  # disabled
pipe_3 = Pipe(Curve=curve_11, Radius=number_slider_42, Caps=2)  # disabled
wstransformation = WSTransformation(geometry=pipe_3, domain_end=number_slider_43)  # disabled
wstransformations = WSTransformations(geometry=pipe_3, domain_end=number_slider_43)  # disabled
geometry_2 = Geometry(wstransformations)  # disabled
geometry_3 = Geometry(wstransformation)  # disabled

number_slider_44 = Slider(3, range=0..3)  # disabled
boolean_toggle_4 = BooleanToggle(False)  # disabled
point_8 = Point([<point referenced from the Rhino model> x5])  # disabled
number_slider_45 = Slider(12, range=0..100)  # disabled
number_slider_46 = Slider(17, range=0..100)  # disabled
number_slider_47 = Slider(25, range=0..100)  # disabled
interpolate_8 = Interpolate(Vertices=point_8, Degree=number_slider_44, Periodic=boolean_toggle_4, KnotStyle=1)  # -> Curve, Length, Domain; disabled
number_slider_48 = Slider(2, range=0..10)  # disabled
unit_x_3 = UnitX(Factor=number_slider_46)  # disabled
number_slider_49 = Slider(75, range=0..1000)  # disabled
number_slider_50 = Slider(37, range=0..100)  # disabled
number_slider_51 = Slider(12, range=0..100)  # disabled
number_slider_52 = Slider(35, range=0..100)  # disabled
number_slider_53 = Slider(0.25, range=0..1)  # disabled
populate_2d_6 = Populate2D(Region={Plane=PlaneXY(0, 0, 0), Size=Domain2(u=0..20, v=0..10)}, Count=number_slider_45, Seed=1)  # disabled
point_9 = Point([<point referenced from the Rhino model> x2])  # disabled
circle_6 = Circle(Plane=PlaneXY(0, 0, 0), Radius=number_slider_47)  # disabled
point_10 = Point(<point referenced from the Rhino model>)  # disabled
point_11 = Point(<point referenced from the Rhino model>)  # disabled
control_polygon = ControlPolygon(Curve=interpolate_8.Curve)  # -> Polygon, Points; disabled
number_slider_54 = Slider(42, range=0..100)  # disabled
control_points = ControlPoints(Curve=interpolate_8.Curve)  # -> Points, Weights, Knots; disabled
move = Move(Geometry=circle_6, Motion=unit_x_3)  # -> Geometry, Transform; disabled
number_slider_55 = Slider(0.62, range=0..1)  # disabled
curve_12 = Curve(<curve referenced from the Rhino model>)  # disabled
number_slider_56 = Slider(3, range=1..3)  # disabled
curve_b_2 = CurveB(<curve b referenced from the Rhino model>)  # disabled
curve_b_3 = CurveB(<curve b referenced from the Rhino model>)  # disabled
number_slider_57 = Slider(3.1, range=0..10)  # disabled
number_slider_58 = Slider(0.33, range=0..1)  # disabled
number_slider_59 = Slider(105.12, range=100..110)  # disabled
number_slider_60 = Slider(41, range=0..100)  # disabled
polyline_2 = Polyline(<polyline referenced from the Rhino model>)  # disabled
curve_13 = Curve(<curve referenced from the Rhino model>)  # disabled
curve_b_4 = CurveB(<curve b referenced from the Rhino model>)  # disabled
number_slider_61 = Slider(0.58, range=0..1)  # disabled
number_slider_62 = Slider(0.78, range=0..1)  # disabled
interpolate_9 = Interpolate(Vertices=point_9, Degree=3, Periodic=False, KnotStyle=1)  # -> Curve, Length, Domain; disabled
sphere = Sphere(Base=populate_2d_6, Radius=number_slider_48)  # disabled
circle_7 = Circle(Plane=PlaneXY(0, 0, 0), Radius=number_slider_47)  # disabled
point_on_curve_3 = PointOnCurve(circle_7, parameter=0.74)  # disabled
arc_2 = Arc(Plane=PlaneXY(0, 0, 0), Radius=number_slider_51, Angle=number_slider_49)  # -> Arc, Length; disabled
rectangle_2 = Rectangle(Plane=PlaneXY(0, 0, 0), XSize=number_slider_52, YSize=number_slider_50, Radius=0)  # -> Rectangle, Length; disabled
curve_a_2 = CurveA(<curve a referenced from the Rhino model>)  # disabled
point_12 = Point(control_polygon.Points)  # disabled
geometry_4 = Geometry(control_polygon.Polygon)  # disabled
panel_5 = Panel(control_points.Weights)  # disabled
point_in_curves = PointInCurves(Point=[point_10, point_11, point_on_curve_3], Curves=move.Geometry)  # -> Relationship, Index, Point; disabled
point_13 = Point(control_points.Points)  # disabled
polygon_center = PolygonCenter(Polyline=curve_13)  # -> CenterV, CenterE, CenterA; disabled
evaluate_curve = EvaluateCurve(Curve=reparameterize(curve_b_4), Parameter=number_slider_53)  # -> Point, Tangent, Angle; disabled
closed = Closed(Curve=curve_13)  # -> Closed, Periodic; disabled
panel_6 = Panel(control_points.Knots)  # disabled
end_points = EndPoints(Curve=interpolate_9.Curve)  # -> Start, End; disabled
perp_frame = PerpFrame(Curve=reparameterize(curve_b_4), Parameter=number_slider_53)  # disabled
derivatives = Derivatives(Curve=reparameterize(curve_b_4), Parameter=number_slider_53)  # -> Point, FirstDerivative, SecondDerivative, ThirdDerivative; disabled
discontinuity = Discontinuity(Curve=reparameterize(curve_b_2), Level=number_slider_56)  # -> Points, Parameters; disabled
horizontal_frame = HorizontalFrame(Curve=reparameterize(curve_b_4), Parameter=number_slider_53)  # disabled
curve_domain = CurveDomain(Curve=reparameterize(curve_b_3), Domain=number_slider_54)  # -> Curve, Domain; disabled
curve_closest_point = CurveClosestPoint(Point=populate_2d_6, Curve=curve_12)  # -> Point, Parameter, Distance; disabled
evaluate_length = EvaluateLength(Curve=reparameterize(curve_b_3), Length=number_slider_58, Normalized=True)  # -> Point, Tangent, Parameter; disabled
point_on_curve_4 = PointOnCurve(curve_b_4, parameter=0.36)  # disabled
curve_nearest_object = CurveNearestObject(Curve=curve_12, Geometry=sphere)  # -> PointA, PointB, Index; disabled
curvature = Curvature(Curve=reparameterize(curve_b_4), Parameter=number_slider_53)  # -> Point, Curvature, Curvature_2; disabled
curve_frame = CurveFrame(Curve=reparameterize(curve_b_4), Parameter=number_slider_53)  # disabled
torsion = Torsion(Curve=reparameterize(curve_b_3), Parameter=number_slider_55)  # -> Point, Torsion; disabled
planar = Planar(Curve=curve_b_2)  # -> Planar, Plane, Deviation; disabled
curvature_graph = CurvatureGraph(Curve=curve_12, Density=number_slider_57, Scale=number_slider_59)  # disabled
segment_lengths = SegmentLengths(Curve=reparameterize(curve_b_3))  # -> ShortestLength, ShortestDomain, LongestLength, LongestDomain; disabled
extremes = Extremes(Curve=curve_b_2, Plane=PlaneXY(0, 0, 0))  # -> Highest, Lowest; disabled
curve_proximity = CurveProximity(CurveA=reparameterize(curve_a_2), CurveB=reparameterize(curve_b_2))  # -> PointA, PointB, Distance; disabled
curve_side = CurveSide(Curve=curve_a_2, Point=populate_2d_6)  # -> Side, Left, Right; disabled
point_in_curve = PointInCurve(Point=point_10, Curve=reparameterize(circle_7))  # -> Relationship, Point; disabled
point_in_curve_2 = PointInCurve(Point=point_11, Curve=reparameterize(circle_7))  # -> Relationship, Point; disabled
length = Length(Curve=reparameterize(curve_b_3))  # disabled
point_in_curve_3 = PointInCurve(Point=point_on_curve_3, Curve=reparameterize(circle_7))  # -> Relationship, Point; disabled
length_parameter = LengthParameter(Curve=reparameterize(curve_b_3), Parameter=[number_slider_62, number_slider_61])  # -> graft(Length), graft(Length_2); disabled
deconstuct_rectangle = DeconstuctRectangle(Rectangle=rectangle_2.Rectangle)  # -> BasePlane, XInterval, YInterval; disabled
length_domain = LengthDomain(Curve=curve_b_3, Domain=number_slider_60)  # disabled
deconstruct_arc = DeconstructArc(Arc=arc_2.Arc)  # -> BasePlane, Radius, Angle; disabled
curve_middle = CurveMiddle(Curve=interpolate_8.Curve)  # disabled
panel_7 = Panel(closed.Closed)  # disabled
point_14 = Point(end_points.Start)  # disabled
point_15 = Point(end_points.End)  # disabled
panel_8 = Panel(closed.Periodic)  # disabled
point_16 = Point(polygon_center.CenterV)  # disabled
point_17 = Point(polygon_center.CenterE)  # disabled
point_18 = Point(polygon_center.CenterA)  # disabled
panel_9 = Panel(point_in_curves.Index)  # disabled
point_19 = Point(point_in_curves.Point)  # disabled
panel_10 = Panel(point_in_curves.Relationship)  # disabled
interpolate_10 = Interpolate(Vertices=point_13, Degree=number_slider_44, Periodic=boolean_toggle_4, KnotStyle=1)  # -> Curve, Length, Domain; disabled
point_20 = Point(derivatives.Point)  # disabled
point_21 = Point(evaluate_curve.Tangent)  # disabled
point_22 = Point(derivatives.FirstDerivative)  # disabled
point_23 = Point(derivatives.SecondDerivative)  # disabled
point_24 = Point(evaluate_curve.Point)  # disabled
point_25 = Point(derivatives.ThirdDerivative)  # disabled
panel_11 = Panel(curve_side.Right)  # disabled
point_26 = Point(curve_nearest_object.PointA)  # disabled
point_27 = Point(curve_nearest_object.PointB)  # disabled
panel_12 = Panel(curve_nearest_object.Index)  # disabled
point_28 = Point(extremes.Highest)  # disabled
panel_13 = Panel(discontinuity.Parameters)  # disabled
point_29 = Point(extremes.Lowest)  # disabled
point_30 = Point(discontinuity.Points)  # disabled
panel_14 = Panel(curve_domain.Domain)  # disabled
panel_15 = Panel(planar.Planar)  # disabled
curve_14 = Curve(curve_domain.Curve)  # disabled
panel_16 = Panel(planar.Plane)  # disabled
point_31 = Point(curve_proximity.PointA)  # disabled
panel_17 = Panel(planar.Deviation)  # disabled
plane = Plane(deconstruct_arc.BasePlane)  # disabled
panel_18 = Panel(curve_proximity.Distance)  # disabled
panel_19 = Panel(deconstruct_arc.Radius)  # disabled
panel_20 = Panel(deconstruct_arc.Angle)  # disabled
plane_2 = Plane(deconstuct_rectangle.BasePlane)  # disabled
panel_21 = Panel(evaluate_curve.Angle)  # disabled
panel_22 = Panel(torsion.Torsion)  # disabled
panel_23 = Panel(deconstuct_rectangle.YInterval)  # disabled
point_32 = Point(torsion.Point)  # disabled
point_33 = Point(evaluate_length.Point)  # disabled
point_34 = Point(evaluate_length.Tangent)  # disabled
panel_24 = Panel(deconstuct_rectangle.XInterval)  # disabled
panel_25 = Panel(length_domain)  # disabled
panel_26 = Panel(length_parameter.Length)  # disabled
panel_27 = Panel(segment_lengths.LongestLength)  # disabled
panel_28 = Panel(segment_lengths.LongestDomain)  # disabled
panel_29 = Panel(evaluate_length.Parameter)  # disabled
panel_30 = Panel(length)  # disabled
panel_31 = Panel(length_parameter.Length_2)  # disabled
panel_32 = Panel(segment_lengths.ShortestLength)  # disabled
panel_33 = Panel(segment_lengths.ShortestDomain)  # disabled
point_35 = Point(point_in_curve_2.Point)  # disabled
panel_34 = Panel(point_in_curve.Relationship)  # disabled
panel_35 = Panel(point_in_curve_2.Relationship)  # disabled
point_36 = Point(point_in_curve.Point)  # disabled
panel_36 = Panel(point_in_curve_3.Relationship)  # disabled
point_37 = Point(point_in_curve_3.Point)  # disabled
line_6 = Line(StartPoint=point_24, EndPoint=point_21)  # disabled
point_38 = Point(curve_proximity.PointB)  # disabled
panel_37 = Panel(curve_side.Side)  # disabled
line_7 = Line(StartPoint=point_28, EndPoint=point_29)  # disabled
line_8 = Line(StartPoint=point_33, EndPoint=point_34)  # disabled
line_9 = Line(StartPoint=point_38, EndPoint=point_31)  # disabled
panel_38 = Panel(curve_side.Left)  # disabled
domain = Domain(panel_24)  # disabled
domain_2 = Domain(panel_23)  # disabled

curve_15 = Curve(<curve referenced from the Rhino model>)  # disabled
number_slider_63 = Slider(10, range=0..10)  # disabled
curve_16 = Curve(<curve referenced from the Rhino model>)  # disabled
curve_17 = Curve(<curve referenced from the Rhino model>)  # disabled
curve_18 = Curve(<curve referenced from the Rhino model>)  # disabled
number_slider_64 = Slider(41, range=0..100)  # disabled
number_slider_65 = Slider(5.94, range=0..10)  # disabled
number_slider_66 = Slider(90, range=0..100)  # disabled
number_slider_67 = Slider(2, range=0..2)  # disabled
number_slider_68 = Slider(0.33, range=0..1)  # disabled
number_slider_69 = Slider(1, range=0..2)  # disabled
number_slider_70 = Slider(8.12, range=0..10)  # disabled
number_slider_71 = Slider(2, range=0..4)  # disabled
number_slider_72 = Slider(8.14, range=0..10)  # disabled
number_slider_73 = Slider(64, range=0..100)  # disabled
curve_19 = Curve(<curve referenced from the Rhino model>)  # disabled
unit_z_3 = UnitZ(Factor=1)  # disabled
number_slider_74 = Slider(86, range=0..100)  # disabled
number_slider_75 = Slider(68, range=0..100)  # disabled
number_slider_76 = Slider(11, range=0..100)  # disabled
number_slider_77 = Slider(3, range=0..10)  # disabled
curve_20 = Curve(<curve referenced from the Rhino model>)  # disabled
curve_21 = Curve(<curve referenced from the Rhino model>)  # disabled
boolean_toggle_5 = BooleanToggle(True)  # disabled
number_slider_78 = Slider(3, range=0..10)  # disabled
number_slider_79 = Slider(0.83, range=0..10)  # disabled
negative = Negative(Value=number_slider_63)  # disabled
curve_22 = Curve(reparameterize(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))  # disabled
guide = Guide(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)  # disabled
curves = Curves([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])  # disabled
guide_2 = Guide(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)  # disabled
sphere_2 = Sphere(Base=PlaneXY(0, 0, 0), Radius=number_slider_64)  # disabled
curve_23 = Curve(<curve referenced from the Rhino model>)  # disabled
number_slider_80 = Slider(5.45, range=0..10)  # disabled
curve_24 = Curve(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)  # disabled
curve_25 = Curve(<curve referenced from the Rhino model>)  # disabled
curve_26 = Curve(<curve referenced from the Rhino model>)  # disabled
curve_27 = Curve(<curve referenced from the Rhino model>)  # disabled
polyline_3 = Polyline(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)  # disabled
extend_curve = ExtendCurve(Curve=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, Type=number_slider_69, Start=number_slider_66, End=number_slider_66)  # disabled
fillet = Fillet(Curve=reparameterize(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), Parameter=number_slider_68, Radius=number_slider_65)  # -> Curve, Parameter; disabled
extend_curve_2 = ExtendCurve(Curve=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, Type=number_slider_67, Start=number_slider_66, End=number_slider_66)  # disabled
flip_curve = FlipCurve(Curve=reparameterize(curve_22), Guide=guide)  # -> Curve, Flag; disabled
flip_curve_2 = FlipCurve(Curve=reparameterize(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), Guide=guide_2)  # -> Curve, Flag; disabled
join_curves = JoinCurves(Curves=curves, Preserve=False)  # disabled
offset_curve_loose = OffsetCurveLoose(Curve=reparameterize(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), Distance=number_slider_70)  # disabled
fillet_distance = FilletDistance(Curve=reparameterize(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), Distance=number_slider_72)  # disabled
fillet_2 = Fillet(Curve=curve_21, Radius=number_slider_65)  # disabled
offset_curve = OffsetCurve(Curve=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, Distance=negative, Plane=PlaneXY(0, 0, 0), Corners=number_slider_71)  # disabled
explode_2 = Explode(Curve=curve_24, Recursive=boolean_toggle_5)  # -> Segments, Vertices; disabled
pull_curve = PullCurve(Curve=curve_20, Surface=sphere_2)  # disabled
project = Project(Curve=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, Brep=sphere_2, Direction=unit_z_3)  # disabled
simplify_curve = SimplifyCurve(Curve=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, Tolerance=number_slider_74)  # -> Curve, Simplified; disabled
reduce = Reduce(Polyline=curve_26, Tolerance=number_slider_73)  # -> Polyline, Reduction; disabled
polyline_collapse = PolylineCollapse(Polyline=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, Tolerance=number_slider_75)  # -> Polyline, Count; disabled
rebuild_curve = RebuildCurve(Curve=curve_23, Count=number_slider_78, Tangents=False)  # disabled
smooth_polyline = SmoothPolyline(Polyline=polyline_3, Strength=number_slider_79, Times=number_slider_77)  # disabled
curve_to_polyline = CurveToPolyline(Curve=curve_27, ToleranceDistance=number_slider_76, ToleranceAngle=0)  # -> Polyline, Segments; disabled
curve_28 = Curve(extend_curve)  # disabled
curve_29 = Curve(extend_curve_2)  # disabled
curve_30 = Curve(flip_curve_2.Curve)  # disabled
panel_39 = Panel(flip_curve.Flag)  # disabled
panel_40 = Panel(flip_curve_2.Flag)  # disabled
curve_31 = Curve(flip_curve.Curve)  # disabled
curve_32 = Curve(fillet.Curve)  # disabled
curve_33 = Curve(fillet_distance)  # disabled
curve_34 = Curve(fillet_2)  # disabled
curve_35 = Curve(join_curves)  # disabled
panel_41 = Panel(fillet.Parameter)  # disabled
panel_42 = Panel(explode_2.Segments)  # disabled
offset_on_srf = OffsetOnSrf(Curve=pull_curve, Distance=number_slider_80, Surface=sphere_2)  # disabled
panel_43 = Panel(reduce.Reduction)  # disabled
panel_44 = Panel(polyline_collapse.Count)  # disabled
panel_45 = Panel(simplify_curve.Simplified)  # disabled
panel_46 = Panel(curve_to_polyline.Segments)  # disabled
point_39 = Point(explode_2.Vertices)  # disabled
panel_47 = Panel(point_39)  # disabled

number_slider_81 = Slider(9, range=0..10)  # disabled
number_slider_82 = Slider(0.001, range=0..0.001)  # disabled
curve_36 = Curve(<curve referenced from the Rhino model>)  # disabled
fit_curve = FitCurve(Curve=curve_36, Degree=number_slider_81, Tolerance=number_slider_82)  # disabled

curve_37 = Curve(<curve referenced from the Rhino model>)  # disabled
number_slider_83 = Slider(0.65, range=0..1)  # disabled
close_curve = CloseCurve(Curve=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, CloseType=0, Bulge=0.5, Tolerance=0)  # -> Closed, ResultBoolean; disabled
seam_to_curve_corner = SeamToCurveCorner(Curve=reparameterize(close_curve.Closed))  # -> Adjusted, Point, ResultBoolean; disabled
seam = Seam(Curve=reparameterize(close_curve.Closed), Seam=number_slider_83)  # disabled

# ==== cluster WSTransformation: Rotates range of geometries around z axis
geometry = ClusterInput()
geometry_2 = Geometry(flatten(geometry))
list_length = ListLength(List=geometry_2)
domain_end = ClusterInput()
volume = Volume(Geometry=geometry_2)  # -> Volume, Centroid
construct_domain = ConstructDomain(DomainStart=0, DomainEnd=domain_end)
expression = Expression(x=list_length, Expression="x-1")
range = Range(Domain=construct_domain, Steps=expression)
unit_z = UnitZ(Factor=1)
pi = Pi(Factor=range)
rotate_3d = Rotate3D(Geometry=geometry_2, Angle=pi, Center=volume.Centroid, Axis=unit_z)  # -> Geometry, Transform

# ---- group: Cluster Output / Unresolved Proxy
geometry_3 = ClusterOutput(rotate_3d.Geometry)

# ==== cluster WSTransformations: Rotate a range of geometries in the y axis

# ---- group: Cluster Input
geometry = ClusterInput()

domain_end = ClusterInput()

# ----
geometry_2 = Geometry(flatten(geometry))
construct_domain = ConstructDomain(DomainStart=0, DomainEnd=domain_end)
list_length = ListLength(List=geometry_2)
volume = Volume(Geometry=geometry_2)  # -> Volume, Centroid
expression = Expression(x=list_length, Expression="x-1")
unit_y = UnitY(Factor=1)
range = Range(Domain=construct_domain, Steps=expression)
pi = Pi(Factor=range)
rotate_3d = Rotate3D(Geometry=geometry_2, Angle=pi, Center=volume.Centroid, Axis=unit_y)  # -> Geometry, Transform

# ---- group: Cluster Output
geometry_3 = ClusterOutput(rotate_3d.Geometry)
