# Grasshopper definition Maths.gh (Grasshopper 1.0.7)
# Copyright: Wickerson Studios
# plug-ins: Bifocals

construct_domain² = ConstructDomain²(DomainU=Domain(0, 1), DomainV=Domain(0, 1))  # disabled
deconstruct_domain² = DeconstructDomain²()  # -> UComponent, VComponent; disabled
construct_domain = ConstructDomain(DomainStart=0, DomainEnd=1)  # disabled
bounds_2d = Bounds2D()  # disabled
consecutive_domains = ConsecutiveDomains(Numbers=[0, 0.5, 1, 1.5, 2], Additive=True)  # disabled
divide_domain² = DivideDomain²(UCount=10, VCount=10)  # disabled
divide_domain = DivideDomain(Domain=Domain(0, 1), Count=10)  # disabled
construct_domain²_2 = ConstructDomain²(UMin=0, UMax=1, VMin=0, VMax=1)  # disabled
bounds = Bounds()  # disabled
remap_numbers = RemapNumbers(Source=Domain(0, 1), Target=Domain(0, 1))  # -> Mapped, Clipped; disabled
deconstruct_domain²_2 = DeconstructDomain²()  # -> UMin, UMax, VMin, VMax; disabled
deconstruct_domain = DeconstructDomain()  # -> Start, End; disabled
find_domain = FindDomain(Strict=False)  # -> Index, Neighbour; disabled
includes = Includes(Domain=Domain(0, 1))  # -> Includes, Deviation; disabled
remap = Remap(min=0, max=1)  # disabled

display_matrix = DisplayMatrix()  # disabled
invert_matrix = InvertMatrix(Tolerance=0)  # -> Matrix, Success; disabled
swap_columns = SwapColumns()  # disabled
construct_matrix = ConstructMatrix(Rows=3, Columns=3)  # disabled
deconstruct_matrix = DeconstructMatrix()  # -> Rows, Columns, Values; disabled
transpose_matrix = TransposeMatrix()  # disabled
swap_rows = SwapRows()  # disabled

similarity = Similarity(Threshold=0.1)  # -> Similarity, AbsoluteDifference; disabled
similarity_2 = Similarity(Threshold=0.1)  # -> Similarity, AbsoluteDifference; disabled
larger_than = LargerThan(SecondNumber=0)  # -> LargerThan, OrEqualTo; disabled
smaller_than = SmallerThan(SecondNumber=0)  # -> SmallerThan, OrEqualTo; disabled
larger_than_2 = LargerThan(SecondNumber=0)  # -> LargerThan, OrEqualTo; disabled
smaller_than_2 = SmallerThan(SecondNumber=0)  # -> SmallerThan, OrEqualTo; disabled
equality = Equality()  # -> Equality, Inequality; disabled
factorial = Factorial()  # disabled
negative = Negative()  # disabled
absolute = Absolute()  # disabled
addition = Addition()  # disabled
division = Division()  # disabled
multiplication = Multiplication()  # disabled
power = Power()  # disabled
subtraction = Subtraction()  # disabled
integer_division = IntegerDivision()  # disabled
modulus = Modulus()  # disabled
gate_and = GateAnd()  # disabled
gate_majority = GateMajority()  # disabled
gate_nand = GateNand()  # disabled
gate_nor = GateNor()  # disabled
gate_xnor = GateXnor()  # disabled
mass_addition = MassAddition()  # -> Result, PartialResults; disabled
mass_multiplication = MassMultiplication()  # -> Result, PartialResults; disabled
relative_differences = RelativeDifferences()  # disabled

log_n = LogN()  # disabled
cube = Cube()  # disabled
cube_root = CubeRoot()  # disabled
square = Square()  # disabled
square_root = SquareRoot()  # disabled
one_over_x = OneOverX()  # disabled
power_of_10 = PowerOf10()  # disabled
power_of_2 = PowerOf2()  # disabled
power_of_e = PowerOfE()  # disabled
logarithm = Logarithm()  # disabled
natural_logarithm = NaturalLogarithm()  # disabled

expression = Expression(Expression="Format(\"{0}, {1}\", x, y)")  # disabled
ghpython_script = GhPythonScript()  # -> Out, A; disabled
evaluate = Evaluate()  # disabled
c_script = CSharpScript()  # -> Out, A; disabled
vb_script = VBScript()  # -> Out, A; disabled

construct_date = ConstructDate(Year=2020, Month=5, Day=21, Hour=12, Minute=0, Second=0)  # disabled
construct_exotic_date = ConstructExoticDate(Calendar=0)  # disabled
deconstruct_date = DeconstructDate(Date=637256609780743672)  # -> Year, Month, Day, Hour, Minute, Second; disabled
construct_time = ConstructTime(Hour=12, Minute=29, Second=0)  # disabled
combine_date_time = CombineDateTime()  # disabled
interpolate_date = InterpolateDate(Interpolation=0)  # disabled
date_range = DateRange(Count=10)  # disabled
construct_smooth_time = ConstructSmoothTime(Days=0, Hours=0, Minutes=0, Seconds=0)  # disabled

degrees = Degrees()  # disabled
radians = Radians()  # disabled
cosine = Cosine()  # disabled
sine = Sine()  # disabled
sinc = Sinc()  # disabled
tangent = Tangent()  # disabled
right_trigonometry = RightTrigonometry()  # -> Alpha, Beta, PLength, QLength, RLength; disabled
triangle_trigonometry = TriangleTrigonometry()  # -> Alpha, Beta, Gamma, ALength, BLength, CLength; disabled
orthocentre = Orthocentre()  # -> Orthocentre, AltitudeAB, AltitudeBC, AltitudeCA; disabled
incentre = Incentre()  # -> Incentre, BisectorA, BisectorB, BisectorC; disabled
circumcentre = Circumcentre()  # -> Circumcentre, BisectorAB, BisectorBC, BisectorCA; disabled
centroid = Centroid()  # -> Centroid, MedianAB, MedianBC, MedianCA; disabled
arccosine = ArcCosine()  # disabled
arcsine = ArcSine()  # disabled
arctangent = ArcTangent()  # disabled
cosecant = CoSecant()  # disabled
cotangent = CoTangent()  # disabled
secant = Secant()  # disabled

average = Average()  # disabled
round = Round()  # -> Nearest, Floor, Ceiling; disabled
golden_ratio = GoldenRatio(Factor=1)  # disabled
pi = Pi(Factor=1)  # disabled
extremes = Extremes()  # -> Mininum, Maximum; disabled
maximum = Maximum()  # disabled
minimum = Minimum()  # disabled
natural_logarithm_2 = NaturalLogarithm(Factor=1)  # disabled
epsilon = Epsilon(Factor=1)  # disabled
weighted_average = WeightedAverage()  # disabled
truncate = Truncate(TruncationFactor=0)  # disabled
smooth_numbers = SmoothNumbers(SmoothDelay=2000)  # disabled
complex_conjugate = ComplexConjugate()  # disabled
blur_numbers = BlurNumbers(Strength=0.5, Iterations=1, Lock=True, Wrap=False)  # disabled
complex_argument = ComplexArgument()  # disabled
complex_components = ComplexComponents()  # -> Real, Imaginary; disabled
create_complex = CreateComplex(Real=0, Imaginary=0)  # disabled
complex_modulus = ComplexModulus()  # disabled
interpolate_data = InterpolateData(Interpolation=2)  # disabled

number_slider = Slider(0, range=0..1)  # disabled
number_slider_2 = Slider(10, range=0..10)  # disabled
construct_domain_2 = ConstructDomain(DomainStart=number_slider, DomainEnd=number_slider_2)  # disabled
number_slider_3 = Slider(4, range=0..10)  # disabled
number_slider_4 = Slider(36, range=0..100)  # disabled
range = Range(Domain=construct_domain_2, Steps=10)  # disabled
construct_domain_3 = ConstructDomain(DomainStart=number_slider_3, DomainEnd=number_slider_4)  # disabled
bounds_2 = Bounds(Numbers=range)  # disabled
remap_numbers_2 = RemapNumbers(Value=range, Source=bounds_2, Target=construct_domain_3)  # -> Mapped, Clipped; disabled
panel = Panel(remap_numbers_2.Mapped)  # disabled

number_slider_5 = Slider(2, range=0..10)  # disabled
number_slider_6 = Slider(8, range=0..10)  # disabled
number_slider_7 = Slider(4, range=0..10)  # disabled
number_slider_8 = Slider(10, range=0..10)  # disabled
number_slider_9 = Slider(4, range=0..10)  # disabled
number_slider_10 = Slider(8, range=0..10)  # disabled
number_slider_11 = Slider(4, range=0..10)  # disabled
number_slider_12 = Slider(8, range=0..10)  # disabled
construct_domain_4 = ConstructDomain(DomainStart=number_slider_5, DomainEnd=number_slider_6)  # disabled
construct_domain_5 = ConstructDomain(DomainStart=number_slider_7, DomainEnd=number_slider_8)  # disabled
construct_domain²_3 = ConstructDomain²(UMin=number_slider_9, UMax=number_slider_10, VMin=number_slider_11, VMax=number_slider_12)  # disabled
construct_domain²_4 = ConstructDomain²(DomainU=construct_domain_4, DomainV=construct_domain_5)  # disabled
panel_2 = Panel(construct_domain²_3)  # disabled
panel_3 = Panel(construct_domain²_4)  # disabled
deconstruct_domain²_3 = DeconstructDomain²(Domain=construct_domain²_4)  # -> UComponent, VComponent; disabled
deconstruct_domain²_4 = DeconstructDomain²(Domain=construct_domain²_3)  # -> UMin, UMax, VMin, VMax; disabled
panel_4 = Panel(deconstruct_domain²_3.VComponent)  # disabled
panel_5 = Panel(deconstruct_domain²_4.VMax)  # disabled
panel_6 = Panel(deconstruct_domain²_4.UMax)  # disabled
panel_7 = Panel(deconstruct_domain²_4.VMin)  # disabled
panel_8 = Panel(deconstruct_domain²_3.UComponent)  # disabled
panel_9 = Panel(deconstruct_domain²_4.UMin)  # disabled

number_slider_13 = Slider(2, range=0..10)  # disabled
surface = Surface(<surface referenced from the Rhino model>)  # disabled
domain² = Domain²(surface)  # disabled
divide_domain²_2 = DivideDomain²(Domain=surface, UCount=number_slider_13, VCount=number_slider_13)  # disabled
panel_10 = Panel(domain²)  # disabled
domain²_2 = Domain²(divide_domain²_2)  # disabled
panel_11 = Panel(domain²_2)  # disabled

remap_2 = Remap(min=0, max=1)  # disabled
number_slider_14 = Slider(3, range=0..10)  # disabled
coordinates = Coordinates([Point(91, -125, 0), Point(5, -152, 0), Point(91, -63, 0), Point(-43, -63, 0), Point(-105, -64, 0)])  # disabled
bounds_2d_2 = Bounds2D(Coordinates=coordinates)  # disabled
panel_12 = Panel(bounds_2d_2)  # disabled

number_slider_15 = Slider(0, range=0..1)  # disabled
number_slider_16 = Slider(10, range=0..10)  # disabled
construct_domain_6 = ConstructDomain(DomainStart=number_slider_15, DomainEnd=number_slider_16)  # disabled
panel_13 = Panel(construct_domain_6)  # disabled
range_2 = Range(Domain=construct_domain_6, Steps=number_slider_14)  # disabled
bounds_3 = Bounds(Numbers=range_2)  # disabled
boolean_toggle = BooleanToggle(False)  # disabled
deconstruct_domain_2 = DeconstructDomain(Domain=construct_domain_6)  # -> Start, End; disabled
number_slider_17 = Slider(4, range=0..10)  # disabled
panel_14 = Panel(deconstruct_domain_2.Start)  # disabled
panel_15 = Panel(deconstruct_domain_2.End)  # disabled
panel_16 = Panel(bounds_3)  # disabled
consecutive_domains_2 = ConsecutiveDomains(Numbers=range_2, Additive=boolean_toggle)  # disabled
panel_17 = Panel(range_2)  # disabled
deconstruct_domain_3 = DeconstructDomain(Domain=consecutive_domains_2)  # -> Start, End; disabled
divide_domain_2 = DivideDomain(Domain=construct_domain_6, Count=number_slider_17)  # disabled
panel_18 = Panel(deconstruct_domain_3.Start)  # disabled
panel_19 = Panel(divide_domain_2)  # disabled
panel_20 = Panel(deconstruct_domain_3.End)  # disabled

number_slider_18 = Slider(0, range=0..3)  # disabled
number_slider_19 = Slider(2, range=0..3)  # disabled
number_slider_20 = Slider(4, range=0..10)  # disabled
panel_21 = Panel("""2
5
6
61
1
2
3
4
34
3
2
34
34
34
2
21""")  # disabled
list_length = ListLength(List=panel_21)  # disabled
# Grasshopper for Rhino MATHS
# Wickerson Studios
# 
# Youtube: Michael Wickerson
# 
# Subscribe Today
construct_matrix_2 = ConstructMatrix(Rows=number_slider_20, Columns=number_slider_20, Values=panel_21)  # disabled
swap_columns_2 = SwapColumns(Matrix=construct_matrix_2, ColumnA=number_slider_18, ColumnB=number_slider_19)  # disabled
panel_22 = Panel(list_length)  # disabled
display_matrix_2 = DisplayMatrix(swap_columns_2)  # disabled
deconstruct_matrix_2 = DeconstructMatrix(Matrix=construct_matrix_2)  # -> Rows, Columns, Values; disabled
number_slider_21 = Slider(2, range=0..3)  # disabled
number_slider_22 = Slider(1, range=0..3)  # disabled
transpose_matrix_2 = TransposeMatrix(Matrix=construct_matrix_2)  # disabled
panel_23 = Panel(deconstruct_matrix_2.Rows)  # disabled
panel_24 = Panel(deconstruct_matrix_2.Columns)  # disabled
panel_25 = Panel(deconstruct_matrix_2.Values)  # disabled
swap_rows_2 = SwapRows(Matrix=construct_matrix_2, RowA=number_slider_21, RowB=number_slider_22)  # disabled
display_matrix_3 = DisplayMatrix(construct_matrix_2)  # disabled
display_matrix_4 = DisplayMatrix(transpose_matrix_2)  # disabled
display_matrix_5 = DisplayMatrix(swap_rows_2)  # disabled

number_slider_23 = Slider(-2, range=-2..10)  # disabled
number_slider_24 = Slider(3, range=0..10)  # disabled
negative_2 = Negative(Value=number_slider_23)  # disabled
factorial_2 = Factorial(Number=number_slider_24)  # disabled
subtraction_2 = Subtraction(A=number_slider_23, B=number_slider_24)  # disabled
addition_2 = Addition(A=number_slider_23, B=number_slider_24)  # disabled
division_2 = Division(A=number_slider_23, B=number_slider_24)  # disabled
multiplication_2 = Multiplication(A=number_slider_23, B=number_slider_24)  # disabled
absolute_2 = Absolute(Value=number_slider_23)  # disabled
power_2 = Power(A=number_slider_23, B=number_slider_24)  # disabled
integer_division_2 = IntegerDivision(A=number_slider_23, B=number_slider_24)  # disabled
modulus_2 = Modulus(A=number_slider_24, B=number_slider_23)  # disabled
panel_26 = Panel([addition_2, division_2, multiplication_2, negative_2, power_2, subtraction_2, absolute_2, factorial_2, integer_division_2, modulus_2])  # disabled

number_slider_25 = Slider(4, range=0..10)  # disabled
number_slider_26 = Slider(2, range=0..10)  # disabled
similarity_3 = Similarity(FirstNumber=number_slider_26, SecondNumber=number_slider_25, Threshold=0.1)  # -> Similarity, AbsoluteDifference; disabled
larger_than_3 = LargerThan(FirstNumber=number_slider_26, SecondNumber=number_slider_25)  # -> LargerThan, OrEqualTo; disabled
equality_2 = Equality(FirstNumber=number_slider_26, SecondNumber=number_slider_25)  # -> Equality, Inequality; disabled
smaller_than_3 = SmallerThan(FirstNumber=number_slider_26, SecondNumber=number_slider_25)  # -> SmallerThan, OrEqualTo; disabled
panel_27 = Panel([equality_2.Equality, equality_2.Inequality])  # disabled
panel_28 = Panel([smaller_than_3.SmallerThan, smaller_than_3.OrEqualTo])  # disabled
panel_29 = Panel([larger_than_3.LargerThan, larger_than_3.OrEqualTo])  # disabled
panel_30 = Panel([similarity_3.Similarity, similarity_3.AbsoluteDifference])  # disabled

number_slider_27 = Slider(2, range=0..10)  # disabled
number_slider_28 = Slider(10, range=0..10)  # disabled
number_slider_29 = Slider(10, range=0..10)  # disabled
log_n_2 = LogN(Number=number_slider_29, Base=number_slider_28)  # disabled
natural_logarithm_3 = NaturalLogarithm(Factor=number_slider_27)  # disabled
logarithm_2 = Logarithm(Value=number_slider_29)  # disabled
natural_logarithm_4 = NaturalLogarithm(Value=number_slider_29)  # disabled
merge = Merge(Data1=logarithm_2, Data2=log_n_2, Data3=natural_logarithm_4)  # disabled
panel_31 = Panel([merge, natural_logarithm_3])  # disabled

number_slider_30 = Slider(2, range=0..10)  # disabled
circle = Circle(Plane=PlaneXY(0, 0, 0), Radius=expr("x*3", number_slider_30))  # disabled
circle_2 = Circle(Plane=PlaneXY(0, 0, 0), Radius=number_slider_30)  # disabled
merge_2 = Merge(Data1=circle_2, Data2=circle)  # disabled
panel_32 = Panel(merge_2)  # disabled

panel_33 = Panel("x")  # disabled
number_slider_31 = Slider(2, range=0..10)  # disabled
panel_34 = Panel("x*3")  # disabled
evaluate_2 = Evaluate()  # disabled
evaluate_3 = Evaluate(Expression=panel_33, x=number_slider_31)  # disabled
evaluate_4 = Evaluate(Expression=panel_34, x=number_slider_31)  # disabled
circle_3 = Circle(Plane=PlaneXY(0, 0, 0), Radius=evaluate_3)  # disabled
circle_4 = Circle(Plane=PlaneXY(0, 0, 0), Radius=evaluate_4)  # disabled
merge_3 = Merge(Data1=circle_3, Data2=circle_4)  # disabled
panel_35 = Panel(merge_3)  # disabled

number_slider_32 = Slider(2, range=0..10)  # disabled
expression_2 = Expression(Expression="Format(\"{0}, {1}\", x, y)")  # disabled
expression_3 = Expression(x=number_slider_32, Expression="x*3")  # disabled
expression_4 = Expression(x=number_slider_32, Expression="x")  # disabled
circle_5 = Circle(Plane=PlaneXY(0, 0, 0), Radius=expression_4)  # disabled
circle_6 = Circle(Plane=PlaneXY(0, 0, 0), Radius=expression_3)  # disabled
merge_4 = Merge(Data1=circle_5, Data2=circle_6)  # disabled
panel_36 = Panel(merge_4)  # disabled

c_script_2 = CSharpScript()  # -> Out, A; disabled
vb_script_2 = VBScript()  # -> Out, A; disabled

ghpython_script_2 = GhPythonScript()  # -> out, a; disabled
# ---------- ghpython_script_2: Python ----------
__author__ = "Sculpture"
__version__ = "2020.05.22"

import rhinoscriptsyntax as rs

x = 2

a = x

print a
# ---------- end ghpython_script_2 ----------
ghpython_script_3 = GhPythonScript()  # -> out, a; disabled
# ---------- ghpython_script_3: Python ----------
__author__ = "Sculpture"
__version__ = "2020.05.22"

import rhinoscriptsyntax as rs

x = 2
y = 3

a = x * y

print a
# ---------- end ghpython_script_3 ----------
circle_7 = Circle(Plane=PlaneXY(0, 0, 0), Radius=ghpython_script_3.a)  # disabled
circle_8 = Circle(Plane=PlaneXY(0, 0, 0), Radius=ghpython_script_2.a)  # disabled
merge_5 = Merge(Data1=circle_8, Data2=circle_7)  # disabled
panel_37 = Panel(ghpython_script_2.out)  # disabled
panel_38 = Panel(merge_5)  # disabled
panel_39 = Panel(ghpython_script_3.out)  # disabled

hour = Hour(12)  # disabled
year = Year(2020)  # disabled
month = Month(5)  # disabled
day = Day(21)  # disabled
minute = Minute(0)  # disabled
second = Second(0)  # disabled
panel_40 = Panel(year)  # disabled
panel_41 = Panel(second)  # disabled
panel_42 = Panel(month)  # disabled
panel_43 = Panel(minute)  # disabled
panel_44 = Panel(day)  # disabled
panel_45 = Panel(hour)  # disabled
construct_date_2 = ConstructDate(Year=year, Month=month, Day=day, Hour=hour, Minute=minute, Second=second)  # disabled
panel_46 = Panel(construct_date_2)  # disabled
deconstruct_date_2 = DeconstructDate(Date=construct_date_2)  # -> Year, Month, Day, Hour, Minute, Second; disabled
panel_47 = Panel(deconstruct_date_2.Year)  # disabled
panel_48 = Panel(deconstruct_date_2.Month)  # disabled
panel_49 = Panel(deconstruct_date_2.Day)  # disabled
panel_50 = Panel(deconstruct_date_2.Hour)  # disabled
panel_51 = Panel(deconstruct_date_2.Minute)  # disabled
panel_52 = Panel(deconstruct_date_2.Second)  # disabled

second_2 = Second(0)  # disabled
minute_2 = Minute(29)  # disabled
hour_2 = Hour(12)  # disabled
panel_53 = Panel(hour_2)  # disabled
panel_54 = Panel(minute_2)  # disabled
panel_55 = Panel(second_2)  # disabled
construct_time_2 = ConstructTime(Hour=hour_2, Minute=minute_2, Second=second_2)  # disabled
panel_56 = Panel(construct_time_2)  # disabled

# ----
# First Cool .gh File worth playing with!
number_slider_33 = Slider(4.738, range=0..10)  # disabled
negative_3 = Negative(Value=number_slider_33)  # disabled
construct_domain_7 = ConstructDomain(DomainStart=negative_3, DomainEnd=number_slider_33)  # disabled
sine_2 = Sine(Value=construct_domain_7)  # disabled
tangent_2 = Tangent(Value=construct_domain_7)  # disabled
cosine_2 = Cosine(Value=construct_domain_7)  # disabled
number_slider_34 = Slider(6, range=0..10)  # disabled
merge_6 = Merge(Data1=sine_2, Data2=cosine_2)  # disabled
panel_57 = Panel(merge_6)  # disabled
range_3 = Range(Domain=sine_2, Steps=10)  # disabled
range_4 = Range(Domain=cosine_2, Steps=10)  # disabled
number_slider_35 = Slider(0.905, range=0..1)  # disabled
multiplication_3 = Multiplication(A=number_slider_34, B=range_4)  # disabled
multiplication_4 = Multiplication(A=number_slider_34, B=range_3)  # disabled
deconstruct_domain_4 = DeconstructDomain(Domain=merge_6)  # -> Start, End; disabled
construct_point = ConstructPoint(XCoordinate=construct_domain_7, YCoordinate=multiplication_4, ZCoordinate=multiplication_3)  # disabled
panel_58 = Panel(deconstruct_domain_4.Start)  # disabled
panel_59 = Panel(deconstruct_domain_4.End)  # disabled
polyline = PolyLine(Vertices=construct_point, Closed=True)  # disabled
pipe = Pipe(Curve=polyline, Radius=number_slider_35, Caps=2)  # disabled

number_slider_36 = Slider(0.5, range=0..2)  # disabled
pi_2 = Pi(Factor=number_slider_36)  # disabled
construct_domain_8 = ConstructDomain(DomainStart=0, DomainEnd=pi_2)  # disabled
sinc_2 = Sinc(Value=construct_domain_8)  # disabled
sine_3 = Sine(Value=construct_domain_8)  # disabled
cosine_3 = Cosine(Value=construct_domain_8)  # disabled
merge_7 = Merge(Data1=sine_3, Data2=cosine_3, Data3=sinc_2)  # disabled
panel_60 = Panel(merge_7)  # disabled

number_slider_37 = Slider(0, range=0..360)  # disabled
radians_2 = Radians(Degrees=number_slider_37)  # disabled
panel_61 = Panel(radians_2)  # disabled
degrees_2 = Degrees(Radians=radians_2)  # disabled
panel_62 = Panel(degrees_2)  # disabled

number_slider_38 = Slider(42, range=0..90)  # disabled
number_slider_39 = Slider(58, range=0..90)  # disabled
number_slider_40 = Slider(74, range=0..90)  # disabled
number_slider_41 = Slider(6.64, range=1..10)  # disabled
number_slider_42 = Slider(6.65, range=1..10)  # disabled
right_trigonometry_2 = RightTrigonometry(Alpha=degrees(number_slider_38), PLength=number_slider_42)  # -> Alpha, Beta, PLength, QLength, RLength; disabled
triangle_trigonometry_2 = TriangleTrigonometry(Alpha=degrees(number_slider_40), Beta=degrees(number_slider_39), BLength=number_slider_41)  # -> Alpha, Beta, Gamma, ALength, BLength, CLength; disabled
degrees_3 = Degrees(Radians=right_trigonometry_2.Beta)  # disabled
degrees_4 = Degrees(Radians=triangle_trigonometry_2.Beta)  # disabled
panel_63 = Panel(right_trigonometry_2.QLength)  # disabled
panel_64 = Panel(degrees_3)  # disabled
panel_65 = Panel(degrees_4)  # disabled
panel_66 = Panel(triangle_trigonometry_2.CLength)  # disabled

number_slider_43 = Slider(156, range=0..1000)
number_slider_44 = Slider(12, range=0..100)
extremes_2 = Extremes(A=Slider(2, range=0..10), B=number_slider_44, C=number_slider_43)  # -> Mininum, Maximum
maximum_2 = Maximum(A=number_slider_44, B=number_slider_43)
minimum_2 = Minimum(A=number_slider_44, B=number_slider_43)
panel_67 = Panel(extremes_2.Mininum)
panel_68 = Panel(extremes_2.Maximum)
panel_69 = Panel(maximum_2)
panel_70 = Panel(minimum_2)

round_2 = Round(Number=Slider(243.377, range=0..1000))  # -> Nearest, Floor, Ceiling
panel_71 = Panel(round_2.Nearest)
panel_72 = Panel(round_2.Floor)
panel_73 = Panel(round_2.Ceiling)

merge_8 = Merge(
    Data1=Slider(1, range=0..1),
    Data2=Slider(2, range=0..10),
    Data3=Slider(12, range=0..100),
    Data4=Slider(122, range=0..1000))
range_5 = Range(Domain=merge_8, Steps=Slider(51, range=0..100))
average_2 = Average(Input=merge_8)
truncate_2 = Truncate(Input=range_5, TruncationFactor=Slider(0.6, range=0..1))  # -> flatten(Result)
blur_numbers_2 = BlurNumbers(
    Numbers=merge_8,
    Strength=Slider(0.36, range=0..1),
    Iterations=Slider(2, range=0..10),
    Lock=Toggle(True),
    Wrap=Toggle(False))
smooth_numbers_2 = SmoothNumbers(Numbers=merge_8, SmoothDelay=2000)
interpolate_data_2 = InterpolateData(Data=merge_8, Parameter=Slider(0.43, range=0..1), Interpolation=2)
panel_74 = Panel(average_2)
panel_75 = Panel(blur_numbers_2)
panel_76 = Panel(interpolate_data_2)
panel_77 = Panel(smooth_numbers_2)
panel_78 = Panel(truncate_2)
param_viewer = ParamViewer(panel_78)

epsilon_2 = Epsilon(Factor=1)
natural_logarithm_5 = NaturalLogarithm(Factor=1)
golden_ratio_2 = GoldenRatio(Factor=1)
pi_3 = Pi(Factor=1)
merge_9 = Merge(Data1=epsilon_2, Data2=golden_ratio_2, Data3=natural_logarithm_5, Data4=pi_3)
panel_79 = Panel(merge_9)

list_length_2 = ListLength(List=truncate_2)
panel_80 = Panel(list_length_2)

panel_81 = Panel("""2
3
4
6""")  # disabled
boolean_toggle_2 = BooleanToggle(False)  # disabled
boolean_toggle_3 = BooleanToggle(False)  # disabled
boolean_toggle_4 = BooleanToggle(True)  # disabled
mass_addition_2 = MassAddition(Input=panel_81)  # -> Result, PartialResults; disabled
mass_multiplication_2 = MassMultiplication(Input=panel_81)  # -> Result, PartialResults; disabled
gate_majority_2 = GateMajority(A=boolean_toggle_4, B=boolean_toggle_2, C=boolean_toggle_3)  # disabled
panel_82 = Panel(mass_addition_2.Result)  # disabled
panel_83 = Panel(mass_multiplication_2.Result)  # disabled
panel_84 = Panel(gate_majority_2)  # disabled

boolean_toggle_5 = BooleanToggle(False)  # disabled
boolean_toggle_6 = BooleanToggle(False)  # disabled
gate_and_2 = GateAnd(A=boolean_toggle_5, B=boolean_toggle_6)  # disabled
gate_nand_2 = GateNand(A=boolean_toggle_5, B=boolean_toggle_6)  # disabled
gate_nor_2 = GateNor(A=boolean_toggle_5, B=boolean_toggle_6)  # disabled
gate_xnor_2 = GateXnor(A=boolean_toggle_5, B=boolean_toggle_6)  # disabled

gate_xor = GateXor(A=boolean_toggle_5, B=boolean_toggle_6)  # disabled
gate_not = GateNot(A=boolean_toggle_5)  # disabled
gate_or = GateOr(A=boolean_toggle_5, B=boolean_toggle_6)  # disabled

panel_85 = Panel([gate_and_2, gate_not, gate_or, gate_xor, gate_nand_2, gate_nor_2, gate_xnor_2])  # disabled

number_slider_45 = Slider(1, range=0..10)  # disabled
cube_root_2 = CubeRoot(Value=number_slider_45)  # disabled
cube_2 = Cube(Value=number_slider_45)  # disabled
square_2 = Square(Value=number_slider_45)  # disabled
square_root_2 = SquareRoot(Value=number_slider_45)  # disabled
one_over_x_2 = OneOverX(Value=number_slider_45)  # disabled
power_of_10_2 = PowerOf10(Value=number_slider_45)  # disabled
power_of_2_2 = PowerOf2(Value=number_slider_45)  # disabled
power_of_e_2 = PowerOfE(Value=number_slider_45)  # disabled

merge_10 = Merge(
    Data1=cube_root_2,
    Data2=cube_2,
    Data3=square_2,
    Data4=square_root_2,
    Data5=one_over_x_2,
    Data6=power_of_10_2,
    Data7=power_of_2_2,
    Data8=power_of_e_2)  # disabled

panel_86 = Panel(merge_10)  # disabled

number_slider_46 = Slider(31, range=1..31)  # disabled
number_slider_47 = Slider(3, range=1..12)  # disabled
panel_87 = Panel("2020")  # disabled
month_2 = Month(number_slider_47)  # disabled
day_2 = Day(number_slider_46)  # disabled

year_2 = Year(panel_87)  # disabled

construct_exotic_date_2 = ConstructExoticDate(Year=year_2, Month=month_2, Day=day_2, Calendar=0)  # disabled
panel_88 = Panel(construct_exotic_date_2)  # disabled

combine_date_time_2 = CombineDateTime(Date=construct_exotic_date_2, Time=construct_time_2)  # disabled
panel_89 = Panel(combine_date_time_2)  # disabled

# ==== cluster Remap: Remaps numbers
data = ClusterInput()
min = ClusterInput()
max = ClusterInput()
bnd = Bounds(Numbers=data)
dom = ConstructDomain(DomainStart=min, DomainEnd=max)
remap = RemapNumbers(Value=data, Source=bnd, Target=dom)  # -> Mapped, Clipped
R = ClusterOutput(remap.Mapped)
