# Grasshopper definition Mesh001.gh (Grasshopper 1.0.7)
# Copyright: Wickerson Studios
# plug-ins: MeshEdit Components, Fologram For Grasshopper Utilities, PlanktonGh, Bifocals

mesh = Mesh(<mesh referenced from the Rhino model>)
mesh_plane = MeshPlane(Boundary={Plane=PlaneXY(0, 0, 0), Size=Domain2(u=-10..10, v=-10..10)}, WidthCount=10, HeightCount=10)  # -> Mesh, Area
construct_mesh = ConstructMesh(Vertices=[Point(0, 0, 0), Point(10, 0, 0), Point(10, 10, 0), Point(0, 10, 0)], Faces={A=0, B=1, C=2, D=3})
mesh_colours = MeshColours(
    Mesh=mesh,
    Colours=[RGB(127, 255, 0), RGB(0, 100, 0), RGB(34, 139, 34), RGB(124, 252, 0), RGB(154, 205, 50), RGB(173, 255, 47), RGB(50, 205, 50), RGB(152, 251, 152)])
mesh_quad = MeshQuad(CornerA=0, CornerB=1, CornerC=2, CornerD=3)
mesh_box = MeshBox(Base={Plane=PlaneXY(0, 0, 0), X=Domain(-10, 10), Y=Domain(-10, 10), Z=Domain(-10, 10)}, XCount=10, YCount=10, ZCount=10)
mesh_spray = MeshSpray(Mesh=mesh, SprayMode=11)
mesh_triangle = MeshTriangle(CornerA=0, CornerB=1, CornerC=2)
mesh_sphere = MeshSphere(Base=PlaneXY(0, 0, 0), Radius=10, UCount=10, VCount=20)
mesh_sphere_ex = MeshSphereEx(Base=PlaneXY(0, 0, 0), Radius=10, Count=5)
convex_hull = ConvexHull(Plane=PlaneXY(0, 0, 0))  # -> Hull, HullZ, Indices
deconstructplankton = DeconstructPlankton(PMesh=mesh)  # -> Vertex_Points, Vertex_Outgoing_Halfedge, Halfedge_StartVertex, Halfedge_AdjacentFace, Halfedge_NextHalfedge, Halfedge_PrevHalfedge, Halfedge_Pair, Face_Halfedge
planktonfrompoints = PlanktonFromPoints(PMesh=mesh)
substrate = Substrate(Border={Plane=PlaneXY(0, 0, 0), Size=Domain2(u=0..20, v=0..5)}, Count=100, Angles=[0.1, 0.3, 0.5], Deviation=0, Seed=5)
delaunay_edges = DelaunayEdges(Plane=PlaneXY(0, 0, 0))  # -> Connectivity, Edges
delaunay_mesh = DelaunayMesh(Plane=PlaneXY(0, 0, 0))
panel = Panel(deconstructplankton.Face_Halfedge)
point = Point(deconstructplankton.Vertex_Points)
proximity_2d = Proximity2D(Plane=PlaneXY(0, 0, 0), Group=5)  # -> Links, Topology
proximity_3d = Proximity3D(Group=5)  # -> Links, Topology
voronoi_cell = VoronoiCell()
voronoi_3d = Voronoi3D()  # -> Cells, Boundary
facet_dome = FacetDome()  # -> Pattern, Dome
voronoi = Voronoi(BruteForceOverride=False)
voronoi_groups = VoronoiGroups(Boundary={Plane=PlaneXY(0, 0, 0), Size=Domain2(u=-10..10, v=-10..10)})  # -> Diagram1, Diagram2
quadtree = QuadTree(Plane=PlaneXY(0, 0, 0), Square=False, Group=5)  # -> Quads, Points
octree = OcTree(Square=False, Group=5)  # -> Boxes, Points
metaball_t = MetaBallT(Plane=PlaneXY(0, 0, 0), Threshold=0.5)
metaball = MetaBall(Plane=PlaneXY(0, 0, 0))
metaball_t_custom = MetaBallTCustom(Plane=PlaneXY(0, 0, 0), Threshold=0.5)
_3d_voronoi = _3DVoronoi()  # -> _3DVoronoiCells, Connectivity
_3d_delaunaycell = _3DDelaunayCell()  # -> _3DDelaunayCells, CellIndices
_3d_delaunay = _3DDelaunay()  # -> TopologicalEdges, Connectivity
convex_hull_points = ConvexHullPoints()  # -> ConvexHull, Indices
_3d_convexhull = _3DConvexHull()
mesh_2 = Mesh(<mesh referenced from the Rhino model>)
deconstruct_mesh = DeconstructMesh(Mesh=mesh_2)  # -> flatten(Vertices), Faces, Colours, Normals
deconstruct_face = DeconstructFace()  # -> CornerA, CornerB, CornerC, CornerD
construct_domain = ConstructDomain(DomainStart=Slider(1, range=0..1), DomainEnd=Slider(1.43, range=0..10))
random_reduce = RandomReduce(List=deconstruct_mesh.Vertices, Reduction=Slider(0, range=0..10000), Seed=1)
list_length = ListLength(List=random_reduce)
range = Range(Domain=construct_domain, Steps=expr("x-1", list_length))
unit_z = UnitZ(Factor=range)
move = Move(Geometry=random_reduce, Motion=unit_z)  # -> Geometry, Transform
shift_list = ShiftList(List=move.Geometry, Shift=1, Wrap=True)
line = Line(StartPoint=move.Geometry, EndPoint=shift_list)
mesh_pipe = MeshPipe(Polylines=line, NumberOfSides=4, Tolerance=0.1, Radius=1, Cap=Toggle(True), Join=False)
