# Grasshopper definition Sets.gh (Grasshopper 1.0.7)
# Copyright: Wickerson Studios
# Copyright: WickersonStudios
# plug-ins: Bifocals, LunchBox

insert_items = InsertItems(Wrap=True)
item_index = ItemIndex()
list_item = ListItem(Index=0, Wrap=True)
list_length = ListLength()
replace_nulls = ReplaceNulls()  # -> Items, Count
dispatch = Dispatch(DispatchPattern=[True, False])  # -> ListA, ListB
cross_reference = CrossReference(CrossMode=1)  # -> ListListA, ListListB
longest_list = LongestList(PaddingMode=2)  # -> ListListA, ListListB
shortest_list = ShortestList(TrimMode=2)  # -> ListListA, ListListB
pick_n_choose = PickNChoose(Pattern=[0, 1])
weave = Weave(Pattern=[0, 1], NullGaps=False)
sift_pattern = SiftPattern(SiftPattern=[0, 0, 1, 1])  # -> Output0, Output1
replace_nulls_2 = ReplaceNulls()  # -> Items, Count
sort_list = SortList()  # -> Keys, ValuesValuesA
null_item = NullItem()  # -> NullFlags, InvalidFlags, Description
sub_list = SubList(Wrap=True)  # -> List, Index
partition_list = PartitionList(Size=[3, 2])
split_list = SplitList()  # -> ListA, ListB
replace_items = ReplaceItems(Wrap=False)
shift_list = ShiftList(Shift=1, Wrap=True)
reverse_list = ReverseList()
combine_data = CombineData()  # -> Result, Index

cull_index = CullIndex(Wrap=True)
cull_nth = CullNth(CullFrequency=2)
cull_pattern = CullPattern(CullPattern=[False, False, True, True])
random_reduce = RandomReduce(Seed=1)
duplicate_data = DuplicateData(Number=2, Order=True)
fibonacci = Fibonacci(SeedA=0, SeedB=1, Number=10)
range = Range(Domain=Domain(0, 1), Steps=10)
repeat_data = RepeatData()
sequence = Sequence(Notation="[N-1] + [N-2]", Length=20, Initial=[1, 1])
series = Series(Start=0, Step=1, Count=10)
jitter = Jitter(Jitter=1, Seed=2)  # -> Values, Indices
random = Random(Range=Domain(0, 1), Number=1, Seed=2)
char_sequence = CharSequence(Count=10, CharPool="ABCDEFGHIJKLMNOPQRSTUVWXYZ", Format="{0}")
stack_data = StackData(Data=["A", "B", "C", "D"], Stack=[1, 2, 3, 4])

set_difference_s = SetDifferenceS()
member_index = MemberIndex()  # -> Index, Count
replace_members = ReplaceMembers()
carthesian_product = CarthesianProduct()
key_value_search = KeyValueSearch()
set_difference = SetDifference()
set_intersection = SetIntersection()
set_majority = SetMajority()
set_union = SetUnion()
disjoint = Disjoint()
subset = SubSet()
delete_consecutive = DeleteConsecutive(Wrap=False)  # -> Set, Count
find_similar_member = FindSimilarMember()  # -> Hit, Index
create_set = CreateSet()  # -> Set, Map

text_case = TextCase(Culture=127)  # -> UpperCase, LowerCase
concatenate = Concatenate()
text_split = TextSplit()
text_fragment = TextFragment()
text_distance = TextDistance(Case=True)
replace_text = ReplaceText(RecursiveReplace=False)
match_text = MatchText(Case=True)
sort_text = SortText(Culture=127)  # -> Keys, Values
characters = Characters()  # -> Result, Unicode
text_length = TextLength()
text_trim = TextTrim(Start=True, End=True)
text_join = TextJoin()
format = Format(Culture=127)

clean_tree = CleanTree(RemoveNulls=True, RemoveInvalid=True, RemoveEmpty=False)
split_tree = SplitTree()  # -> Positive, Negative
relative_item = RelativeItem(WrapPaths=False, WrapItems=False)  # -> ItemA, ItemB
relative_items = RelativeItems(WrapPaths=False, WrapItems=False)  # -> ItemA, ItemB
path_compare = PathCompare(Mask="*")
stream_gate = StreamGate(Gate=0)  # -> Target0, Target1
path_mapper = PathMapper()
prune_tree = PruneTree(Minimum=0, Maximum=0)
construct_path = ConstructPath()
explode_tree = ExplodeTree()  # -> Branch0, Branch1
tree_item = TreeItem(Index=0, Wrap=True)
replace_paths = ReplacePaths(Search="*")
tree_statistics = TreeStatistics()  # -> Paths, Length, Count
tree_branch = TreeBranch(MaintainPaths=True)
trim_tree = TrimTree(Depth=1)
unflatten_tree = UnflattenTree()
match_tree = MatchTree()
simplify_tree = SimplifyTree(Front=False)
flip_matrix = FlipMatrix()
graft_tree = GraftTree(IncludeEmptyLists=True, IncludeNullItems=True)
merge = Merge()
stream_filter = StreamFilter(Gate=0)
entwine = Entwine(FlattenInputs=True)
flatten_tree = FlattenTree(Path="{0}")
shift_paths = ShiftPaths(Offset=-1)
deconstruct_path = DeconstructPath()

construct_domain = ConstructDomain(DomainStart=Slider(0, range=0..10), DomainEnd=Slider(10, range=0..10))
range_2 = Range(Domain=construct_domain, Steps=10)
panel = Panel(range_2)
list_length_2 = ListLength(List=range_2)
partition_list_2 = PartitionList(List=range_2, Size=Slider(7, range=0..10))
replace_items_2 = ReplaceItems(List=range_2, Item=Slider(3, range=0..10), Indices=Slider(7, range=0..10), Wrap=False)
reverse_list_2 = ReverseList(List=range_2)
panel_2 = Panel(replace_items_2)
panel_3 = Panel(partition_list_2)
panel_4 = Panel(reverse_list_2)
panel_5 = Panel(list_length_2)

# ----
# Second Pretty cool .gh script to play with!
number_slider = Slider(10, range=0..10)
number_slider_2 = Slider(6, range=0..10)
series_2 = Series(Start=Slider(0, range=0..100), Step=Slider(1, range=0..1), Count=number_slider_2)
series_3 = Series(Start=Slider(0, range=0..100), Step=Slider(1, range=0..1), Count=number_slider_2)
longest_list_2 = LongestList(ListListA=series_2, ListListB=series_3, PaddingMode=2)  # -> ListListA, ListListB
cross_reference_2 = CrossReference(ListListA=series_2, ListListB=series_3, CrossMode=1)  # -> ListListA, ListListB
shortest_list_2 = ShortestList(ListListA=series_2, ListListB=series_3, TrimMode=2)  # -> ListListA, ListListB
construct_point = ConstructPoint(XCoordinate=graft(cross_reference_2.ListListA), YCoordinate=graft(cross_reference_2.ListListB), ZCoordinate=0)
construct_point_2 = ConstructPoint(XCoordinate=longest_list_2.ListListA, YCoordinate=longest_list_2.ListListB, ZCoordinate=0)
construct_point_3 = ConstructPoint(XCoordinate=shortest_list_2.ListListA, YCoordinate=shortest_list_2.ListListB, ZCoordinate=0)
construct_point_4 = ConstructPoint(XCoordinate=series_2, YCoordinate=series_3, ZCoordinate=0)
line = Line(StartPoint=construct_point, EndPoint=construct_point_3)
line_2 = Line(StartPoint=construct_point, EndPoint=construct_point_2)
merge_2 = Merge(Data1=line_2, Data2=line)
pipe = Pipe(Curve=merge_2, Radius=Slider(0.823, range=0..10), Caps=0)

construct_domain_2 = ConstructDomain(DomainStart=Slider(0, range=0..10), DomainEnd=Slider(10, range=0..10))
range_3 = Range(Domain=construct_domain_2, Steps=10)
panel_6 = Panel(range_3)
construct_domain_3 = ConstructDomain(DomainStart=Slider(2, range=0..10), DomainEnd=Slider(7, range=0..10))
sub_list_2 = SubList(List=range_3, Domain=construct_domain_3, Wrap=True)  # -> List, Index
shift_list_2 = ShiftList(List=range_3, Shift=Slider(6, range=0..10), Wrap=True)
split_list_2 = SplitList(List=range_3, Index=Slider(3, range=0..10))  # -> ListA, ListB
panel_7 = Panel(shift_list_2)
panel_8 = Panel(split_list_2.ListB)
panel_9 = Panel(split_list_2.ListA)
panel_10 = Panel(sub_list_2.List)
panel_11 = Panel(sub_list_2.Index)

fibonacci_2 = Fibonacci(SeedA=Slider(0, range=0..10), SeedB=Slider(2, range=0..10), Number=Slider(9, range=0..10))
panel_12 = Panel(fibonacci_2)

notation = Notation("[N-1] + [N-2]")
panel_13 = Panel("""12
23""")
panel_14 = Panel(notation)
construct_domain_4 = ConstructDomain(DomainStart=Slider(0, range=0..10), DomainEnd=Slider(10, range=0..10))
sequence_2 = Sequence(Notation=notation, Length=Slider(9, range=0..20), Initial=[1, 1])
range_4 = Range(Domain=construct_domain_4, Steps=Slider(5, range=0..10))
repeat_data_2 = RepeatData(Data=range_4, Length=Slider(5, range=1..100))
panel_15 = Panel(sequence_2)
panel_16 = Panel(repeat_data_2)
panel_17 = Panel(range_4)

construct_domain_5 = ConstructDomain(DomainStart=Slider(0, range=0..10), DomainEnd=Slider(10, range=0..10))
panel_18 = Panel("""0
1
1""")
range_5 = Range(Domain=construct_domain_5, Steps=10)
cull_nth_2 = CullNth(List=range_5, CullFrequency=Slider(3, range=0..10))
random_reduce_2 = RandomReduce(List=range_5, Reduction=Slider(6, range=0..10), Seed=Slider(380, range=0..1000))
cull_pattern_2 = CullPattern(List=range_5, CullPattern=panel_18)
cull_index_2 = CullIndex(List=range_5, Indices=Slider(9, range=0..20), Wrap=Toggle(True))
panel_19 = Panel(cull_index_2)
panel_20 = Panel(cull_nth_2)
panel_21 = Panel(cull_pattern_2)
panel_22 = Panel(random_reduce_2)

series_4 = Series(Start=Slider(0, range=0..10), Step=Slider(1, range=0..10), Count=Slider(4, range=0..10))
jitter_2 = Jitter(List=series_4, Jitter=Slider(0.753, range=0..1), Seed=Slider(396, range=0..1000))  # -> Values, Indices
stack_data_2 = StackData(Data=series_4, Stack=[1, 2, 3, 4])
panel_23 = Panel(series_4)
panel_24 = Panel(stack_data_2)
panel_25 = Panel(jitter_2.Values)
panel_26 = Panel(jitter_2.Indices)

construct_domain_6 = ConstructDomain(DomainStart=Slider(0, range=0..10), DomainEnd=Slider(10, range=0..10))
range_6 = Range(Domain=construct_domain_6, Steps=Slider(5, range=0..10))
random_2 = Random(Range=range_6, Number=Slider(3, range=0..10), Seed=Slider(349, range=0..1000))
panel_27 = Panel(random_2)

char_pool = CharPool("ABCDEFGHIJKLMNOPQRSTUVWXYZ")
panel_28 = Panel(char_pool)
number_slider_3 = Slider(0, range=0..3)
char_sequence_2 = CharSequence(Count=Slider(8, range=0..10), CharPool=char_pool, Format="{0}")
duplicate_data_2 = DuplicateData(Data=char_sequence_2, Number=Slider(2, range=0..10), Order=True)
panel_29 = Panel(char_sequence_2)
panel_30 = Panel(duplicate_data_2)

panel_31 = Panel(range_5)

series_5 = Series(Start=0, Step=1, Count=Slider(12, range=0..100))
series_6 = Series(Start=Slider(4, range=0..10), Step=1, Count=10)
panel_32 = Panel(series_6)
panel_33 = Panel(series_5)
merge_3 = Merge(Data1=series_6, Data2=series_5)
create_set_2 = CreateSet(List=merge_3)  # -> Set, Map
panel_34 = Panel(create_set_2.Set)
panel_35 = Panel(merge_3)
sort_list_2 = SortList(Keys=create_set_2.Set, ValuesValuesA=create_set_2.Set)  # -> Keys, ValuesValuesA
item_index_2 = ItemIndex(List=sort_list_2.ValuesValuesA, Item=series_6)
item_index_3 = ItemIndex(List=merge_3, Item=series_5)
panel_36 = Panel(item_index_2)
panel_37 = Panel(item_index_3)

number_slider_4 = Slider(4, range=0..10)
panel_38 = Panel("""133
144
155
166""")
series_7 = Series(Start=Slider(6, range=0..20), Step=1, Count=10)
series_8 = Series(Start=0, Step=1, Count=10)
merge_4 = Merge(Data1=Slider(2, range=0..10), Data2=Slider(5, range=0..10))
series_9 = Series(Start=0, Step=1, Count=10)
series_10 = Series(Start=Slider(0, range=0..20), Step=1, Count=Slider(4, range=0..10))
series_11 = Series(Start=Slider(2, range=0..20), Step=1, Count=Slider(6, range=0..10))
series_12 = Series(Start=0, Step=1, Count=10)
series_13 = Series(Start=0, Step=1, Count=number_slider_4)
series_14 = Series(Start=0, Step=1, Count=number_slider_4)
carthesian_product_2 = CarthesianProduct(SetA=series_8, SetB=series_7)
member_index_2 = MemberIndex(Set=series_8, Member=merge_4)  # -> Index, Count
disjoint_2 = Disjoint(SetA=series_8, SetB=series_7)
carthesian_product_3 = CarthesianProduct(SetA=series_14, SetB=series_13)
find_similar_member_2 = FindSimilarMember(Data=series_14, Set=series_13)  # -> Hit, Index
replace_members_2 = ReplaceMembers(Set=series_9, Find=series_10, Replace=panel_38)
subset_2 = SubSet(SetA=series_12, SetB=series_11)
panel_39 = Panel(carthesian_product_3)
panel_40 = Panel(carthesian_product_2)
panel_41 = Panel(disjoint_2)
panel_42 = Panel(member_index_2.Index)
panel_43 = Panel(member_index_2.Count)
panel_44 = Panel(replace_members_2)
panel_45 = Panel(series_11)
panel_46 = Panel(subset_2)
delete_consecutive_2 = DeleteConsecutive(Set=carthesian_product_3, Wrap=False)  # -> Set, Count
panel_47 = Panel(find_similar_member_2.Index)
panel_48 = Panel(find_similar_member_2.Hit)
panel_49 = Panel(delete_consecutive_2.Set)

panel_50 = Panel(series_8)

series_15 = Series(Start=Slider(1, range=0..10), Step=1, Count=10)
series_16 = Series(Start=Slider(6, range=0..10), Step=1, Count=10)
sort_list_3 = SortList(Keys=series_15, ValuesValuesA=series_16)  # -> Keys, ValuesValuesA
panel_51 = Panel(sort_list_3.Keys)
panel_52 = Panel(sort_list_3.ValuesValuesA)
key_value_search_2 = KeyValueSearch(Keys=sort_list_3.Keys, Values=sort_list_3.ValuesValuesA, Search=Slider(8, range=0..10))
panel_53 = Panel(key_value_search_2)

char_sequence_3 = CharSequence(Count=10, CharPool="ABCDEFGHIJKLMNOPQRSTUVWXYZ", Format="{0}")
create_set_3 = CreateSet(List=char_sequence_3)  # -> Set, Map
char_sequence_4 = CharSequence(Count=Slider(14, range=0..20), CharPool="ABCDEFGHIJKLMNOPQRSTUVWXYZ", Format="{0}")
char_sequence_5 = CharSequence(Count=Slider(5, range=0..20), CharPool="ABCDEFGHIJKLMNOPQRSTUVWXYZ", Format="{0}")
panel_54 = Panel(create_set_3.Set)
set_difference_2 = SetDifference(SetA=char_sequence_3, SetB=char_sequence_5)
panel_55 = Panel(create_set_3.Map)
set_difference_s_2 = SetDifferenceS(SetA=char_sequence_3, SetB=char_sequence_4)
panel_56 = Panel(set_difference_2)
panel_57 = Panel(set_difference_s_2)

char_sequence_6 = CharSequence(Count=Slider(4, range=0..20), CharPool="ABCDEFGHIJKLMNOPQRSTUVWXYZ", Format="{0}")
char_sequence_7 = CharSequence(Count=Slider(13, range=0..20), CharPool="ABCDEFGHIJKLMNOPQRSTUVWXYZ", Format="{0}")
char_sequence_8 = CharSequence(Count=10, CharPool="ABCDEFGHIJKLMNOPQRSTUVWXYZ", Format="{0}")
char_sequence_9 = CharSequence(Count=Slider(13, range=0..20), CharPool="ABCDEFGHIJKLMNOPQRSTUVWXYZ", Format="{0}")
char_sequence_10 = CharSequence(Count=10, CharPool="ABCDEFGHIJKLMNOPQRSTUVWXYZ", Format="{0}")
set_intersection_2 = SetIntersection(SetA=char_sequence_8, SetB=char_sequence_6)
set_majority_2 = SetMajority(SetA=char_sequence_8, SetB=char_sequence_6, SetC=char_sequence_7)
set_union_2 = SetUnion(SetA=char_sequence_10, SetB=char_sequence_9)
panel_58 = Panel(set_majority_2)
panel_59 = Panel(set_union_2)
panel_60 = Panel(set_intersection_2)

# ----
# Format and Culture BIG ?
panel_61 = Panel("""a
s
w""")
_1 = Data1("g")
_0 = Data0("f")
culture = Culture(127)
format_2 = Format(Format=panel_61, Culture=culture, Data0=_0, Data1=_1)
panel_62 = Panel(format_2)

char_sequence_11 = CharSequence(Count=10, CharPool="ABCDEFGHIJKLMNOPQRSTUVWXYZ", Format="{0}")
concatenate_2 = Concatenate(FragmentA=char_sequence_11, FragmentB=char_sequence_11)
characters_2 = Characters(Text=char_sequence_11)  # -> Result, Unicode
text_join_2 = TextJoin(Text=char_sequence_11, Join=",")
panel_63 = Panel(characters_2.Result)
text_length_2 = TextLength(Text=text_join_2)
panel_64 = Panel(concatenate_2)
panel_65 = Panel(text_join_2)
panel_66 = Panel(characters_2.Unicode)
panel_67 = Panel(text_length_2)

panel_68 = Panel("                     Double click to edit panel content…                   ")
panel_69 = Panel()
text_case_2 = TextCase(Text=panel_69, Culture=127)  # -> UpperCase, LowerCase
text_fragment_2 = TextFragment(Text=panel_69, Start=Slider(3, range=0..10), Count=Slider(5, range=0..10))
text_trim_2 = TextTrim(Text=panel_68, Start=Slider(3, range=0..10), End=Slider(34, range=0..100))
panel_70 = Panel(text_case_2.LowerCase)
panel_71 = Panel(text_case_2.UpperCase)
panel_72 = Panel(text_fragment_2)
panel_73 = Panel(text_trim_2)

panel_74 = Panel()
text_split_2 = TextSplit(Text=panel_74, Separators=" ")
panel_75 = Panel(text_split_2)

panel_76 = Panel()
match_text_2 = MatchText(Text="asasasasas", Pattern="as", Case=True)
replace_text_2 = ReplaceText(Text=panel_76, Find="Double click", Replace="qwerty", RecursiveReplace=False)
panel_77 = Panel(match_text_2)
panel_78 = Panel(replace_text_2)

text_distance_2 = TextDistance(TextA="Double click", TextB="Double", Case=True)
panel_79 = Panel(text_distance_2)

panel_80 = Panel("""Double 
click 
to 
edit 
panel 
content…""")
sort_text_2 = SortText(Keys=panel_80, Values=panel_80, Culture=127)  # -> Keys, Values
item_index_4 = ItemIndex(List=sort_text_2.Values, Item=panel_80)
panel_81 = Panel(sort_text_2.Keys)
panel_82 = Panel(item_index_4)

clean_tree_2 = CleanTree(RemoveNulls=True, RemoveInvalid=True, RemoveEmpty=False)
split_tree_2 = SplitTree()  # -> Positive, Negative
relative_item_2 = RelativeItem(WrapPaths=False, WrapItems=False)  # -> ItemA, ItemB
relative_items_2 = RelativeItems(WrapPaths=False, WrapItems=False)  # -> ItemA, ItemB
path_compare_2 = PathCompare(Mask="*")
path_mapper_2 = PathMapper()
prune_tree_2 = PruneTree(Minimum=0, Maximum=0)
construct_path_2 = ConstructPath()
tree_item_2 = TreeItem(Index=0, Wrap=True)
replace_paths_2 = ReplacePaths(Search="*")
tree_statistics_2 = TreeStatistics()  # -> Paths, Length, Count
tree_branch_2 = TreeBranch(MaintainPaths=True)
trim_tree_2 = TrimTree(Depth=1)
entwine_2 = Entwine(FlattenInputs=True)
shift_paths_2 = ShiftPaths(Offset=-1)
unflatten_tree_2 = UnflattenTree()
match_tree_2 = MatchTree()
simplify_tree_2 = SimplifyTree(Front=False)
flip_matrix_2 = FlipMatrix()
flatten_tree_2 = FlattenTree(Path="{0}")
merge_5 = Merge()
graft_tree_2 = GraftTree(IncludeEmptyLists=True, IncludeNullItems=True)
stream_filter_2 = StreamFilter(Gate=0)
stream_gate_2 = StreamGate(Gate=0)  # -> Target0, Target1
explode_tree_2 = ExplodeTree()  # -> Branch0, Branch1
deconstruct_path_2 = DeconstructPath()

series_17 = Series(Start=0, Step=1, Count=10)
panel_83 = Panel(series_17)
param_viewer = ParamViewer(series_17)
graft_tree_3 = GraftTree(Tree=series_17, IncludeEmptyLists=True, IncludeNullItems=True)
panel_84 = Panel(graft_tree_3)
param_viewer_2 = ParamViewer(graft_tree_3)
flatten_tree_3 = FlattenTree(Tree=graft_tree_3, Path="{0}")
panel_85 = Panel(flatten_tree_3)
param_viewer_3 = ParamViewer(flatten_tree_3)

xpos = Slider(3.955, range=1..6)
ypos = Slider(4.239, range=1..6)
series_18 = Series(Start=0, Step=xpos, Count=Slider(12, range=1..20))
construct_point_5 = ConstructPoint(XCoordinate=series_18, YCoordinate=ypos, ZCoordinate=0)
panel_86 = Panel(construct_point_5)

number_slider_5 = Slider(5, range=1..25)
number_slider_6 = Slider(8, range=1..25)
square = Square(Plane=PlaneXY(0, 0, 0), Size=1, ExtentX=number_slider_5, ExtentY=number_slider_6)  # -> Cells, Points
point = Point(square.Points)
graft_tree_4 = GraftTree(Tree=point, IncludeEmptyLists=True, IncludeNullItems=True)
simplify_tree_3 = SimplifyTree(Tree=graft_tree_4, Front=False)
integer = Integer(number_slider_5)
integer_2 = Integer(number_slider_6)
concatenate_3 = Concatenate(Fragment_A="{", Fragment_B=integer, A=";*}")
concatenate_4 = Concatenate(Fragment_A="{*", Fragment_B=";", A=integer_2, B="}")
panel_87 = Panel("""{2;*}
{*;1}""")
split_tree_3 = SplitTree(Data=simplify_tree_3, Masks=flatten(panel_87))  # -> Positive, Negative
split_tree_4 = SplitTree(Data=simplify_tree_3, Masks=flatten([concatenate_4, concatenate_3]))  # -> Positive, Negative
point_2 = Point(split_tree_3.Positive)
point_3 = Point(split_tree_4.Positive)

reference_surface = Surface(reparameterize(<surface referenced from the Rhino model>))
divide_surface = DivideSurface(Surface=reference_surface, UCount=Slider(100, range=0..100), VCount=Slider(100, range=0..100))  # -> Points, Normals, Parameters
boolean_toggle = BooleanToggle(True)
flip_matrix_3 = FlipMatrix(Data=divide_surface.Parameters)
flip_matrix_4 = FlipMatrix(Data=divide_surface.Points)
flip_matrix_5 = FlipMatrix(Data=divide_surface.Normals)
points_uvw = StreamFilter(Gate=boolean_toggle, Stream0=divide_surface.Parameters, Stream1=flip_matrix_3)
normal_vectors = StreamFilter(Gate=boolean_toggle, Stream0=divide_surface.Normals, Stream1=flip_matrix_5)
points_xyz = StreamFilter(Gate=boolean_toggle, Stream0=divide_surface.Points, Stream1=flip_matrix_4)
image_sampler = ImageSampler(
    points_uvw,
    FilePath="C:\Users\Sculpture\Documents\2020Grasshopper\ScreenShots2019\BlackandWhiteMax.PNG",
    Filter="Value",
    Interpolate=False,
    Umax=1,
    Umin=0,
    Vmax=1,
    Vmin=0,
    Wrap=1)
multiplication = Multiplication(A=normal_vectors, B=image_sampler)
addition = Addition(A=points_xyz, B=multiplication)
panel_88 = Panel(image_sampler)
interpolate = Interpolate(Vertices=points_xyz, Degree=3, Periodic=False, KnotStyle=1)  # -> Curve, Length, Domain
interpolate_2 = Interpolate(Vertices=addition, Degree=3, Periodic=False, KnotStyle=1)  # -> flatten(Curve), Length, Domain
path_mapper_3 = PathMapper(interpolate_2.Curve, source="{A;B;C}(i)", target="{A;B;C+2}(i)")
path_mapper_4 = PathMapper(interpolate_2.Curve)
param_viewer_4 = ParamViewer(interpolate.Curve)
param_viewer_5 = ParamViewer(interpolate_2.Curve)
merge_6 = Merge(Data1=flatten(interpolate.Curve), Data2=path_mapper_3)
param_viewer_6 = ParamViewer(interpolate.Curve)
prune_tree_3 = PruneTree(Tree=merge_6, Minimum=Slider(2, range=0..10), Maximum=0)
loft = Loft(Curves=prune_tree_3, Options={Adjust=False, Closed=False, LoftEnds=0, LoftSimp=0, LoftType=0, Rebuild=10, Refit=0.01})

xpos_2 = Slider(3.955, range=1..6)
ypos_2 = Slider(4.239, range=1..6)
construct_point_6 = ConstructPoint(XCoordinate=xpos_2, YCoordinate=ypos_2, ZCoordinate=0)
panel_89 = Panel(construct_point_6)

number_slider_7 = Slider(13, range=0..100)
mesh_sphere = MeshSphere(Base=PlaneXY(0, 0, 0), Radius=10, UCount=number_slider_7, VCount=number_slider_7)
weld_mesh = WeldMesh(Mesh=mesh_sphere, Angle=3.141592654)
merge_7 = Merge(
    Data1=ColourSwatch(SwatchColor=RGB(255, 255, 255)),
    Data2=ColourSwatch(SwatchColor=RGBA(32, 193, 91, 251)),
    Data3=ColourSwatch(SwatchColor=RGB(241, 15, 165)),
    Data4=ColourSwatch(SwatchColor=RGB(29, 44, 255)))
point_4 = Point([<point referenced from the Rhino model> x4])
sbmesh = SprayBlurMesh(meshtocolor=weld_mesh, spraypoint=point_4, spraycolour=merge_7, blurringiterations=Slider(4, range=0..10))
blurredmesh = Mesh(sbmesh)

xpos_3 = Slider(3.955, range=1..6)
ypos_3 = Slider(4.239, range=1..6)
xpos_4 = Slider(3.955, range=1..6)
ypos_4 = Slider(4.239, range=1..6)
series_19 = Series(Start=0, Step=xpos_3, Count=Slider(8, range=1..20))
series_20 = Series(Start=0, Step=ypos_3, Count=Slider(15, range=1..20))
series_21 = Series(Start=0, Step=xpos_4, Count=Slider(8, range=1..20))  # -> graft(Series)
series_22 = Series(Start=0, Step=ypos_4, Count=Slider(11, range=1..20))
shortest_list_3 = ShortestList(ListListA=series_19, ListListB=series_20, TrimMode=2)  # -> ListListA, ListListB
cross_reference_3 = CrossReference(ListListA=series_19, ListListB=series_20, CrossMode=1)  # -> ListListA, ListListB
longest_list_3 = LongestList(ListListA=series_19, ListListB=series_20, PaddingMode=2)  # -> ListListA, ListListB
construct_point_7 = ConstructPoint(XCoordinate=series_21, YCoordinate=series_22, ZCoordinate=0)  # -> graft(Point)
construct_point_8 = ConstructPoint(XCoordinate=shortest_list_3.ListListA, YCoordinate=shortest_list_3.ListListB, ZCoordinate=0)
construct_point_9 = ConstructPoint(XCoordinate=longest_list_3.ListListA, YCoordinate=longest_list_3.ListListB, ZCoordinate=0)
construct_point_10 = ConstructPoint(XCoordinate=cross_reference_3.ListListA, YCoordinate=cross_reference_3.ListListB, ZCoordinate=0)
point_list = PointList(Points=construct_point_7, Size=Slider(2, range=0..10))
number_slider_8 = Slider(2, range=0..10)
panel_90 = Panel(construct_point_10)
panel_91 = Panel(construct_point_7)
construct_point_11 = ConstructPoint(XCoordinate=cross_reference_3.ListListA, YCoordinate=cross_reference_3.ListListB, ZCoordinate=0)  # -> graft(Point)
param_viewer_7 = ParamViewer(construct_point_10)
point_list_2 = PointList(Points=construct_point_10, Size=number_slider_8)
tree_statistics_3 = TreeStatistics(Tree=construct_point_7)  # -> graft(Paths), Length, Count
panel_92 = Panel(construct_point_11)
text_tag_3d = TextTag3D(Location=construct_point_7, Text=tree_statistics_3.Paths, Size=Slider(0.59, range=0..1), Justification=7)
point_list_3 = PointList(Points=construct_point_11, Size=number_slider_8)
param_viewer_8 = ParamViewer(construct_point_11)
panel_93 = Panel(tree_statistics_3.Paths)
param_viewer_9 = ParamViewer(construct_point_11)
param_viewer_10 = ParamViewer(construct_point_10)
param_viewer_11 = ParamViewer(construct_point_7)
panel_95 = Panel(tree_statistics_3.Length)
param_viewer_12 = ParamViewer(construct_point_11)
param_viewer_13 = ParamViewer(construct_point_10)
param_viewer_14 = ParamViewer(construct_point_7)
panel_96 = Panel(tree_statistics_3.Count)
simplify_tree_4 = SimplifyTree(Tree=construct_point_7, Front=False)
param_viewer_15 = ParamViewer(simplify_tree_4)
param_viewer_16 = ParamViewer(simplify_tree_4)

reference_surface_2 = Surface(reparameterize(<surface referenced from the Rhino model>))
divide_surface_2 = DivideSurface(Surface=reference_surface_2, UCount=Slider(6, range=0..100), VCount=Slider(7, range=0..100))  # -> Points, Normals, Parameters
boolean_toggle_2 = BooleanToggle(False)
flip_matrix_6 = FlipMatrix(Data=divide_surface_2.Parameters)
flip_matrix_7 = FlipMatrix(Data=divide_surface_2.Normals)
flip_matrix_8 = FlipMatrix(Data=divide_surface_2.Points)
points_uvw_2 = StreamFilter(Gate=boolean_toggle_2, Stream0=divide_surface_2.Parameters, Stream1=flip_matrix_6)
points_xyz_2 = StreamFilter(Gate=boolean_toggle_2, Stream0=divide_surface_2.Points, Stream1=flip_matrix_8)
normal_vectors_2 = StreamFilter(Gate=boolean_toggle_2, Stream0=divide_surface_2.Normals, Stream1=flip_matrix_7)
image_sampler_2 = ImageSampler(
    points_uvw_2,
    FilePath="C:\Users\Sculpture\Documents\2020Grasshopper\ScreenShots2019\BlackandWhiteMax.PNG",
    Filter="Value",
    Interpolate=False,
    Umax=1,
    Umin=0,
    Vmax=1,
    Vmin=0,
    Wrap=1)
multiplication_2 = Multiplication(A=normal_vectors_2, B=image_sampler_2)
multiplication_3 = Multiplication(A=multiplication_2, B=Slider(10, range=0..10))
panel_97 = Panel(image_sampler_2)
addition_2 = Addition(A=points_xyz_2, B=multiplication_3)
graft_tree_5 = GraftTree(Tree=points_xyz_2, IncludeEmptyLists=True, IncludeNullItems=True)
graft_tree_6 = GraftTree(Tree=addition_2, IncludeEmptyLists=True, IncludeNullItems=True)
simplify_tree_5 = SimplifyTree(Tree=graft_tree_5, Front=False)
panel_98 = Panel("""{0;0}
{0;3}
{1;1}
{-3,0}""")
simplify_tree_6 = SimplifyTree(Tree=graft_tree_6, Front=False)
panel_99 = Panel("{0;1}")
relative_items_3 = RelativeItems(TreeA=simplify_tree_5, TreeB=simplify_tree_6, Offset=panel_98, WrapPaths=False, WrapItems=False)  # -> ItemA, ItemB
polyline = PolyLine(Vertices=relative_items_3.ItemB, Closed=True)
line_3 = Line(StartPoint=relative_items_3.ItemA, EndPoint=relative_items_3.ItemB)
panel_100 = Panel(polyline)
loft_2 = Loft(Curves=line_3, Options={Adjust=False, Closed=False, LoftEnds=0, LoftSimp=0, LoftType=0, Rebuild=10, Refit=0.01})

square_2 = Square(Plane=PlaneXY(0, 0, 0), Size=1, ExtentX=5, ExtentY=5)  # -> Cells, Points
point_5 = Point(square_2.Points)
graft_tree_7 = GraftTree(Tree=point_5, IncludeEmptyLists=True, IncludeNullItems=True)
simplify_tree_7 = SimplifyTree(Tree=graft_tree_7, Front=False)
tree_statistics_4 = TreeStatistics(Tree=simplify_tree_7)  # -> Paths, Length, Count
param_viewer_17 = ParamViewer()
panel_101 = Panel("{1;0}")
panel_102 = Panel("""{1;1}
{0;-1}""")
graft_tree_8 = GraftTree(Tree=tree_statistics_4.Paths, IncludeEmptyLists=True, IncludeNullItems=True)
panel_103 = Panel("""{0;0}
{1;1}
{1;2}
{0;1}""")
relative_item_3 = RelativeItem(Tree=simplify_tree_7, Offset=panel_103, WrapPaths=False, WrapItems=False)  # -> ItemA, ItemB
text_tag_3d_2 = TextTag3D(Location=simplify_tree_7, Text=graft_tree_8, Size=Slider(0.13, range=0..1), Justification=7)
panel_104 = Panel(param_viewer_17)
line_4 = Line(StartPoint=relative_item_3.ItemA, EndPoint=relative_item_3.ItemB)
polyline_2 = PolyLine(Vertices=relative_item_3.ItemB, Closed=Toggle(True))

square_3 = Square(Plane=PlaneXY(0, 0, 0), Size=1, ExtentX=5, ExtentY=5)  # -> Cells, Points
point_6 = Point(square_3.Points)
graft_tree_9 = GraftTree(Tree=point_6, IncludeEmptyLists=True, IncludeNullItems=True)
panel_105 = Panel("-2")
shift_paths_3 = ShiftPaths(Data=graft_tree_9, Offset=-1)
param_viewer_18 = ParamViewer(point_6)
panel_106 = Panel(graft_tree_9)
simplify_tree_8 = SimplifyTree(Tree=shift_paths_3, Front=False)
param_viewer_19 = ParamViewer(panel_106)
panel_107 = Panel(shift_paths_3)
panel_108 = Panel(simplify_tree_8)
flatten_tree_4 = FlattenTree(Tree=simplify_tree_8, Path="{0}")
param_viewer_20 = ParamViewer(panel_107)
param_viewer_21 = ParamViewer(simplify_tree_8)
param_viewer_22 = ParamViewer(flatten_tree_4)
param_viewer_23 = ParamViewer(flatten_tree_4)
param_viewer_24 = ParamViewer(panel_107)
param_viewer_25 = ParamViewer(simplify_tree_8)

square_4 = Square(Plane=PlaneXY(0, 0, 0), Size=1, ExtentX=5, ExtentY=5)  # -> Cells, Points
point_7 = Point(square_4.Points)
graft_tree_10 = GraftTree(Tree=point_7, IncludeEmptyLists=True, IncludeNullItems=True)
simplify_tree_9 = SimplifyTree(Tree=graft_tree_10, Front=False)
tree_statistics_5 = TreeStatistics(Tree=simplify_tree_9)  # -> Paths, Length, Count
param_viewer_26 = ParamViewer(tree_statistics_5.Paths)
graft_tree_11 = GraftTree(Tree=tree_statistics_5.Paths, IncludeEmptyLists=True, IncludeNullItems=True)
panel_110 = Panel("""{1;1}
{0;-1}""")
relative_item_4 = RelativeItem(Tree=simplify_tree_9, Offset=panel_110, WrapPaths=False, WrapItems=False)  # -> ItemA, ItemB
text_tag_3d_3 = TextTag3D(Location=simplify_tree_9, Text=graft_tree_11, Size=Slider(0.13, range=0..1), Justification=7)
panel_111 = Panel(param_viewer_26)
line_5 = Line(StartPoint=relative_item_4.ItemA, EndPoint=relative_item_4.ItemB)

tree_statistics_6 = TreeStatistics(Tree=simplify_tree_3)  # -> Paths, Length, Count
graft_tree_12 = GraftTree(Tree=tree_statistics_6.Paths, IncludeEmptyLists=True, IncludeNullItems=True)
text_tag_3d_4 = TextTag3D(Location=simplify_tree_3, Text=graft_tree_12, Size=Slider(0.23, range=0..1), Justification=7)

panel_112 = Panel("""True
True
False""")
tree_statistics_7 = TreeStatistics(Tree=simplify_tree_3)  # -> Paths, Length, Count
cull_pattern_3 = CullPattern(List=tree_statistics_7.Paths, CullPattern=panel_112)
param_viewer_27 = ParamViewer(simplify_tree_3)
tree_branch_3 = TreeBranch(Tree=simplify_tree_3, Path=cull_pattern_3, MaintainPaths=True)

# ----
# Data Trees Intermediate
# Fancy Wires
# View Tree
# Param Viewer
# Data Lab
# Mode Lab
# Facebook out of date
# All Credit on these scripts go to ModeLab online:
# 
# ckeck out this series fo videos for starters!
# 
# https://www.youtube.com/playlist?list=PLGV167zE8gnV-mffyzD3mDhOrSM-CXaYW
# 
# https://www.youtube.com/watch?v=kL8tAdl3q6M&list=PLGV167zE8gnVRrzCCWvdlHYh3XQWTXFDo
# Processing Data Trees Kicks ass!
# add ons,  Weaver bird
# Python for Grasshopper
# Kangaroo!
polyline_3 = PolyLine(Closed=False)
curve_array = CurveArray(
    Geometry=<curve referenced from the Rhino model>,
    Curve=<geometry referenced from the Rhino model>,
    Count=Slider(52, range=0..100))  # -> Geometry, Transform

curve = Curve([<curve referenced from the Rhino model> x3])
colour_wheel = ColourWheel(
    "3",
    ColourGrips_Style=31,
    ColourGrips_Grip=[4.497481019, 0.3086908147, 2.403085917, 1.355888366],
    ColourGrips_Lum=[0.1, 0.6178896269],
    ColourGrips_Range=[0.2617993878, 0.2617993878, 0.2617993878, 0.2617993878],
    ColourGrips_Sat=[0.1053561537, 0.8665956261])
boundary_surfaces = BoundarySurfaces(Edges=curve)
custom_preview = CustomPreview(Geometry=boundary_surfaces, Material=colour_wheel)
panel_113 = Panel(colour_wheel)

square_5 = Square(Plane=PlaneXY(0, 0, 0), Size=1, ExtentX=5, ExtentY=5)  # -> Cells, Points
button = Button()
cherry_picker = CherryPicker(square_5.Cells, ListIndex=2, TreePath_path="{0;0;1}")
panel_114 = Panel(button)
dispatch_2 = Dispatch(List=cherry_picker, DispatchPattern=button)  # -> ListA, ListB
colour_picker = ColourPicker(PickedColour=RGB(44, 139, 255))
boundary_surfaces_2 = BoundarySurfaces(Edges=dispatch_2.ListB)
custom_preview_2 = CustomPreview(Geometry=boundary_surfaces_2, Material=colour_picker)

polygon = Polygon(Plane=PlaneXY(0, 0, 0), Radius=3, Segments=6, FilletRadius=0)  # -> Polygon, Length
explode = Explode(Curve=polygon.Polygon, Recursive=True)  # -> Segments, Vertices
shortest_list_4 = ShortestList(ListListA=explode.Segments, ListListB=explode.Vertices, TrimMode=2)  # -> ListListA, ListListB
longest_list_4 = LongestList(PaddingMode=2)  # -> ListListA, ListListB
panel_115 = Panel(explode.Segments)
circle = Circle(Plane=shortest_list_4.ListListB, Radius=Slider(0.48, range=0..1))
cross_reference_4 = CrossReference(ListListA=shortest_list_4.ListListB, ListListB=shortest_list_4.ListListB, CrossMode=1)  # -> ListListA, ListListB
line_6 = Line(StartPoint=cross_reference_4.ListListA, EndPoint=cross_reference_4.ListListB)

square_6 = Square(Plane=PlaneXY(0, 0, 0), Size=1, ExtentX=5, ExtentY=5)  # -> Cells, simplify(graft(Points))
param_viewer_28 = ParamViewer(square_6.Points)
tree_statistics_8 = TreeStatistics(Tree=square_6.Points)  # -> graft(Paths), Length, Count
match_tree_3 = MatchTree(Tree=tree_statistics_8.Paths, Guide=square_6.Points)
panel_116 = Panel(tree_statistics_8.Paths)
text_tag = TextTag(Location=square_6.Points, Text=match_tree_3)

panel_117 = Panel("""New York
London
Barcelona
Sydney""")
panel_118 = Panel("""0
1
1""")
sift_pattern_2 = SiftPattern(List=panel_117, SiftPattern=panel_118)  # -> Output0, Output1
replace_nulls_3 = ReplaceNulls(Items=sift_pattern_2.Output1, Replacements="Berlin")  # -> Items, Count
panel_119 = Panel(sift_pattern_2.Output0)
panel_120 = Panel(sift_pattern_2.Output1)
panel_121 = Panel(replace_nulls_3.Items)

number_slider_9 = Slider(52, range=0..100)
number_slider_10 = Slider(43, range=0..100)
curve_2 = Curve(<curve referenced from the Rhino model>)
number_slider_11 = Slider(23, range=0..100)
number_slider_12 = Slider(43, range=0..100)
curve_3 = Curve(<curve referenced from the Rhino model>)
curve_array_2 = CurveArray(
    Geometry=<curve referenced from the Rhino model>,
    Curve=<geometry referenced from the Rhino model>,
    Count=number_slider_9)  # -> Geometry, Transform
rectangular_array = RectangularArray(
    Geometry=curve_2,
    Cell={Plane=PlaneXY(349.5, -250, 0), Size=Domain2(u=-18.5..18.5, v=-29..29)},
    XCount=number_slider_10,
    YCount=number_slider_10)  # -> Geometry, Transform
polar_array = PolarArray(Geometry=curve_2, Plane=PlaneXY(0, 0, 0), Count=number_slider_9, Angle=6.283185307)  # -> Geometry, Transform
curve_array_3 = CurveArray(
    Geometry=<curve referenced from the Rhino model>,
    Curve=<geometry referenced from the Rhino model>,
    Count=number_slider_11)  # -> Geometry, Transform
rectangle_mapping = RectangleMapping()  # -> Geometry, Transform
triangle_mapping = TriangleMapping()  # -> Geometry, Transform
rectangular_array_2 = RectangularArray(
    Geometry=curve_3,
    Cell={Plane=PlaneXY(349.5, -250, 0), Size=Domain2(u=-18.5..18.5, v=-29..29)},
    XCount=number_slider_12,
    YCount=number_slider_12)  # -> Geometry, Transform
polar_array_2 = PolarArray(Geometry=curve_3, Plane=PlaneXY(0, 0, 0), Count=number_slider_11, Angle=6.283185307)  # -> Geometry, Transform
kaleidoscope = Kaleidoscope(Geometry=polar_array.Geometry, Plane=PlaneXY(46, 45, 0), Segments=Slider(6, range=0..100))  # -> Geometry, Transform
divide_curve = DivideCurve(Curve=kaleidoscope.Geometry, Count=Slider(10, range=0..10), Kinks=False)  # -> flatten(Points), Tangents, Parameters
kaleidoscope_2 = Kaleidoscope(Geometry=polar_array_2.Geometry, Plane=PlaneXY(46, 45, 0), Segments=Slider(17, range=0..100))  # -> Geometry, Transform
voronoi = Voronoi(Points=divide_curve.Points, Radius=Slider(5, range=1..5), BruteForceOverride=False)
boundary_surfaces_3 = BoundarySurfaces(Edges=voronoi)

mesh_sphere_2 = MeshSphere(Base=PlaneXY(0, 0, 0), Radius=10, UCount=10, VCount=20)
point_8 = Point([<point referenced from the Rhino model> x4])
weld_mesh_2 = WeldMesh(Mesh=mesh_sphere_2, Angle=3.141592654)
mesh_closest_point = MeshClosestPoint(Point=point_8, Mesh=weld_mesh_2)  # -> Point, Index, Parameter
mesh_eval = MeshEval(Mesh=weld_mesh_2, Parameter=mesh_closest_point.Parameter)  # -> Point, Normal, Colour
vector_display = VectorDisplay(Anchor=mesh_eval.Point, Vector=expr("x*5", mesh_eval.Normal))
mesh_edges = MeshEdges()  # -> NakedEdges, InteriorEdges, NonManifoldEdges
panel_122 = Panel(mesh_eval.Point)

number_slider_13 = Slider(27, range=3..100)
mesh_sphere_3 = MeshSphere(Base=PlaneXY(0, 0, 0), Radius=10, UCount=number_slider_13, VCount=number_slider_13)
merge_8 = Merge(
    Data1=ColourSwatch(SwatchColor=RGB(255, 255, 255)),
    Data2=ColourSwatch(SwatchColor=RGB(60, 86, 255)),
    Data3=ColourSwatch(SwatchColor=RGB(225, 62, 255)),
    Data4=ColourSwatch(SwatchColor=RGB(106, 143, 38)))
weld_mesh_3 = WeldMesh(Mesh=mesh_sphere_3, Angle=3.141592654)
mesh_colours = MeshColours(Mesh=weld_mesh_3, Colours=merge_8)
point_9 = Point([<point referenced from the Rhino model> x4])
mesh_spray = MeshSpray(Mesh=weld_mesh_3, Points=point_9, Colours=merge_8, SprayMode=0)
blur_mesh = BlurMesh(Mesh=mesh_spray, Iterations=Slider(2, range=0..10))

colour_wheel_2 = ColourWheel(
    ColourGrips_Style=31,
    ColourGrips_Grip=[6.203947177, 2.015156972, 4.109552075, 3.062354523],
    ColourGrips_Lum=[0.1, 0.5],
    ColourGrips_Range=[0.2617993878, 0.2617993878, 0.2617993878, 0.2617993878],
    ColourGrips_Sat=[0.2, 0.6])
boolean_toggle_3 = BooleanToggle(False)
button_2 = Button()
cherry_picker_2 = CherryPicker(ListIndex=0)
legend = Legend(
    Colour=[RGB(211, 211, 211), RGB(105, 105, 105), RGB(128, 0, 0), RGB(0, 0, 128)],
    Tags=["One Fish", "Two Fish", "Red Fish", "Blue Fish"],
    LegendType=101)
colour_swatch = ColourSwatch(SwatchColor=RGB(255, 255, 255))

curve_4 = Curve(<curve referenced from the Rhino model>)
polar_array_3 = PolarArray(Geometry=curve_4, Plane=PlaneXY(0, 0, 0), Count=Slider(52, range=0..100), Angle=6.283185307)  # -> Geometry, Transform
kaleidoscope_3 = Kaleidoscope(Geometry=polar_array_3.Geometry, Plane=PlaneXY(46, 45, 0), Segments=Slider(6, range=0..100))  # -> Geometry, Transform
divide_curve_2 = DivideCurve(Curve=kaleidoscope_3.Geometry, Count=Slider(10, range=0..10), Kinks=False)  # -> flatten(Points), Tangents, Parameters
voronoi_2 = Voronoi(Points=divide_curve_2.Points, Radius=Slider(5, range=1..5), BruteForceOverride=False)
boundary_surfaces_4 = BoundarySurfaces(Edges=voronoi_2)

surface = Surface(<surface referenced from the Rhino model>)
domain² = Domain²(surface)
panel_123 = Panel(domain²)
divide_surface_3 = DivideSurface(Surface=surface, UCount=Slider(25, range=1..40), VCount=Slider(9, range=1..40))  # -> Points, Normals, Parameters
clean_tree_3 = CleanTree(RemoveNulls=True, RemoveInvalid=True, RemoveEmpty=False, Tree=divide_surface_3.Points)
graft_tree_13 = GraftTree(Tree=clean_tree_3, IncludeEmptyLists=True, IncludeNullItems=True)
interpolate_3 = Interpolate(Vertices=divide_surface_3.Points, Degree=3, Periodic=False, KnotStyle=1)  # -> Curve, Length, Domain
param_viewer_29 = ParamViewer(graft_tree_13)
simplify_tree_10 = SimplifyTree(Tree=graft_tree_13, Front=False)
param_viewer_30 = ParamViewer(simplify_tree_10)
tree_statistics_9 = TreeStatistics(Tree=simplify_tree_10)  # -> graft(Paths), Length, Count
text_tag_3d_5 = TextTag3D(Location=simplify_tree_10, Text=tree_statistics_9.Paths, Size=Slider(0.15, range=0..1), Justification=7)
panel_124 = Panel("""{0;0}
{1;0}
{1;1}""")
param_viewer_31 = ParamViewer(clean_tree_3)
relative_item_5 = RelativeItem(Tree=simplify_tree_10, Offset=panel_124, WrapPaths=False, WrapItems=False)  # -> ItemA, ItemB
relative_items_4 = RelativeItems(WrapPaths=False, WrapItems=False)  # -> ItemA, ItemB
prune_tree_4 = PruneTree(Tree=relative_item_5.ItemB, Minimum="3", Maximum=0)
param_viewer_32 = ParamViewer()
param_viewer_33 = ParamViewer(relative_item_5.ItemA)
line_7 = Line(StartPoint=relative_item_5.ItemA, EndPoint=relative_item_5.ItemB)
polyline_4 = PolyLine(Vertices=prune_tree_4, Closed=Toggle(True))
panel_125 = Panel(polyline_4)
param_viewer_34 = ParamViewer(prune_tree_4)

square_7 = Square(Plane=PlaneXY(0, 0, 0), Size=1, ExtentX=5, ExtentY=5)  # -> Cells, Points
param_viewer_35 = ParamViewer(square_7.Points)
param_viewer_36 = ParamViewer(square_7.Cells)
range_7 = Range(Domain=Domain(0, 1), Steps=10)
series_23 = Series(Start=0, Step=1, Count=Slider(6, range=1..25))
series_24 = Series(Start=0, Step=1, Count=Slider(8, range=1..25))
cross_reference_5 = CrossReference(ListListA=series_23, ListListB=series_24, CrossMode=1)  # -> ListListA, ListListB
longest_list_5 = LongestList(ListListA=series_23, ListListB=series_24, PaddingMode=2)  # -> ListListA, ListListB
graft_tree_14 = GraftTree(Tree=longest_list_5.ListListA, IncludeEmptyLists=True, IncludeNullItems=True)
construct_point_12 = ConstructPoint(XCoordinate=graft_tree_14, YCoordinate=longest_list_5.ListListB, ZCoordinate=0)
point_list_4 = PointList(Points=construct_point_12, Size=Slider(0.49, range=0..1))
panel_126 = Panel(construct_point_12)
param_viewer_37 = ParamViewer(construct_point_12)
param_viewer_38 = ParamViewer(construct_point_12)
tree_statistics_10 = TreeStatistics(Tree=construct_point_12)  # -> Paths, Length, Count
panel_127 = Panel(tree_statistics_10.Count)
panel_128 = Panel(tree_statistics_10.Length)
panel_129 = Panel(tree_statistics_10.Paths)

region = Region({Plane=PlaneXY(0, 0, 0), Size=Domain2(u=0..20, v=0..10)})
populate_2d = Populate2D(Region=region, Count=Slider(120, range=0..1000), Seed=1)
populate_3d = Populate3D(Region={Plane=PlaneXY(0, 0, 0), X=Domain(0, 10), Y=Domain(0, 10), Z=Domain(0, 2)}, Count=100, Seed=1)
delaunay_mesh = DelaunayMesh(Points=populate_2d, Plane=PlaneXY(0, 0, 0))
face_normals = FaceNormals(Mesh=delaunay_mesh)  # -> Centers, Normals
deconstruct_mesh = DeconstructMesh(Mesh=delaunay_mesh)  # -> Vertices, Faces, Colours, Normals
deconstruct_face = DeconstructFace(Face=graft(deconstruct_mesh.Faces))  # -> CornerA, CornerB, CornerC, CornerD
point_list_5 = PointList(Points=face_normals.Centers)
merge_9 = Merge(Data1=deconstruct_face.CornerA, Data2=deconstruct_face.CornerB, Data3=deconstruct_face.CornerC)
list_item_2 = ListItem(List=deconstruct_mesh.Vertices, Index=merge_9, Wrap=True)
point_on_curve = PointOnCurve(region, parameter=0.357)
polyline_5 = PolyLine(Vertices=list_item_2, Closed=False)
simplify_tree_11 = SimplifyTree(Tree=polyline_5, Front=False)
polygon_center = PolygonCenter(Polyline=simplify_tree_11)  # -> CenterV, CenterE, CenterA
tree_statistics_11 = TreeStatistics(Tree=simplify_tree_11)  # -> Paths, Length, Count
distance = Distance(PointA=point_on_curve, PointB=polygon_center.CenterV)
flip_matrix_9 = FlipMatrix(Data=distance)
param_viewer_39 = ParamViewer(distance)
panel_130 = Panel(distance)
sort_list_4 = SortList(Keys=flip_matrix_9, ValuesValuesA=tree_statistics_11.Paths)  # -> reverse(Keys), ValuesValuesA
bounds = Bounds(Numbers=sort_list_4.Keys)
panel_131 = Panel(sort_list_4.Keys)
remap_numbers = RemapNumbers(Value=sort_list_4.Keys, Source=bounds, Target=Slider(10, range=1..15))  # -> Mapped, Clipped
deconstruct_path_3 = DeconstructPath(Branch=sort_list_4.ValuesValuesA)
integer_3 = Integer(graft(remap_numbers.Mapped))
merge_10 = Merge(Data1=integer_3, Data2=deconstruct_path_3)
construct_path_3 = ConstructPath(Indices=merge_10)
flip_matrix_10 = FlipMatrix(Data=construct_path_3)
replace_paths_3 = ReplacePaths(Data=simplify_tree_11, Search=tree_statistics_11.Paths, Replace=flip_matrix_10)
polygon_center_2 = PolygonCenter(Polyline=replace_paths_3)  # -> CenterV, CenterE, CenterA
shift_paths_4 = ShiftPaths(Data=replace_paths_3, Offset=-1)
tree_statistics_12 = TreeStatistics(Tree=polygon_center_2.CenterE)  # -> graft(Paths), Length, Count
tree_statistics_13 = TreeStatistics(Tree=shift_paths_4)  # -> Paths, Length, Count
text_tag_3d_6 = TextTag3D(Location=polygon_center_2.CenterE, Text=tree_statistics_12.Paths, Size=Slider(0.13, range=0..1), Justification=7)
repeat_data_3 = RepeatData(
    Data=[ColourSwatch(SwatchColor=RGB(255, 255, 255)), ColourSwatch(SwatchColor=RGB(252, 27, 255))],
    Length=tree_statistics_13.Count)  # -> graft(Data)
custom_preview_3 = CustomPreview(Geometry=shift_paths_4, Material=repeat_data_3)

curve_5 = Curve([<curve referenced from the Rhino model> x6])
graft_tree_15 = GraftTree(Tree=curve_5, IncludeEmptyLists=True, IncludeNullItems=True)
curve_curve = CurveCurve(CurveA=graft_tree_15, CurveB=curve_5)  # -> Points, ParamsA, ParamsB
param_viewer_40 = ParamViewer(curve_curve.Points)
simplify_tree_12 = SimplifyTree(Tree=curve_curve.Points, Front=False)
param_viewer_41 = ParamViewer(simplify_tree_12)
tree_statistics_14 = TreeStatistics(Tree=simplify_tree_12)  # -> Paths, Length, Count
deconstruct_path_4 = DeconstructPath(Branch=tree_statistics_14.Paths)
flip_matrix_11 = FlipMatrix(Data=deconstruct_path_4)
explode_tree_3 = ExplodeTree(Data=flip_matrix_11)  # -> Branch0, Branch1
equality = Equality(FirstNumber=explode_tree_3.Branch0, SecondNumber=explode_tree_3.Branch1)  # -> Equality, Inequality
cull_pattern_4 = CullPattern(List=tree_statistics_14.Paths, CullPattern=equality.Inequality)
panel_132 = Panel(cull_pattern_4)
tree_branch_4 = TreeBranch(Tree=simplify_tree_12, Path=cull_pattern_4, MaintainPaths=True)

curve_6 = Curve([<curve referenced from the Rhino model> x6])
graft_tree_16 = GraftTree(Tree=curve_6, IncludeEmptyLists=True, IncludeNullItems=True)
curve_curve_2 = CurveCurve(CurveA=graft_tree_16, CurveB=curve_6)  # -> Points, ParamsA, ParamsB
param_viewer_42 = ParamViewer(curve_curve_2.Points)
simplify_tree_13 = SimplifyTree(Tree=curve_curve_2.Points, Front=False)
param_viewer_43 = ParamViewer(simplify_tree_13)
tree_statistics_15 = TreeStatistics(Tree=simplify_tree_13)  # -> Paths, Length, Count
deconstruct_path_5 = DeconstructPath(Branch=tree_statistics_15.Paths)
flip_matrix_12 = FlipMatrix(Data=deconstruct_path_5)
explode_tree_4 = ExplodeTree(Data=flip_matrix_12)  # -> Branch0, Branch1
equality_2 = Equality(FirstNumber=explode_tree_4.Branch0, SecondNumber=explode_tree_4.Branch1)  # -> Equality, Inequality
cull_pattern_5 = CullPattern(List=tree_statistics_15.Paths, CullPattern=equality_2.Inequality)
panel_133 = Panel(cull_pattern_5)
tree_branch_5 = TreeBranch(Tree=simplify_tree_13, Path=cull_pattern_5, MaintainPaths=True)
shift_paths_5 = ShiftPaths(Data=tree_branch_5, Offset=-1)
curve_7 = Curve(graft_tree_16)
curve_closest_point = CurveClosestPoint(Point=shift_paths_5, Curve=curve_7)  # -> Point, Parameter, Distance
evaluate_curve = EvaluateCurve(Curve=curve_7, Parameter=curve_closest_point.Parameter)  # -> Point, Tangent, Angle
construct_plane = ConstructPlane(Origin=evaluate_curve.Point, XAxis=evaluate_curve.Tangent, YAxis=Vector(0, 1, 0))
vector_display_2 = VectorDisplay(Anchor=evaluate_curve.Point, Vector=evaluate_curve.Tangent)
rectangle = Rectangle(Plane=construct_plane, XSize=Slider(12, range=0..12), YSize=Slider(3.154, range=0..11), Radius=0)  # -> Rectangle, Length

region_2 = Region({Plane=PlaneXY(0, 0, 0), Size=Domain2(u=0..20, v=0..10)})
populate_2d_2 = Populate2D(Region=region_2, Count=Slider(120, range=0..1000), Seed=1)
populate_3d_2 = Populate3D(Region={Plane=PlaneXY(0, 0, 0), X=Domain(0, 10), Y=Domain(0, 10), Z=Domain(0, 2)}, Count=100, Seed=1)
delaunay_mesh_2 = DelaunayMesh(Points=populate_2d_2, Plane=PlaneXY(0, 0, 0))
face_normals_2 = FaceNormals(Mesh=delaunay_mesh_2)  # -> Centers, Normals
deconstruct_mesh_2 = DeconstructMesh(Mesh=delaunay_mesh_2)  # -> Vertices, Faces, Colours, Normals
deconstruct_face_2 = DeconstructFace(Face=graft(deconstruct_mesh_2.Faces))  # -> CornerA, CornerB, CornerC, CornerD
point_list_6 = PointList(Points=face_normals_2.Centers)
merge_11 = Merge(Data1=deconstruct_face_2.CornerA, Data2=deconstruct_face_2.CornerB, Data3=deconstruct_face_2.CornerC)
list_item_3 = ListItem(List=deconstruct_mesh_2.Vertices, Index=merge_11, Wrap=True)
point_on_curve_2 = PointOnCurve(region_2, parameter=0.357)
polyline_6 = PolyLine(Vertices=list_item_3, Closed=False)
simplify_tree_14 = SimplifyTree(Tree=polyline_6, Front=False)
polygon_center_3 = PolygonCenter(Polyline=simplify_tree_14)  # -> CenterV, CenterE, CenterA
tree_statistics_16 = TreeStatistics(Tree=simplify_tree_14)  # -> Paths, Length, Count
distance_2 = Distance(PointA=point_on_curve_2, PointB=polygon_center_3.CenterV)
flip_matrix_13 = FlipMatrix(Data=distance_2)
param_viewer_44 = ParamViewer(distance_2)
panel_134 = Panel(distance_2)
sort_list_5 = SortList(Keys=flip_matrix_13, ValuesValuesA=tree_statistics_16.Paths)  # -> reverse(Keys), ValuesValuesA
bounds_2 = Bounds(Numbers=sort_list_5.Keys)
panel_135 = Panel(sort_list_5.Keys)
remap_numbers_2 = RemapNumbers(Value=sort_list_5.Keys, Source=bounds_2, Target=Slider(10, range=1..15))  # -> Mapped, Clipped
deconstruct_path_6 = DeconstructPath(Branch=sort_list_5.ValuesValuesA)
integer_4 = Integer(graft(remap_numbers_2.Mapped))
merge_12 = Merge(Data1=integer_4, Data2=deconstruct_path_6)
construct_path_4 = ConstructPath(Indices=merge_12)
flip_matrix_14 = FlipMatrix(Data=construct_path_4)
replace_paths_4 = ReplacePaths(Data=simplify_tree_14, Search=tree_statistics_16.Paths, Replace=flip_matrix_14)
data = Data(replace_paths_4)
graft_tree_17 = GraftTree(Tree=data, IncludeEmptyLists=True, IncludeNullItems=True)
simplify_tree_15 = SimplifyTree(Tree=graft_tree_17, Front=False)
polygon_center_4 = PolygonCenter(Polyline=graft_tree_17)  # -> CenterV, CenterE, CenterA
tree_statistics_17 = TreeStatistics(Tree=simplify_tree_15)  # -> Paths, Length, Count
deconstruct_path_7 = DeconstructPath(Branch=tree_statistics_17.Paths)
weave_2 = Weave(Pattern=[0, 1], Stream0=deconstruct_path_7, Stream1="-", NullGaps=False)
text_join_3 = TextJoin(Text=weave_2)
text_tag_3d_7 = TextTag3D(Location=polygon_center_4.CenterV, Text=text_join_3, Size=Slider(0.18, range=0..1), Justification=7)
panel_136 = Panel(text_join_3)
object_bake = ObjectBake(
    BakeToggle=Button(),
    GeometryObjects=graft_tree_17,
    Layer="GH_Bake",
    ObjectName=text_join_3,
    ObjectColor=RGB(255, 255, 255),
    LayerColor=RGB(255, 255, 255))
polygon_center_5 = PolygonCenter(Polyline=replace_paths_4)  # -> CenterV, CenterE, CenterA
shift_paths_6 = ShiftPaths(Data=replace_paths_4, Offset=-1)
tree_statistics_18 = TreeStatistics(Tree=polygon_center_5.CenterE)  # -> graft(Paths), Length, Count
tree_statistics_19 = TreeStatistics(Tree=shift_paths_6)  # -> Paths, Length, Count
text_tag_3d_8 = TextTag3D(Location=polygon_center_5.CenterE, Text=tree_statistics_18.Paths, Size=Slider(0.13, range=0..1), Justification=7)
repeat_data_4 = RepeatData(
    Data=[ColourSwatch(SwatchColor=RGB(255, 255, 255)), ColourSwatch(SwatchColor=RGB(252, 27, 255))],
    Length=tree_statistics_19.Count)  # -> graft(Data)
custom_preview_4 = CustomPreview(Geometry=shift_paths_6, Material=repeat_data_4)

path_mapper_5 = PathMapper()
flatten_tree_5 = FlattenTree(Path="{0}")

construct_domain_7 = ConstructDomain(DomainStart=Slider(0, range=0..10), DomainEnd=Slider(10, range=0..10))
number_slider_14 = Slider(4, range=0..10)
number_slider_15 = Slider(6, range=0..10)

construct_domain_8 = ConstructDomain(DomainStart=Slider(0, range=0..10), DomainEnd=Slider(10, range=0..10))
panel_137 = Panel("""0
1""")
range_8 = Range(Domain=construct_domain_8, Steps=10)
repeat_data_5 = RepeatData(Data=panel_137, Length=Slider(4, range=0..10))
panel_138 = Panel("""0
1
1""")
dispatch_3 = Dispatch(List=range_8, DispatchPattern=panel_138)  # -> ListA, ListB
panel_139 = Panel(dispatch_3.ListA)
panel_140 = Panel(dispatch_3.ListB)
pick_n_choose_2 = PickNChoose(Pattern=repeat_data_5, Stream0=panel_139, Stream1=panel_140)
weave_3 = Weave(Pattern=repeat_data_5, Stream0=panel_139, Stream1=panel_140, NullGaps=False)
panel_141 = Panel(pick_n_choose_2)
panel_142 = Panel(weave_3)

panel_143 = Panel(range_8)
panel_144 = Panel("""0
0
1
1""")

range_9 = Range(Domain=construct_domain_7, Steps=Slider(10, range=0..10))
panel_145 = Panel(range_9)
insert_items_2 = InsertItems(List=range_9, Item=number_slider_14, Indices=number_slider_15, Wrap=True)
list_item_4 = ListItem(List=range_9, Index=Slider(5, range=0..10), Wrap=True)
list_item_5 = ListItem(List=range_9, Index=0, Wrap=True)  # -> Item, Item1, Item2, Item3, Item4
panel_146 = Panel(insert_items_2)
panel_147 = Panel(list_item_5.Item3)
panel_148 = Panel(list_item_4)
panel_149 = Panel(list_item_5.Item)
panel_150 = Panel(list_item_5.Item1)
panel_151 = Panel(list_item_5.Item2)
panel_152 = Panel(list_item_5.Item4)

# ----
# https://www.grasshopper3d.com/forum/topics/list-index
member_index_3 = MemberIndex(Set=range_9, Member=number_slider_15)  # -> Index, Count
item_index_5 = ItemIndex(List=range_9, Item=number_slider_14)
panel_153 = Panel(item_index_5)
panel_154 = Panel(member_index_3.Index)
sort_list_6 = SortList()  # -> Keys, ValuesValuesA

sift_pattern_3 = SiftPattern(List=weave_3, SiftPattern=panel_144)  # -> Output0, Output1
null_item_2 = NullItem(Item=sift_pattern_3.Output0)  # -> NullFlags, InvalidFlags, Description
combine_data_2 = CombineData(Input0=sift_pattern_3.Output0, Input1=sift_pattern_3.Output1)  # -> Result, Index
panel_155 = Panel(sift_pattern_3.Output0)
panel_156 = Panel(combine_data_2.Result)
panel_157 = Panel(null_item_2.NullFlags)
panel_158 = Panel(sift_pattern_3.Output1)
replace_nulls_4 = ReplaceNulls(Items=sift_pattern_3.Output0, Replacements=Slider(3, range=0..10))  # -> Items, Count
panel_159 = Panel(replace_nulls_4.Items)

panel_160 = Panel(panel_158)
clean_tree_4 = CleanTree(RemoveNulls=Toggle(True), RemoveInvalid=Toggle(False), RemoveEmpty=Toggle(False), Tree=panel_160)
panel_161 = Panel(clean_tree_4)

# ==== cluster SprayBlurMesh: spray and blur a Mesh based on Proximity to points
meshtocolor = ClusterInput()
spraypoint = ClusterInput()
spraycolour = ClusterInput()
blurringiterations = ClusterInput()

meshtocolor_2 = Mesh(meshtocolor)
spraypoint_2 = Point(spraypoint)
spraycolour_2 = Colour(spraycolour)
blurringiterations_2 = Integer(blurringiterations)

list_length = ListLength(List=spraypoint_2)
repeat_data = RepeatData(Data=spraycolour_2, Length=list_length)
mesh_spray = MeshSpray(Mesh=meshtocolor_2, Points=spraypoint_2, Colours=repeat_data, SprayMode=11)
blur_mesh = BlurMesh(Mesh=mesh_spray, Iterations=blurringiterations_2)
blurredmesh = Mesh(blur_mesh)
blurredmesh_2 = ClusterOutput(blurredmesh)
