# Grasshopper definition Sets002.gh (Grasshopper 1.0.7)
# Copyright: Wickerson Studios
# plug-ins: Bifocals, LunchBox

construct_path = ConstructPath()

# ----
# Data Trees Intermediate
# Fancy Wires
# View Tree
# Param Viewer
# Data Lab
# Mode Lab
# Facebook out of date
clean_tree = CleanTree(RemoveNulls=True, RemoveInvalid=True, RemoveEmpty=False)

split_tree = SplitTree()  # -> Positive, Negative

relative_item = RelativeItem(WrapPaths=False, WrapItems=False)  # -> ItemA, ItemB

relative_items = RelativeItems(WrapPaths=False, WrapItems=False)  # -> ItemA, ItemB

path_mapper = PathMapper()

prune_tree = PruneTree(Minimum=0, Maximum=0)

replace_paths = ReplacePaths(Search="*")

tree_statistics = TreeStatistics()  # -> Paths, Length, Count

tree_branch = TreeBranch(MaintainPaths=True)

shift_paths = ShiftPaths(Offset=-1)

match_tree = MatchTree()

simplify_tree = SimplifyTree(Front=False)

flip_matrix = FlipMatrix()

merge = Merge()

# ---- group: Jump
flatten_tree = FlattenTree(Path="{0}")

# ----
graft_tree = GraftTree(IncludeEmptyLists=True, IncludeNullItems=True)

explode_tree = ExplodeTree()  # -> Branch0, Branch1

deconstruct_path = DeconstructPath()

path_compare = PathCompare(Mask="*")
tree_item = TreeItem(Index=0, Wrap=True)
stream_filter = StreamFilter(Gate=0)
stream_gate = StreamGate(Gate=0)  # -> Target0, Target1

# ---- group: Trim Tree
trim_tree = TrimTree(Depth=1)
unflatten_tree = UnflattenTree()
entwine = Entwine(FlattenInputs=True)

# ----
series = Series(Start=0, Step=1, Count=10)
panel = Panel(series)
param_viewer = ParamViewer(series)
graft_tree_2 = GraftTree(Tree=series, IncludeEmptyLists=True, IncludeNullItems=True)
panel_2 = Panel(graft_tree_2)
param_viewer_2 = ParamViewer(graft_tree_2)
flatten_tree_2 = FlattenTree(Tree=graft_tree_2, Path="{0}")
panel_3 = Panel(flatten_tree_2)
param_viewer_3 = ParamViewer(flatten_tree_2)

tree = Tree(["2", "3", "5", "9", "10"])
panel_4 = Panel(tree)
clean_tree_2 = CleanTree(RemoveNulls=Toggle(True), RemoveInvalid=Toggle(False), RemoveEmpty=Toggle(False), Tree=tree)
panel_5 = Panel(clean_tree_2)

square = Square(Plane=PlaneXY(0, 0, 0), Size=1, ExtentX=5, ExtentY=5)  # -> Cells, Points
point = Point(square.Points)
graft_tree_3 = GraftTree(Tree=point, IncludeEmptyLists=True, IncludeNullItems=True)
simplify_tree_2 = SimplifyTree(Tree=graft_tree_3, Front=False)
tree_statistics_2 = TreeStatistics(Tree=simplify_tree_2)  # -> Paths, Length, Count
param_viewer_4 = ParamViewer(tree_statistics_2.Paths)
graft_tree_4 = GraftTree(Tree=tree_statistics_2.Paths, IncludeEmptyLists=True, IncludeNullItems=True)
panel_6 = Panel("""{1;1}
{0;-1}""")
panel_7 = Panel("{1;0}")
relative_item_2 = RelativeItem(Tree=simplify_tree_2, Offset=panel_6, WrapPaths=False, WrapItems=False)  # -> ItemA, ItemB
text_tag_3d = TextTag3D(Location=simplify_tree_2, Text=graft_tree_4, Size=Slider(0.13, range=0..1), Justification=7)
polyline = PolyLine(Closed=False)
panel_8 = Panel(param_viewer_4)
line = Line(StartPoint=relative_item_2.ItemA, EndPoint=relative_item_2.ItemB)

# ----
# Processing Data Trees Kicks ass!
# add ons,  Weaver bird
# Python for Grasshopper
# Kangaroo!
square_2 = Square(Plane=PlaneXY(0, 0, 0), Size=1, ExtentX=5, ExtentY=5)  # -> Cells, simplify(graft(Points))
param_viewer_5 = ParamViewer(square_2.Points)
tree_statistics_3 = TreeStatistics(Tree=square_2.Points)  # -> graft(Paths), Length, Count
match_tree_2 = MatchTree(Tree=tree_statistics_3.Paths, Guide=square_2.Points)
panel_9 = Panel(tree_statistics_3.Paths)
text_tag = TextTag(Location=square_2.Points, Text=match_tree_2)

square_3 = Square(Plane=PlaneXY(0, 0, 0), Size=1, ExtentX=5, ExtentY=5)  # -> Cells, Points
param_viewer_6 = ParamViewer(square_3.Points)
param_viewer_7 = ParamViewer(square_3.Cells)
range = Range(Domain=Domain(0, 1), Steps=10)
series_2 = Series(Start=0, Step=1, Count=Slider(6, range=1..25))
series_3 = Series(Start=0, Step=1, Count=Slider(8, range=1..25))
cross_reference = CrossReference(ListListA=series_2, ListListB=series_3, CrossMode=1)  # -> ListListA, ListListB
longest_list = LongestList(ListListA=series_2, ListListB=series_3, PaddingMode=2)  # -> ListListA, ListListB
graft_tree_5 = GraftTree(Tree=longest_list.ListListA, IncludeEmptyLists=True, IncludeNullItems=True)
construct_point = ConstructPoint(XCoordinate=graft_tree_5, YCoordinate=longest_list.ListListB, ZCoordinate=0)
point_list = PointList(Points=construct_point, Size=Slider(0.49, range=0..1))
panel_10 = Panel(construct_point)
tree_2 = Tree(["2", "3", "5", "9", "10"])
param_viewer_8 = ParamViewer(construct_point)
param_viewer_9 = ParamViewer(construct_point)
tree_statistics_4 = TreeStatistics(Tree=construct_point)  # -> Paths, Length, Count
panel_11 = Panel(tree_statistics_4.Count)
panel_12 = Panel(tree_statistics_4.Length)
panel_13 = Panel(tree_statistics_4.Paths)

relative_items_2 = RelativeItems(WrapPaths=False, WrapItems=False)  # -> ItemA, ItemB

xpos = Slider(3.955, range=1..6)
ypos = Slider(4.239, range=1..6)
xpos_2 = Slider(3.955, range=1..6)
ypos_2 = Slider(4.239, range=1..6)
series_4 = Series(Start=0, Step=xpos, Count=Slider(8, range=1..20))
series_5 = Series(Start=0, Step=ypos, Count=Slider(15, range=1..20))
series_6 = Series(Start=0, Step=xpos_2, Count=Slider(8, range=1..20))  # -> graft(Series)
series_7 = Series(Start=0, Step=ypos_2, Count=Slider(11, range=1..20))
shortest_list = ShortestList(ListListA=series_4, ListListB=series_5, TrimMode=2)  # -> ListListA, ListListB
cross_reference_2 = CrossReference(ListListA=series_4, ListListB=series_5, CrossMode=1)  # -> ListListA, ListListB
longest_list_2 = LongestList(ListListA=series_4, ListListB=series_5, PaddingMode=2)  # -> ListListA, ListListB
construct_point_2 = ConstructPoint(XCoordinate=series_6, YCoordinate=series_7, ZCoordinate=0)  # -> graft(Point)
construct_point_3 = ConstructPoint(XCoordinate=shortest_list.ListListA, YCoordinate=shortest_list.ListListB, ZCoordinate=0)
construct_point_4 = ConstructPoint(XCoordinate=longest_list_2.ListListA, YCoordinate=longest_list_2.ListListB, ZCoordinate=0)
construct_point_5 = ConstructPoint(XCoordinate=cross_reference_2.ListListA, YCoordinate=cross_reference_2.ListListB, ZCoordinate=0)
point_list_2 = PointList(Points=construct_point_2, Size=Slider(2, range=0..10))
number_slider = Slider(2, range=0..10)
# All Credit on these scripts go to ModeLab online:
# 
# ckeck out this series fo videos for starters!
# 
# https://www.youtube.com/playlist?list=PLGV167zE8gnV-mffyzD3mDhOrSM-CXaYW
# 
# https://www.youtube.com/watch?v=kL8tAdl3q6M&list=PLGV167zE8gnVRrzCCWvdlHYh3XQWTXFDo
panel_14 = Panel(construct_point_5)
panel_15 = Panel(construct_point_2)
construct_point_6 = ConstructPoint(XCoordinate=cross_reference_2.ListListA, YCoordinate=cross_reference_2.ListListB, ZCoordinate=0)  # -> graft(Point)
param_viewer_10 = ParamViewer(construct_point_5)
point_list_3 = PointList(Points=construct_point_5, Size=number_slider)
panel_16 = Panel(construct_point_6)
point_list_4 = PointList(Points=construct_point_6, Size=number_slider)
param_viewer_11 = ParamViewer(construct_point_6)
param_viewer_12 = ParamViewer(construct_point_6)
param_viewer_13 = ParamViewer(construct_point_5)
param_viewer_14 = ParamViewer(construct_point_2)
param_viewer_15 = ParamViewer(construct_point_6)
param_viewer_16 = ParamViewer(construct_point_5)
param_viewer_17 = ParamViewer(construct_point_2)

tree_statistics_5 = TreeStatistics(Tree=construct_point_2)  # -> graft(Paths), Length, Count

simplify_tree_3 = SimplifyTree(Tree=construct_point_2, Front=False)

text_tag_3d_2 = TextTag3D(Location=construct_point_2, Text=tree_statistics_5.Paths, Size=Slider(0.59, range=0..1), Justification=7)
panel_17 = Panel(tree_statistics_5.Paths)
panel_19 = Panel(tree_statistics_5.Length)
panel_20 = Panel(tree_statistics_5.Count)
param_viewer_18 = ParamViewer(simplify_tree_3)
param_viewer_19 = ParamViewer(simplify_tree_3)

square_4 = Square(Plane=PlaneXY(0, 0, 0), Size=1, ExtentX=5, ExtentY=5)  # -> Cells, Points
point_2 = Point(square_4.Points)
graft_tree_6 = GraftTree(Tree=point_2, IncludeEmptyLists=True, IncludeNullItems=True)
panel_21 = Panel("-2")
param_viewer_20 = ParamViewer(point_2)
panel_22 = Panel(graft_tree_6)
param_viewer_21 = ParamViewer(panel_22)

shift_paths_2 = ShiftPaths(Data=graft_tree_6, Offset=-1)

simplify_tree_4 = SimplifyTree(Tree=shift_paths_2, Front=False)
panel_23 = Panel(shift_paths_2)
panel_24 = Panel(simplify_tree_4)
flatten_tree_3 = FlattenTree(Tree=simplify_tree_4, Path="{0}")
param_viewer_22 = ParamViewer(panel_23)
param_viewer_23 = ParamViewer(simplify_tree_4)
param_viewer_24 = ParamViewer(flatten_tree_3)
param_viewer_25 = ParamViewer(flatten_tree_3)
param_viewer_26 = ParamViewer(panel_23)
param_viewer_27 = ParamViewer(simplify_tree_4)

reference_surface = Surface(reparameterize(<surface referenced from the Rhino model>))
divide_surface = DivideSurface(Surface=reference_surface, UCount=Slider(100, range=0..100), VCount=Slider(100, range=0..100))  # -> Points, Normals, Parameters
boolean_toggle = BooleanToggle(True)

flip_matrix_2 = FlipMatrix(Data=divide_surface.Normals)
flip_matrix_3 = FlipMatrix(Data=divide_surface.Points)
flip_matrix_4 = FlipMatrix(Data=divide_surface.Parameters)

reference_surface_2 = Surface(reparameterize(<surface referenced from the Rhino model>))
divide_surface_2 = DivideSurface(Surface=reference_surface_2, UCount=Slider(6, range=0..100), VCount=Slider(7, range=0..100))  # -> Points, Normals, Parameters
boolean_toggle_2 = BooleanToggle(False)
panel_25 = Panel("""{0;0}
{0;3}
{1;1}
{-3,0}""")
panel_26 = Panel("{0;1}")

flip_matrix_5 = FlipMatrix(Data=divide_surface_2.Parameters)

flip_matrix_6 = FlipMatrix(Data=divide_surface_2.Normals)
flip_matrix_7 = FlipMatrix(Data=divide_surface_2.Points)

number_slider_2 = Slider(5, range=1..25)
number_slider_3 = Slider(8, range=1..25)
square_5 = Square(Plane=PlaneXY(0, 0, 0), Size=1, ExtentX=number_slider_2, ExtentY=number_slider_3)  # -> Cells, Points
point_3 = Point(square_5.Points)
integer = Integer(number_slider_2)
integer_2 = Integer(number_slider_3)
concatenate = Concatenate(Fragment_A="{", Fragment_B=integer, A=";*}")
concatenate_2 = Concatenate(Fragment_A="{*", Fragment_B=";", A=integer_2, B="}")
panel_27 = Panel("""{2;*}
{*;1}""")
panel_28 = Panel("""True
True
False""")

graft_tree_7 = GraftTree(Tree=point_3, IncludeEmptyLists=True, IncludeNullItems=True)

simplify_tree_5 = SimplifyTree(Tree=graft_tree_7, Front=False)

tree_statistics_6 = TreeStatistics(Tree=simplify_tree_5)  # -> Paths, Length, Count

graft_tree_8 = GraftTree(Tree=tree_statistics_6.Paths, IncludeEmptyLists=True, IncludeNullItems=True)

split_tree_2 = SplitTree(Data=simplify_tree_5, Masks=flatten(panel_27))  # -> Positive, Negative

split_tree_3 = SplitTree(Data=simplify_tree_5, Masks=flatten([concatenate_2, concatenate]))  # -> Positive, Negative

tree_statistics_7 = TreeStatistics(Tree=simplify_tree_5)  # -> Paths, Length, Count

text_tag_3d_3 = TextTag3D(Location=simplify_tree_5, Text=graft_tree_8, Size=Slider(0.23, range=0..1), Justification=7)
point_4 = Point(split_tree_2.Positive)
point_5 = Point(split_tree_3.Positive)
cull_pattern = CullPattern(List=tree_statistics_7.Paths, CullPattern=panel_28)
param_viewer_28 = ParamViewer(simplify_tree_5)

tree_branch_2 = TreeBranch(Tree=simplify_tree_5, Path=cull_pattern, MaintainPaths=True)

square_6 = Square(Plane=PlaneXY(0, 0, 0), Size=1, ExtentX=5, ExtentY=5)  # -> Cells, Points
point_6 = Point(square_6.Points)
graft_tree_9 = GraftTree(Tree=point_6, IncludeEmptyLists=True, IncludeNullItems=True)
simplify_tree_6 = SimplifyTree(Tree=graft_tree_9, Front=False)
tree_statistics_8 = TreeStatistics(Tree=simplify_tree_6)  # -> Paths, Length, Count
param_viewer_29 = ParamViewer()
panel_30 = Panel("""{1;1}
{0;-1}""")
graft_tree_10 = GraftTree(Tree=tree_statistics_8.Paths, IncludeEmptyLists=True, IncludeNullItems=True)
panel_31 = Panel("""{0;0}
{1;1}
{1;2}
{0;1}""")
text_tag_3d_4 = TextTag3D(Location=simplify_tree_6, Text=graft_tree_10, Size=Slider(0.13, range=0..1), Justification=7)
panel_32 = Panel(param_viewer_29)

relative_item_3 = RelativeItem(Tree=simplify_tree_6, Offset=panel_31, WrapPaths=False, WrapItems=False)  # -> ItemA, ItemB

line_2 = Line(StartPoint=relative_item_3.ItemA, EndPoint=relative_item_3.ItemB)
polyline_2 = PolyLine(Vertices=relative_item_3.ItemB, Closed=Toggle(True))

points_uvw = StreamFilter(Gate=boolean_toggle, Stream0=divide_surface.Parameters, Stream1=flip_matrix_4)
normal_vectors = StreamFilter(Gate=boolean_toggle, Stream0=divide_surface.Normals, Stream1=flip_matrix_2)
points_xyz = StreamFilter(Gate=boolean_toggle, Stream0=divide_surface.Points, Stream1=flip_matrix_3)
image_sampler = ImageSampler(
    points_uvw,
    FilePath="C:\Users\Sculpture\Documents\2020Grasshopper\ScreenShots2019\BlackandWhiteMax.PNG",
    Filter="Value",
    Interpolate=False,
    Umax=1,
    Umin=0,
    Vmax=1,
    Vmin=0,
    Wrap=1)
multiplication = Multiplication(A=normal_vectors, B=image_sampler)
addition = Addition(A=points_xyz, B=multiplication)
panel_33 = Panel(image_sampler)
interpolate = Interpolate(Vertices=points_xyz, Degree=3, Periodic=False, KnotStyle=1)  # -> Curve, Length, Domain
interpolate_2 = Interpolate(Vertices=addition, Degree=3, Periodic=False, KnotStyle=1)  # -> flatten(Curve), Length, Domain
param_viewer_30 = ParamViewer(interpolate.Curve)
param_viewer_31 = ParamViewer(interpolate_2.Curve)
param_viewer_32 = ParamViewer(interpolate.Curve)

path_mapper_2 = PathMapper(interpolate_2.Curve, source="{A;B;C}(i)", target="{A;B;C+2}(i)")
path_mapper_3 = PathMapper(interpolate_2.Curve)

merge_2 = Merge(Data1=flatten(interpolate.Curve), Data2=path_mapper_2)
prune_tree_2 = PruneTree(Tree=merge_2, Minimum=Slider(2, range=0..10), Maximum=0)
loft = Loft(Curves=prune_tree_2, Options={Adjust=False, Closed=False, LoftEnds=0, LoftSimp=0, LoftType=0, Rebuild=10, Refit=0.01})

points_uvw_2 = StreamFilter(Gate=boolean_toggle_2, Stream0=divide_surface_2.Parameters, Stream1=flip_matrix_5)
points_xyz_2 = StreamFilter(Gate=boolean_toggle_2, Stream0=divide_surface_2.Points, Stream1=flip_matrix_7)
normal_vectors_2 = StreamFilter(Gate=boolean_toggle_2, Stream0=divide_surface_2.Normals, Stream1=flip_matrix_6)
image_sampler_2 = ImageSampler(
    points_uvw_2,
    FilePath="C:\Users\Sculpture\Documents\2020Grasshopper\ScreenShots2019\BlackandWhiteMax.PNG",
    Filter="Value",
    Interpolate=False,
    Umax=1,
    Umin=0,
    Vmax=1,
    Vmin=0,
    Wrap=1)
multiplication_2 = Multiplication(A=normal_vectors_2, B=image_sampler_2)
multiplication_3 = Multiplication(A=multiplication_2, B=Slider(10, range=0..10))
panel_34 = Panel(image_sampler_2)
addition_2 = Addition(A=points_xyz_2, B=multiplication_3)
graft_tree_11 = GraftTree(Tree=points_xyz_2, IncludeEmptyLists=True, IncludeNullItems=True)
graft_tree_12 = GraftTree(Tree=addition_2, IncludeEmptyLists=True, IncludeNullItems=True)
simplify_tree_7 = SimplifyTree(Tree=graft_tree_11, Front=False)
simplify_tree_8 = SimplifyTree(Tree=graft_tree_12, Front=False)

relative_items_3 = RelativeItems(TreeA=simplify_tree_7, TreeB=simplify_tree_8, Offset=panel_25, WrapPaths=False, WrapItems=False)  # -> ItemA, ItemB

polyline_3 = PolyLine(Vertices=relative_items_3.ItemB, Closed=True)
line_3 = Line(StartPoint=relative_items_3.ItemA, EndPoint=relative_items_3.ItemB)
panel_35 = Panel(polyline_3)
loft_2 = Loft(Curves=line_3, Options={Adjust=False, Closed=False, LoftEnds=0, LoftSimp=0, LoftType=0, Rebuild=10, Refit=0.01})

surface = Surface(<surface referenced from the Rhino model>)
domain² = Domain²(surface)
panel_36 = Panel(domain²)
divide_surface_3 = DivideSurface(Surface=surface, UCount=Slider(25, range=1..40), VCount=Slider(9, range=1..40))  # -> Points, Normals, Parameters
interpolate_3 = Interpolate(Vertices=divide_surface_3.Points, Degree=3, Periodic=False, KnotStyle=1)  # -> Curve, Length, Domain
panel_37 = Panel("""{0;0}
{1;0}
{1;1}""")
param_viewer_33 = ParamViewer()

clean_tree_3 = CleanTree(RemoveNulls=True, RemoveInvalid=True, RemoveEmpty=False, Tree=divide_surface_3.Points)

graft_tree_13 = GraftTree(Tree=clean_tree_3, IncludeEmptyLists=True, IncludeNullItems=True)

simplify_tree_9 = SimplifyTree(Tree=graft_tree_13, Front=False)

tree_statistics_9 = TreeStatistics(Tree=simplify_tree_9)  # -> graft(Paths), Length, Count

relative_item_4 = RelativeItem(Tree=simplify_tree_9, Offset=panel_37, WrapPaths=False, WrapItems=False)  # -> ItemA, ItemB

prune_tree_3 = PruneTree(Tree=relative_item_4.ItemB, Minimum="3", Maximum=0)

param_viewer_34 = ParamViewer(graft_tree_13)
param_viewer_35 = ParamViewer(simplify_tree_9)
text_tag_3d_5 = TextTag3D(Location=simplify_tree_9, Text=tree_statistics_9.Paths, Size=Slider(0.15, range=0..1), Justification=7)
param_viewer_36 = ParamViewer(clean_tree_3)
param_viewer_37 = ParamViewer(relative_item_4.ItemA)
line_4 = Line(StartPoint=relative_item_4.ItemA, EndPoint=relative_item_4.ItemB)
polyline_4 = PolyLine(Vertices=prune_tree_3, Closed=Toggle(True))
param_viewer_38 = ParamViewer(prune_tree_3)
panel_38 = Panel(polyline_4)

curve = Curve([<curve referenced from the Rhino model> x6])
curve_2 = Curve([<curve referenced from the Rhino model> x6])
region = Region({Plane=PlaneXY(0, 0, 0), Size=Domain2(u=0..20, v=0..10)})
region_2 = Region({Plane=PlaneXY(0, 0, 0), Size=Domain2(u=0..20, v=0..10)})
populate_2d = Populate2D(Region=region, Count=Slider(120, range=0..1000), Seed=1)
populate_3d = Populate3D(Region={Plane=PlaneXY(0, 0, 0), X=Domain(0, 10), Y=Domain(0, 10), Z=Domain(0, 2)}, Count=100, Seed=1)
populate_2d_2 = Populate2D(Region=region_2, Count=Slider(120, range=0..1000), Seed=1)
populate_3d_2 = Populate3D(Region={Plane=PlaneXY(0, 0, 0), X=Domain(0, 10), Y=Domain(0, 10), Z=Domain(0, 2)}, Count=100, Seed=1)
delaunay_mesh = DelaunayMesh(Points=populate_2d, Plane=PlaneXY(0, 0, 0))
delaunay_mesh_2 = DelaunayMesh(Points=populate_2d_2, Plane=PlaneXY(0, 0, 0))
face_normals = FaceNormals(Mesh=delaunay_mesh)  # -> Centers, Normals
deconstruct_mesh = DeconstructMesh(Mesh=delaunay_mesh)  # -> Vertices, Faces, Colours, Normals
face_normals_2 = FaceNormals(Mesh=delaunay_mesh_2)  # -> Centers, Normals
deconstruct_mesh_2 = DeconstructMesh(Mesh=delaunay_mesh_2)  # -> Vertices, Faces, Colours, Normals
deconstruct_face = DeconstructFace(Face=graft(deconstruct_mesh.Faces))  # -> CornerA, CornerB, CornerC, CornerD
point_list_5 = PointList(Points=face_normals.Centers)
deconstruct_face_2 = DeconstructFace(Face=graft(deconstruct_mesh_2.Faces))  # -> CornerA, CornerB, CornerC, CornerD
point_list_6 = PointList(Points=face_normals_2.Centers)
merge_3 = Merge(Data1=deconstruct_face.CornerA, Data2=deconstruct_face.CornerB, Data3=deconstruct_face.CornerC)
merge_4 = Merge(Data1=deconstruct_face_2.CornerA, Data2=deconstruct_face_2.CornerB, Data3=deconstruct_face_2.CornerC)
list_item = ListItem(List=deconstruct_mesh.Vertices, Index=merge_3, Wrap=True)
point_on_curve = PointOnCurve(region, parameter=0.357)
list_item_2 = ListItem(List=deconstruct_mesh_2.Vertices, Index=merge_4, Wrap=True)
point_on_curve_2 = PointOnCurve(region_2, parameter=0.357)
polyline_5 = PolyLine(Vertices=list_item, Closed=False)
polyline_6 = PolyLine(Vertices=list_item_2, Closed=False)
simplify_tree_10 = SimplifyTree(Tree=polyline_5, Front=False)
polygon_center = PolygonCenter(Polyline=simplify_tree_10)  # -> CenterV, CenterE, CenterA
distance = Distance(PointA=point_on_curve, PointB=polygon_center.CenterV)
param_viewer_39 = ParamViewer(distance)
panel_39 = Panel(distance)

graft_tree_14 = GraftTree(Tree=curve, IncludeEmptyLists=True, IncludeNullItems=True)

graft_tree_15 = GraftTree(Tree=curve_2, IncludeEmptyLists=True, IncludeNullItems=True)

simplify_tree_11 = SimplifyTree(Tree=polyline_6, Front=False)

tree_statistics_10 = TreeStatistics(Tree=simplify_tree_10)  # -> Paths, Length, Count

tree_statistics_11 = TreeStatistics(Tree=simplify_tree_11)  # -> Paths, Length, Count

flip_matrix_8 = FlipMatrix(Data=distance)

curve_curve = CurveCurve(CurveA=graft_tree_14, CurveB=curve)  # -> Points, ParamsA, ParamsB
curve_curve_2 = CurveCurve(CurveA=graft_tree_15, CurveB=curve_2)  # -> Points, ParamsA, ParamsB
param_viewer_40 = ParamViewer(curve_curve.Points)
param_viewer_41 = ParamViewer(curve_curve_2.Points)
polygon_center_2 = PolygonCenter(Polyline=simplify_tree_11)  # -> CenterV, CenterE, CenterA
distance_2 = Distance(PointA=point_on_curve_2, PointB=polygon_center_2.CenterV)
param_viewer_42 = ParamViewer(distance_2)
panel_40 = Panel(distance_2)
sort_list = SortList(Keys=flip_matrix_8, ValuesValuesA=tree_statistics_10.Paths)  # -> reverse(Keys), ValuesValuesA
curve_3 = Curve(graft_tree_15)
bounds = Bounds(Numbers=sort_list.Keys)
panel_41 = Panel(sort_list.Keys)
remap_numbers = RemapNumbers(Value=sort_list.Keys, Source=bounds, Target=Slider(10, range=1..15))  # -> Mapped, Clipped
integer_3 = Integer(graft(remap_numbers.Mapped))

simplify_tree_12 = SimplifyTree(Tree=curve_curve.Points, Front=False)

simplify_tree_13 = SimplifyTree(Tree=curve_curve_2.Points, Front=False)

tree_statistics_12 = TreeStatistics(Tree=simplify_tree_12)  # -> Paths, Length, Count

tree_statistics_13 = TreeStatistics(Tree=simplify_tree_13)  # -> Paths, Length, Count

deconstruct_path_2 = DeconstructPath(Branch=tree_statistics_12.Paths)

deconstruct_path_3 = DeconstructPath(Branch=tree_statistics_13.Paths)

flip_matrix_9 = FlipMatrix(Data=deconstruct_path_2)

explode_tree_2 = ExplodeTree(Data=flip_matrix_9)  # -> Branch0, Branch1

flip_matrix_10 = FlipMatrix(Data=distance_2)

deconstruct_path_4 = DeconstructPath(Branch=sort_list.ValuesValuesA)

param_viewer_43 = ParamViewer(simplify_tree_12)
param_viewer_44 = ParamViewer(simplify_tree_13)
flip_matrix_11 = FlipMatrix(Data=deconstruct_path_3)
equality = Equality(FirstNumber=explode_tree_2.Branch0, SecondNumber=explode_tree_2.Branch1)  # -> Equality, Inequality
cull_pattern_2 = CullPattern(List=tree_statistics_12.Paths, CullPattern=equality.Inequality)
panel_42 = Panel(cull_pattern_2)
sort_list_2 = SortList(Keys=flip_matrix_10, ValuesValuesA=tree_statistics_11.Paths)  # -> reverse(Keys), ValuesValuesA
bounds_2 = Bounds(Numbers=sort_list_2.Keys)
panel_43 = Panel(sort_list_2.Keys)
remap_numbers_2 = RemapNumbers(Value=sort_list_2.Keys, Source=bounds_2, Target=Slider(10, range=1..15))  # -> Mapped, Clipped
integer_4 = Integer(graft(remap_numbers_2.Mapped))
merge_5 = Merge(Data1=integer_3, Data2=deconstruct_path_4)

explode_tree_3 = ExplodeTree(Data=flip_matrix_11)  # -> Branch0, Branch1

tree_branch_3 = TreeBranch(Tree=simplify_tree_12, Path=cull_pattern_2, MaintainPaths=True)

deconstruct_path_5 = DeconstructPath(Branch=sort_list_2.ValuesValuesA)

construct_path_2 = ConstructPath(Indices=merge_5)

flip_matrix_12 = FlipMatrix(Data=construct_path_2)

replace_paths_2 = ReplacePaths(Data=simplify_tree_10, Search=tree_statistics_10.Paths, Replace=flip_matrix_12)

shift_paths_3 = ShiftPaths(Data=replace_paths_2, Offset=-1)

equality_2 = Equality(FirstNumber=explode_tree_3.Branch0, SecondNumber=explode_tree_3.Branch1)  # -> Equality, Inequality
cull_pattern_3 = CullPattern(List=tree_statistics_13.Paths, CullPattern=equality_2.Inequality)
panel_44 = Panel(cull_pattern_3)
merge_6 = Merge(Data1=integer_4, Data2=deconstruct_path_5)
polygon_center_3 = PolygonCenter(Polyline=replace_paths_2)  # -> CenterV, CenterE, CenterA

tree_branch_4 = TreeBranch(Tree=simplify_tree_13, Path=cull_pattern_3, MaintainPaths=True)

shift_paths_4 = ShiftPaths(Data=tree_branch_4, Offset=-1)

construct_path_3 = ConstructPath(Indices=merge_6)

flip_matrix_13 = FlipMatrix(Data=construct_path_3)

replace_paths_3 = ReplacePaths(Data=simplify_tree_11, Search=tree_statistics_11.Paths, Replace=flip_matrix_13)

shift_paths_5 = ShiftPaths(Data=replace_paths_3, Offset=-1)

tree_statistics_14 = TreeStatistics(Tree=polygon_center_3.CenterE)  # -> graft(Paths), Length, Count
tree_statistics_15 = TreeStatistics(Tree=shift_paths_3)  # -> Paths, Length, Count

data = Data(replace_paths_3)
curve_closest_point = CurveClosestPoint(Point=shift_paths_4, Curve=curve_3)  # -> Point, Parameter, Distance
evaluate_curve = EvaluateCurve(Curve=curve_3, Parameter=curve_closest_point.Parameter)  # -> Point, Tangent, Angle
construct_plane = ConstructPlane(Origin=evaluate_curve.Point, XAxis=evaluate_curve.Tangent, YAxis=Vector(0, 1, 0))
vector_display = VectorDisplay(Anchor=evaluate_curve.Point, Vector=evaluate_curve.Tangent)
rectangle = Rectangle(Plane=construct_plane, XSize=Slider(12, range=0..12), YSize=Slider(3.154, range=0..11), Radius=0)  # -> Rectangle, Length
polygon_center_4 = PolygonCenter(Polyline=replace_paths_3)  # -> CenterV, CenterE, CenterA
text_tag_3d_6 = TextTag3D(Location=polygon_center_3.CenterE, Text=tree_statistics_14.Paths, Size=Slider(0.13, range=0..1), Justification=7)
repeat_data = RepeatData(
    Data=[ColourSwatch(SwatchColor=RGB(255, 255, 255)), ColourSwatch(SwatchColor=RGB(252, 27, 255))],
    Length=tree_statistics_15.Count)  # -> graft(Data)
custom_preview = CustomPreview(Geometry=shift_paths_3, Material=repeat_data)

graft_tree_16 = GraftTree(Tree=data, IncludeEmptyLists=True, IncludeNullItems=True)

simplify_tree_14 = SimplifyTree(Tree=graft_tree_16, Front=False)

tree_statistics_16 = TreeStatistics(Tree=simplify_tree_14)  # -> Paths, Length, Count

deconstruct_path_6 = DeconstructPath(Branch=tree_statistics_16.Paths)

tree_statistics_17 = TreeStatistics(Tree=polygon_center_4.CenterE)  # -> graft(Paths), Length, Count
tree_statistics_18 = TreeStatistics(Tree=shift_paths_5)  # -> Paths, Length, Count

polygon_center_5 = PolygonCenter(Polyline=graft_tree_16)  # -> CenterV, CenterE, CenterA
weave = Weave(Pattern=[0, 1], Stream0=deconstruct_path_6, Stream1="-", NullGaps=False)
text_join = TextJoin(Text=weave)
text_tag_3d_7 = TextTag3D(Location=polygon_center_5.CenterV, Text=text_join, Size=Slider(0.18, range=0..1), Justification=7)
panel_45 = Panel(text_join)
object_bake = ObjectBake(
    BakeToggle=Button(),
    GeometryObjects=graft_tree_16,
    Layer="GH_Bake",
    ObjectName=text_join,
    ObjectColor=RGB(255, 255, 255),
    LayerColor=RGB(255, 255, 255))
text_tag_3d_8 = TextTag3D(Location=polygon_center_4.CenterE, Text=tree_statistics_17.Paths, Size=Slider(0.13, range=0..1), Justification=7)
repeat_data_2 = RepeatData(
    Data=[ColourSwatch(SwatchColor=RGB(255, 255, 255)), ColourSwatch(SwatchColor=RGB(252, 27, 255))],
    Length=tree_statistics_18.Count)  # -> graft(Data)
custom_preview_2 = CustomPreview(Geometry=shift_paths_5, Material=repeat_data_2)
