# Grasshopper definition Surfaces001.gh (Grasshopper 1.0.7)
# Copyright: Wickerson Studios
# plug-ins: Bifocals

number_slider = Slider(12, range=0..100)  # disabled
rectangle = Rectangle(Plane=PlaneXY(0, 0, 0), XSize=Domain(-1, 1), YSize=Domain(-2, 2), Radius=0)  # -> Rectangle, Length; disabled
plane_surface = PlaneSurface(Plane=PlaneXY(0, 0, 0), XSize=Domain(-10, 10), YSize=Domain(-10, 10))  # disabled
sphere = Sphere(Base=PlaneXY(0, 0, 0), Radius=1)  # disabled
number_slider_2 = Slider(0.34, range=0..10)  # disabled
point_a = PointA(<point a referenced from the Rhino model>)  # disabled
point_b = PointB(<point b referenced from the Rhino model>)  # disabled
point_a_2 = PointA(<point a referenced from the Rhino model>)  # disabled
point_b_2 = PointB(<point b referenced from the Rhino model>)  # disabled
point_a_3 = PointA(<point a referenced from the Rhino model>)  # disabled
point_b_3 = PointB(<point b referenced from the Rhino model>)  # disabled
points = Points([<points referenced from the Rhino model> x4])  # disabled
cylinder = Cylinder(Base=PlaneXY(0, 0, 0), Radius=0.5, Length=1)  # disabled
sphere_4pt = Sphere4Pt(Point1=Point(16, 56, 49), Point2=Point(16, 56, 49), Point3=Point(-25, 1, 0), Point4=Point(62, -68, 0))  # -> Center, Radius, Sphere; disabled
plane_through_shape = PlaneThroughShape(Plane=plane_surface, Shape=sphere, Inflate=number_slider_2, SectionLogic=False)  # disabled
box_rectangle = BoxRectangle(Rectangle=rectangle.Rectangle, Height=number_slider)  # disabled
quad_sphere = QuadSphere(Base=PlaneXY(0, 0, 0), Radius=1)  # disabled
sphere_2 = Sphere(Base=PlaneXY(0, 0, 0), Radius=1)  # disabled
sphere_fit = SphereFit(Points=[Point(62, -68, 0), Point(-25, 1, 0), Point(-128, 125, 69), Point(16, 56, 49)])  # -> Center, Radius, Sphere; disabled
cone = Cone(Base=PlaneXY(0, 0, 0), Radius=0.5, Length=1)  # -> Cone, Tip; disabled
bounding_box = BoundingBox(Content=sphere, Plane=plane_surface)  # -> Box, Box_2; disabled
box_2pt = Box2Pt(PointA=Point(62, -68, 0), PointB=Point(-41, 56, 49), Plane=plane_surface)  # disabled
center_box = CenterBox(Base=plane_surface, X=number_slider, Y=number_slider, Z=1)  # disabled
domain_box = DomainBox(Base=plane_surface, X=number_slider, Y=Domain(-0.5, 0.5), Z=number_slider)  # disabled
extrude_linear = ExtrudeLinear(OrientationP=PlaneXY(0, 0, 0))
surface_from_points = SurfaceFromPoints(Interpolate=False)
extrude = Extrude()
network_surface = NetworkSurface(Continuity=2)
sweep2 = Sweep2(SameHeight=False)
fit_loft = FitLoft(CountU=15, DegreeU=5, DegreeV=5)
_4point_surface = _4PointSurface()
edge_surface = EdgeSurface()
loft_options = LoftOptions(Closed=False, Adjust=False, Rebuild=0, Refit=0, Type=0)
pipe_variable = PipeVariable(Caps=0)
ruled_surface = RuledSurface()
sum_surface = SumSurface()
fragment_patch = FragmentPatch()
revolution = Revolution(Domain=Domain(0, 6.283185307))
control_point_loft = ControlPointLoft(Degree=5)
extrude_along = ExtrudeAlong()
patch = Patch(Spans=20, Flexibility=1, Trim=True)
boundary_surfaces = BoundarySurfaces()
extrude_point = ExtrudePoint()
rail_revolution = RailRevolution(Scale=False)
sweep1 = Sweep1(Miter=1)
loft = Loft(Options={Adjust=False, Closed=False, LoftEnds=0, LoftSimp=0, LoftType=0, Rebuild=10, Refit=0.01})
pipe = Pipe(Radius=1, Caps=0)
brep_topology = BrepTopology(PerspectiveOnly=False)  # -> FaceFaceAdjacency, FaceEdgeAdjacency, EdgeFaceAdjacency
principal_curvature = PrincipalCurvature()  # -> Frame, Min, Max, MinDirection, MaxDirection
osculating_circles = OsculatingCircles()  # -> Point, FirstCircle, SecondCircle
evaluate_box = EvaluateBox(UParameter=0.5, VParameter=0.5, WParameter=0.5)  # -> Plane, Point, Include
dimensions = Dimensions()  # -> UDimension, VDimension
brep_edges = BrepEdges()  # -> Naked, Interior, NonManifold
area = Area()  # -> Area, Centroid
volume = Volume()  # -> Volume, Centroid
evaluate_surface = EvaluateSurface()  # -> Point, Normal, UDirection, VDirection, Frame
brep_wireframe = BrepWireframe(Density=-1)
point_in_trim = PointInTrim()
surface_closest_point = SurfaceClosestPoint()  # -> Point, UVPoint, Distance
surface_curvature = SurfaceCurvature()  # -> Frame, Gaussian, Mean
surface_points = SurfacePoints()  # -> Points, Weights, Greville, UCount, VCount
box_properties = BoxProperties()  # -> Center, Diagonal, Area, Volume, Degeneracy
shape_in_brep = ShapeInBrep()
is_planar = IsPlanar(Interior=True)  # -> Planar, Plane
brep_closest_point = BrepClosestPoint()  # -> Point, Normal, Distance
box_corners = BoxCorners()  # -> CornerA, CornerB, CornerC, CornerD, CornerE, CornerF, CornerG, CornerH
deconstruct_brep = DeconstructBrep()  # -> Faces, Edges, Vertices
point_in_brep = PointInBrep(Strict=False)
deconstruct_box = DeconstructBox()  # -> Plane, X, Y, Z
point_in_breps = PointInBreps(Strict=False)  # -> Inside, Index
volume_moments = VolumeMoments()  # -> Volume, Centroid, Inertia, InertiaError, Secondary, SecondaryError, Gyration
area_moments = AreaMoments()  # -> Area, Centroid, Inertia, InertiaError, Secondary, SecondaryError, Gyration
divide_surface = DivideSurface(UCount=10, VCount=10)  # -> Points, Normals, Parameters
surface_frames = SurfaceFrames(UCount=10, VCount=10)  # -> Frames, Parameters
edges_from_directions = EdgesFromDirections(Reflex=True, Angle=0)  # -> Edges, Indices, Map
edges_from_points = EdgesFromPoints(Valence=1)  # -> Edges, Indices, Map
edges_from_linearity = EdgesFromLinearity(Minimum=0, Maximum=1)  # -> Edges, Indices
offset_surface = OffsetSurface(Distance=0, Retrim=True)
offset_surface_loose = OffsetSurfaceLoose(Distance=0, Retrim=True)
fillet_edge = FilletEdge(Blend=0, Metric=0)
isotrim = Isotrim()
untrim = Untrim()
flip = Flip()  # -> Surface, Result
copy_trim = CopyTrim()
retrim = Retrim()
edges_from_length = EdgesFromLength(Minimum=0, Maximum=100)  # -> Edges, Indices
convex_edges = ConvexEdges()  # -> Convex, Concave, Mixed
brep_join = BrepJoin()  # -> Breps, Closed
edges_from_faces = EdgesFromFaces()  # -> Edges, Indices
merge_faces = MergeFaces()  # -> Breps, Before, After
cap_holes = CapHoles()
cap_holes_ex = CapHolesEx()  # -> Brep, Caps, Solid
number_slider_3 = Slider(50, range=1..100)
number_slider_4 = Slider(78, range=1..100)
number_slider_5 = Slider(29, range=0..100)
plane_surface_2 = PlaneSurface(Plane=PlaneXY(0, 0, 0), XSize=number_slider_3, YSize=number_slider_3)
sphere_3 = Sphere(Base=PlaneXY(0, 0, 0), Radius=number_slider_3)
bounding_box_2 = BoundingBox(Content=sphere_3, Plane=plane_surface_2)  # -> Box, Box_2
rectangle_2 = Rectangle(Plane=PlaneXY(0, 0, 0), XSize=number_slider_4, YSize=number_slider_4, Radius=0)  # -> Rectangle, Length
populate_geometry = PopulateGeometry(Geometry=bounding_box_2.Box, Count=Slider(4, range=0..10), Seed=Slider(735, range=0..1000))
populate_3d = Populate3D(Region=bounding_box_2.Box, Count=Slider(55, range=0..100), Seed=1)
negative = Negative(Value=number_slider_3)
box_rectangle_2 = BoxRectangle(Rectangle=rectangle_2.Rectangle, Height=number_slider_5)
list_item = ListItem(List=populate_geometry, Index=0, Wrap=True)  # -> Item, Item1, Item2, Item3
sphere_fit_2 = SphereFit(Points=populate_3d)  # -> Center, Radius, Sphere
domain_box_2 = DomainBox(Base=rectangle_2.Rectangle, X=number_slider_5, Y=number_slider_5, Z=number_slider_5)
quad_sphere_2 = QuadSphere(Base=rectangle_2.Rectangle, Radius=number_slider_5)
cone_2 = Cone(Base=rectangle_2.Rectangle, Radius=number_slider_5, Length=number_slider_5)  # -> Cone, Tip
cylinder_2 = Cylinder(Base=rectangle_2.Rectangle, Radius=number_slider_5, Length=number_slider_5)
center_box_2 = CenterBox(Base=rectangle_2.Rectangle, X=number_slider_5, Y=number_slider_5, Z=number_slider_5)
negative_2 = Negative(Value=number_slider_4)
plane_through_shape_2 = PlaneThroughShape(Plane=plane_surface_2, Shape=sphere_3, Inflate=Slider(9.06, range=0..10), SectionLogic=False)
bounding_box_3 = BoundingBox(Content=sphere_3, Plane=plane_surface_2)  # -> Box, Box_2
sphere_4pt_2 = Sphere4Pt(Point1=list_item.Item, Point2=list_item.Item1, Point3=list_item.Item2, Point4=list_item.Item3)  # -> Center, Radius, Sphere
construct_domain = ConstructDomain(DomainStart=negative, DomainEnd=number_slider_3)
construct_domain_2 = ConstructDomain(DomainStart=negative, DomainEnd=number_slider_3)
construct_domain_3 = ConstructDomain(DomainStart=negative_2, DomainEnd=number_slider_4)
deconstruct_brep_2 = DeconstructBrep(Brep=bounding_box_3.Box)  # -> Faces, Edges, Vertices
construct_domain_4 = ConstructDomain(DomainStart=negative_2, DomainEnd=number_slider_4)
list_item_2 = ListItem(List=deconstruct_brep_2.Vertices, Index=0, Wrap=True)
list_item_3 = ListItem(List=deconstruct_brep_2.Vertices, Index=Slider(6, range=0..10), Wrap=True)
plane_surface_3 = PlaneSurface(Plane=PlaneXY(0, 0, 0), XSize=construct_domain, YSize=construct_domain_2)
rectangle_3 = Rectangle(Plane=PlaneXY(0, 0, 0), XSize=construct_domain_4, YSize=construct_domain_3, Radius=0)  # -> Rectangle, Length
box_2pt_2 = Box2Pt(PointA=list_item_2, PointB=list_item_3, Plane=PlaneXY(0, 0, 0))
box_rectangle_3 = BoxRectangle(Rectangle=rectangle_3.Rectangle, Height=number_slider_5)
