# Grasshopper definition Surfaces002.gh (Grasshopper 1.0.7)
# Copyright: Wickerson Studios
# plug-ins: Bifocals

number_slider = Slider(12, range=0..100)  # disabled
rectangle = Rectangle(Plane=PlaneXY(0, 0, 0), XSize=Domain(-1, 1), YSize=Domain(-2, 2), Radius=0)  # -> Rectangle, Length; disabled
plane_surface = PlaneSurface(Plane=PlaneXY(0, 0, 0), XSize=Domain(-10, 10), YSize=Domain(-10, 10))  # disabled
sphere = Sphere(Base=PlaneXY(0, 0, 0), Radius=1)  # disabled
number_slider_2 = Slider(0.34, range=0..10)  # disabled
point_a = PointA(<point a referenced from the Rhino model>)  # disabled
point_b = PointB(<point b referenced from the Rhino model>)  # disabled
point_a_2 = PointA(<point a referenced from the Rhino model>)  # disabled
point_b_2 = PointB(<point b referenced from the Rhino model>)  # disabled
point_a_3 = PointA(<point a referenced from the Rhino model>)  # disabled
point_b_3 = PointB(<point b referenced from the Rhino model>)  # disabled
points = Points([<points referenced from the Rhino model> x4])  # disabled
cylinder = Cylinder(Base=PlaneXY(0, 0, 0), Radius=0.5, Length=1)  # disabled
sphere_4pt = Sphere4Pt(Point1=Point(16, 56, 49), Point2=Point(16, 56, 49), Point3=Point(-25, 1, 0), Point4=Point(62, -68, 0))  # -> Center, Radius, Sphere; disabled
plane_through_shape = PlaneThroughShape(Plane=plane_surface, Shape=sphere, Inflate=number_slider_2, SectionLogic=False)  # disabled
box_rectangle = BoxRectangle(Rectangle=rectangle.Rectangle, Height=number_slider)  # disabled
quad_sphere = QuadSphere(Base=PlaneXY(0, 0, 0), Radius=1)  # disabled
sphere_2 = Sphere(Base=PlaneXY(0, 0, 0), Radius=1)  # disabled
sphere_fit = SphereFit(Points=[Point(62, -68, 0), Point(-25, 1, 0), Point(-128, 125, 69), Point(16, 56, 49)])  # -> Center, Radius, Sphere; disabled
cone = Cone(Base=PlaneXY(0, 0, 0), Radius=0.5, Length=1)  # -> Cone, Tip; disabled
bounding_box = BoundingBox(Content=sphere, Plane=plane_surface)  # -> Box, Box_2; disabled
box_2pt = Box2Pt(PointA=Point(62, -68, 0), PointB=Point(-41, 56, 49), Plane=plane_surface)  # disabled
center_box = CenterBox(Base=plane_surface, X=number_slider, Y=number_slider, Z=1)  # disabled
domain_box = DomainBox(Base=plane_surface, X=number_slider, Y=Domain(-0.5, 0.5), Z=number_slider)  # disabled
extrude_linear = ExtrudeLinear(OrientationP=PlaneXY(0, 0, 0))  # disabled
surface_from_points = SurfaceFromPoints(Interpolate=False)  # disabled
extrude = Extrude()  # disabled
network_surface = NetworkSurface(Continuity=2)  # disabled
sweep2 = Sweep2(SameHeight=False)  # disabled
fit_loft = FitLoft(CountU=15, DegreeU=5, DegreeV=5)  # disabled
_4point_surface = _4PointSurface()  # disabled
edge_surface = EdgeSurface()  # disabled
loft_options = LoftOptions(Closed=False, Adjust=False, Rebuild=0, Refit=0, Type=0)  # disabled
pipe_variable = PipeVariable(Caps=0)  # disabled
ruled_surface = RuledSurface()  # disabled
sum_surface = SumSurface()  # disabled
fragment_patch = FragmentPatch()  # disabled
revolution = Revolution(Domain=Domain(0, 6.283185307))  # disabled
control_point_loft = ControlPointLoft(Degree=5)  # disabled
extrude_along = ExtrudeAlong()  # disabled
patch = Patch(Spans=20, Flexibility=1, Trim=True)  # disabled
boundary_surfaces = BoundarySurfaces()  # disabled
extrude_point = ExtrudePoint()  # disabled
rail_revolution = RailRevolution(Scale=False)  # disabled
sweep1 = Sweep1(Miter=1)  # disabled
loft = Loft(Options={Adjust=False, Closed=False, LoftEnds=0, LoftSimp=0, LoftType=0, Rebuild=10, Refit=0.01})  # disabled
pipe = Pipe(Radius=1, Caps=0)  # disabled
brep_topology = BrepTopology(PerspectiveOnly=False)  # -> FaceFaceAdjacency, FaceEdgeAdjacency, EdgeFaceAdjacency
principal_curvature = PrincipalCurvature()  # -> Frame, Min, Max, MinDirection, MaxDirection
osculating_circles = OsculatingCircles()  # -> Point, FirstCircle, SecondCircle
evaluate_box = EvaluateBox(UParameter=0.5, VParameter=0.5, WParameter=0.5)  # -> Plane, Point, Include
dimensions = Dimensions()  # -> UDimension, VDimension
brep_edges = BrepEdges()  # -> Naked, Interior, NonManifold
area = Area()  # -> Area, Centroid
volume = Volume()  # -> Volume, Centroid
evaluate_surface = EvaluateSurface()  # -> Point, Normal, UDirection, VDirection, Frame
brep_wireframe = BrepWireframe(Density=-1)
point_in_trim = PointInTrim()
surface_closest_point = SurfaceClosestPoint()  # -> Point, UVPoint, Distance
surface_curvature = SurfaceCurvature()  # -> Frame, Gaussian, Mean
surface_points = SurfacePoints()  # -> Points, Weights, Greville, UCount, VCount
box_properties = BoxProperties()  # -> Center, Diagonal, Area, Volume, Degeneracy
shape_in_brep = ShapeInBrep()
is_planar = IsPlanar(Interior=True)  # -> Planar, Plane
brep_closest_point = BrepClosestPoint()  # -> Point, Normal, Distance
box_corners = BoxCorners()  # -> CornerA, CornerB, CornerC, CornerD, CornerE, CornerF, CornerG, CornerH
deconstruct_brep = DeconstructBrep()  # -> Faces, Edges, Vertices
point_in_brep = PointInBrep(Strict=False)
deconstruct_box = DeconstructBox()  # -> Plane, X, Y, Z
point_in_breps = PointInBreps(Strict=False)  # -> Inside, Index
volume_moments = VolumeMoments()  # -> Volume, Centroid, Inertia, InertiaError, Secondary, SecondaryError, Gyration
area_moments = AreaMoments()  # -> Area, Centroid, Inertia, InertiaError, Secondary, SecondaryError, Gyration
divide_surface = DivideSurface(UCount=10, VCount=10)  # -> Points, Normals, Parameters
surface_frames = SurfaceFrames(UCount=10, VCount=10)  # -> Frames, Parameters
edges_from_directions = EdgesFromDirections(Reflex=True, Angle=0)  # -> Edges, Indices, Map
edges_from_points = EdgesFromPoints(Valence=1)  # -> Edges, Indices, Map
edges_from_linearity = EdgesFromLinearity(Minimum=0, Maximum=1)  # -> Edges, Indices
offset_surface = OffsetSurface(Distance=0, Retrim=True)
offset_surface_loose = OffsetSurfaceLoose(Distance=0, Retrim=True)
fillet_edge = FilletEdge(Blend=0, Metric=0)
isotrim = Isotrim()
untrim = Untrim()
flip = Flip()  # -> Surface, Result
copy_trim = CopyTrim()
retrim = Retrim()
edges_from_length = EdgesFromLength(Minimum=0, Maximum=100)  # -> Edges, Indices
convex_edges = ConvexEdges()  # -> Convex, Concave, Mixed
brep_join = BrepJoin()  # -> Breps, Closed
edges_from_faces = EdgesFromFaces()  # -> Edges, Indices
merge_faces = MergeFaces()  # -> Breps, Before, After
cap_holes = CapHoles()
cap_holes_ex = CapHolesEx()  # -> Brep, Caps, Solid

curve = Curve(reparameterize(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))
curve_2 = Curve(reparameterize(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))
unit_x = UnitX(Factor=1)
circle = Circle(Plane=PlaneXY(0, 0, 0), Radius=Slider(12, range=0..100))
end_points = EndPoints(Curve=curve_2)  # -> Start, End
end_points_2 = EndPoints(Curve=curve)  # -> Start, End
rotate_3d = Rotate3D(Geometry=circle, Angle=1.570796327, Center=Point(0, 0, 0), Axis=unit_x)  # -> Geometry, Transform
orient = Orient(Geometry=rotate_3d.Geometry, Source=PlaneXY(0, 0, 0), Target=end_points.End)  # -> Geometry, Transform
orient_2 = Orient(Geometry=rotate_3d.Geometry, Source=PlaneXY(0, 0, 0), Target=end_points_2.End)  # -> Geometry, Transform
sweep2_2 = Sweep2(Rail1=curve, Rail2=curve_2, Sections=[orient_2.Geometry, orient.Geometry], SameHeight=Toggle(True))

number_slider_3 = Slider(40, range=1..100)
number_slider_4 = Slider(47, range=0..100)
number_slider_5 = Slider(4, range=0..10)
number_slider_6 = Slider(52, range=0..100)
sphere_3 = Sphere(Base=PlaneXY(0, 0, 0), Radius=number_slider_3)
curve_3 = Curve(reparameterize(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))
number_slider_7 = Slider(2, range=0..5)
curve_4 = Curve(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)
curve_5 = Curve(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)
curve_6 = Curve(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)
curve_7 = Curve(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)
curve_8 = Curve(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)
curve_9 = Curve(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)
curve_10 = Curve(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)
circle_2 = Circle(Plane=PlaneXY(0, 0, 0), Radius=number_slider_4)
unit_z = UnitZ(Factor=number_slider_4)
populate_3d = Populate3D(Region=sphere_3, Count=Slider(20, range=0..100), Seed=Slider(55, range=0..100))
circle_3 = Circle(Plane=PlaneXY(0, 0, 0), Radius=1)
unit_x_2 = UnitX(Factor=1)
construct_point = ConstructPoint(XCoordinate=0, YCoordinate=0, ZCoordinate=0)
circle_4 = Circle(Plane=PlaneXY(0, 0, 0), Radius=number_slider_3)
unit_z_2 = UnitZ(Factor=number_slider_6)
merge = Merge(Data1=curve_10, Data2=curve_7, Data3=curve_8)
construct_point_2 = ConstructPoint(XCoordinate=0, YCoordinate=0, ZCoordinate=0)
merge_2 = Merge(Data1=curve_9, Data2=curve_5, Data3=curve_6, Data4=curve_4)
curve_c = CurveC(<curve c referenced from the Rhino model>)
curve_a = CurveA(<curve a referenced from the Rhino model>)
curve_b = CurveB(<curve b referenced from the Rhino model>)
curve_c_2 = CurveC(<curve c referenced from the Rhino model>)
unit_z_3 = UnitZ(Factor=Slider(23, range=0..100))
curves = Curves([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])
divide_curve = DivideCurve(Curve=circle_2, Count=10, Kinks=False)  # -> Points, Tangents, Parameters
end_points_3 = EndPoints(Curve=curve_3)  # -> Start, End
curve_11 = Curve(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)
list_item = ListItem(List=populate_3d, Index=0, Wrap=True)  # -> Item, Item1, Item2, Item3
sort_points = SortPoints(Points=populate_3d)  # -> Points, Indices
rotate_3d_2 = Rotate3D(Geometry=circle_3, Angle=1.570796327, Center=Point(0, 0, 0), Axis=unit_x_2)  # -> Geometry, Transform
list_item_2 = ListItem(List=populate_3d, Index=0, Wrap=True)  # -> Item, Item1, Item2, Item3
move = Move(Geometry=construct_point, Motion=unit_z)  # -> Geometry, Transform
line_sdl = LineSDL(Start=construct_point, Direction=unit_z, Length=number_slider_4)
boundary_surfaces_2 = BoundarySurfaces(Edges=circle_4)
network_surface_2 = NetworkSurface(CurvesU=merge_2, CurvesV=merge, Continuity=Slider(3, range=0..10))
control_point_loft_2 = ControlPointLoft(Curves=curves, Degree=Slider(2, range=0..5))
edge_surface_2 = EdgeSurface(CurveA=curve_a, CurveB=curve_b, CurveC=curve_c_2, CurveD=curve_c)
line_sdl_2 = LineSDL(Start=construct_point_2, Direction=unit_z_2, Length=number_slider_6)
fit_loft_2 = FitLoft(
    Curves=[curve_a, curve_b, curve_c_2, curve_c],
    CountU=Slider(6, range=0..10),
    DegreeU=number_slider_7,
    DegreeV=number_slider_7)
extrude_2 = Extrude(Base=curve_7, Direction=unit_z_3)
ruled_surface_2 = RuledSurface(CurveA=curve_10, CurveB=curve_4)
sum_surface_2 = SumSurface(CurveA=curve_10, CurveB=curve_8)
extrude_along_2 = ExtrudeAlong(Base=curve_10, Curve=curve_11)
ruled_surface_3 = RuledSurface(CurveA=curve_9, CurveB=curve_7)
curve_12 = Curve(reparameterize(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))
polyline = PolyLine(Vertices=divide_curve.Points, Closed=Toggle(True))
curve_13 = Curve(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)
orient_3 = Orient(Geometry=rotate_3d_2.Geometry, Source=PlaneXY(0, 0, 0), Target=end_points_3.End)  # -> Geometry, Transform
_4point_surface_2 = _4PointSurface(CornerA=list_item_2.Item, CornerB=list_item_2.Item1, CornerC=list_item_2.Item2, CornerD=list_item_2.Item3)
_4point_surface_3 = _4PointSurface(CornerA=list_item.Item, CornerB=list_item.Item1, CornerC=list_item.Item2)
surface_from_points_2 = SurfaceFromPoints(Points=populate_3d, UCount=number_slider_5, Interpolate=False)
surface_from_points_3 = SurfaceFromPoints(Points=sort_points.Points, UCount=number_slider_5, Interpolate=False)
ruled_surface_4 = RuledSurface(CurveA=curve_5, CurveB=curve_10)
gene_pool = GenePool(Decimals=2, Maximum=1, Minimum=0, Value=[0, 0.1, 0.13, 0.19, 0.25, 0.38, 0.61, 0.75, 0.89, 1])
gene_pool_2 = GenePool(
    Decimals=2,
    Maximum=2,
    Minimum=0,
    Value=[1.83506571, 1.335091966, 0.8250211435, 1.05559629, 0.07154086422, 0.3327241495, 0.3591400489, 1.271825277, 1.916369935, 1.229276542])
extrude_linear_2 = ExtrudeLinear(Profile=extrude_along_2, OrientationP=PlaneXY(0, 0, 0), Axis=line_sdl)
extrude_point_2 = ExtrudePoint(Base=extrude_along_2, Point=move.Geometry)
loft_options_2 = LoftOptions(Closed=False, Adjust=False, Rebuild=0, Refit=0, Type=Slider(3, range=0..5))
fragment_patch_2 = FragmentPatch(Boundary=polyline)
boundary_surfaces_3 = BoundarySurfaces(Edges=polyline)
revolution_2 = Revolution(Curve=curve_13, Axis=line_sdl_2, Domain=Domain(0, 6.283185307))
rail_revolution_2 = RailRevolution(Curve=rotate_3d.Geometry, Rail=curve_12, Axis=line_sdl_2, Scale=Toggle(True))
curve_14 = Curve(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)
curve_15 = Curve(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)
curve_16 = Curve(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)
curve_17 = Curve(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)
loft_2 = Loft(
    Curves=[curve_c_2, curve_c],
    Options={Adjust=False, Closed=False, LoftEnds=0, LoftSimp=0, LoftType=0, Rebuild=10, Refit=0.01})
patch_2 = Patch(Curves=[curve_15, curve_16, curve_17], Spans=20, Flexibility=1, Trim=True)
pipe_variable_2 = PipeVariable(Curve=reparameterize(curve_16), Parameters=gene_pool, Radii=gene_pool_2, Caps=0)
pipe_2 = Pipe(Curve=curve_17, Radius=1, Caps=0)
sweep1_2 = Sweep1(Rail=curve_3, Sections=orient_3.Geometry, Miter=Slider(2, range=0..2))

brep_topology_2 = BrepTopology(PerspectiveOnly=False)  # -> FaceFaceAdjacency, FaceEdgeAdjacency, EdgeFaceAdjacency
principal_curvature_2 = PrincipalCurvature()  # -> Frame, Min, Max, MinDirection, MaxDirection
osculating_circles_2 = OsculatingCircles()  # -> Point, FirstCircle, SecondCircle
evaluate_box_2 = EvaluateBox(UParameter=0.5, VParameter=0.5, WParameter=0.5)  # -> Plane, Point, Include
dimensions_2 = Dimensions()  # -> UDimension, VDimension
brep_edges_2 = BrepEdges()  # -> Naked, Interior, NonManifold
area_2 = Area()  # -> Area, Centroid
volume_2 = Volume()  # -> Volume, Centroid
evaluate_surface_2 = EvaluateSurface()  # -> Point, Normal, UDirection, VDirection, Frame
brep_wireframe_2 = BrepWireframe(Density=-1)
point_in_trim_2 = PointInTrim()
surface_closest_point_2 = SurfaceClosestPoint()  # -> Point, UVPoint, Distance
surface_curvature_2 = SurfaceCurvature()  # -> Frame, Gaussian, Mean
surface_points_2 = SurfacePoints()  # -> Points, Weights, Greville, UCount, VCount
box_properties_2 = BoxProperties()  # -> Center, Diagonal, Area, Volume, Degeneracy
shape_in_brep_2 = ShapeInBrep()
is_planar_2 = IsPlanar(Interior=True)  # -> Planar, Plane
brep_closest_point_2 = BrepClosestPoint()  # -> Point, Normal, Distance
box_corners_2 = BoxCorners()  # -> CornerA, CornerB, CornerC, CornerD, CornerE, CornerF, CornerG, CornerH
deconstruct_brep_2 = DeconstructBrep()  # -> Faces, Edges, Vertices
point_in_brep_2 = PointInBrep(Strict=False)
deconstruct_box_2 = DeconstructBox()  # -> Plane, X, Y, Z
point_in_breps_2 = PointInBreps(Strict=False)  # -> Inside, Index
volume_moments_2 = VolumeMoments()  # -> Volume, Centroid, Inertia, InertiaError, Secondary, SecondaryError, Gyration
area_moments_2 = AreaMoments()  # -> Area, Centroid, Inertia, InertiaError, Secondary, SecondaryError, Gyration

number_slider_8 = Slider(52, range=1..100)  # disabled
number_slider_9 = Slider(60, range=1..100)  # disabled
number_slider_10 = Slider(29, range=0..100)  # disabled
number_slider_11 = Slider(40, range=0..100)  # disabled
number_slider_12 = Slider(4, range=0..10)  # disabled
number_slider_13 = Slider(455, range=0..1000)  # disabled
number_slider_14 = Slider(4.45, range=0..10)  # disabled
plane_surface_2 = PlaneSurface(Plane=PlaneXY(0, 0, 0), XSize=number_slider_8, YSize=number_slider_8)  # disabled
sphere_4 = Sphere(Base=PlaneXY(0, 0, 0), Radius=number_slider_8)  # disabled
rectangle_2 = Rectangle(Plane=PlaneXY(0, 0, 0), XSize=number_slider_9, YSize=number_slider_9, Radius=0)  # -> Rectangle, Length; disabled
negative = Negative(Value=number_slider_8)  # disabled
box_rectangle_2 = BoxRectangle(Rectangle=rectangle_2.Rectangle, Height=number_slider_10)  # disabled
sphere_5 = Sphere(Base=PlaneXY(0, 0, 0), Radius=number_slider_10)  # disabled
domain_box_2 = DomainBox(Base=rectangle_2.Rectangle, X=number_slider_10, Y=number_slider_10, Z=number_slider_10)  # disabled
quad_sphere_2 = QuadSphere(Base=rectangle_2.Rectangle, Radius=number_slider_10)  # disabled
cone_2 = Cone(Base=rectangle_2.Rectangle, Radius=number_slider_10, Length=number_slider_10)  # -> Cone, Tip; disabled
cylinder_2 = Cylinder(Base=rectangle_2.Rectangle, Radius=number_slider_10, Length=number_slider_10)  # disabled
center_box_2 = CenterBox(Base=rectangle_2.Rectangle, X=number_slider_10, Y=number_slider_10, Z=number_slider_10)  # disabled
negative_2 = Negative(Value=number_slider_9)  # disabled
plane_through_shape_2 = PlaneThroughShape(Plane=plane_surface_2, Shape=sphere_4, Inflate=number_slider_14, SectionLogic=False)  # disabled
bounding_box_2 = BoundingBox(Content=sphere_4, Plane=plane_surface_2, UnionBox=False)  # -> Box, Box_2; disabled
number_slider_15 = Slider(6, range=0..10)  # disabled
construct_domain = ConstructDomain(DomainStart=negative, DomainEnd=number_slider_8)  # disabled
construct_domain_2 = ConstructDomain(DomainStart=negative, DomainEnd=number_slider_8)  # disabled
construct_domain_3 = ConstructDomain(DomainStart=negative_2, DomainEnd=number_slider_9)  # disabled
deconstruct_brep_3 = DeconstructBrep(Brep=bounding_box_2.Box)  # -> Faces, Edges, Vertices; disabled
construct_domain_4 = ConstructDomain(DomainStart=negative_2, DomainEnd=number_slider_9)  # disabled
list_item_3 = ListItem(List=deconstruct_brep_3.Vertices, Index=0, Wrap=True)  # disabled
list_item_4 = ListItem(List=deconstruct_brep_3.Vertices, Index=number_slider_15, Wrap=True)  # disabled
plane_surface_3 = PlaneSurface(Plane=PlaneXY(0, 0, 0), XSize=construct_domain, YSize=construct_domain_2)  # disabled
rectangle_3 = Rectangle(Plane=PlaneXY(0, 0, 0), XSize=construct_domain_4, YSize=construct_domain_3, Radius=0)  # -> Rectangle, Length; disabled
box_2pt_2 = Box2Pt(PointA=list_item_3, PointB=list_item_4, Plane=PlaneXY(0, 0, 0))  # disabled
box_rectangle_3 = BoxRectangle(Rectangle=rectangle_3.Rectangle, Height=number_slider_10)  # disabled

bounding_box_3 = BoundingBox(Content=sphere_4, Plane=plane_surface_2)  # -> Box, Box_2; disabled
populate_3d_2 = Populate3D(Region=bounding_box_3.Box, Count=number_slider_11, Seed=1)  # disabled
sphere_fit_2 = SphereFit(Points=populate_3d_2)  # -> Center, Radius, Sphere; disabled

populate_geometry = PopulateGeometry(Geometry=bounding_box_3.Box, Count=number_slider_12, Seed=number_slider_13)  # disabled
list_item_5 = ListItem(List=populate_geometry, Index=0, Wrap=True)  # -> Item, Item1, Item2, Item3; disabled
sphere_4pt_2 = Sphere4Pt(Point1=list_item_5.Item, Point2=list_item_5.Item1, Point3=list_item_5.Item2, Point4=list_item_5.Item3)  # -> Center, Radius, Sphere; disabled
