# Grasshopper definition Surfaces004.gh (Grasshopper 1.0.7)
# Copyright: Wickerson Studios
# plug-ins: Bifocals

number_slider = Slider(12, range=0..100)  # disabled
rectangle = Rectangle(Plane=PlaneXY(0, 0, 0), XSize=Domain(-1, 1), YSize=Domain(-2, 2), Radius=0)  # -> Rectangle, Length; disabled
plane_surface = PlaneSurface(Plane=PlaneXY(0, 0, 0), XSize=Domain(-10, 10), YSize=Domain(-10, 10))  # disabled
sphere = Sphere(Base=PlaneXY(0, 0, 0), Radius=1)  # disabled
number_slider_2 = Slider(0.34, range=0..10)  # disabled
point_a = PointA(<point a referenced from the Rhino model>)  # disabled
point_b = PointB(<point b referenced from the Rhino model>)  # disabled
point_a_2 = PointA(<point a referenced from the Rhino model>)  # disabled
point_b_2 = PointB(<point b referenced from the Rhino model>)  # disabled
point_a_3 = PointA(<point a referenced from the Rhino model>)  # disabled
point_b_3 = PointB(<point b referenced from the Rhino model>)  # disabled
points = Points([<points referenced from the Rhino model> x4])  # disabled
cylinder = Cylinder(Base=PlaneXY(0, 0, 0), Radius=0.5, Length=1)  # disabled
sphere_4pt = Sphere4Pt(Point1=Point(16, 56, 49), Point2=Point(16, 56, 49), Point3=Point(-25, 1, 0), Point4=Point(62, -68, 0))  # -> Center, Radius, Sphere; disabled
plane_through_shape = PlaneThroughShape(Plane=plane_surface, Shape=sphere, Inflate=number_slider_2, SectionLogic=False)  # disabled
box_rectangle = BoxRectangle(Rectangle=rectangle.Rectangle, Height=number_slider)  # disabled
quad_sphere = QuadSphere(Base=PlaneXY(0, 0, 0), Radius=1)  # disabled
sphere_2 = Sphere(Base=PlaneXY(0, 0, 0), Radius=1)  # disabled
sphere_fit = SphereFit(Points=[Point(62, -68, 0), Point(-25, 1, 0), Point(-128, 125, 69), Point(16, 56, 49)])  # -> Center, Radius, Sphere; disabled
cone = Cone(Base=PlaneXY(0, 0, 0), Radius=0.5, Length=1)  # -> Cone, Tip; disabled
bounding_box = BoundingBox(Content=sphere, Plane=plane_surface)  # -> Box, Box_2; disabled
box_2pt = Box2Pt(PointA=Point(62, -68, 0), PointB=Point(-41, 56, 49), Plane=plane_surface)  # disabled
center_box = CenterBox(Base=plane_surface, X=number_slider, Y=number_slider, Z=1)  # disabled
domain_box = DomainBox(Base=plane_surface, X=number_slider, Y=Domain(-0.5, 0.5), Z=number_slider)  # disabled
extrude_linear = ExtrudeLinear(OrientationP=PlaneXY(0, 0, 0))  # disabled
surface_from_points = SurfaceFromPoints(Interpolate=False)  # disabled
extrude = Extrude()  # disabled
network_surface = NetworkSurface(Continuity=2)  # disabled
sweep2 = Sweep2(SameHeight=False)  # disabled
fit_loft = FitLoft(CountU=15, DegreeU=5, DegreeV=5)  # disabled
_4point_surface = _4PointSurface()  # disabled
edge_surface = EdgeSurface()  # disabled
loft_options = LoftOptions(Closed=False, Adjust=False, Rebuild=0, Refit=0, Type=0)  # disabled
pipe_variable = PipeVariable(Caps=0)  # disabled
ruled_surface = RuledSurface()  # disabled
sum_surface = SumSurface()  # disabled
fragment_patch = FragmentPatch()  # disabled
revolution = Revolution(Domain=Domain(0, 6.283185307))  # disabled
control_point_loft = ControlPointLoft(Degree=5)  # disabled
extrude_along = ExtrudeAlong()  # disabled
patch = Patch(Spans=20, Flexibility=1, Trim=True)  # disabled
boundary_surfaces = BoundarySurfaces()  # disabled
extrude_point = ExtrudePoint()  # disabled
rail_revolution = RailRevolution(Scale=False)  # disabled
sweep1 = Sweep1(Miter=1)  # disabled
loft = Loft(Options={Adjust=False, Closed=False, LoftEnds=0, LoftSimp=0, LoftType=0, Rebuild=10, Refit=0.01})  # disabled
pipe = Pipe(Radius=1, Caps=0)  # disabled
brep_topology = BrepTopology(PerspectiveOnly=False)  # -> FaceFaceAdjacency, FaceEdgeAdjacency, EdgeFaceAdjacency; disabled
principal_curvature = PrincipalCurvature()  # -> Frame, Min, Max, MinDirection, MaxDirection; disabled
osculating_circles = OsculatingCircles()  # -> Point, FirstCircle, SecondCircle; disabled
evaluate_box = EvaluateBox(UParameter=0.5, VParameter=0.5, WParameter=0.5)  # -> Plane, Point, Include; disabled
dimensions = Dimensions()  # -> UDimension, VDimension; disabled
brep_edges = BrepEdges()  # -> Naked, Interior, NonManifold; disabled
area = Area()  # -> Area, Centroid; disabled
volume = Volume()  # -> Volume, Centroid; disabled
evaluate_surface = EvaluateSurface()  # -> Point, Normal, UDirection, VDirection, Frame; disabled
brep_wireframe = BrepWireframe(Density=-1)  # disabled
point_in_trim = PointInTrim()  # disabled
surface_closest_point = SurfaceClosestPoint()  # -> Point, UVPoint, Distance; disabled
surface_curvature = SurfaceCurvature()  # -> Frame, Gaussian, Mean; disabled
surface_points = SurfacePoints()  # -> Points, Weights, Greville, UCount, VCount; disabled
box_properties = BoxProperties()  # -> Center, Diagonal, Area, Volume, Degeneracy; disabled
shape_in_brep = ShapeInBrep()  # disabled
is_planar = IsPlanar(Interior=True)  # -> Planar, Plane; disabled
brep_closest_point = BrepClosestPoint()  # -> Point, Normal, Distance; disabled
box_corners = BoxCorners()  # -> CornerA, CornerB, CornerC, CornerD, CornerE, CornerF, CornerG, CornerH; disabled
deconstruct_brep = DeconstructBrep()  # -> Faces, Edges, Vertices; disabled
point_in_brep = PointInBrep(Strict=False)  # disabled
deconstruct_box = DeconstructBox()  # -> Plane, X, Y, Z; disabled
point_in_breps = PointInBreps(Strict=False)  # -> Inside, Index; disabled
volume_moments = VolumeMoments()  # -> Volume, Centroid, Inertia, InertiaError, Secondary, SecondaryError, Gyration; disabled
area_moments = AreaMoments()  # -> Area, Centroid, Inertia, InertiaError, Secondary, SecondaryError, Gyration; disabled
divide_surface = DivideSurface(UCount=10, VCount=10)  # -> Points, Normals, Parameters; disabled
surface_frames = SurfaceFrames(UCount=10, VCount=10)  # -> Frames, Parameters; disabled
edges_from_directions = EdgesFromDirections(Reflex=True, Angle=0)  # -> Edges, Indices, Map; disabled
edges_from_points = EdgesFromPoints(Valence=1)  # -> Edges, Indices, Map; disabled
edges_from_linearity = EdgesFromLinearity(Minimum=0, Maximum=1)  # -> Edges, Indices; disabled
offset_surface = OffsetSurface(Distance=0, Retrim=True)  # disabled
offset_surface_loose = OffsetSurfaceLoose(Distance=0, Retrim=True)  # disabled
fillet_edge = FilletEdge(Blend=0, Metric=0)  # disabled
isotrim = Isotrim()  # disabled
untrim = Untrim()  # disabled
flip = Flip()  # -> Surface, Result; disabled
copy_trim = CopyTrim()  # disabled
retrim = Retrim()  # disabled
edges_from_length = EdgesFromLength(Minimum=0, Maximum=100)  # -> Edges, Indices; disabled
convex_edges = ConvexEdges()  # -> Convex, Concave, Mixed; disabled
brep_join = BrepJoin()  # -> Breps, Closed; disabled
edges_from_faces = EdgesFromFaces()  # -> Edges, Indices; disabled
merge_faces = MergeFaces()  # -> Breps, Before, After; disabled
cap_holes = CapHoles()  # disabled
cap_holes_ex = CapHolesEx()  # -> Brep, Caps, Solid; disabled

number_slider_3 = Slider(12, range=0..100)  # disabled
curve = Curve(reparameterize(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))  # disabled
curve_2 = Curve(reparameterize(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))  # disabled
unit_x = UnitX(Factor=1)  # disabled
circle = Circle(Plane=PlaneXY(0, 0, 0), Radius=number_slider_3)  # disabled
end_points = EndPoints(Curve=curve_2)  # -> Start, End; disabled
end_points_2 = EndPoints(Curve=curve)  # -> Start, End; disabled
rotate_3d = Rotate3D(Geometry=circle, Angle=1.570796327, Center=Point(0, 0, 0), Axis=unit_x)  # -> Geometry, Transform; disabled
orient = Orient(Geometry=rotate_3d.Geometry, Source=PlaneXY(0, 0, 0), Target=end_points.End)  # -> Geometry, Transform; disabled
orient_2 = Orient(Geometry=rotate_3d.Geometry, Source=PlaneXY(0, 0, 0), Target=end_points_2.End)  # -> Geometry, Transform; disabled
boolean_toggle = BooleanToggle(True)  # disabled
sweep2_2 = Sweep2(Rail1=curve, Rail2=curve_2, Sections=[orient_2.Geometry, orient.Geometry], SameHeight=boolean_toggle)  # disabled

number_slider_4 = Slider(40, range=1..100)  # disabled
number_slider_5 = Slider(20, range=0..100)  # disabled
number_slider_6 = Slider(55, range=0..100)  # disabled
number_slider_7 = Slider(47, range=0..100)  # disabled
number_slider_8 = Slider(4, range=0..10)  # disabled
number_slider_9 = Slider(52, range=0..100)  # disabled
sphere_3 = Sphere(Base=PlaneXY(0, 0, 0), Radius=number_slider_4)  # disabled
number_slider_10 = Slider(3, range=0..10)  # disabled
number_slider_11 = Slider(23, range=0..100)  # disabled
curve_3 = Curve(reparameterize(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))  # disabled
number_slider_12 = Slider(6, range=0..10)  # disabled
number_slider_13 = Slider(2, range=0..5)  # disabled
curve_4 = Curve(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)  # disabled
curve_5 = Curve(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)  # disabled
curve_6 = Curve(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)  # disabled
curve_7 = Curve(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)  # disabled
curve_8 = Curve(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)  # disabled
curve_9 = Curve(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)  # disabled
curve_10 = Curve(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)  # disabled
circle_2 = Circle(Plane=PlaneXY(0, 0, 0), Radius=number_slider_7)  # disabled
number_slider_14 = Slider(2, range=0..5)  # disabled
boolean_toggle_2 = BooleanToggle(True)  # disabled
unit_z = UnitZ(Factor=number_slider_7)  # disabled
populate_3d = Populate3D(Region=sphere_3, Count=number_slider_5, Seed=number_slider_6)  # disabled
circle_3 = Circle(Plane=PlaneXY(0, 0, 0), Radius=1)  # disabled
unit_x_2 = UnitX(Factor=1)  # disabled
construct_point = ConstructPoint(XCoordinate=0, YCoordinate=0, ZCoordinate=0)  # disabled
circle_4 = Circle(Plane=PlaneXY(0, 0, 0), Radius=number_slider_4)  # disabled
unit_z_2 = UnitZ(Factor=number_slider_9)  # disabled
merge = Merge(Data1=curve_10, Data2=curve_7, Data3=curve_8)  # disabled
construct_point_2 = ConstructPoint(XCoordinate=0, YCoordinate=0, ZCoordinate=0)  # disabled
merge_2 = Merge(Data1=curve_9, Data2=curve_5, Data3=curve_6, Data4=curve_4)  # disabled
curve_c = CurveC(<curve c referenced from the Rhino model>)  # disabled
curve_a = CurveA(<curve a referenced from the Rhino model>)  # disabled
curve_b = CurveB(<curve b referenced from the Rhino model>)  # disabled
curve_c_2 = CurveC(<curve c referenced from the Rhino model>)  # disabled
unit_z_3 = UnitZ(Factor=number_slider_11)  # disabled
curves = Curves([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])  # disabled
divide_curve = DivideCurve(Curve=circle_2, Count=10, Kinks=False)  # -> Points, Tangents, Parameters; disabled
end_points_3 = EndPoints(Curve=curve_3)  # -> Start, End; disabled
curve_11 = Curve(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)  # disabled
list_item = ListItem(List=populate_3d, Index=0, Wrap=True)  # -> Item, Item1, Item2, Item3; disabled
sort_points = SortPoints(Points=populate_3d)  # -> Points, Indices; disabled
rotate_3d_2 = Rotate3D(Geometry=circle_3, Angle=1.570796327, Center=Point(0, 0, 0), Axis=unit_x_2)  # -> Geometry, Transform; disabled
list_item_2 = ListItem(List=populate_3d, Index=0, Wrap=True)  # -> Item, Item1, Item2, Item3; disabled
move = Move(Geometry=construct_point, Motion=unit_z)  # -> Geometry, Transform; disabled
line_sdl = LineSDL(Start=construct_point, Direction=unit_z, Length=number_slider_7)  # disabled
boundary_surfaces_2 = BoundarySurfaces(Edges=circle_4)  # disabled
network_surface_2 = NetworkSurface(CurvesU=merge_2, CurvesV=merge, Continuity=number_slider_10)  # disabled
number_slider_15 = Slider(3, range=0..5)  # disabled
control_point_loft_2 = ControlPointLoft(Curves=curves, Degree=number_slider_14)  # disabled
edge_surface_2 = EdgeSurface(CurveA=curve_a, CurveB=curve_b, CurveC=curve_c_2, CurveD=curve_c)  # disabled
line_sdl_2 = LineSDL(Start=construct_point_2, Direction=unit_z_2, Length=number_slider_9)  # disabled
fit_loft_2 = FitLoft(
    Curves=[curve_a, curve_b, curve_c_2, curve_c],
    CountU=number_slider_12,
    DegreeU=number_slider_13,
    DegreeV=number_slider_13)  # disabled
extrude_2 = Extrude(Base=curve_7, Direction=unit_z_3)  # disabled
ruled_surface_2 = RuledSurface(CurveA=curve_10, CurveB=curve_4)  # disabled
sum_surface_2 = SumSurface(CurveA=curve_10, CurveB=curve_8)  # disabled
extrude_along_2 = ExtrudeAlong(Base=curve_10, Curve=curve_11)  # disabled
ruled_surface_3 = RuledSurface(CurveA=curve_9, CurveB=curve_7)  # disabled
curve_12 = Curve(reparameterize(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))  # disabled
polyline = PolyLine(Vertices=divide_curve.Points, Closed=boolean_toggle_2)  # disabled
boolean_toggle_3 = BooleanToggle(True)  # disabled
curve_13 = Curve(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)  # disabled
orient_3 = Orient(Geometry=rotate_3d_2.Geometry, Source=PlaneXY(0, 0, 0), Target=end_points_3.End)  # -> Geometry, Transform; disabled
_4point_surface_2 = _4PointSurface(CornerA=list_item_2.Item, CornerB=list_item_2.Item1, CornerC=list_item_2.Item2, CornerD=list_item_2.Item3)  # disabled
_4point_surface_3 = _4PointSurface(CornerA=list_item.Item, CornerB=list_item.Item1, CornerC=list_item.Item2)  # disabled
surface_from_points_2 = SurfaceFromPoints(Points=populate_3d, UCount=number_slider_8, Interpolate=False)  # disabled
surface_from_points_3 = SurfaceFromPoints(Points=sort_points.Points, UCount=number_slider_8, Interpolate=False)  # disabled
ruled_surface_4 = RuledSurface(CurveA=curve_5, CurveB=curve_10)  # disabled
gene_pool = GenePool(Decimals=2, Maximum=1, Minimum=0, Value=[0, 0.1, 0.13, 0.19, 0.25, 0.38, 0.61, 0.75, 0.89, 1])  # disabled
gene_pool_2 = GenePool(
    Decimals=2,
    Maximum=2,
    Minimum=0,
    Value=[1.83506571, 1.335091966, 0.8250211435, 1.05559629, 0.07154086422, 0.3327241495, 0.3591400489, 1.271825277, 1.916369935, 1.229276542])  # disabled
extrude_linear_2 = ExtrudeLinear(Profile=extrude_along_2, OrientationP=PlaneXY(0, 0, 0), Axis=line_sdl)  # disabled
extrude_point_2 = ExtrudePoint(Base=extrude_along_2, Point=move.Geometry)  # disabled
loft_options_2 = LoftOptions(Closed=False, Adjust=False, Rebuild=0, Refit=0, Type=number_slider_15)  # disabled
fragment_patch_2 = FragmentPatch(Boundary=polyline)  # disabled
boundary_surfaces_3 = BoundarySurfaces(Edges=polyline)  # disabled
number_slider_16 = Slider(2, range=0..2)  # disabled
revolution_2 = Revolution(Curve=curve_13, Axis=line_sdl_2, Domain=Domain(0, 6.283185307))  # disabled
rail_revolution_2 = RailRevolution(Curve=rotate_3d.Geometry, Rail=curve_12, Axis=line_sdl_2, Scale=boolean_toggle_3)  # disabled
curve_14 = Curve(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)  # disabled
curve_15 = Curve(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)  # disabled
curve_16 = Curve(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)  # disabled
curve_17 = Curve(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)  # disabled
loft_2 = Loft(
    Curves=[curve_c_2, curve_c],
    Options={Adjust=False, Closed=False, LoftEnds=0, LoftSimp=0, LoftType=0, Rebuild=10, Refit=0.01})  # disabled
patch_2 = Patch(Curves=[curve_15, curve_16, curve_17], Spans=20, Flexibility=1, Trim=True)  # disabled
pipe_variable_2 = PipeVariable(Curve=reparameterize(curve_16), Parameters=gene_pool, Radii=gene_pool_2, Caps=0)  # disabled
pipe_2 = Pipe(Curve=curve_17, Radius=1, Caps=0)  # disabled
sweep1_2 = Sweep1(Rail=curve_3, Sections=orient_3.Geometry, Miter=number_slider_16)  # disabled

md_slider = MDSlider(SliderMode=0, slider_value=Point(0, 1, 0.5), x_domain=Domain(0, 1), y_domain=Domain(0, 1), z_domain=Domain(0, 1))  # disabled
curve_18 = Curve([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])  # disabled
construct_domain² = ConstructDomain²(DomainU=md_slider, DomainV=md_slider)  # disabled
loft_3 = Loft(Curves=curve_18, Options={Adjust=False, Closed=False, LoftEnds=0, LoftSimp=0, LoftType=0, Rebuild=10, Refit=0.01})  # disabled
isotrim_2 = Isotrim(Surface=reparameterize(loft_3), Domain=construct_domain²)  # disabled
number_slider_17 = Slider(1, range=0..3)  # disabled
deconstruct_brep_2 = DeconstructBrep(Brep=isotrim_2)  # -> Faces, Edges, Vertices; disabled
list_item_3 = ListItem(List=deconstruct_brep_2.Vertices, Index=number_slider_17, Wrap=True)  # disabled
surface_closest_point_2 = SurfaceClosestPoint(Point=list_item_3, Surface=loft_3)  # -> Point, UVPoint, Distance; disabled
number_slider_18 = Slider(28, range=0..100)  # disabled
evaluate_surface_2 = EvaluateSurface(Surface=loft_3, Point=surface_closest_point_2.UVPoint)  # -> Point, Normal, UDirection, VDirection, Frame; disabled
multiplication = Multiplication(A=evaluate_surface_2.Normal, B=number_slider_18)  # disabled
amplitude = Amplitude(Vector=evaluate_surface_2.Normal, Amplitude=number_slider_18)  # disabled
extrude_3 = Extrude(Base=loft_3, Direction=multiplication)  # disabled
vector_display = VectorDisplay(Anchor=evaluate_surface_2.Point, Vector=amplitude)  # disabled

number_slider_19 = Slider(12, range=0..100)  # disabled
number_slider_20 = Slider(39, range=0..100)  # disabled
number_slider_21 = Slider(12, range=0..100)  # disabled
curve_19 = Curve([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])  # disabled
number_slider_22 = Slider(1, range=0..10)  # disabled
curve_20 = Curve([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])  # disabled
number_slider_23 = Slider(12, range=0..100)  # disabled
number_slider_24 = Slider(3, range=0..100)  # disabled
number_slider_25 = Slider(6, range=0..10)  # disabled
md_slider_2 = MDSlider(
    SliderMode=0,
    slider_value=Point(0.3402846828, 0.3737450576, 0.5),
    x_domain=Domain(0, 1),
    y_domain=Domain(0, 1),
    z_domain=Domain(0, 1))  # disabled
number_slider_26 = Slider(2, range=0..5)  # disabled
number_slider_27 = Slider(14, range=0..100)  # disabled
cylinder_2 = Cylinder(Base=PlaneXY(0, 0, 0), Radius=0.5, Length=1)  # disabled
number_slider_28 = Slider(12, range=0..100)  # disabled
number_slider_29 = Slider(5, range=0..10)  # disabled
loft_4 = Loft(Curves=curve_19, Options={Adjust=False, Closed=False, LoftEnds=0, LoftSimp=0, LoftType=0, Rebuild=10, Refit=0.01})  # disabled
scale = Scale(Geometry=loft_4, Center=Point(0, 0, 0), Factor=0.5)  # -> Geometry, Transform; disabled
move_2 = Move(Geometry=scale.Geometry, Motion=Vector(0, 0, 10))  # -> Geometry, Transform; disabled
number_slider_30 = Slider(2, range=0..10)  # disabled
number_slider_31 = Slider(37.84, range=0..110)  # disabled
loft_5 = Loft(Curves=curve_20, Options={Adjust=False, Closed=False, LoftEnds=0, LoftSimp=0, LoftType=0, Rebuild=10, Refit=0.01})  # disabled
cylinder_3 = Cylinder(Base=PlaneXY(0, 0, 0), Radius=number_slider_19, Length=number_slider_19)  # disabled
number_slider_32 = Slider(0, range=0..1)  # disabled
number_slider_33 = Slider(1, range=0..1)  # disabled
unit_z_4 = UnitZ(Factor=1)  # disabled
md_slider_3 = MDSlider(
    SliderMode=0,
    slider_value=Point(0.5603959517, 0.4459861197, 0.5),
    x_domain=Domain(0, 1),
    y_domain=Domain(0, 1),
    z_domain=Domain(0, 1))  # disabled
circle_5 = Circle(Plane=PlaneXY(0, 0, 0), Radius=number_slider_20)  # disabled
center_box_2 = CenterBox(Base=PlaneXY(0, 0, 0), X=number_slider_21, Y=number_slider_21, Z=number_slider_21)  # disabled
cap_holes_ex_2 = CapHolesEx(Brep=cylinder_2)  # -> Brep, Caps, Solid; disabled
deconstruct_brep_3 = DeconstructBrep(Brep=center_box_2)  # -> Faces, Edges, Vertices; disabled
cap_holes_2 = CapHoles(Brep=cylinder_2)  # disabled
populate_2d = Populate2D(Region=deconstruct_brep_3.Edges, Count=number_slider_22, Seed=1)  # disabled
construct_domain²_2 = ConstructDomain²(DomainU=md_slider_2, DomainV=md_slider_2)  # disabled
number_slider_34 = Slider(11, range=0..11)  # disabled
center_box_3 = CenterBox(Base=PlaneXY(0, 0, 0), X=number_slider_28, Y=number_slider_28, Z=number_slider_28)  # disabled
ellipse = Ellipse(Plane=PlaneXY(0, 0, 0), Radius1=number_slider_23, Radius2=number_slider_24)  # -> Ellipse, Focus1, Focus2; disabled
list_item_4 = ListItem(List=deconstruct_brep_3.Faces, Index=number_slider_26, Wrap=True)  # disabled
cap_holes_3 = CapHoles(Brep=cylinder_3)  # disabled
number_slider_35 = Slider(5, range=0..10)  # disabled
rotate_3d_3 = Rotate3D(Geometry=move_2.Geometry, Angle=1.570796327, Center=Point(0, 0, 0), Axis=Vector(0, 0, 1))  # -> Geometry, Transform; disabled
boundary_surfaces_4 = BoundarySurfaces(Edges=circle_5)  # disabled
divide_surface_2 = DivideSurface(Surface=loft_4, UCount=number_slider_29, VCount=number_slider_29)  # -> Points, Normals, Parameters; disabled
panel = Panel(cap_holes_ex_2.Caps)  # disabled
panel_2 = Panel(cap_holes_ex_2.Solid)  # disabled
surface_frames_2 = SurfaceFrames(Surface=loft_4, UCount=number_slider_29, VCount=number_slider_29)  # -> Frames, Parameters; disabled
edges_from_directions_2 = EdgesFromDirections(Brep=cap_holes_3, Directions=unit_z_4, Reflex=True, Angle=0)  # -> Edges, Indices, Map; disabled
convex_edges_2 = ConvexEdges(Brep=cap_holes_3)  # -> Convex, Concave, Mixed; disabled
boundary_surfaces_5 = BoundarySurfaces(Edges=ellipse.Ellipse)  # disabled
offset_surface_2 = OffsetSurface(Surface=boundary_surfaces_5, Distance=number_slider_27, Retrim=True)  # disabled
offset_surface_loose_2 = OffsetSurfaceLoose(Surface=boundary_surfaces_5, Distance=number_slider_27, Retrim=True)  # disabled
evaluate_surface_3 = EvaluateSurface(Surface=reparameterize(boundary_surfaces_5), Point=md_slider_3)  # -> Point, Normal, UDirection, VDirection, Frame; disabled
deconstruct_brep_4 = DeconstructBrep(Brep=cap_holes_3)  # -> Faces, Edges, Vertices; disabled
edges_from_length_2 = EdgesFromLength(Brep=list_item_4, Minimum=number_slider_30, Maximum=number_slider_31)  # -> Edges, Indices; disabled
edges_from_linearity_2 = EdgesFromLinearity(Brep=list_item_4, Minimum=number_slider_32, Maximum=number_slider_33)  # -> Edges, Indices; disabled
isotrim_3 = Isotrim(Surface=reparameterize(loft_5), Domain=construct_domain²_2)  # disabled
edges_from_points_2 = EdgesFromPoints(Brep=list_item_4, Points=populate_2d, Valence=1)  # -> Edges, Indices, Map; disabled
populate_2d_2 = Populate2D(Region=list_item_4, Count=number_slider_25, Seed=1)  # disabled
edges_from_faces_2 = EdgesFromFaces(Brep=center_box_2, Points=populate_2d_2)  # -> Edges, Indices; disabled
copy_trim_2 = CopyTrim(Source=loft_4, Target=rotate_3d_3.Geometry)  # disabled
fillet_edge_2 = FilletEdge(Shape=center_box_3, Blend=0, Metric=0, Edges=number_slider_35, Radii=number_slider_34)  # disabled
copy_trim_3 = CopyTrim(Source=loft_4, Target=boundary_surfaces_4)  # disabled
panel_3 = Panel(divide_surface_2.Parameters)  # disabled
flip_2 = Flip(Surface=boundary_surfaces_5)  # -> Surface, Result; disabled
evaluate_surface_4 = EvaluateSurface(Surface=reparameterize(flip_2.Surface), Point=md_slider_3)  # -> Point, Normal, UDirection, VDirection, Frame; disabled
vector_display_2 = VectorDisplay(Anchor=evaluate_surface_3.Point, Vector=evaluate_surface_3.Normal)  # disabled
vector_display_3 = VectorDisplay(Anchor=evaluate_surface_4.Point, Vector=evaluate_surface_4.Normal)  # disabled
panel_4 = Panel(edges_from_length_2.Edges)  # disabled
panel_5 = Panel(convex_edges_2.Convex)  # disabled
panel_6 = Panel(convex_edges_2.Concave)  # disabled
panel_7 = Panel(convex_edges_2.Mixed)  # disabled
panel_8 = Panel(edges_from_points_2.Edges)  # disabled
panel_9 = Panel(edges_from_linearity_2.Edges)  # disabled
panel_10 = Panel(edges_from_directions_2.Edges)  # disabled
panel_11 = Panel(edges_from_faces_2.Edges)  # disabled
panel_12 = Panel(edges_from_directions_2.Indices)  # disabled
dimensions_2 = Dimensions(Surface=loft_4)  # -> UDimension, VDimension; disabled
panel_13 = Panel(edges_from_directions_2.Map)  # disabled
dimensions_3 = Dimensions(Surface=copy_trim_2)  # -> UDimension, VDimension; disabled
dimensions_4 = Dimensions(Surface=copy_trim_3)  # -> UDimension, VDimension; disabled
dimensions_5 = Dimensions(Surface=loft_4)  # -> UDimension, VDimension; disabled
brep = Brep([<brep referenced from the Rhino model> x3])  # disabled
panel_14 = Panel(edges_from_length_2.Indices)  # disabled
panel_15 = Panel(edges_from_points_2.Indices)  # disabled
panel_16 = Panel(edges_from_linearity_2.Indices)  # disabled
panel_17 = Panel(edges_from_faces_2.Indices)  # disabled
panel_18 = Panel(dimensions_2.UDimension)  # disabled
panel_19 = Panel(dimensions_3.UDimension)  # disabled
panel_20 = Panel(dimensions_2.VDimension)  # disabled
panel_21 = Panel(dimensions_5.VDimension)  # disabled
panel_22 = Panel(dimensions_3.VDimension)  # disabled
panel_23 = Panel(dimensions_5.UDimension)  # disabled
merge_faces_2 = MergeFaces(Brep=brep)  # -> Breps, Before, After; disabled
panel_24 = Panel(dimensions_4.UDimension)  # disabled
panel_25 = Panel(dimensions_4.VDimension)  # disabled
panel_26 = Panel(edges_from_points_2.Map)  # disabled
panel_27 = Panel(merge_faces_2.Breps)  # disabled
panel_28 = Panel(merge_faces_2.Before)  # disabled
panel_29 = Panel(merge_faces_2.After)  # disabled
untrim_2 = Untrim(Surface=boundary_surfaces_4)  # disabled
retrim_2 = Retrim(Source=rotate_3d_3.Geometry, Target=loft_4)  # disabled
retrim_3 = Retrim(Source=loft_4, Target=boundary_surfaces_4)  # disabled
retrim_4 = Retrim(Source=loft_4, Target=rotate_3d_3.Geometry)  # disabled
brep_join_2 = BrepJoin(Breps=[retrim_2, retrim_4, boundary_surfaces_4])  # -> Breps, Closed; disabled

number_slider_36 = Slider(52, range=1..100)  # disabled
number_slider_37 = Slider(60, range=1..100)  # disabled
number_slider_38 = Slider(29, range=0..100)  # disabled
number_slider_39 = Slider(40, range=0..100)  # disabled
number_slider_40 = Slider(4, range=0..10)  # disabled
number_slider_41 = Slider(455, range=0..1000)  # disabled
number_slider_42 = Slider(4.45, range=0..10)  # disabled
plane_surface_2 = PlaneSurface(Plane=PlaneXY(0, 0, 0), XSize=number_slider_36, YSize=number_slider_36)  # disabled
sphere_4 = Sphere(Base=PlaneXY(0, 0, 0), Radius=number_slider_36)  # disabled
rectangle_2 = Rectangle(Plane=PlaneXY(0, 0, 0), XSize=number_slider_37, YSize=number_slider_37, Radius=0)  # -> Rectangle, Length; disabled
negative = Negative(Value=number_slider_36)  # disabled
box_rectangle_2 = BoxRectangle(Rectangle=rectangle_2.Rectangle, Height=number_slider_38)  # disabled
sphere_5 = Sphere(Base=PlaneXY(0, 0, 0), Radius=number_slider_38)  # disabled
domain_box_2 = DomainBox(Base=rectangle_2.Rectangle, X=number_slider_38, Y=number_slider_38, Z=number_slider_38)  # disabled
quad_sphere_2 = QuadSphere(Base=rectangle_2.Rectangle, Radius=number_slider_38)  # disabled
cone_2 = Cone(Base=rectangle_2.Rectangle, Radius=number_slider_38, Length=number_slider_38)  # -> Cone, Tip; disabled
cylinder_4 = Cylinder(Base=rectangle_2.Rectangle, Radius=number_slider_38, Length=number_slider_38)  # disabled
center_box_4 = CenterBox(Base=rectangle_2.Rectangle, X=number_slider_38, Y=number_slider_38, Z=number_slider_38)  # disabled
negative_2 = Negative(Value=number_slider_37)  # disabled
plane_through_shape_2 = PlaneThroughShape(Plane=plane_surface_2, Shape=sphere_4, Inflate=number_slider_42, SectionLogic=False)  # disabled
bounding_box_2 = BoundingBox(Content=sphere_4, Plane=plane_surface_2, UnionBox=False)  # -> Box, Box_2; disabled
number_slider_43 = Slider(6, range=0..10)  # disabled
construct_domain = ConstructDomain(DomainStart=negative, DomainEnd=number_slider_36)  # disabled
construct_domain_2 = ConstructDomain(DomainStart=negative, DomainEnd=number_slider_36)  # disabled
construct_domain_3 = ConstructDomain(DomainStart=negative_2, DomainEnd=number_slider_37)  # disabled
deconstruct_brep_5 = DeconstructBrep(Brep=bounding_box_2.Box)  # -> Faces, Edges, Vertices; disabled
construct_domain_4 = ConstructDomain(DomainStart=negative_2, DomainEnd=number_slider_37)  # disabled
list_item_5 = ListItem(List=deconstruct_brep_5.Vertices, Index=0, Wrap=True)  # disabled
list_item_6 = ListItem(List=deconstruct_brep_5.Vertices, Index=number_slider_43, Wrap=True)  # disabled
plane_surface_3 = PlaneSurface(Plane=PlaneXY(0, 0, 0), XSize=construct_domain, YSize=construct_domain_2)  # disabled
rectangle_3 = Rectangle(Plane=PlaneXY(0, 0, 0), XSize=construct_domain_4, YSize=construct_domain_3, Radius=0)  # -> Rectangle, Length; disabled
box_2pt_2 = Box2Pt(PointA=list_item_5, PointB=list_item_6, Plane=PlaneXY(0, 0, 0))  # disabled
box_rectangle_3 = BoxRectangle(Rectangle=rectangle_3.Rectangle, Height=number_slider_38)  # disabled

bounding_box_3 = BoundingBox(Content=sphere_4, Plane=plane_surface_2)  # -> Box, Box_2; disabled
populate_3d_2 = Populate3D(Region=bounding_box_3.Box, Count=number_slider_39, Seed=1)  # disabled
sphere_fit_2 = SphereFit(Points=populate_3d_2)  # -> Center, Radius, Sphere; disabled

populate_geometry = PopulateGeometry(Geometry=bounding_box_3.Box, Count=number_slider_40, Seed=number_slider_41)  # disabled
list_item_7 = ListItem(List=populate_geometry, Index=0, Wrap=True)  # -> Item, Item1, Item2, Item3; disabled
sphere_4pt_2 = Sphere4Pt(Point1=list_item_7.Item, Point2=list_item_7.Item1, Point3=list_item_7.Item2, Point4=list_item_7.Item3)  # -> Center, Radius, Sphere; disabled

number_slider_44 = Slider(40, range=0..100)  # disabled
center_box_5 = CenterBox(Base=PlaneXY(0, 0, 0), X=1, Y=1, Z=1)  # disabled
center_box_6 = CenterBox(Base=PlaneXY(0, 0, 0), X=1, Y=1, Z=1)  # disabled
number_slider_45 = Slider(1, range=0..1)  # disabled
number_slider_46 = Slider(0.6, range=0..1)  # disabled
number_slider_47 = Slider(2.14, range=0..10)  # disabled
point = Point(Point(2.697401981, 4.359917182, -0.06579014066))  # disabled
center_box_7 = CenterBox(Base=PlaneXY(0, 0, 0), X=1, Y=1, Z=1)  # disabled
point_2 = Point(<point referenced from the Rhino model>)  # disabled
point_3 = Point(<point referenced from the Rhino model>)  # disabled
point_4 = Point(<point referenced from the Rhino model>)  # disabled
number_slider_48 = Slider(12, range=0..100)  # disabled
deconstruct_brep_6 = DeconstructBrep(Brep=center_box_5)  # -> Faces, Edges, Vertices; disabled
list_item_8 = ListItem(List=deconstruct_brep_6.Faces, Index=number_slider_44, Wrap=True)  # disabled
list_item_9 = ListItem(List=deconstruct_brep_6.Faces, Index=number_slider_44, Wrap=True)  # disabled
brep_edges_2 = BrepEdges(Brep=center_box_5)  # -> Naked, Interior, NonManifold; disabled
brep_topology_2 = BrepTopology(Brep=center_box_5, PerspectiveOnly=False)  # -> FaceFaceAdjacency, FaceEdgeAdjacency, EdgeFaceAdjacency; disabled
brep_wireframe_2 = BrepWireframe(Brep=center_box_5, Density=-1)  # disabled
dimensions_6 = Dimensions(Surface=list_item_9)  # -> UDimension, VDimension; disabled
box_properties_2 = BoxProperties(Box=center_box_7)  # -> Center, Diagonal, Area, Volume, Degeneracy; disabled
evaluate_box_2 = EvaluateBox(Box=center_box_7, UParameter=number_slider_47, VParameter=number_slider_46, WParameter=number_slider_45)  # -> Plane, Point, Include; disabled
box_corners_2 = BoxCorners(Box=center_box_7)  # -> CornerA, CornerB, CornerC, CornerD, CornerE, CornerF, CornerG, CornerH; disabled
area_2 = Area(Geometry=list_item_9)  # -> Area, Centroid; disabled
deconstruct_box_2 = DeconstructBox(Box=center_box_7)  # -> Plane, X, Y, Z; disabled
surface_points_2 = SurfacePoints(Surface=list_item_9)  # -> Points, Weights, Greville, UCount, VCount; disabled
is_planar_2 = IsPlanar(Surface=list_item_9, Interior=True)  # -> Planar, Plane; disabled
volume_2 = Volume(Geometry=center_box_6)  # -> Volume, Centroid; disabled
surface_closest_point_3 = SurfaceClosestPoint(Point=point_2, Surface=list_item_9)  # -> Point, UVPoint, Distance; disabled
brep_closest_point_2 = BrepClosestPoint(Point=point, Brep=center_box_6)  # -> Point, Normal, Distance; disabled
point_in_brep_2 = PointInBrep(Brep=list_item_8, Point=point_2, Strict=False)  # disabled
point_in_breps_2 = PointInBreps(Brep=center_box_6, Point=[Point(-4, -5, 3), Point(-1, -5, 3)], Strict=False)  # -> Inside, Index; disabled
md_slider_4 = MDSlider(
    SliderMode=0,
    slider_value=Point(0.6311316857, 0.3802981493, 0.5),
    x_domain=Domain(0, 1),
    y_domain=Domain(0, 1),
    z_domain=Domain(0, 1))  # disabled
plane = Plane(deconstruct_box_2.Plane)  # disabled
point_5 = Point(box_properties_2.Center)  # disabled
panel_30 = Panel(surface_points_2.UCount)  # disabled
panel_31 = Panel(surface_points_2.VCount)  # disabled
area_moments_2 = AreaMoments(Geometry=list_item_9)  # -> Area, Centroid, Inertia, InertiaError, Secondary, SecondaryError, Gyration; disabled
panel_32 = Panel(evaluate_box_2.Include)  # disabled
volume_moments_2 = VolumeMoments(Geometry=center_box_6)  # -> Volume, Centroid, Inertia, InertiaError, Secondary, SecondaryError, Gyration; disabled
panel_33 = Panel(surface_points_2.Weights)  # disabled
panel_34 = Panel(surface_points_2.Points)  # disabled
panel_35 = Panel(point_in_breps_2.Index)  # disabled
panel_36 = Panel(point_in_breps_2.Inside)  # disabled
panel_37 = Panel(point_in_brep_2)  # disabled
plane_surface_4 = PlaneSurface(Plane=PlaneXY(0, 0, 0), XSize=Domain(-10, 10), YSize=Domain(-10, 10))  # disabled
point_6 = Point(evaluate_box_2.Point)  # disabled
sphere_6 = Sphere(Base=PlaneXY(0, 0, 0), Radius=number_slider_48)  # -> reparameterize(Sphere); disabled
panel_38 = Panel(brep_topology_2.FaceFaceAdjacency)  # disabled
number_slider_49 = Slider(11, range=0..100)  # disabled
panel_39 = Panel(surface_points_2.Greville)  # disabled
surface = Surface(reparameterize(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))  # disabled
md_slider_5 = MDSlider(
    SliderMode=0,
    slider_value=Point(0.1941146302, 0.6591387493, 0.5),
    x_domain=Domain(0, 1),
    y_domain=Domain(0, 1),
    z_domain=Domain(0, 1))  # disabled
center_box_8 = CenterBox(Base=PlaneXY(0, 0, 0), X=number_slider_48, Y=number_slider_48, Z=number_slider_48)  # disabled
principal_curvature_2 = PrincipalCurvature(Surface=reparameterize(loft_3), Point=md_slider_4)  # -> Frame, Min, Max, MinDirection, MaxDirection; disabled
surface_curvature_2 = SurfaceCurvature(Surface=reparameterize(loft_3), Point=md_slider_4)  # -> Frame, Gaussian, Mean; disabled
osculating_circles_2 = OsculatingCircles(Surface=reparameterize(surface), Point=md_slider_4)  # -> Point, FirstCircle, SecondCircle; disabled
circle_6 = Circle(Plane=PlaneXY(0, 0, 0), Radius=number_slider_49)  # disabled
construct_domain_5 = ConstructDomain(DomainU=md_slider_5, DomainV=md_slider_5)  # disabled
geometry = Geometry(surface_curvature_2.Frame)  # disabled
geometry_2 = Geometry(principal_curvature_2.Frame)  # disabled
shape_in_brep_2 = ShapeInBrep(Brep=center_box_8, Shape=sphere_6)  # disabled
shape_in_brep_3 = ShapeInBrep(Brep=sphere_6, Shape=center_box_8)  # disabled
panel_40 = Panel(surface_curvature_2.Frame)  # disabled
panel_41 = Panel(surface_curvature_2.Gaussian)  # disabled
boundary_surfaces_6 = BoundarySurfaces(Edges=circle_6)  # disabled
panel_42 = Panel(principal_curvature_2.Min)  # disabled
panel_43 = Panel(principal_curvature_2.Max)  # disabled
panel_44 = Panel(principal_curvature_2.MaxDirection)  # disabled
panel_45 = Panel(principal_curvature_2.Frame)  # disabled
panel_46 = Panel(principal_curvature_2.MinDirection)  # disabled
panel_47 = Panel(surface_curvature_2.Mean)  # disabled
number_slider_50 = Slider(2, range=0..3)  # disabled
panel_48 = Panel(shape_in_brep_2)  # disabled
panel_49 = Panel(shape_in_brep_3)  # disabled
isotrim_4 = Isotrim(Surface=reparameterize(boundary_surfaces_6), Domain=construct_domain_5)  # disabled

# ---- group: Isotrim
md_slider_6 = MDSlider(
    SliderMode=0,
    slider_value=Point(0, 0.91855305, 0.5),
    x_domain=Domain(0, 1),
    y_domain=Domain(0, 1),
    z_domain=Domain(0, 1))  # disabled
construct_domain_6 = ConstructDomain(DomainU=md_slider_6, DomainV=md_slider_6)  # disabled

# ----
point_in_trim_2 = PointInTrim(Surface=isotrim_4, UVPoint=md_slider_6)  # disabled
panel_50 = Panel(point_in_trim_2)  # disabled

surface_2 = Surface(reparameterize(plane_surface_4))  # disabled
number_slider_51 = Slider(8, range=0..100)  # disabled

# ---- group: Isotrim (continued)
isotrim_5 = Isotrim(Surface=surface_2, Domain=construct_domain_6)  # disabled

# ----
deconstruct_brep_7 = DeconstructBrep(Brep=isotrim_5)  # -> Faces, Edges, Vertices; disabled
list_item_10 = ListItem(List=deconstruct_brep_7.Vertices, Index=number_slider_50, Wrap=True)  # disabled

surface_closest_point_4 = SurfaceClosestPoint(Point=list_item_10, Surface=surface_2)  # -> Point, UVPoint, Distance; disabled
evaluate_surface_5 = EvaluateSurface(Surface=surface_2, Point=surface_closest_point_4.UVPoint)  # -> Point, Normal, UDirection, VDirection, Frame; disabled

amplitude_2 = Amplitude(Vector=evaluate_surface_5.Normal, Amplitude=number_slider_51)  # disabled
multiplication_2 = Multiplication(A=evaluate_surface_5.Normal, B=number_slider_51)  # disabled
extrude_4 = Extrude(Base=surface_2, Direction=multiplication_2)  # disabled
vector_display_4 = VectorDisplay(Anchor=evaluate_surface_5.Point, Vector=amplitude_2)  # disabled
