# Grasshopper definition Vectors002.gh (Grasshopper 1.0.7)
# Copyright: Wickerson Studios
# plug-ins: MeshEdit Components, Anemone, Bifocals

spin_force = SpinForce(Plane=PlaneXY(0, 0, 0), Strength=1, Radius=5, Decay=2)  # disabled
field_line = FieldLine(Steps=1000, Accuracy=0.1, Method=3)  # disabled
point_charge = PointCharge(Charge=1, Decay=2)  # disabled
merge_fields = MergeFields()  # disabled
perpendicular_display = PerpendicularDisplay(Samples=1000, PositiveColour=RGB(255, 255, 255), NegativeColour=RGB(0, 0, 0))  # disabled
direction_display = DirectionDisplay(Samples=1000)  # disabled
evaluate_field = EvaluateField()  # -> Tensor, Strength; disabled
scalar_display = ScalarDisplay(Samples=1000)  # disabled
vector_force = VectorForce()  # disabled
break_field = BreakField()  # disabled
line_charge = LineCharge(Charge=1)  # disabled
tensor_display = TensorDisplay(Samples=1000)  # disabled

number_slider = Slider(10, range=0..10)  # disabled
construct_point = ConstructPoint(XCoordinate=0, YCoordinate=0, ZCoordinate=0)  # disabled
construct_point_2 = ConstructPoint(XCoordinate=number_slider, YCoordinate=number_slider, ZCoordinate=number_slider)  # disabled
vector_2pt = Vector2Pt(PointA=construct_point, PointB=construct_point_2, Unitize=False)  # -> Vector, Length; disabled
vector_display = VectorDisplay(Anchor=construct_point, Vector=vector_2pt.Vector)  # disabled

number_slider_2 = Slider(73, range=0..100)  # disabled
number_slider_3 = Slider(2, range=0..10)  # disabled
number_slider_4 = Slider(63, range=0..100)  # disabled
square = Square(Plane=PlaneXY(0, 0, 0), Size=number_slider_3, ExtentX=number_slider_2, ExtentY=number_slider_2)  # -> Cells, Points; disabled
construct_point_3 = ConstructPoint(XCoordinate=number_slider_4, YCoordinate=number_slider_4, ZCoordinate=number_slider_4)  # disabled
number_slider_5 = Slider(27, range=0..100)  # disabled
area = Area(Geometry=square.Cells)  # -> Area, Centroid; disabled
vector_2pt_2 = Vector2Pt(PointA=construct_point_3, PointB=area.Centroid, Unitize=False)  # -> Vector, Length; disabled
negative = Negative(Value=number_slider_5)  # disabled
vector_display_2 = VectorDisplay(Anchor=construct_point_3, Vector=vector_2pt_2.Vector)  # disabled
line_sdl = LineSDL(Start=area.Centroid, Direction=vector_2pt_2.Vector, Length=negative)  # disabled
end_points = EndPoints(Curve=line_sdl)  # -> flatten(Start), flatten(End); disabled
surface_from_points = SurfaceFromPoints(Points=end_points.End, UCount=number_slider_2, Interpolate=False)  # disabled

number_slider_6 = Slider(37, range=0..100)  # disabled
number_slider_7 = Slider(21, range=0..100)  # disabled
negative_2 = Negative(Value=number_slider_6)  # disabled
number_slider_8 = Slider(2, range=0..10)  # disabled
number_slider_9 = Slider(1, range=0..1)  # disabled
construct_domain = ConstructDomain(DomainStart=number_slider_6, DomainEnd=negative_2)  # disabled
number_slider_10 = Slider(1.5, range=0..10)  # disabled
circle = Circle(Plane=PlaneXY(0, 0, 0), Radius=number_slider_7)  # disabled
number_slider_11 = Slider(5.7, range=0..10)  # disabled
number_slider_12 = Slider(2, range=0..10)  # disabled
number_slider_13 = Slider(0.9, range=0..1)  # disabled
divide_curve = DivideCurve(Curve=circle, Count=number_slider_8, Kinks=False)  # -> Points, Tangents, Parameters; disabled
rectangle = Rectangle(Plane=PlaneXY(0, 0, 0), XSize=construct_domain, YSize=construct_domain, Radius=0)  # -> Rectangle, Length; disabled
number_slider_14 = Slider(5, range=0..10)  # disabled
number_slider_15 = Slider(20, range=0..100)  # disabled
point_charge_2 = PointCharge(Point=divide_curve.Points, Charge=number_slider_9, Decay=number_slider_10, Bounds=rectangle.Rectangle)  # disabled
spin_force_2 = SpinForce(
    Plane=divide_curve.Points,
    Strength=number_slider_13,
    Radius=number_slider_11,
    Decay=number_slider_12,
    Bounds=rectangle.Rectangle)  # disabled
circle_2 = Circle(Plane=divide_curve.Points, Radius=number_slider_14)  # disabled
merge_fields_2 = MergeFields(Fields=[point_charge_2, spin_force_2])  # disabled
divide_curve_2 = DivideCurve(Curve=circle_2, Count=number_slider_15, Kinks=False)  # -> Points, Tangents, Parameters; disabled
field_line_2 = FieldLine(Field=merge_fields_2, Point=divide_curve_2.Points, Steps=1000, Accuracy=0.1, Method=3)  # disabled

number_slider_16 = Slider(4, range=-10..10)  # disabled
number_slider_17 = Slider(-9, range=-10..10)  # disabled
number_slider_18 = Slider(5, range=-10..10)  # disabled
number_slider_19 = Slider(6, range=-10..10)  # disabled

number_slider_20 = Slider(93, range=0..100)  # disabled
plane_surface = PlaneSurface(Plane=PlaneXY(0, 0, 0), XSize=number_slider_20, YSize=number_slider_20)  # disabled
number_slider_21 = Slider(1.55, range=0..5)  # disabled
surface = Surface(surface_from_points)  # disabled
dimensions = Dimensions(Surface=surface)  # -> UDimension, VDimension; disabled
number_slider_22 = Slider(14, range=0..50)  # disabled
md_slider = MDSlider(
    SliderMode=0,
    slider_value=Point(0.4141400965, 0.3752348365, 0.5),
    x_domain=Domain(0, 1),
    y_domain=Domain(0, 1),
    z_domain=Domain(0, 1))  # disabled
division = Division(A=dimensions.UDimension, B=dimensions.VDimension)  # disabled
area_2 = Area(Geometry=surface)  # -> Area, Centroid; disabled
multiplication = Multiplication(A=division, B=number_slider_22)  # disabled
integer = Integer(multiplication)  # disabled
scale = Scale(Geometry=surface, Center=area_2.Centroid, Factor=number_slider_21)  # -> Geometry, Transform; disabled
divide_surface = DivideSurface(Surface=surface, UCount=integer, VCount=number_slider_22)  # -> flatten(Points), Normals, Parameters; disabled
number_slider_23 = Slider(0.106, range=0..2)  # disabled
expression = Expression(x=integer, Expression="x+1")  # disabled
evaluate_surface = EvaluateSurface(Surface=reparameterize(scale.Geometry), Point=md_slider)  # -> Point, Normal, UDirection, VDirection, Frame; disabled
distance = Distance(PointA=graft(evaluate_surface.Point), PointB=divide_surface.Points)  # disabled
expression_2 = Expression(w=graft(number_slider_23), t=distance, Expression="sin(w*t)^2")  # disabled
number_slider_24 = Slider(14.83, range=0..20)  # disabled
multiplication_2 = Multiplication(A=number_slider_24, B=expression_2)  # disabled
unit_z = UnitZ(Factor=multiplication_2)  # disabled
move = Move(Geometry=divide_surface.Points, Motion=unit_z)  # -> Geometry, Transform; disabled
surface_from_points_2 = SurfaceFromPoints(Points=move.Geometry, UCount=expression, Interpolate=False)  # disabled

flip_matrix = FlipMatrix(Data=expression_2)  # disabled
mass_multiplication = MassMultiplication(Input=flip_matrix)  # -> flatten(Result), PartialResults; disabled
mass_addition = MassAddition(Input=flip_matrix)  # -> flatten(Result), PartialResults; disabled

number_slider_25 = Slider(5, range=0..100)  # disabled
surface_2 = Surface(surface_from_points_2)  # disabled
number_slider_26 = Slider(7.534, range=0.001..12)  # disabled
divide_surface_2 = DivideSurface(Surface=surface_2, UCount=number_slider_25, VCount=number_slider_25)  # -> Points, Normals, Parameters; disabled
amplitude = Amplitude(Vector=divide_surface_2.Normals, Amplitude=number_slider_26)  # disabled
vector_display_3 = VectorDisplay(Anchor=divide_surface_2.Points, Vector=divide_surface_2.Normals)  # disabled
move_2 = Move(Geometry=divide_surface_2.Points, Motion=amplitude)  # -> flatten(Geometry), Transform; disabled
expression_3 = Expression(x=number_slider_25, Expression="x+1")  # disabled
surface_from_points_3 = SurfaceFromPoints(Points=move_2.Geometry, UCount=expression_3, Interpolate=False)  # disabled
mesh_frompoints = MeshFromPoints(Points=move_2.Geometry, UDirection=expression_3, VDirection=expression_3)  # disabled
deconstruct_brep = DeconstructBrep(Brep=surface_from_points_3)  # -> Faces, graft(Edges), Vertices; disabled
deconstruct_brep_2 = DeconstructBrep(Brep=surface)  # -> Faces, graft(Edges), Vertices; disabled
geometry = Geometry(deconstruct_brep_2.Edges)  # disabled
merge = Merge(Data1=deconstruct_brep.Edges, Data2=geometry)  # disabled
loft = Loft(Curves=merge, Options={Adjust=False, Closed=False, LoftEnds=0, LoftSimp=0, LoftType=0, Rebuild=10, Refit=0.01})  # -> flatten(Loft); disabled
geometry_2 = Geometry(surface)  # disabled
merge_2 = Merge(Data1=surface_from_points_3, Data2=loft, Data3=geometry_2)  # disabled
brep_join = BrepJoin(Breps=merge_2)  # -> Breps, Closed; disabled

number_slider_27 = Slider(73, range=0..100)
negative_3 = Negative(Value=number_slider_27)
construct_domain_2 = ConstructDomain(DomainStart=number_slider_27, DomainEnd=negative_3)
rectangle_2 = Rectangle(Plane=PlaneXY(0, 0, 0), XSize=construct_domain_2, YSize=construct_domain_2, Radius=0)  # -> Rectangle, Length

number_slider_28 = Slider(68, range=0..100)  # disabled
circle_3 = Circle(Plane=PlaneXY(0, 0, 0), Radius=number_slider_28)  # disabled
boundary_surfaces = BoundarySurfaces(Edges=circle_3)  # disabled
number_slider_29 = Slider(1, range=0..1)  # disabled
divide_surface_3 = DivideSurface(Surface=boundary_surfaces, UCount=10, VCount=10)  # -> Points, Normals, Parameters; disabled
number_slider_30 = Slider(4503, range=0..10000)  # disabled

point_charge_3 = PointCharge(Point=Point(-67, 0, 0), Charge=number_slider_16, Decay=number_slider_29)  # disabled
point_charge_4 = PointCharge(Point=Point(67, 0, 0), Charge=number_slider_19, Decay=number_slider_29)  # disabled

point_charge_5 = PointCharge(Point=Point(-67, 0, 0), Charge=number_slider_17, Decay=number_slider_29)  # disabled
point_charge_6 = PointCharge(Point=Point(67, 0, 0), Charge=number_slider_18, Decay=number_slider_29)  # disabled

merge_fields_3 = MergeFields(Fields=[point_charge_5, point_charge_6, point_charge_3, point_charge_4])  # disabled
field_line_3 = FieldLine(Field=merge_fields_3, Point=divide_surface_3.Points, Steps=number_slider_30, Accuracy=0.1, Method=3)  # disabled

number_slider_31 = Slider(61, range=0..100)  # disabled
number_slider_32 = Slider(43.45, range=0..100)  # disabled
number_slider_33 = Slider(20, range=0..100)  # disabled
number_slider_34 = Slider(42.15, range=0..100)  # disabled
circle_4 = Circle(Plane=PlaneXY(0, 0, 0), Radius=number_slider_31)  # disabled
boundary_surfaces_2 = BoundarySurfaces(Edges=circle_4)  # disabled
point = Point(Point(14, 48, 0))  # disabled
point_2 = Point(Point(26, -24, 0))  # disabled
point_3 = Point(Point(-39, -13, 0))  # disabled
populate_geometry = PopulateGeometry(Geometry=boundary_surfaces_2, Count=100, Seed=1)  # -> flatten(Population); disabled
populate_3d = Populate3D(Region=boundary_surfaces_2, Count=100, Seed=1)  # disabled
number_slider_35 = Slider(100, range=0..100)  # disabled
closest_point = ClosestPoint(Point=populate_geometry, Cloud=[point_3, point, point_2])  # -> ClosestPoint, CPIndex, Distance; disabled
multiplication_3 = Multiplication(A=closest_point.Distance, B=number_slider_35)  # disabled

spin_force_3 = SpinForce(Plane=point_3, Strength=1, Radius=number_slider_33, Decay=2)  # disabled
spin_force_4 = SpinForce(Plane=point, Strength=1, Radius=number_slider_34, Decay=2)  # disabled
spin_force_5 = SpinForce(Plane=point_2, Strength=1, Radius=number_slider_32, Decay=2)  # disabled

merge_fields_4 = MergeFields(Fields=[spin_force_3, spin_force_4, spin_force_5])  # disabled
field_line_4 = FieldLine(Field=merge_fields_4, Point=populate_geometry, Steps=multiplication_3, Accuracy=0.1, Method=3)  # disabled

division_2 = Division(A=number_slider_27, B=Slider(2, range=0..10))
construct_domain_3 = ConstructDomain(DomainStart=0, DomainEnd=Slider(34, range=0..100))

circle_5 = Circle(Plane=PlaneXY(0, 0, 0), Radius=division_2)
divide_curve_3 = DivideCurve(Curve=circle_5, Count=Slider(2, range=0..10), Kinks=False)  # -> Points, Tangents, Parameters
point_charge_7 = PointCharge(Point=divide_curve_3.Points, Charge=Slider(1, range=0..1), Decay=Slider(1.5, range=0..10), Bounds=rectangle_2.Rectangle)
spin_force_6 = SpinForce(
    Plane=divide_curve_3.Points,
    Strength=Slider(0.9, range=0..1),
    Radius=Slider(5.7, range=0..10),
    Decay=Slider(2, range=0..10),
    Bounds=rectangle_2.Rectangle)
circle_6 = Circle(Plane=divide_curve_3.Points, Radius=Slider(5, range=0..10))
merge_fields_5 = MergeFields(Fields=[point_charge_7, spin_force_6])
divide_curve_4 = DivideCurve(Curve=circle_6, Count=Slider(20, range=0..100), Kinks=False)  # -> Points, Tangents, Parameters
field_line_5 = FieldLine(Field=merge_fields_5, Point=divide_curve_4.Points, Steps=1000, Accuracy=0.1, Method=3)  # -> flatten(Curve)

list_length = ListLength(List=field_line_5)
range = Range(Domain=construct_domain_3, Steps=list_length)
unit_z_2 = UnitZ(Factor=range)
move_3 = Move(Geometry=field_line_5, Motion=unit_z_2)  # -> Geometry, Transform
divide_curve_5 = DivideCurve(Curve=move_3.Geometry, Count=10, Kinks=False)  # -> flatten(Points), Tangents, Parameters
addition = Addition(A=list_length, B=Slider(1, range=0..1))
surface_from_points_4 = SurfaceFromPoints(Points=divide_curve_5.Points, UCount=addition, Interpolate=False)

number_slider_36 = Slider(0.96, range=0..1)
list_length_2 = ListLength(List=divide_curve_5.Points)
multiplication_4 = Multiplication(A=list_length_2, B=number_slider_36)
integer_2 = Integer(multiplication_4)
random_reduce = RandomReduce(List=divide_curve_5.Points, Reduction=integer_2, Seed=number_slider_36)

number_slider_37 = Slider(93, range=0..100)
plane_surface_2 = PlaneSurface(Plane=PlaneXY(0, 0, 0), XSize=number_slider_37, YSize=number_slider_37)
surface_3 = Surface(surface_from_points_4)
dimensions_2 = Dimensions(Surface=surface_3)  # -> UDimension, VDimension
number_slider_38 = Slider(14, range=0..50)
md_slider_2 = MDSlider(
    SliderMode=0,
    slider_value=Point(0.4141400965, 0.3752348365, 0.5),
    x_domain=Domain(0, 1),
    y_domain=Domain(0, 1),
    z_domain=Domain(0, 1))
division_3 = Division(A=dimensions_2.UDimension, B=dimensions_2.VDimension)
area_3 = Area(Geometry=surface_3)  # -> Area, Centroid
multiplication_5 = Multiplication(A=division_3, B=number_slider_38)
integer_3 = Integer(multiplication_5)
scale_2 = Scale(Geometry=surface_3, Center=area_3.Centroid, Factor=Slider(1.55, range=0..5))  # -> Geometry, Transform
divide_surface_4 = DivideSurface(Surface=surface_3, UCount=integer_3, VCount=number_slider_38)  # -> flatten(Points), Normals, Parameters
expression_4 = Expression(x=integer_3, Expression="x+1")
evaluate_surface_2 = EvaluateSurface(Surface=reparameterize(scale_2.Geometry), Point=md_slider_2)  # -> Point, Normal, UDirection, VDirection, Frame
distance_2 = Distance(PointA=graft(evaluate_surface_2.Point), PointB=divide_surface_4.Points)
expression_5 = Expression(w=graft(Slider(0.106, range=0..2)), t=distance_2, Expression="sin(w*t)^2")
multiplication_6 = Multiplication(A=Slider(14.83, range=0..20), B=expression_5)
unit_z_3 = UnitZ(Factor=multiplication_6)
move_4 = Move(Geometry=divide_surface_4.Points, Motion=unit_z_3)  # -> Geometry, Transform
surface_from_points_5 = SurfaceFromPoints(Points=move_4.Geometry, UCount=expression_4, Interpolate=False)
unit_z_4 = UnitZ(Factor=Slider(-10, range=-10..10.01))

flip_matrix_2 = FlipMatrix(Data=expression_5)
mass_multiplication_2 = MassMultiplication(Input=flip_matrix_2)  # -> flatten(Result), PartialResults
mass_addition_2 = MassAddition(Input=flip_matrix_2)  # -> flatten(Result), PartialResults

number_slider_39 = Slider(7, range=0..100)
polygon = Polygon(Plane=PlaneXY(0, 0, 0), Radius=number_slider_39, Segments=number_slider_39, FilletRadius=0)  # -> Polygon, Length
construct_domain_4 = ConstructDomain(DomainStart=Slider(0.01, range=0..0.01), DomainEnd=Slider(1, range=1..2))
range_2 = Range(Domain=construct_domain_4, Steps=10)
point_4 = Point(random_reduce)
jitter = Jitter(List=range_2, Jitter=1, Seed=2)  # -> Values, Indices

curve = Curve(polygon.Polygon)
fast_loop_start = FastLoopStart(Iterations=Slider(12, range=0..100), Curve=curve)  # -> port, Counter, Curve
curve_2 = Curve(fast_loop_start.Curve)
explode = Explode(Curve=curve_2, Recursive=True)  # -> Segments, Vertices
point_on_curve = PointOnCurve(explode.Segments, parameter=0.225)
unit_z_5 = UnitZ(Factor=Slider(5, range=0..10))
polyline = PolyLine(Vertices=point_on_curve, Closed=Toggle(True))
move_5 = Move(Geometry=polyline, Motion=unit_z_5)  # -> Geometry, Transform
fast_loop_end = FastLoopEnd(port=fast_loop_start.port, Exit=False, Curve=move_5.Geometry, RecordData=True, TimeOutVal=0)  # -> flatten(Data)
unit_z_6 = UnitZ(Factor=1)
curve_3 = Curve([curve, fast_loop_end])
surface_4 = Surface(curve_3)
extrude = Extrude(Base=surface_4, Direction=unit_z_6)
loft_2 = Loft(Curves=curve_3, Options={Adjust=False, Closed=False, LoftEnds=0, LoftSimp=0, LoftType=0, Rebuild=10, Refit=0.01})

cap_holes = CapHoles(Brep=loft_2)
volume = Volume(Geometry=cap_holes)  # -> Volume, Centroid
scale_3 = Scale(Geometry=cap_holes, Center=volume.Centroid, Factor=jitter.Values)  # -> Geometry, Transform

number_slider_40 = Slider(0.046, range=0..2)
md_slider_3 = MDSlider(
    SliderMode=0,
    slider_value=Point(0.3761499917, 0.5818377239, 0.5),
    x_domain=Domain(0, 1),
    y_domain=Domain(0, 1),
    z_domain=Domain(0, 1))

number_slider_41 = Slider(35, range=0..100)
surface_5 = Surface(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)
dimensions_3 = Dimensions(Surface=surface_5)  # -> UDimension, VDimension
division_4 = Division(A=dimensions_3.UDimension, B=dimensions_3.VDimension)
multiplication_7 = Multiplication(A=division_4, B=number_slider_41)

area_4 = Area(Geometry=surface_5)  # -> Area, Centroid
integer_4 = Integer(multiplication_7)
scale_4 = Scale(Geometry=surface_5, Center=area_4.Centroid, Factor=Slider(2.66, range=0..5))  # -> Geometry, Transform
expression_6 = Expression(x=integer_4, Expression="x+1")
evaluate_surface_3 = EvaluateSurface(Surface=reparameterize(scale_4.Geometry), Point=md_slider_3)  # -> Point, Normal, UDirection, VDirection, Frame

divide_surface_5 = DivideSurface(Surface=surface_5, UCount=integer_4, VCount=number_slider_41)  # -> flatten(Points), Normals, Parameters

distance_3 = Distance(PointA=evaluate_surface_3.Point, PointB=divide_surface_5.Points)
expression_7 = Expression(w=graft(number_slider_40), t=distance_3, k=Slider(0, range=-10..10), Expression="sin(w*t + k*sin(w*t))")
expression_8 = Expression(w=graft(number_slider_40), t=distance_3, Expression="sin(w*t)^2")
multiplication_8 = Multiplication(A=Slider(8.72, range=0..10), B=expression_7)
unit_z_7 = UnitZ(Factor=multiplication_8)
move_6 = Move(Geometry=divide_surface_5.Points, Motion=unit_z_7)  # -> Geometry, Transform
surface_from_points_6 = SurfaceFromPoints(Points=move_6.Geometry, UCount=expression_6, Interpolate=False)

orient = Orient(Geometry=scale_3.Geometry, Source=PlaneXY(0, 0, 0), Target=point_4)  # -> Geometry, Transform
extrude_2 = Extrude(Base=surface_from_points_5, Direction=unit_z_4)
surface_6 = Surface(surface_from_points_6)
merge_3 = Merge(Data1=extrude_2, Data2=orient.Geometry, Data3=surface_6)
