# Grasshopper definition Vectors003.gh (Grasshopper 1.0.7)
# Copyright: Wickerson Studios
# plug-ins: MeshEdit Components, Anemone, Bifocals

spin_force = SpinForce(Plane=PlaneXY(0, 0, 0), Strength=1, Radius=5, Decay=2)  # disabled

field_line = FieldLine(Steps=1000, Accuracy=0.1, Method=3)  # disabled

point_charge = PointCharge(Charge=1, Decay=2)  # disabled

merge_fields = MergeFields()  # disabled

perpendicular_display = PerpendicularDisplay(Samples=1000, PositiveColour=RGB(255, 255, 255), NegativeColour=RGB(0, 0, 0))  # disabled
direction_display = DirectionDisplay(Samples=1000)  # disabled
evaluate_field = EvaluateField()  # -> Tensor, Strength; disabled
scalar_display = ScalarDisplay(Samples=1000)  # disabled
vector_force = VectorForce()  # disabled
break_field = BreakField()  # disabled
line_charge = LineCharge(Charge=1)  # disabled
tensor_display = TensorDisplay(Samples=1000)  # disabled

number_slider = Slider(73, range=0..100)
negative = Negative(Value=number_slider)
division = Division(A=number_slider, B=Slider(2, range=0..10))
construct_domain = ConstructDomain(DomainStart=number_slider, DomainEnd=negative)
circle = Circle(Plane=PlaneXY(0, 0, 0), Radius=division)
divide_curve = DivideCurve(Curve=circle, Count=Slider(2, range=0..10), Kinks=False)  # -> Points, Tangents, Parameters
rectangle = Rectangle(Plane=PlaneXY(0, 0, 0), XSize=construct_domain, YSize=construct_domain, Radius=0)  # -> Rectangle, Length
point_charge_2 = PointCharge(Point=divide_curve.Points, Charge=Slider(1, range=0..1), Decay=Slider(1.5, range=0..10), Bounds=rectangle.Rectangle)
spin_force_2 = SpinForce(
    Plane=divide_curve.Points,
    Strength=Slider(0.9, range=0..1),
    Radius=Slider(5.7, range=0..10),
    Decay=Slider(2, range=0..10),
    Bounds=rectangle.Rectangle)
circle_2 = Circle(Plane=divide_curve.Points, Radius=Slider(5, range=0..10))
merge_fields_2 = MergeFields(Fields=[point_charge_2, spin_force_2])
divide_curve_2 = DivideCurve(Curve=circle_2, Count=Slider(20, range=0..100), Kinks=False)  # -> Points, Tangents, Parameters
field_line_2 = FieldLine(Field=merge_fields_2, Point=divide_curve_2.Points, Steps=1000, Accuracy=0.1, Method=3)  # -> flatten(Curve)
list_length = ListLength(List=field_line_2)
construct_domain_2 = ConstructDomain(DomainStart=0, DomainEnd=Slider(34, range=0..100))
range = Range(Domain=construct_domain_2, Steps=list_length)
jitter = Jitter(List=range, Jitter=1, Seed=2)  # -> Values, Indices
unit_z = UnitZ(Factor=range)
move = Move(Geometry=field_line_2, Motion=unit_z)  # -> Geometry, Transform
divide_curve_3 = DivideCurve(Curve=move.Geometry, Count=10, Kinks=False)  # -> flatten(Points), Tangents, Parameters
addition = Addition(A=list_length, B=Slider(1, range=0..1))
surface_from_points = SurfaceFromPoints(Points=divide_curve_3.Points, UCount=addition, Interpolate=False)

number_slider_2 = Slider(10, range=0..10)
construct_point = ConstructPoint(XCoordinate=0, YCoordinate=0, ZCoordinate=0)
construct_point_2 = ConstructPoint(XCoordinate=number_slider_2, YCoordinate=number_slider_2, ZCoordinate=number_slider_2)
vector_2pt = Vector2Pt(PointA=construct_point, PointB=construct_point_2, Unitize=False)  # -> Vector, Length
vector_display = VectorDisplay(Anchor=construct_point, Vector=vector_2pt.Vector)

number_slider_3 = Slider(63, range=0..100)
number_slider_4 = Slider(39, range=0..100)
square = Square(Plane=PlaneXY(0, 0, 0), Size=Slider(2, range=0..10), ExtentX=number_slider_3, ExtentY=number_slider_3)  # -> Cells, Points
construct_point_3 = ConstructPoint(XCoordinate=number_slider_4, YCoordinate=number_slider_4, ZCoordinate=number_slider_4)
area = Area(Geometry=square.Cells)  # -> Area, Centroid
vector_2pt_2 = Vector2Pt(PointA=construct_point_3, PointB=area.Centroid, Unitize=False)  # -> Vector, Length
negative_2 = Negative(Value=Slider(27, range=0..100))
vector_display_2 = VectorDisplay(Anchor=construct_point_3, Vector=vector_2pt_2.Vector)
line_sdl = LineSDL(Start=area.Centroid, Direction=vector_2pt_2.Vector, Length=negative_2)
end_points = EndPoints(Curve=line_sdl)  # -> flatten(Start), flatten(End)
surface_from_points_2 = SurfaceFromPoints(Points=end_points.End, UCount=number_slider_3, Interpolate=False)

number_slider_5 = Slider(68, range=0..100)  # disabled
circle_3 = Circle(Plane=PlaneXY(0, 0, 0), Radius=number_slider_5)  # disabled
boundary_surfaces = BoundarySurfaces(Edges=circle_3)  # disabled
number_slider_6 = Slider(1, range=0..1)  # disabled
divide_surface = DivideSurface(Surface=boundary_surfaces, UCount=10, VCount=10)  # -> Points, Normals, Parameters; disabled
number_slider_7 = Slider(4503, range=0..10000)  # disabled

number_slider_8 = Slider(37, range=0..100)  # disabled
number_slider_9 = Slider(21, range=0..100)  # disabled
negative_3 = Negative(Value=number_slider_8)  # disabled
number_slider_10 = Slider(2, range=0..10)  # disabled
number_slider_11 = Slider(1, range=0..1)  # disabled
construct_domain_3 = ConstructDomain(DomainStart=number_slider_8, DomainEnd=negative_3)  # disabled
number_slider_12 = Slider(1.5, range=0..10)  # disabled
circle_4 = Circle(Plane=PlaneXY(0, 0, 0), Radius=number_slider_9)  # disabled
number_slider_13 = Slider(5.7, range=0..10)  # disabled
number_slider_14 = Slider(2, range=0..10)  # disabled
number_slider_15 = Slider(0.9, range=0..1)  # disabled
divide_curve_4 = DivideCurve(Curve=circle_4, Count=number_slider_10, Kinks=False)  # -> Points, Tangents, Parameters; disabled
rectangle_2 = Rectangle(Plane=PlaneXY(0, 0, 0), XSize=construct_domain_3, YSize=construct_domain_3, Radius=0)  # -> Rectangle, Length; disabled
number_slider_16 = Slider(5, range=0..10)  # disabled
number_slider_17 = Slider(20, range=0..100)  # disabled
point_charge_3 = PointCharge(Point=divide_curve_4.Points, Charge=number_slider_11, Decay=number_slider_12, Bounds=rectangle_2.Rectangle)  # disabled
spin_force_3 = SpinForce(
    Plane=divide_curve_4.Points,
    Strength=number_slider_15,
    Radius=number_slider_13,
    Decay=number_slider_14,
    Bounds=rectangle_2.Rectangle)  # disabled
circle_5 = Circle(Plane=divide_curve_4.Points, Radius=number_slider_16)  # disabled
merge_fields_3 = MergeFields(Fields=[point_charge_3, spin_force_3])  # disabled
divide_curve_5 = DivideCurve(Curve=circle_5, Count=number_slider_17, Kinks=False)  # -> Points, Tangents, Parameters; disabled
field_line_3 = FieldLine(Field=merge_fields_3, Point=divide_curve_5.Points, Steps=1000, Accuracy=0.1, Method=3)  # disabled

number_slider_18 = Slider(4, range=-10..10)  # disabled
number_slider_19 = Slider(-10, range=-10..10)  # disabled
number_slider_20 = Slider(5, range=-10..10)  # disabled
number_slider_21 = Slider(6, range=-10..10)  # disabled

point_charge_4 = PointCharge(Point=Point(-67, 0, 0), Charge=number_slider_18, Decay=number_slider_6)  # disabled
point_charge_5 = PointCharge(Point=Point(67, 0, 0), Charge=number_slider_21, Decay=number_slider_6)  # disabled

point_charge_6 = PointCharge(Point=Point(-67, 0, 0), Charge=number_slider_19, Decay=number_slider_6)  # disabled
point_charge_7 = PointCharge(Point=Point(67, 0, 0), Charge=number_slider_20, Decay=number_slider_6)  # disabled

merge_fields_4 = MergeFields(Fields=[point_charge_6, point_charge_7, point_charge_4, point_charge_5])  # disabled

field_line_4 = FieldLine(Field=merge_fields_4, Point=divide_surface.Points, Steps=number_slider_7, Accuracy=0.1, Method=3)  # disabled

number_slider_22 = Slider(93, range=0..100)
plane_surface = PlaneSurface(Plane=PlaneXY(0, 0, 0), XSize=number_slider_22, YSize=number_slider_22)
surface = Surface(surface_from_points_2)
dimensions = Dimensions(Surface=surface)  # -> UDimension, VDimension
number_slider_23 = Slider(14, range=0..50)
md_slider = MDSlider(
    SliderMode=0,
    slider_value=Point(0.6234400679, 0.4224961444, 0.5),
    x_domain=Domain(0, 1),
    y_domain=Domain(0, 1),
    z_domain=Domain(0, 1))
division_2 = Division(A=dimensions.UDimension, B=dimensions.VDimension)
area_2 = Area(Geometry=surface)  # -> Area, Centroid
multiplication = Multiplication(A=division_2, B=number_slider_23)
integer = Integer(multiplication)
scale = Scale(Geometry=surface, Center=area_2.Centroid, Factor=Slider(1.55, range=0..5))  # -> Geometry, Transform
divide_surface_2 = DivideSurface(Surface=surface, UCount=integer, VCount=number_slider_23)  # -> flatten(Points), Normals, Parameters
expression = Expression(x=integer, Expression="x+1")
evaluate_surface = EvaluateSurface(Surface=reparameterize(scale.Geometry), Point=md_slider)  # -> Point, Normal, UDirection, VDirection, Frame
distance = Distance(PointA=graft(evaluate_surface.Point), PointB=divide_surface_2.Points)
expression_2 = Expression(w=graft(Slider(0.106, range=0..2)), t=distance, Expression="sin(w*t)^2")
multiplication_2 = Multiplication(A=Slider(14.83, range=0..20), B=expression_2)
unit_z_2 = UnitZ(Factor=multiplication_2)
move_2 = Move(Geometry=divide_surface_2.Points, Motion=unit_z_2)  # -> Geometry, Transform
surface_from_points_3 = SurfaceFromPoints(Points=move_2.Geometry, UCount=expression, Interpolate=False)

number_slider_24 = Slider(7, range=0..100)

number_slider_25 = Slider(0.96, range=0..1)
list_length_2 = ListLength(List=divide_curve_3.Points)
multiplication_3 = Multiplication(A=list_length_2, B=number_slider_25)
integer_2 = Integer(multiplication_3)
random_reduce = RandomReduce(List=divide_curve_3.Points, Reduction=integer_2, Seed=number_slider_25)

polygon = Polygon(Plane=PlaneXY(0, 0, 0), Radius=number_slider_24, Segments=number_slider_24, FilletRadius=0)  # -> Polygon, Length

curve = Curve(polygon.Polygon)
fast_loop_start = FastLoopStart(Iterations=Slider(12, range=0..100), Curve=curve)  # -> port, Counter, Curve
curve_2 = Curve(fast_loop_start.Curve)
explode = Explode(Curve=curve_2, Recursive=True)  # -> Segments, Vertices
point_on_curve = PointOnCurve(explode.Segments, parameter=0.225)
unit_z_3 = UnitZ(Factor=Slider(5, range=0..10))
polyline = PolyLine(Vertices=point_on_curve, Closed=Toggle(True))
move_3 = Move(Geometry=polyline, Motion=unit_z_3)  # -> Geometry, Transform
fast_loop_end = FastLoopEnd(port=fast_loop_start.port, Exit=False, Curve=move_3.Geometry, RecordData=True, TimeOutVal=0)  # -> flatten(Data)
unit_z_4 = UnitZ(Factor=1)
curve_3 = Curve([curve, fast_loop_end])
surface_2 = Surface(curve_3)
extrude = Extrude(Base=surface_2, Direction=unit_z_4)
loft = Loft(Curves=curve_3, Options={Adjust=False, Closed=False, LoftEnds=0, LoftSimp=0, LoftType=0, Rebuild=10, Refit=0.01})

number_slider_26 = Slider(93, range=0..100)
plane_surface_2 = PlaneSurface(Plane=PlaneXY(0, 0, 0), XSize=number_slider_26, YSize=number_slider_26)
surface_3 = Surface(surface_from_points)
dimensions_2 = Dimensions(Surface=surface_3)  # -> UDimension, VDimension
number_slider_27 = Slider(14, range=0..50)
md_slider_2 = MDSlider(
    SliderMode=0,
    slider_value=Point(0.4141400965, 0.3752348365, 0.5),
    x_domain=Domain(0, 1),
    y_domain=Domain(0, 1),
    z_domain=Domain(0, 1))
division_3 = Division(A=dimensions_2.UDimension, B=dimensions_2.VDimension)
area_3 = Area(Geometry=surface_3)  # -> Area, Centroid
multiplication_4 = Multiplication(A=division_3, B=number_slider_27)
integer_3 = Integer(multiplication_4)
scale_2 = Scale(Geometry=surface_3, Center=area_3.Centroid, Factor=Slider(1.55, range=0..5))  # -> Geometry, Transform
divide_surface_3 = DivideSurface(Surface=surface_3, UCount=integer_3, VCount=number_slider_27)  # -> flatten(Points), Normals, Parameters
expression_3 = Expression(x=integer_3, Expression="x+1")
evaluate_surface_2 = EvaluateSurface(Surface=reparameterize(scale_2.Geometry), Point=md_slider_2)  # -> Point, Normal, UDirection, VDirection, Frame
distance_2 = Distance(PointA=graft(evaluate_surface_2.Point), PointB=divide_surface_3.Points)
expression_4 = Expression(w=graft(Slider(0.106, range=0..2)), t=distance_2, Expression="sin(w*t)^2")
multiplication_5 = Multiplication(A=Slider(14.83, range=0..20), B=expression_4)
unit_z_5 = UnitZ(Factor=multiplication_5)
move_4 = Move(Geometry=divide_surface_3.Points, Motion=unit_z_5)  # -> Geometry, Transform
surface_from_points_4 = SurfaceFromPoints(Points=move_4.Geometry, UCount=expression_3, Interpolate=False)
unit_z_6 = UnitZ(Factor=Slider(-10, range=-10..10.01))

flip_matrix = FlipMatrix(Data=expression_2)
mass_multiplication = MassMultiplication(Input=flip_matrix)  # -> flatten(Result), PartialResults
mass_addition = MassAddition(Input=flip_matrix)  # -> flatten(Result), PartialResults

construct_domain_4 = ConstructDomain(DomainStart=Slider(0.01, range=0..0.01), DomainEnd=Slider(1, range=1..2))
range_2 = Range(Domain=construct_domain_4, Steps=10)
cap_holes = CapHoles(Brep=loft)
volume = Volume(Geometry=cap_holes)  # -> Volume, Centroid
point = Point(random_reduce)
jitter_2 = Jitter(List=range_2, Jitter=1, Seed=2)  # -> Values, Indices
scale_3 = Scale(Geometry=cap_holes, Center=volume.Centroid, Factor=jitter_2.Values)  # -> Geometry, Transform

number_slider_28 = Slider(5, range=0..100)
surface_4 = Surface(surface_from_points_3)
divide_surface_4 = DivideSurface(Surface=surface_4, UCount=number_slider_28, VCount=number_slider_28)  # -> Points, Normals, Parameters
amplitude = Amplitude(Vector=divide_surface_4.Normals, Amplitude=Slider(7.534, range=0.001..12))
vector_display_3 = VectorDisplay(Anchor=divide_surface_4.Points, Vector=divide_surface_4.Normals)
move_5 = Move(Geometry=divide_surface_4.Points, Motion=amplitude)  # -> flatten(Geometry), Transform
expression_5 = Expression(x=number_slider_28, Expression="x+1")
surface_from_points_5 = SurfaceFromPoints(Points=move_5.Geometry, UCount=expression_5, Interpolate=False)
mesh_frompoints = MeshFromPoints(Points=move_5.Geometry, UDirection=expression_5, VDirection=expression_5)
deconstruct_brep = DeconstructBrep(Brep=surface_from_points_5)  # -> Faces, graft(Edges), Vertices
deconstruct_brep_2 = DeconstructBrep(Brep=surface)  # -> Faces, graft(Edges), Vertices
geometry = Geometry(deconstruct_brep_2.Edges)
merge = Merge(Data1=deconstruct_brep.Edges, Data2=geometry)
loft_2 = Loft(Curves=merge, Options={Adjust=False, Closed=False, LoftEnds=0, LoftSimp=0, LoftType=0, Rebuild=10, Refit=0.01})  # -> flatten(Loft)
geometry_2 = Geometry(surface)
merge_2 = Merge(Data1=surface_from_points_5, Data2=loft_2, Data3=geometry_2)
brep_join = BrepJoin(Breps=merge_2)  # -> Breps, Closed

flip_matrix_2 = FlipMatrix(Data=expression_4)
mass_multiplication_2 = MassMultiplication(Input=flip_matrix_2)  # -> flatten(Result), PartialResults
mass_addition_2 = MassAddition(Input=flip_matrix_2)  # -> flatten(Result), PartialResults

number_slider_29 = Slider(61, range=0..100)  # disabled
number_slider_30 = Slider(43.45, range=0..100)  # disabled
number_slider_31 = Slider(26.36, range=0..100)  # disabled
number_slider_32 = Slider(42.15, range=0..100)  # disabled
circle_6 = Circle(Plane=PlaneXY(0, 0, 0), Radius=number_slider_29)  # disabled
boundary_surfaces_2 = BoundarySurfaces(Edges=circle_6)  # disabled
point_2 = Point(Point(14, 48, 0))  # disabled
point_3 = Point(Point(26, -24, 0))  # disabled
point_4 = Point(Point(-39, -13, 0))  # disabled
populate_geometry = PopulateGeometry(Geometry=boundary_surfaces_2, Count=100, Seed=1)  # -> flatten(Population); disabled
populate_3d = Populate3D(Region=boundary_surfaces_2, Count=100, Seed=1)  # disabled
number_slider_33 = Slider(100, range=0..100)  # disabled
closest_point = ClosestPoint(Point=populate_geometry, Cloud=[point_4, point_2, point_3])  # -> ClosestPoint, CPIndex, Distance; disabled
multiplication_6 = Multiplication(A=closest_point.Distance, B=number_slider_33)  # disabled

spin_force_4 = SpinForce(Plane=point_4, Strength=1, Radius=number_slider_31, Decay=2)  # disabled
spin_force_5 = SpinForce(Plane=point_2, Strength=1, Radius=number_slider_32, Decay=2)  # disabled
spin_force_6 = SpinForce(Plane=point_3, Strength=1, Radius=number_slider_30, Decay=2)  # disabled

merge_fields_5 = MergeFields(Fields=[spin_force_4, spin_force_5, spin_force_6])  # disabled
field_line_5 = FieldLine(Field=merge_fields_5, Point=populate_geometry, Steps=multiplication_6, Accuracy=0.1, Method=3)  # disabled

number_slider_34 = Slider(0.046, range=0..2)
md_slider_3 = MDSlider(
    SliderMode=0,
    slider_value=Point(0.4871952708, 0.3116216892, 0.5),
    x_domain=Domain(0, 1),
    y_domain=Domain(0, 1),
    z_domain=Domain(0, 1))

number_slider_35 = Slider(35, range=0..100)
surface_5 = Surface(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)
dimensions_3 = Dimensions(Surface=surface_5)  # -> UDimension, VDimension
division_4 = Division(A=dimensions_3.UDimension, B=dimensions_3.VDimension)
multiplication_7 = Multiplication(A=division_4, B=number_slider_35)

area_4 = Area(Geometry=surface_5)  # -> Area, Centroid
integer_4 = Integer(multiplication_7)
scale_4 = Scale(Geometry=surface_5, Center=area_4.Centroid, Factor=Slider(2.66, range=0..5))  # -> Geometry, Transform
expression_6 = Expression(x=integer_4, Expression="x+1")
evaluate_surface_3 = EvaluateSurface(Surface=reparameterize(scale_4.Geometry), Point=md_slider_3)  # -> Point, Normal, UDirection, VDirection, Frame

divide_surface_5 = DivideSurface(Surface=surface_5, UCount=integer_4, VCount=number_slider_35)  # -> flatten(Points), Normals, Parameters

distance_3 = Distance(PointA=evaluate_surface_3.Point, PointB=divide_surface_5.Points)
expression_7 = Expression(w=graft(number_slider_34), t=distance_3, k=Slider(3, range=-10..10), Expression="sin(w*t + k*sin(w*t))")
expression_8 = Expression(w=graft(number_slider_34), t=distance_3, Expression="sin(w*t)^2")
multiplication_8 = Multiplication(A=Slider(8.72, range=0..10), B=expression_7)
unit_z_7 = UnitZ(Factor=multiplication_8)
move_6 = Move(Geometry=divide_surface_5.Points, Motion=unit_z_7)  # -> Geometry, Transform
surface_from_points_6 = SurfaceFromPoints(Points=move_6.Geometry, UCount=expression_6, Interpolate=False)

orient = Orient(Geometry=scale_3.Geometry, Source=PlaneXY(0, 0, 0), Target=point)  # -> Geometry, Transform
extrude_2 = Extrude(Base=surface_from_points_4, Direction=unit_z_6)
surface_6 = Surface(surface_from_points_6)
merge_3 = Merge(Data1=extrude_2, Data2=orient.Geometry, Data3=surface_6)
