# Grasshopper definition Vectors004.gh (Grasshopper 1.0.7)
# Copyright: Wickerson Studios
# plug-ins: MeshEdit Components, Anemone, Bifocals

field_line = FieldLine(Steps=1000, Accuracy=0.1, Method=3)  # disabled

field_line_2 = FieldLine(Steps=1000, Accuracy=0.1, Method=3)

spin_force = SpinForce(Plane=PlaneXY(0, 0, 0), Strength=1, Radius=5, Decay=2)  # disabled

spin_force_2 = SpinForce(Plane=PlaneXY(0, 0, 0), Strength=1, Radius=5, Decay=2)

point_charge = PointCharge(Charge=1, Decay=2)  # disabled

merge_fields = MergeFields()

point_charge_2 = PointCharge(Charge=1, Decay=2)

merge_fields_2 = MergeFields()  # disabled

perpendicular_display = PerpendicularDisplay(Samples=1000, PositiveColour=RGB(255, 255, 255), NegativeColour=RGB(0, 0, 0))
direction_display = DirectionDisplay(Samples=1000)
evaluate_field = EvaluateField()  # -> Tensor, Strength
scalar_display = ScalarDisplay(Samples=1000)
vector_force = VectorForce()
break_field = BreakField()
line_charge = LineCharge(Charge=1)
tensor_display = TensorDisplay(Samples=1000)

number_slider = Slider(73, range=0..100)  # disabled
number_slider_2 = Slider(2, range=0..10)  # disabled
negative = Negative(Value=number_slider)  # disabled
number_slider_3 = Slider(2, range=0..10)  # disabled
division = Division(A=number_slider, B=number_slider_2)  # disabled
number_slider_4 = Slider(1, range=0..1)  # disabled
construct_domain = ConstructDomain(DomainStart=number_slider, DomainEnd=negative)  # disabled
number_slider_5 = Slider(1.5, range=0..10)  # disabled
circle = Circle(Plane=PlaneXY(0, 0, 0), Radius=division)  # disabled
number_slider_6 = Slider(5.7, range=0..10)  # disabled
number_slider_7 = Slider(2, range=0..10)  # disabled
number_slider_8 = Slider(0.9, range=0..1)  # disabled
divide_curve = DivideCurve(Curve=circle, Count=number_slider_3, Kinks=False)  # -> Points, Tangents, Parameters; disabled
rectangle = Rectangle(Plane=PlaneXY(0, 0, 0), XSize=construct_domain, YSize=construct_domain, Radius=0)  # -> Rectangle, Length; disabled
number_slider_9 = Slider(5, range=0..10)  # disabled
number_slider_10 = Slider(20, range=0..100)  # disabled
point_charge_3 = PointCharge(Point=divide_curve.Points, Charge=number_slider_4, Decay=number_slider_5, Bounds=rectangle.Rectangle)  # disabled
spin_force_3 = SpinForce(
    Plane=divide_curve.Points,
    Strength=number_slider_8,
    Radius=number_slider_6,
    Decay=number_slider_7,
    Bounds=rectangle.Rectangle)  # disabled
circle_2 = Circle(Plane=divide_curve.Points, Radius=number_slider_9)  # disabled
merge_fields_3 = MergeFields(Fields=[point_charge_3, spin_force_3])  # disabled
divide_curve_2 = DivideCurve(Curve=circle_2, Count=number_slider_10, Kinks=False)  # -> Points, Tangents, Parameters; disabled
field_line_3 = FieldLine(Field=merge_fields_3, Point=divide_curve_2.Points, Steps=1000, Accuracy=0.1, Method=3)  # -> flatten(Curve); disabled
number_slider_11 = Slider(34, range=0..100)  # disabled
list_length = ListLength(List=field_line_3)  # disabled
construct_domain_2 = ConstructDomain(DomainStart=0, DomainEnd=number_slider_11)  # disabled
range = Range(Domain=construct_domain_2, Steps=list_length)  # disabled
jitter = Jitter(List=range, Jitter=1, Seed=2)  # -> Values, Indices; disabled
unit_z = UnitZ(Factor=range)  # disabled
number_slider_12 = Slider(1, range=0..1)  # disabled
move = Move(Geometry=field_line_3, Motion=unit_z)  # -> Geometry, Transform; disabled
divide_curve_3 = DivideCurve(Curve=move.Geometry, Count=10, Kinks=False)  # -> flatten(Points), Tangents, Parameters; disabled
addition = Addition(A=list_length, B=number_slider_12)  # disabled
surface_from_points = SurfaceFromPoints(Points=divide_curve_3.Points, UCount=addition, Interpolate=False)  # disabled

number_slider_13 = Slider(10, range=0..10)  # disabled
construct_point = ConstructPoint(XCoordinate=0, YCoordinate=0, ZCoordinate=0)  # disabled
construct_point_2 = ConstructPoint(XCoordinate=number_slider_13, YCoordinate=number_slider_13, ZCoordinate=number_slider_13)  # disabled
vector_2pt = Vector2Pt(PointA=construct_point, PointB=construct_point_2, Unitize=False)  # -> Vector, Length; disabled
vector_display = VectorDisplay(Anchor=construct_point, Vector=vector_2pt.Vector)  # disabled

number_slider_14 = Slider(63, range=0..100)  # disabled
number_slider_15 = Slider(2, range=0..10)  # disabled
number_slider_16 = Slider(39, range=0..100)  # disabled
square = Square(Plane=PlaneXY(0, 0, 0), Size=number_slider_15, ExtentX=number_slider_14, ExtentY=number_slider_14)  # -> Cells, Points; disabled
construct_point_3 = ConstructPoint(XCoordinate=number_slider_16, YCoordinate=number_slider_16, ZCoordinate=number_slider_16)  # disabled
number_slider_17 = Slider(27, range=0..100)  # disabled
area = Area(Geometry=square.Cells)  # -> Area, Centroid; disabled
vector_2pt_2 = Vector2Pt(PointA=construct_point_3, PointB=area.Centroid, Unitize=False)  # -> Vector, Length; disabled
negative_2 = Negative(Value=number_slider_17)  # disabled
vector_display_2 = VectorDisplay(Anchor=construct_point_3, Vector=vector_2pt_2.Vector)  # disabled
line_sdl = LineSDL(Start=area.Centroid, Direction=vector_2pt_2.Vector, Length=negative_2)  # disabled
end_points = EndPoints(Curve=line_sdl)  # -> flatten(Start), flatten(End); disabled
surface_from_points_2 = SurfaceFromPoints(Points=end_points.End, UCount=number_slider_14, Interpolate=False)  # disabled

number_slider_18 = Slider(68, range=0..100)  # disabled
circle_3 = Circle(Plane=PlaneXY(0, 0, 0), Radius=number_slider_18)  # disabled
boundary_surfaces = BoundarySurfaces(Edges=circle_3)  # disabled
number_slider_19 = Slider(1, range=0..1)  # disabled
divide_surface = DivideSurface(Surface=boundary_surfaces, UCount=10, VCount=10)  # -> Points, Normals, Parameters; disabled
number_slider_20 = Slider(4503, range=0..10000)  # disabled

number_slider_21 = Slider(37, range=0..100)  # disabled
number_slider_22 = Slider(21, range=0..100)  # disabled
negative_3 = Negative(Value=number_slider_21)  # disabled
number_slider_23 = Slider(2, range=0..10)  # disabled
number_slider_24 = Slider(1, range=0..1)  # disabled
construct_domain_3 = ConstructDomain(DomainStart=number_slider_21, DomainEnd=negative_3)  # disabled
number_slider_25 = Slider(1.5, range=0..10)  # disabled
circle_4 = Circle(Plane=PlaneXY(0, 0, 0), Radius=number_slider_22)  # disabled
number_slider_26 = Slider(5.7, range=0..10)  # disabled
number_slider_27 = Slider(2, range=0..10)  # disabled
number_slider_28 = Slider(0.9, range=0..1)  # disabled
divide_curve_4 = DivideCurve(Curve=circle_4, Count=number_slider_23, Kinks=False)  # -> Points, Tangents, Parameters; disabled
rectangle_2 = Rectangle(Plane=PlaneXY(0, 0, 0), XSize=construct_domain_3, YSize=construct_domain_3, Radius=0)  # -> Rectangle, Length; disabled
number_slider_29 = Slider(5, range=0..10)  # disabled
number_slider_30 = Slider(20, range=0..100)  # disabled
point_charge_4 = PointCharge(Point=divide_curve_4.Points, Charge=number_slider_24, Decay=number_slider_25, Bounds=rectangle_2.Rectangle)  # disabled
spin_force_4 = SpinForce(
    Plane=divide_curve_4.Points,
    Strength=number_slider_28,
    Radius=number_slider_26,
    Decay=number_slider_27,
    Bounds=rectangle_2.Rectangle)  # disabled
circle_5 = Circle(Plane=divide_curve_4.Points, Radius=number_slider_29)  # disabled
merge_fields_4 = MergeFields(Fields=[point_charge_4, spin_force_4])  # disabled
divide_curve_5 = DivideCurve(Curve=circle_5, Count=number_slider_30, Kinks=False)  # -> Points, Tangents, Parameters; disabled
field_line_4 = FieldLine(Field=merge_fields_4, Point=divide_curve_5.Points, Steps=1000, Accuracy=0.1, Method=3)  # disabled

number_slider_31 = Slider(4, range=-10..10)  # disabled
number_slider_32 = Slider(-10, range=-10..10)  # disabled
number_slider_33 = Slider(5, range=-10..10)  # disabled
number_slider_34 = Slider(6, range=-10..10)  # disabled

point_charge_5 = PointCharge(Point=Point(-67, 0, 0), Charge=number_slider_31, Decay=number_slider_19)  # disabled
point_charge_6 = PointCharge(Point=Point(67, 0, 0), Charge=number_slider_34, Decay=number_slider_19)  # disabled

point_charge_7 = PointCharge(Point=Point(-67, 0, 0), Charge=number_slider_32, Decay=number_slider_19)  # disabled
point_charge_8 = PointCharge(Point=Point(67, 0, 0), Charge=number_slider_33, Decay=number_slider_19)  # disabled

merge_fields_5 = MergeFields(Fields=[point_charge_7, point_charge_8, point_charge_5, point_charge_6])  # disabled

field_line_5 = FieldLine(Field=merge_fields_5, Point=divide_surface.Points, Steps=number_slider_20, Accuracy=0.1, Method=3)  # disabled

number_slider_35 = Slider(93, range=0..100)  # disabled
plane_surface = PlaneSurface(Plane=PlaneXY(0, 0, 0), XSize=number_slider_35, YSize=number_slider_35)  # disabled
number_slider_36 = Slider(1.55, range=0..5)  # disabled
surface = Surface(surface_from_points_2)  # disabled
dimensions = Dimensions(Surface=surface)  # -> UDimension, VDimension; disabled
number_slider_37 = Slider(14, range=0..50)  # disabled
md_slider = MDSlider(
    SliderMode=0,
    slider_value=Point(0.6234400679, 0.4224961444, 0.5),
    x_domain=Domain(0, 1),
    y_domain=Domain(0, 1),
    z_domain=Domain(0, 1))  # disabled
division_2 = Division(A=dimensions.UDimension, B=dimensions.VDimension)  # disabled
area_2 = Area(Geometry=surface)  # -> Area, Centroid; disabled
multiplication = Multiplication(A=division_2, B=number_slider_37)  # disabled
integer = Integer(multiplication)  # disabled
scale = Scale(Geometry=surface, Center=area_2.Centroid, Factor=number_slider_36)  # -> Geometry, Transform; disabled
divide_surface_2 = DivideSurface(Surface=surface, UCount=integer, VCount=number_slider_37)  # -> flatten(Points), Normals, Parameters; disabled
number_slider_38 = Slider(0.106, range=0..2)  # disabled
expression = Expression(x=integer, Expression="x+1")  # disabled
evaluate_surface = EvaluateSurface(Surface=reparameterize(scale.Geometry), Point=md_slider)  # -> Point, Normal, UDirection, VDirection, Frame; disabled
distance = Distance(PointA=graft(evaluate_surface.Point), PointB=divide_surface_2.Points)  # disabled
expression_2 = Expression(w=graft(number_slider_38), t=distance, Expression="sin(w*t)^2")  # disabled
number_slider_39 = Slider(14.83, range=0..20)  # disabled
multiplication_2 = Multiplication(A=number_slider_39, B=expression_2)  # disabled
unit_z_2 = UnitZ(Factor=multiplication_2)  # disabled
move_2 = Move(Geometry=divide_surface_2.Points, Motion=unit_z_2)  # -> Geometry, Transform; disabled
surface_from_points_3 = SurfaceFromPoints(Points=move_2.Geometry, UCount=expression, Interpolate=False)  # disabled

number_slider_40 = Slider(7, range=0..100)  # disabled

number_slider_41 = Slider(0.96, range=0..1)  # disabled
list_length_2 = ListLength(List=divide_curve_3.Points)  # disabled
multiplication_3 = Multiplication(A=list_length_2, B=number_slider_41)  # disabled
integer_2 = Integer(multiplication_3)  # disabled
random_reduce = RandomReduce(List=divide_curve_3.Points, Reduction=integer_2, Seed=number_slider_41)  # disabled

polygon = Polygon(Plane=PlaneXY(0, 0, 0), Radius=number_slider_40, Segments=number_slider_40, FilletRadius=0)  # -> Polygon, Length; disabled

number_slider_42 = Slider(12, range=0..100)  # disabled
number_slider_43 = Slider(5, range=0..10)  # disabled
curve = Curve(polygon.Polygon)  # disabled
fast_loop_start = FastLoopStart(Iterations=number_slider_42, Curve=curve)  # -> port, Counter, Curve; disabled
curve_2 = Curve(fast_loop_start.Curve)  # disabled
explode = Explode(Curve=curve_2, Recursive=True)  # -> Segments, Vertices; disabled
boolean_toggle = BooleanToggle(True)  # disabled
point_on_curve = PointOnCurve(explode.Segments, parameter=0.225)  # disabled
unit_z_3 = UnitZ(Factor=number_slider_43)  # disabled
polyline = PolyLine(Vertices=point_on_curve, Closed=boolean_toggle)  # disabled
move_3 = Move(Geometry=polyline, Motion=unit_z_3)  # -> Geometry, Transform; disabled
fast_loop_end = FastLoopEnd(port=fast_loop_start.port, Exit=False, Curve=move_3.Geometry, RecordData=True, TimeOutVal=0)  # -> flatten(Data); disabled
unit_z_4 = UnitZ(Factor=1)  # disabled
curve_3 = Curve([curve, fast_loop_end])  # disabled
surface_2 = Surface(curve_3)  # disabled
extrude = Extrude(Base=surface_2, Direction=unit_z_4)  # disabled
loft = Loft(Curves=curve_3, Options={Adjust=False, Closed=False, LoftEnds=0, LoftSimp=0, LoftType=0, Rebuild=10, Refit=0.01})  # disabled

number_slider_44 = Slider(93, range=0..100)  # disabled
plane_surface_2 = PlaneSurface(Plane=PlaneXY(0, 0, 0), XSize=number_slider_44, YSize=number_slider_44)  # disabled
number_slider_45 = Slider(1.55, range=0..5)  # disabled
surface_3 = Surface(surface_from_points)  # disabled
dimensions_2 = Dimensions(Surface=surface_3)  # -> UDimension, VDimension; disabled
number_slider_46 = Slider(14, range=0..50)  # disabled
md_slider_2 = MDSlider(
    SliderMode=0,
    slider_value=Point(0.4141400965, 0.3752348365, 0.5),
    x_domain=Domain(0, 1),
    y_domain=Domain(0, 1),
    z_domain=Domain(0, 1))  # disabled
division_3 = Division(A=dimensions_2.UDimension, B=dimensions_2.VDimension)  # disabled
area_3 = Area(Geometry=surface_3)  # -> Area, Centroid; disabled
multiplication_4 = Multiplication(A=division_3, B=number_slider_46)  # disabled
integer_3 = Integer(multiplication_4)  # disabled
scale_2 = Scale(Geometry=surface_3, Center=area_3.Centroid, Factor=number_slider_45)  # -> Geometry, Transform; disabled
divide_surface_3 = DivideSurface(Surface=surface_3, UCount=integer_3, VCount=number_slider_46)  # -> flatten(Points), Normals, Parameters; disabled
number_slider_47 = Slider(0.106, range=0..2)  # disabled
expression_3 = Expression(x=integer_3, Expression="x+1")  # disabled
evaluate_surface_2 = EvaluateSurface(Surface=reparameterize(scale_2.Geometry), Point=md_slider_2)  # -> Point, Normal, UDirection, VDirection, Frame; disabled
distance_2 = Distance(PointA=graft(evaluate_surface_2.Point), PointB=divide_surface_3.Points)  # disabled
expression_4 = Expression(w=graft(number_slider_47), t=distance_2, Expression="sin(w*t)^2")  # disabled
number_slider_48 = Slider(14.83, range=0..20)  # disabled
multiplication_5 = Multiplication(A=number_slider_48, B=expression_4)  # disabled
unit_z_5 = UnitZ(Factor=multiplication_5)  # disabled
move_4 = Move(Geometry=divide_surface_3.Points, Motion=unit_z_5)  # -> Geometry, Transform; disabled
surface_from_points_4 = SurfaceFromPoints(Points=move_4.Geometry, UCount=expression_3, Interpolate=False)  # disabled
number_slider_49 = Slider(-10, range=-10..10.01)  # disabled
unit_z_6 = UnitZ(Factor=number_slider_49)  # disabled

flip_matrix = FlipMatrix(Data=expression_2)  # disabled
mass_multiplication = MassMultiplication(Input=flip_matrix)  # -> flatten(Result), PartialResults; disabled
mass_addition = MassAddition(Input=flip_matrix)  # -> flatten(Result), PartialResults; disabled

number_slider_50 = Slider(1, range=1..2)  # disabled
number_slider_51 = Slider(0.01, range=0..0.01)  # disabled
construct_domain_4 = ConstructDomain(DomainStart=number_slider_51, DomainEnd=number_slider_50)  # disabled
range_2 = Range(Domain=construct_domain_4, Steps=10)  # disabled
cap_holes = CapHoles(Brep=loft)  # disabled
volume = Volume(Geometry=cap_holes)  # -> Volume, Centroid; disabled
point = Point(random_reduce)  # disabled
jitter_2 = Jitter(List=range_2, Jitter=1, Seed=2)  # -> Values, Indices; disabled
scale_3 = Scale(Geometry=cap_holes, Center=volume.Centroid, Factor=jitter_2.Values)  # -> Geometry, Transform; disabled

number_slider_52 = Slider(5, range=0..100)  # disabled
surface_4 = Surface(surface_from_points_3)  # disabled
number_slider_53 = Slider(7.534, range=0.001..12)  # disabled
divide_surface_4 = DivideSurface(Surface=surface_4, UCount=number_slider_52, VCount=number_slider_52)  # -> Points, Normals, Parameters; disabled
amplitude = Amplitude(Vector=divide_surface_4.Normals, Amplitude=number_slider_53)  # disabled
vector_display_3 = VectorDisplay(Anchor=divide_surface_4.Points, Vector=divide_surface_4.Normals)  # disabled
move_5 = Move(Geometry=divide_surface_4.Points, Motion=amplitude)  # -> flatten(Geometry), Transform; disabled
expression_5 = Expression(x=number_slider_52, Expression="x+1")  # disabled
surface_from_points_5 = SurfaceFromPoints(Points=move_5.Geometry, UCount=expression_5, Interpolate=False)  # disabled
mesh_frompoints = MeshFromPoints(Points=move_5.Geometry, UDirection=expression_5, VDirection=expression_5)  # disabled
deconstruct_brep = DeconstructBrep(Brep=surface_from_points_5)  # -> Faces, graft(Edges), Vertices; disabled
deconstruct_brep_2 = DeconstructBrep(Brep=surface)  # -> Faces, graft(Edges), Vertices; disabled
geometry = Geometry(deconstruct_brep_2.Edges)  # disabled
merge = Merge(Data1=deconstruct_brep.Edges, Data2=geometry)  # disabled
loft_2 = Loft(Curves=merge, Options={Adjust=False, Closed=False, LoftEnds=0, LoftSimp=0, LoftType=0, Rebuild=10, Refit=0.01})  # -> flatten(Loft); disabled
geometry_2 = Geometry(surface)  # disabled
merge_2 = Merge(Data1=surface_from_points_5, Data2=loft_2, Data3=geometry_2)  # disabled
brep_join = BrepJoin(Breps=merge_2)  # -> Breps, Closed; disabled

flip_matrix_2 = FlipMatrix(Data=expression_4)  # disabled
mass_multiplication_2 = MassMultiplication(Input=flip_matrix_2)  # -> flatten(Result), PartialResults; disabled
mass_addition_2 = MassAddition(Input=flip_matrix_2)  # -> flatten(Result), PartialResults; disabled

number_slider_54 = Slider(61, range=0..100)  # disabled
number_slider_55 = Slider(43.45, range=0..100)  # disabled
number_slider_56 = Slider(26.36, range=0..100)  # disabled
number_slider_57 = Slider(42.15, range=0..100)  # disabled
circle_6 = Circle(Plane=PlaneXY(0, 0, 0), Radius=number_slider_54)  # disabled
boundary_surfaces_2 = BoundarySurfaces(Edges=circle_6)  # disabled
point_2 = Point(Point(14, 48, 0))  # disabled
point_3 = Point(Point(26, -24, 0))  # disabled
point_4 = Point(Point(-39, -13, 0))  # disabled
populate_geometry = PopulateGeometry(Geometry=boundary_surfaces_2, Count=100, Seed=1)  # -> flatten(Population); disabled
populate_3d = Populate3D(Region=boundary_surfaces_2, Count=100, Seed=1)  # disabled
number_slider_58 = Slider(100, range=0..100)  # disabled
closest_point = ClosestPoint(Point=populate_geometry, Cloud=[point_4, point_2, point_3])  # -> ClosestPoint, CPIndex, Distance; disabled
multiplication_6 = Multiplication(A=closest_point.Distance, B=number_slider_58)  # disabled

spin_force_5 = SpinForce(Plane=point_4, Strength=1, Radius=number_slider_56, Decay=2)  # disabled
spin_force_6 = SpinForce(Plane=point_2, Strength=1, Radius=number_slider_57, Decay=2)  # disabled
spin_force_7 = SpinForce(Plane=point_3, Strength=1, Radius=number_slider_55, Decay=2)  # disabled

merge_fields_6 = MergeFields(Fields=[spin_force_5, spin_force_6, spin_force_7])  # disabled
field_line_6 = FieldLine(Field=merge_fields_6, Point=populate_geometry, Steps=multiplication_6, Accuracy=0.1, Method=3)  # disabled

number_slider_59 = Slider(0.046, range=0..2)  # disabled
number_slider_60 = Slider(3, range=-10..10)  # disabled
md_slider_3 = MDSlider(
    SliderMode=0,
    slider_value=Point(0.4871952708, 0.3116216892, 0.5),
    x_domain=Domain(0, 1),
    y_domain=Domain(0, 1),
    z_domain=Domain(0, 1))  # disabled
number_slider_61 = Slider(8.72, range=0..10)  # disabled
number_slider_62 = Slider(2.66, range=0..5)  # disabled

number_slider_63 = Slider(35, range=0..100)  # disabled
surface_5 = Surface(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)  # disabled
dimensions_3 = Dimensions(Surface=surface_5)  # -> UDimension, VDimension; disabled
division_4 = Division(A=dimensions_3.UDimension, B=dimensions_3.VDimension)  # disabled
multiplication_7 = Multiplication(A=division_4, B=number_slider_63)  # disabled

area_4 = Area(Geometry=surface_5)  # -> Area, Centroid; disabled
integer_4 = Integer(multiplication_7)  # disabled
scale_4 = Scale(Geometry=surface_5, Center=area_4.Centroid, Factor=number_slider_62)  # -> Geometry, Transform; disabled
expression_6 = Expression(x=integer_4, Expression="x+1")  # disabled
evaluate_surface_3 = EvaluateSurface(Surface=reparameterize(scale_4.Geometry), Point=md_slider_3)  # -> Point, Normal, UDirection, VDirection, Frame; disabled

divide_surface_5 = DivideSurface(Surface=surface_5, UCount=integer_4, VCount=number_slider_63)  # -> flatten(Points), Normals, Parameters; disabled

distance_3 = Distance(PointA=evaluate_surface_3.Point, PointB=divide_surface_5.Points)  # disabled
expression_7 = Expression(w=graft(number_slider_59), t=distance_3, k=number_slider_60, Expression="sin(w*t + k*sin(w*t))")  # disabled
expression_8 = Expression(w=graft(number_slider_59), t=distance_3, Expression="sin(w*t)^2")  # disabled
multiplication_8 = Multiplication(A=number_slider_61, B=expression_7)  # disabled
unit_z_7 = UnitZ(Factor=multiplication_8)  # disabled
move_6 = Move(Geometry=divide_surface_5.Points, Motion=unit_z_7)  # -> Geometry, Transform; disabled
surface_from_points_6 = SurfaceFromPoints(Points=move_6.Geometry, UCount=expression_6, Interpolate=False)  # disabled

orient = Orient(Geometry=scale_3.Geometry, Source=PlaneXY(0, 0, 0), Target=point)  # -> Geometry, Transform; disabled
extrude_2 = Extrude(Base=surface_from_points_4, Direction=unit_z_6)  # disabled
surface_6 = Surface(surface_from_points_6)  # disabled
merge_3 = Merge(Data1=extrude_2, Data2=orient.Geometry, Data3=surface_6)  # disabled
