# Grasshopper definition Vectors005.gh (Grasshopper 1.0.7)
# Copyright: Wickerson Studios
# plug-ins: Bifocals

section = Section({Plane=PlaneXY(-1.5, 1, 0), Size=Domain2(u=-7.5..7.5, v=-6..6)})
section_2 = Section({Plane=PlaneXY(-6, 5.5, 0), Size=Domain2(u=-44..44, v=-41.5..41.5)})
samples = Samples(1000)

circle = Circle(Plane=PlaneXY(0, 0, 0), Radius=Slider(60, range=0..100))
point = Point(Point(-5, 0, 0))
boundary_surfaces = BoundarySurfaces(Edges=circle)
vector_force = VectorForce(Line=Line((11, -5, 0), (8, -2, 0)))
point_charge = PointCharge(Point=point, Charge=1, Decay=2)
spin_force = SpinForce(Plane=PlaneXY(0, 0, 0), Strength=Slider(4.32, range=0..10), Radius=5, Decay=2)
line_charge = LineCharge(Line=[Line((2, -4, 0), (-7, -1, 0)), Line((-5, 4, 0), (4, 5, 0)), Line((3, 1, 0), (-7, 2, 0))], Charge=1)
point_charge_2 = PointCharge(Point=point, Charge=1, Decay=2)
divide_surface = DivideSurface(Surface=boundary_surfaces, UCount=10, VCount=10)  # -> flatten(Points), Normals, Parameters
merge_fields = MergeFields(Fields=[point_charge_2, point_charge, spin_force, line_charge])
evaluate_field = EvaluateField(Field=spin_force, Point=point)  # -> Tensor, Strength
amplitude = Amplitude(Vector=evaluate_field.Tensor, Amplitude=Slider(72, range=0..100))
field_line = FieldLine(Field=merge_fields, Point=divide_surface.Points, Steps=1000, Accuracy=0.1, Method=3)
break_field = BreakField(Field=merge_fields)  # -> graft(Fields)
panel = Panel(evaluate_field.Strength)
vector_display = VectorDisplay(Anchor=point, Vector=amplitude)
perpendicular_display = PerpendicularDisplay(Field=merge_fields, Section=section_2, Samples=samples, PositiveColour=RGB(3, 251, 255), NegativeColour=RGB(0, 0, 0))
scalar_display = ScalarDisplay(Field=merge_fields, Section=section, Samples=1000)
direction_display = DirectionDisplay(Field=merge_fields, Section={Plane=PlaneXY(-3.5, -0.5, 0), Size=Domain2(u=-27.5..27.5, v=-20.5..20.5)}, Samples=1000)
direction_display_2 = DirectionDisplay(Field=point_charge, Section={Plane=PlaneXY(-2, 5.5, 0), Size=Domain2(u=-22..22, v=-26.5..26.5)}, Samples=1000)
tensor_display = TensorDisplay(Field=merge_fields, Section={Plane=PlaneXY(-5.5, -4, 0), Size=Domain2(u=-81.5..81.5, v=-49..49)}, Samples=1000)
