# Grasshopper definition Vectors006.gh (Grasshopper 1.0.7)
# Copyright: Wickerson Studios
# plug-ins: Bifocals

populate_2d = Populate2D(Region={Plane=PlaneXY(0, 0, 0), Size=Domain2(u=0..20, v=0..10)}, Count=100, Seed=1)
populate_3d = Populate3D(Region={Plane=PlaneXY(0, 0, 0), X=Domain(0, 10), Y=Domain(0, 10), Z=Domain(0, 2)}, Count=100, Seed=1)
circle = Circle(Plane=PlaneXY(0, 0, 0), Radius=1)
square = Square(Plane=PlaneXY(0, 0, 0), Size=1, ExtentX=5, ExtentY=5)  # -> Cells, Points
radial = Radial(Plane=PlaneXY(0, 0, 0), Size=1, ExtentR=5, ExtentP=20)  # -> Cells, Points
hexagonal = Hexagonal(Plane=PlaneXY(0, 0, 0), Size=1, ExtentX=5, ExtentY=5)  # -> Cells, Points
triangular = Triangular(Plane=PlaneXY(0, 0, 0), Size=1, ExtentX=5, ExtentY=5)  # -> Cells, Points
boundary_surfaces = BoundarySurfaces(Edges=circle)
populate_geometry = PopulateGeometry(Geometry=boundary_surfaces, Count=100, Seed=1)

number_slider = Slider(2, range=0..10)
deconstruct_plane = DeconstructPlane(Plane=PlaneXY(0, 0, 0))  # -> Origin, XAxis, YAxis, ZAxis
xy_plane = XYPlane(Origin=Point(0, 0, 0))
xz_plane = XZPlane(Origin=Point(0, 0, 0))
yz_plane = YZPlane(Origin=Point(0, 0, 0))
construct_plane = ConstructPlane(Origin=Point(0, 0, 0), XAxis=Vector(1, 0, 0), YAxis=Vector(0, 1, 0))
plane_normal = PlaneNormal(Origin=Point(0, 0, 0), ZAxis=Vector(0, 0, 1))
line = Line(Line((0, 5, -4), (0, 9, 7)))
point = Point(Point(6, -8, 0))
line_a = LineA(Line((0, 6, -2), (0, 2, 7)))
line_b = LineB(Line((13, 8, 0), (4, -7, 0)))
points = Points([Point(14.74976558, 0, -0.7313105586), Point(-0.1931548945, -10, 0.5760255826), Point(0.1554680765, 7, 4.560804375), Point(-0.4546221227, 7, -2.412558512), Point(0.329779562, 3, 6.553193771), Point(9.46984333, 0, 7.761181483), Point(2.7954292, 2, 0.3145583544), Point(-2.185544291, -4, 0.7503370681), Point(11.76118148, 6, -0.4698433303)])
point_a = PointA(Point(-27, -12, 0))
point_b = PointB(Point(0, 8, 4))
point_c = PointC(Point(10, 0, 8))
line_line = LineLine(LineA=line_a, LineB=line_b)
line_pt = LinePt(Line=line, Point=point)
plane_fit = PlaneFit(Points=points)  # -> Plane, Deviation
plane_3pt = Plane3Pt(PointA=point_a, PointB=point_b, PointC=point_c)
construct_point = ConstructPoint(XCoordinate=number_slider, YCoordinate=0, ZCoordinate=0)
adjust_plane = AdjustPlane(Plane=plane_3pt, Normal=Vector(0, 0, 1))
plane_origin = PlaneOrigin(Base=plane_3pt, Origin=points)
plane_offset = PlaneOffset(BasePlane=plane_fit.Plane, Offset=number_slider)
flip_plane = FlipPlane(Plane=adjust_plane, ReverseX=False, ReverseY=False, SwapAxes=True)
vector_xyz = VectorXYZ(XComponent=number_slider, YComponent=0, ZComponent=0)  # -> Vector, Length
pi = Pi(Factor=Slider(0.44, range=0..1))
plane_closest_point = PlaneClosestPoint(Point=construct_point, Plane=flip_plane)  # -> Point, UVPoint, Distance
align_planes = AlignPlanes(Planes=plane_origin, Master=vector_xyz.Vector)
align_plane = AlignPlane(Plane=adjust_plane, Direction=vector_xyz.Vector)  # -> Plane, Angle
plane_coordinates = PlaneCoordinates(Point=flip_plane, System=PlaneXY(0, 0, 0))  # -> XCoordinate, YCoordinate, ZCoordinate
rotate_plane = RotatePlane(Plane=flip_plane, Angle=pi)

number_slider_2 = Slider(9, range=0..100)
number_slider_3 = Slider(30, range=0..100)
number_slider_4 = Slider(12, range=0..100)
cylinder = Cylinder(Base=PlaneXY(0, 0, 0), Radius=0.5, Length=1)
construct_point_2 = ConstructPoint(XCoordinate=0, YCoordinate=0, ZCoordinate=0)
series = Series(Start=0, Step=1, Count=10)
series_2 = Series(Start=0, Step=1, Count=10)
number_slider_5 = Slider(59, range=0..100)
series_3 = Series(Start=0, Step=1, Count=10)
number_slider_6 = Slider(54, range=0..100)
cylinder_2 = Cylinder(Base=PlaneXY(0, 0, 0), Radius=number_slider_2, Length=number_slider_2)
populate_3d_2 = Populate3D(Region={Plane=PlaneXY(0, 0, 0), X=Domain(0, 10), Y=Domain(0, 10), Z=Domain(0, 2)}, Count=100, Seed=1)
number_slider_7 = Slider(4, range=0..10)
populate_3d_3 = Populate3D(
    Region={Plane=PlaneXY(0, 0, 0), X=Domain(0, 10), Y=Domain(0, 10), Z=Domain(0, 2)},
    Count=Slider(41, range=0..100),
    Seed=1)
construct_point_3 = ConstructPoint(XCoordinate=number_slider_3, YCoordinate=number_slider_3, ZCoordinate=number_slider_3)
populate_geometry_2 = PopulateGeometry(Geometry=cylinder, Count=Slider(12, range=0..100), Seed=1)  # -> graft(Population)
panel = Panel(populate_3d_2)
point_2 = Point([<point referenced from the Rhino model> x5])
pi_2 = Pi(Factor=Slider(1.13, range=0..2))
deconstruct = Deconstruct(Point=construct_point_2)  # -> XComponent, YComponent, ZComponent
populate_geometry_3 = PopulateGeometry(Geometry=cylinder_2, Count=Slider(3, range=0..10), Seed=Slider(825, range=0..1000))
numbers_to_points = NumbersToPoints(Numbers=[series, series_2, series_3], Mask=4)
sphere = Sphere(Base=PlaneXY(0, 0, 0), Radius=Slider(7, range=0..100))
populate_3d_4 = Populate3D(
    Region={Plane=PlaneXY(0, 0, 0), X=Domain(0, 10), Y=Domain(0, 10), Z=Domain(0, 2)},
    Count=Slider(100, range=0..100),
    Seed=1)
populate_3d_5 = Populate3D(Region={Plane=PlaneXY(0, 0, 0), X=Domain(0, 10), Y=Domain(0, 10), Z=Domain(0, 2)}, Count=number_slider_4, Seed=1)
populate_3d_6 = Populate3D(Region={Plane=PlaneXY(0, 0, 0), X=Domain(0, 10), Y=Domain(0, 10), Z=Domain(0, 2)}, Count=number_slider_4, Seed=1)
construct_point_4 = ConstructPoint(XCoordinate=number_slider_5, YCoordinate=number_slider_5, ZCoordinate=0)
range = Range(Domain=Slider(2, range=0..2), Steps=number_slider_6)
sort_points = SortPoints(Points=populate_3d_2)  # -> Points, Indices
range_2 = Range(Domain=Slider(2, range=0..2), Steps=number_slider_6)
interpolate = Interpolate(Vertices=point_2, Degree=3, Periodic=False, KnotStyle=1)  # -> Curve, Length, Domain
point_cylindrical = PointCylindrical(BasePlane=PlaneXY(0, 0, 0), Angle=pi_2, Radius=Slider(6, range=0..100), Elevation=Slider(7, range=0..100))
yz_plane_2 = YZPlane(Origin=Point(0, 0, 0))
points_to_numbers = PointsToNumbers(Points=populate_geometry_2, Mask=4)
divide_surface = DivideSurface(Surface=reparameterize(sphere), UCount=number_slider_7, VCount=number_slider_7)  # -> Points, Normals, Parameters
point_groups = PointGroups(Points=populate_3d_4, Distance=Slider(1.398, range=0..10))  # -> Groups, Indices
list_item = ListItem(List=populate_geometry_3, Index=0, Wrap=True)  # -> Item, Item1, Item2
scale = Scale(Geometry=populate_3d_3, Center=Point(0, 0, 0), Factor=Slider(6, range=0..10))  # -> Geometry, Transform
sphere_2 = Sphere(Base=PlaneXY(0, 0, 0), Radius=1)
merge = Merge(Data1=populate_3d_6, Data2=populate_3d_5)
to_polar = ToPolar(Point=construct_point_4, System=PlaneXY(0, 0, 0))  # -> Phi, Theta, Radius
to_polar_2 = ToPolar(Point=construct_point_4, System=PlaneXY(0, 0, 0), AnglePoleDown=True)  # -> Phi, Theta, Radius
param_viewer = ParamViewer(points_to_numbers)
pi_3 = Pi(Factor=range)
pi_4 = Pi(Factor=range_2)
panel_2 = Panel(sort_points.Points)
panel_3 = Panel(points_to_numbers)
sort_along_curve = SortAlongCurve(Points=point_2, Curve=interpolate.Curve)  # -> Points, Indices
negative = Negative(Value=divide_surface.Normals)
geometry = Geometry(point_groups.Groups)
point_3 = Point(point_groups.Groups)
range_3 = Range(Domain=Slider(38, range=0..100), Steps=number_slider_6)
cull_duplicates = CullDuplicates(Points=merge, Tolerance=0.1, CullMode=3)  # -> Points, Indices, Valence
barycentric = Barycentric(PointA=list_item.Item, PointB=list_item.Item1, PointC=list_item.Item2, CoordinateU=1, CoordinateV=1, CoordinateW=1)
point_oriented = PointOriented(BasePlane=yz_plane_2, UComponent=list_item.Item, VComponent=list_item.Item1, WComponent=list_item.Item2)
construct_point_5 = ConstructPoint(XCoordinate=to_polar_2.Phi, YCoordinate=to_polar_2.Theta, ZCoordinate=to_polar_2.Radius)
barycentric_2 = Barycentric(
    PointA=list_item.Item,
    PointB=list_item.Item1,
    PointC=list_item.Item2,
    CoordinateU=list_item.Item,
    CoordinateV=list_item.Item1,
    CoordinateW=list_item.Item2)
construct_point_6 = ConstructPoint(XCoordinate=to_polar.Phi, YCoordinate=to_polar.Theta, ZCoordinate=to_polar.Radius)
pull_point = PullPoint(Point=divide_surface.Points, Geometry=sphere_2, ClosestOnly=True)  # -> ClosestPoint, Distance
point_polar = PointPolar(BasePlane=PlaneXY(0, 0, 0), XYAngle=pi_3, ZAngle=pi_4, Offset=range_3)
panel_4 = Panel(sort_points.Indices)
param_viewer_2 = ParamViewer(point_groups.Groups)
closest_point = ClosestPoint(Point=construct_point_3, Cloud=scale.Geometry)  # -> ClosestPoint, CPIndex, Distance
closest_points = ClosestPoints(Point=construct_point_3, Cloud=scale.Geometry, Count=Slider(4, range=0..10))  # -> ClosestPoint, CPIndex, Distance
project_point = ProjectPoint(Point=divide_surface.Points, Direction=negative, Geometry=sphere_2)  # -> Point, Index
point_4 = Point(sort_along_curve.Points)
distance = Distance(PointA=barycentric, PointB=barycentric_2)
line_2 = Line(StartPoint=barycentric, EndPoint=barycentric_2)
line_3 = Line(StartPoint=construct_point_6, EndPoint=construct_point_5)
line_4 = Line(StartPoint=construct_point_4, EndPoint=construct_point_6)
line_5 = Line(StartPoint=construct_point_4, EndPoint=construct_point_5)
point_5 = Point(cull_duplicates.Points)
list_item_2 = ListItem(List=point_4, Index=Slider(2, range=0..10), Wrap=True)
point_6 = Point(closest_point.ClosestPoint)
interpolate_2 = Interpolate(Vertices=point_polar, Degree=3, Periodic=False, KnotStyle=1)  # -> Curve, Length, Domain
point_7 = Point(closest_points.ClosestPoint)
panel_5 = Panel(distance)
panel_6 = Panel(pull_point.ClosestPoint)
panel_7 = Panel(pull_point.Distance)

number_slider_8 = Slider(5, range=0..100)

cylinder_3 = Cylinder(Base=point_2, Radius=number_slider_8, Length=number_slider_8)

curve_array = CurveArray(Geometry=cylinder_3, Curve=interpolate.Curve, Count=number_slider_8)  # -> Geometry, Transform
