# Grasshopper definition Vectors007.gh (Grasshopper 1.0.7)
# Copyright: Wickerson Studios
# plug-ins: Bifocals

populate_2d = Populate2D(Region={Plane=PlaneXY(0, 0, 0), Size=Domain2(u=0..20, v=0..10)}, Count=100, Seed=1)  # disabled
populate_3d = Populate3D(Region={Plane=PlaneXY(0, 0, 0), X=Domain(0, 10), Y=Domain(0, 10), Z=Domain(0, 2)}, Count=100, Seed=1)  # disabled
circle = Circle(Plane=PlaneXY(0, 0, 0), Radius=1)  # disabled
square = Square(Plane=PlaneXY(0, 0, 0), Size=1, ExtentX=5, ExtentY=5)  # -> Cells, Points; disabled
radial = Radial(Plane=PlaneXY(0, 0, 0), Size=1, ExtentR=5, ExtentP=20)  # -> Cells, Points; disabled
hexagonal = Hexagonal(Plane=PlaneXY(0, 0, 0), Size=1, ExtentX=5, ExtentY=5)  # -> Cells, Points; disabled
triangular = Triangular(Plane=PlaneXY(0, 0, 0), Size=1, ExtentX=5, ExtentY=5)  # -> Cells, Points; disabled
boundary_surfaces = BoundarySurfaces(Edges=circle)  # disabled
populate_geometry = PopulateGeometry(Geometry=boundary_surfaces, Count=100, Seed=1)  # disabled

number_slider = Slider(2, range=0..10)  # disabled
deconstruct_plane = DeconstructPlane(Plane=PlaneXY(0, 0, 0))  # -> Origin, XAxis, YAxis, ZAxis; disabled
xy_plane = XYPlane(Origin=Point(0, 0, 0))  # disabled
xz_plane = XZPlane(Origin=Point(0, 0, 0))  # disabled
yz_plane = YZPlane(Origin=Point(0, 0, 0))  # disabled
construct_plane = ConstructPlane(Origin=Point(0, 0, 0), XAxis=Vector(1, 0, 0), YAxis=Vector(0, 1, 0))  # disabled
plane_normal = PlaneNormal(Origin=Point(0, 0, 0), ZAxis=Vector(0, 0, 1))  # disabled
line = Line(Line((0, 5, -4), (0, 9, 7)))  # disabled
point = Point(Point(6, -8, 0))  # disabled
line_a = LineA(Line((0, 6, -2), (0, 2, 7)))  # disabled
line_b = LineB(Line((13, 8, 0), (4, -7, 0)))  # disabled
points = Points([Point(14.74976558, 0, -0.7313105586), Point(-0.1931548945, -10, 0.5760255826), Point(0.1554680765, 7, 4.560804375), Point(-0.4546221227, 7, -2.412558512), Point(0.329779562, 3, 6.553193771), Point(9.46984333, 0, 7.761181483), Point(2.7954292, 2, 0.3145583544), Point(-2.185544291, -4, 0.7503370681), Point(11.76118148, 6, -0.4698433303)])  # disabled
point_a = PointA(Point(-27, -12, 0))  # disabled
point_b = PointB(Point(0, 8, 4))  # disabled
point_c = PointC(Point(10, 0, 8))  # disabled
line_line = LineLine(LineA=line_a, LineB=line_b)  # disabled
line_pt = LinePt(Line=line, Point=point)  # disabled
plane_fit = PlaneFit(Points=points)  # -> Plane, Deviation; disabled
plane_3pt = Plane3Pt(PointA=point_a, PointB=point_b, PointC=point_c)  # disabled
number_slider_2 = Slider(0.44, range=0..1)  # disabled
construct_point = ConstructPoint(XCoordinate=number_slider, YCoordinate=0, ZCoordinate=0)  # disabled
adjust_plane = AdjustPlane(Plane=plane_3pt, Normal=Vector(0, 0, 1))  # disabled
plane_origin = PlaneOrigin(Base=plane_3pt, Origin=points)  # disabled
plane_offset = PlaneOffset(BasePlane=plane_fit.Plane, Offset=number_slider)  # disabled
flip_plane = FlipPlane(Plane=adjust_plane, ReverseX=False, ReverseY=False, SwapAxes=True)  # disabled
vector_xyz = VectorXYZ(XComponent=number_slider, YComponent=0, ZComponent=0)  # -> Vector, Length; disabled
pi = Pi(Factor=number_slider_2)  # disabled
plane_closest_point = PlaneClosestPoint(Point=construct_point, Plane=flip_plane)  # -> Point, UVPoint, Distance; disabled
align_planes = AlignPlanes(Planes=plane_origin, Master=vector_xyz.Vector)  # disabled
align_plane = AlignPlane(Plane=adjust_plane, Direction=vector_xyz.Vector)  # -> Plane, Angle; disabled
plane_coordinates = PlaneCoordinates(Point=flip_plane, System=PlaneXY(0, 0, 0))  # -> XCoordinate, YCoordinate, ZCoordinate; disabled
rotate_plane = RotatePlane(Plane=flip_plane, Angle=pi)  # disabled

number_slider_3 = Slider(3, range=0..10)  # disabled
number_slider_4 = Slider(6, range=0..10)  # disabled
populate_2d_2 = Populate2D(Region={Plane=PlaneXY(0, 0, 0), Size=Domain2(u=0..20, v=0..10)}, Count=100, Seed=1)  # disabled
populate_3d_2 = Populate3D(Region={Plane=PlaneXY(0, 0, 0), X=Domain(0, 10), Y=Domain(0, 10), Z=Domain(0, 2)}, Count=100, Seed=1)  # disabled
square_2 = Square(Plane=PlaneXY(0, 0, 0), Size=1, ExtentX=number_slider_3, ExtentY=number_slider_3)  # -> Cells, Points; disabled
circle_2 = Circle(Plane=PlaneXY(0, 0, 0), Radius=1)  # disabled
radial_2 = Radial(Plane=PlaneXY(0, 0, 0), Size=1, ExtentR=number_slider_4, ExtentP=number_slider_4)  # -> Cells, Points; disabled
triangular_2 = Triangular(Plane=PlaneXY(0, 0, 0), Size=1, ExtentX=number_slider_3, ExtentY=number_slider_3)  # -> Cells, Points; disabled
hexagonal_2 = Hexagonal(Plane=PlaneXY(0, 0, 0), Size=1, ExtentX=number_slider_3, ExtentY=number_slider_3)  # -> Cells, Points; disabled
number_slider_5 = Slider(12, range=0..100)  # disabled
boundary_surfaces_2 = BoundarySurfaces(Edges=circle_2)  # disabled
number_slider_6 = Slider(3, range=0..10)  # disabled
populate_geometry_2 = PopulateGeometry(Geometry=boundary_surfaces_2, Count=number_slider_5, Seed=1)  # disabled
point_2 = Point(hexagonal_2.Points)  # disabled
number_slider_7 = Slider(6.25, range=0..10)  # disabled
populate_3d_3 = Populate3D(Region=hexagonal_2.Cells, Count=number_slider_6, Seed=1)  # -> graft(Population); disabled
explode = Explode(Curve=hexagonal_2.Cells, Recursive=True)  # -> Segments, Vertices; disabled
list_length = ListLength(List=explode.Segments)  # disabled
expression = Expression(x=list_length, Expression="x-1")  # disabled
construct_domain = ConstructDomain(DomainStart=0, DomainEnd=expression)  # disabled
unit_z = UnitZ(Factor=number_slider_7)  # disabled
range = Range(Domain=construct_domain, Steps=expression)  # disabled
shift = Shift(1)  # disabled
move = Move(Geometry=populate_3d_3, Motion=unit_z)  # -> graft(Geometry), Transform; disabled
shift_list = ShiftList(List=explode.Vertices, Shift=shift, Wrap=True)  # disabled
list_item = ListItem(List=explode.Vertices, Index=range, Wrap=True)  # disabled
line_2 = Line(StartPoint=explode.Vertices, EndPoint=move.Geometry)  # disabled
list_item_2 = ListItem(List=shift_list, Index=range, Wrap=False)  # disabled
line_3 = Line(explode.Segments)  # disabled
_4point_surface = _4PointSurface(CornerA=move.Geometry, CornerB=list_item, CornerC=list_item_2)  # disabled
boundary_surfaces_3 = BoundarySurfaces(Edges=line_3)  # disabled
brep = Brep(boundary_surfaces_3)  # disabled
brep_2 = Brep(_4point_surface)  # disabled
param_viewer = ParamViewer(brep_2)  # disabled
merge = Merge(Data1=brep, Data2=brep_2)  # disabled
panel = Panel(explode.Vertices)  # disabled
panel_2 = Panel(shift_list)  # disabled
brep_join = BrepJoin(Breps=merge)  # -> Breps, Closed; disabled

line_b_2 = LineB(Line((13, 8, 0), (4, -7, 0)))  # disabled
line_4 = Line(Line((0, 5, -4), (0, 9, 7)))  # disabled
point_3 = Point(Point(6, -8, 0))  # disabled
point_a_2 = PointA(Point(-27, -12, 0))  # disabled
point_b_2 = PointB(Point(0, 8, 4))  # disabled
point_c_2 = PointC(Point(10, 0, 8))  # disabled
line_a_2 = LineA(Line((5, 9, 0), (-7, -1, 0)))  # disabled
points_2 = Points([Point(14.74976558, 0, -0.7313105586), Point(-0.1931548945, -10, 0.5760255826), Point(0.1554680765, 7, 4.560804375), Point(-0.4546221227, 7, -2.412558512), Point(0.329779562, 3, 6.553193771), Point(9.46984333, 0, 7.761181483), Point(2.7954292, 2, 0.3145583544), Point(-2.185544291, -4, 0.7503370681), Point(11.76118148, 6, -0.4698433303)])  # disabled
plane = Plane(PlaneXY(0, 0, 0))  # disabled
number_slider_8 = Slider(4.91, range=0..10)  # disabled
construct_plane_2 = ConstructPlane(Origin=plane, XAxis=Vector(1, 0, 0), YAxis=Vector(0, 1, 0))  # disabled
plane_fit_2 = PlaneFit(Points=points_2)  # -> Plane, Deviation; disabled
plane_3pt_2 = Plane3Pt(PointA=point_a_2, PointB=point_b_2, PointC=point_c_2)  # disabled
line_line_2 = LineLine(LineA=line_a_2, LineB=line_b_2)  # disabled
plane_normal_2 = PlaneNormal(Origin=point_c_2, ZAxis=Vector(0, 0, 1))  # disabled
line_pt_2 = LinePt(Line=line_4, Point=point_3)  # disabled
deconstruct_plane_2 = DeconstructPlane(Plane=construct_plane_2)  # -> Origin, XAxis, YAxis, ZAxis; disabled
plane_offset_2 = PlaneOffset(BasePlane=plane_fit_2.Plane, Offset=number_slider_8)  # disabled
boolean_toggle = BooleanToggle(False)  # disabled
vector_xyz_2 = VectorXYZ(XComponent=number_slider_8, YComponent=0, ZComponent=0)  # -> Vector, Length; disabled
number_slider_9 = Slider(0.48, range=0..1)  # disabled
adjust_plane_2 = AdjustPlane(Plane=plane_3pt_2, Normal=Vector(0, 0, 1))  # disabled
panel_3 = Panel(deconstruct_plane_2.ZAxis)  # disabled
xz_plane_2 = XZPlane(Origin=deconstruct_plane_2.Origin)  # disabled
xy_plane_2 = XYPlane(Origin=deconstruct_plane_2.Origin)  # disabled
yz_plane_2 = YZPlane(Origin=deconstruct_plane_2.Origin)  # disabled
construct_point_2 = ConstructPoint(XCoordinate=number_slider_8, YCoordinate=0, ZCoordinate=0)  # disabled
plane_origin_2 = PlaneOrigin(Base=plane_offset_2, Origin=points_2)  # disabled
flip_plane_2 = FlipPlane(Plane=adjust_plane_2, ReverseX=False, ReverseY=False, SwapAxes=boolean_toggle)  # disabled
align_plane_2 = AlignPlane(Plane=adjust_plane_2, Direction=vector_xyz_2.Vector)  # -> Plane, Angle; disabled
pi_2 = Pi(Factor=number_slider_9)  # disabled
align_planes_2 = AlignPlanes(Planes=plane_origin_2, Master=vector_xyz_2.Vector)  # disabled
plane_coordinates_2 = PlaneCoordinates(Point=flip_plane_2, System=PlaneXY(0, 0, 0))  # -> XCoordinate, YCoordinate, ZCoordinate; disabled
plane_closest_point_2 = PlaneClosestPoint(Point=construct_point_2, Plane=flip_plane_2)  # -> Point, UVPoint, Distance; disabled
rotate_plane_2 = RotatePlane(Plane=flip_plane_2, Angle=pi_2)  # disabled
panel_4 = Panel(plane_coordinates_2.XCoordinate)  # disabled

number_slider_10 = Slider(10, range=0..100)
construct_point_3 = ConstructPoint(XCoordinate=0, YCoordinate=0, ZCoordinate=0)
unit_z_2 = UnitZ(Factor=1)
unit_x = UnitX(Factor=1)
unit_y = UnitY(Factor=1)
unit_x_2 = UnitX(Factor=Slider(4, range=0..10))
unit_z_3 = UnitZ(Factor=1)
unit_y_2 = UnitY(Factor=1)
construct_point_4 = ConstructPoint(XCoordinate=0, YCoordinate=0, ZCoordinate=0)
point_b_3 = PointB(Point(1, -1, 0))
xy_plane_3 = XYPlane(Origin=Point(0, 0, 0))
point_a_3 = PointA(Point(-2, 1, 0))
vector_xyz_3 = VectorXYZ(XComponent=number_slider_10, YComponent=Slider(34, range=0..100), ZComponent=number_slider_10)  # -> Vector, Length
dot_product = DotProduct(VectorA=unit_x_2, VectorB=unit_x_2, Unitize=False)
unit_vector = UnitVector(Vector=[unit_x, unit_y, unit_z_2])
pi_3 = Pi(Factor=Slider(0.22, range=0..2))
vector_display = VectorDisplay(Anchor=construct_point_4, Vector=unit_y_2)
cross_product = CrossProduct(VectorA=unit_x_2, VectorB=unit_y_2, Unitize=False)  # -> Vector, Length
vector_display_2 = VectorDisplay(Anchor=construct_point_4, Vector=unit_x_2)
vector_2pt = Vector2Pt(PointA=point_a_3, PointB=point_b_3, Unitize=False)  # -> Vector, Length
angle = Angle(VectorA=unit_x, VectorB=unit_y, Plane=xy_plane_3)  # -> Angle, Reflex
vector_length = VectorLength(Vector=vector_2pt.Vector)
vector_2pt_2 = Vector2Pt(PointA=point_a_3, PointB=point_b_3, Unitize=Toggle(True))  # -> Vector, Length
vector_display_3 = VectorDisplay(Anchor=construct_point_4, Vector=cross_product.Vector)
vector_display_4 = VectorDisplay(Anchor=construct_point_4, Vector=unit_vector)
panel_5 = Panel(dot_product)
rotate = Rotate(Vector=unit_y, Axis=unit_x, Angle=pi_3)
vector_display_5 = VectorDisplay(Anchor=point_a_3, Vector=vector_2pt.Vector)
vector_display_6 = VectorDisplay(Anchor=vector_2pt.Vector, Vector=vector_2pt.Vector)
vector_display_7 = VectorDisplay(Anchor=construct_point_4, Vector=vector_xyz_3.Vector)
vector_display_8 = VectorDisplay(Anchor=vector_2pt.Vector, Vector=vector_2pt_2.Vector)
panel_6 = Panel(angle.Angle)
amplitude = Amplitude(Vector=vector_xyz_3.Vector, Amplitude=Slider(8.72, range=0..10))
rotate_2 = Rotate(Vector=cross_product.Vector, Axis=unit_x_2, Angle=pi_3)
panel_7 = Panel(vector_2pt_2.Length)
panel_8 = Panel(vector_length)
vector_display_9 = VectorDisplay(Anchor=vector_2pt.Vector, Vector=vector_2pt.Vector)
vector_display_10 = VectorDisplay(Anchor=construct_point_3, Vector=vector_2pt.Vector)
vector_display_11 = VectorDisplay(Anchor=construct_point_4, Vector=unit_vector)
reverse = Reverse(Vector=rotate_2)
vector_display_12 = VectorDisplay(Anchor=construct_point_4, Vector=rotate)
deconstruct_vector = DeconstructVector(Vector=amplitude)  # -> XComponent, YComponent, ZComponent
vector_display_13 = VectorDisplay(Anchor=construct_point_4, Vector=reverse)
vector_display_14 = VectorDisplay(Anchor=construct_point_4, Vector=rotate_2)
vector_display_15 = VectorDisplay(Anchor=construct_point_4, Vector=amplitude)
panel_9 = Panel(deconstruct_vector.ZComponent)
param_viewer_2 = ParamViewer(deconstruct_vector.ZComponent)

number_slider_11 = Slider(9, range=0..100)  # disabled
number_slider_12 = Slider(41, range=0..100)  # disabled
number_slider_13 = Slider(30, range=0..100)  # disabled
number_slider_14 = Slider(1.13, range=0..2)  # disabled
number_slider_15 = Slider(2, range=0..2)  # disabled
number_slider_16 = Slider(4, range=0..10)  # disabled
number_slider_17 = Slider(2, range=0..2)  # disabled
number_slider_18 = Slider(12, range=0..100)  # disabled
number_slider_19 = Slider(100, range=0..100)  # disabled
number_slider_20 = Slider(12, range=0..100)  # disabled
number_slider_21 = Slider(3, range=0..10)  # disabled
number_slider_22 = Slider(7, range=0..100)  # disabled
number_slider_23 = Slider(825, range=0..1000)  # disabled
cylinder = Cylinder(Base=PlaneXY(0, 0, 0), Radius=0.5, Length=1)  # disabled
number_slider_24 = Slider(7, range=0..100)  # disabled
number_slider_25 = Slider(6, range=0..100)  # disabled
construct_point_5 = ConstructPoint(XCoordinate=0, YCoordinate=0, ZCoordinate=0)  # disabled
series = Series(Start=0, Step=1, Count=10)  # disabled
series_2 = Series(Start=0, Step=1, Count=10)  # disabled
number_slider_26 = Slider(59, range=0..100)  # disabled
series_3 = Series(Start=0, Step=1, Count=10)  # disabled
number_slider_27 = Slider(54, range=0..100)  # disabled
cylinder_2 = Cylinder(Base=PlaneXY(0, 0, 0), Radius=number_slider_11, Length=number_slider_11)  # disabled
populate_3d_4 = Populate3D(Region={Plane=PlaneXY(0, 0, 0), X=Domain(0, 10), Y=Domain(0, 10), Z=Domain(0, 2)}, Count=100, Seed=1)  # disabled
number_slider_28 = Slider(4, range=0..10)  # disabled
populate_3d_5 = Populate3D(Region={Plane=PlaneXY(0, 0, 0), X=Domain(0, 10), Y=Domain(0, 10), Z=Domain(0, 2)}, Count=number_slider_12, Seed=1)  # disabled
number_slider_29 = Slider(6, range=0..10)  # disabled
number_slider_30 = Slider(1.398, range=0..10)  # disabled
construct_point_6 = ConstructPoint(XCoordinate=number_slider_13, YCoordinate=number_slider_13, ZCoordinate=number_slider_13)  # disabled
populate_geometry_3 = PopulateGeometry(Geometry=cylinder, Count=number_slider_20, Seed=1)  # -> graft(Population); disabled
panel_10 = Panel(populate_3d_4)  # disabled
point_4 = Point([<point referenced from the Rhino model> x5])  # disabled
pi_4 = Pi(Factor=number_slider_14)  # disabled
deconstruct = Deconstruct(Point=construct_point_5)  # -> XComponent, YComponent, ZComponent; disabled
populate_geometry_4 = PopulateGeometry(Geometry=cylinder_2, Count=number_slider_21, Seed=number_slider_23)  # disabled
numbers_to_points = NumbersToPoints(Numbers=[series, series_2, series_3], Mask=4)  # disabled
sphere = Sphere(Base=PlaneXY(0, 0, 0), Radius=number_slider_22)  # disabled
populate_3d_6 = Populate3D(Region={Plane=PlaneXY(0, 0, 0), X=Domain(0, 10), Y=Domain(0, 10), Z=Domain(0, 2)}, Count=number_slider_19, Seed=1)  # disabled
populate_3d_7 = Populate3D(Region={Plane=PlaneXY(0, 0, 0), X=Domain(0, 10), Y=Domain(0, 10), Z=Domain(0, 2)}, Count=number_slider_18, Seed=1)  # disabled
populate_3d_8 = Populate3D(Region={Plane=PlaneXY(0, 0, 0), X=Domain(0, 10), Y=Domain(0, 10), Z=Domain(0, 2)}, Count=number_slider_18, Seed=1)  # disabled
construct_point_7 = ConstructPoint(XCoordinate=number_slider_26, YCoordinate=number_slider_26, ZCoordinate=0)  # disabled
range_2 = Range(Domain=number_slider_15, Steps=number_slider_27)  # disabled
sort_points = SortPoints(Points=populate_3d_4)  # -> Points, Indices; disabled
range_3 = Range(Domain=number_slider_17, Steps=number_slider_27)  # disabled
interpolate = Interpolate(Vertices=point_4, Degree=3, Periodic=False, KnotStyle=1)  # -> Curve, Length, Domain; disabled
point_cylindrical = PointCylindrical(BasePlane=PlaneXY(0, 0, 0), Angle=pi_4, Radius=number_slider_25, Elevation=number_slider_24)  # disabled
yz_plane_3 = YZPlane(Origin=Point(0, 0, 0))  # disabled
number_slider_31 = Slider(38, range=0..100)  # disabled
points_to_numbers = PointsToNumbers(Points=populate_geometry_3, Mask=4)  # disabled
divide_surface = DivideSurface(Surface=reparameterize(sphere), UCount=number_slider_28, VCount=number_slider_28)  # -> Points, Normals, Parameters; disabled
point_groups = PointGroups(Points=populate_3d_6, Distance=number_slider_30)  # -> Groups, Indices; disabled
list_item_3 = ListItem(List=populate_geometry_4, Index=0, Wrap=True)  # -> Item, Item1, Item2; disabled
scale = Scale(Geometry=populate_3d_5, Center=Point(0, 0, 0), Factor=number_slider_29)  # -> Geometry, Transform; disabled
sphere_2 = Sphere(Base=PlaneXY(0, 0, 0), Radius=1)  # disabled
merge_2 = Merge(Data1=populate_3d_8, Data2=populate_3d_7)  # disabled
to_polar = ToPolar(Point=construct_point_7, System=PlaneXY(0, 0, 0))  # -> Phi, Theta, Radius; disabled
to_polar_2 = ToPolar(Point=construct_point_7, System=PlaneXY(0, 0, 0), AnglePoleDown=True)  # -> Phi, Theta, Radius; disabled
param_viewer_3 = ParamViewer(points_to_numbers)  # disabled
pi_5 = Pi(Factor=range_2)  # disabled
pi_6 = Pi(Factor=range_3)  # disabled
panel_11 = Panel(sort_points.Points)  # disabled
panel_12 = Panel(points_to_numbers)  # disabled
sort_along_curve = SortAlongCurve(Points=point_4, Curve=interpolate.Curve)  # -> Points, Indices; disabled
negative = Negative(Value=divide_surface.Normals)  # disabled
geometry = Geometry(point_groups.Groups)  # disabled
number_slider_32 = Slider(2, range=0..10)  # disabled
point_5 = Point(point_groups.Groups)  # disabled
range_4 = Range(Domain=number_slider_31, Steps=number_slider_27)  # disabled
cull_duplicates = CullDuplicates(Points=merge_2, Tolerance=0.1, CullMode=3)  # -> Points, Indices, Valence; disabled
barycentric = Barycentric(PointA=list_item_3.Item, PointB=list_item_3.Item1, PointC=list_item_3.Item2, CoordinateU=1, CoordinateV=1, CoordinateW=1)  # disabled
point_oriented = PointOriented(BasePlane=yz_plane_3, UComponent=list_item_3.Item, VComponent=list_item_3.Item1, WComponent=list_item_3.Item2)  # disabled
construct_point_8 = ConstructPoint(XCoordinate=to_polar_2.Phi, YCoordinate=to_polar_2.Theta, ZCoordinate=to_polar_2.Radius)  # disabled
barycentric_2 = Barycentric(
    PointA=list_item_3.Item,
    PointB=list_item_3.Item1,
    PointC=list_item_3.Item2,
    CoordinateU=list_item_3.Item,
    CoordinateV=list_item_3.Item1,
    CoordinateW=list_item_3.Item2)  # disabled
construct_point_9 = ConstructPoint(XCoordinate=to_polar.Phi, YCoordinate=to_polar.Theta, ZCoordinate=to_polar.Radius)  # disabled
pull_point = PullPoint(Point=divide_surface.Points, Geometry=sphere_2, ClosestOnly=True)  # -> ClosestPoint, Distance; disabled
point_polar = PointPolar(BasePlane=PlaneXY(0, 0, 0), XYAngle=pi_5, ZAngle=pi_6, Offset=range_4)  # disabled
panel_13 = Panel(sort_points.Indices)  # disabled
param_viewer_4 = ParamViewer(point_groups.Groups)  # disabled
closest_point = ClosestPoint(Point=construct_point_6, Cloud=scale.Geometry)  # -> ClosestPoint, CPIndex, Distance; disabled
closest_points = ClosestPoints(Point=construct_point_6, Cloud=scale.Geometry, Count=number_slider_16)  # -> ClosestPoint, CPIndex, Distance; disabled
project_point = ProjectPoint(Point=divide_surface.Points, Direction=negative, Geometry=sphere_2)  # -> Point, Index; disabled
point_6 = Point(sort_along_curve.Points)  # disabled
distance = Distance(PointA=barycentric, PointB=barycentric_2)  # disabled
line_5 = Line(StartPoint=barycentric, EndPoint=barycentric_2)  # disabled
line_6 = Line(StartPoint=construct_point_9, EndPoint=construct_point_8)  # disabled
line_7 = Line(StartPoint=construct_point_7, EndPoint=construct_point_9)  # disabled
line_8 = Line(StartPoint=construct_point_7, EndPoint=construct_point_8)  # disabled
point_7 = Point(cull_duplicates.Points)  # disabled
list_item_4 = ListItem(List=point_6, Index=number_slider_32, Wrap=True)  # disabled
point_8 = Point(closest_point.ClosestPoint)  # disabled
interpolate_2 = Interpolate(Vertices=point_polar, Degree=3, Periodic=False, KnotStyle=1)  # -> Curve, Length, Domain; disabled
point_9 = Point(closest_points.ClosestPoint)  # disabled
panel_14 = Panel(distance)  # disabled
panel_15 = Panel(pull_point.ClosestPoint)  # disabled
panel_16 = Panel(pull_point.Distance)  # disabled

number_slider_33 = Slider(5, range=0..100)  # disabled

cylinder_3 = Cylinder(Base=point_4, Radius=number_slider_33, Length=number_slider_33)  # disabled

curve_array = CurveArray(Geometry=cylinder_3, Curve=interpolate.Curve, Count=number_slider_33)  # -> Geometry, Transform; disabled

number_slider_34 = Slider(12, range=0..100)  # disabled
number_slider_35 = Slider(9, range=0..100)  # disabled
number_slider_36 = Slider(49, range=0..100)  # disabled
number_slider_37 = Slider(40, range=0..100)  # disabled
number_slider_38 = Slider(12, range=0..100)  # disabled
number_slider_39 = Slider(646, range=0..1000)  # disabled
number_slider_40 = Slider(0, range=0..2)  # disabled
number_slider_41 = Slider(0.89, range=0..2)  # disabled
number_slider_42 = Slider(6, range=0..10)  # disabled
number_slider_43 = Slider(0.63, range=0..2)  # disabled
number_slider_44 = Slider(12, range=0..100)  # disabled
number_slider_45 = Slider(100, range=0..100)  # disabled
series_4 = Series(Start=0, Step=1, Count=10)  # disabled
series_5 = Series(Start=0, Step=1, Count=10)  # disabled
cylinder_4 = Cylinder(Base=PlaneXY(0, 0, 0), Radius=0.5, Length=1)  # disabled
number_slider_46 = Slider(3, range=0..10)  # disabled
number_slider_47 = Slider(7, range=0..100)  # disabled
series_6 = Series(Start=0, Step=1, Count=10)  # disabled
number_slider_48 = Slider(8, range=0..100)  # disabled
number_slider_49 = Slider(9, range=0..100)  # disabled
construct_point_10 = ConstructPoint(XCoordinate=number_slider_34, YCoordinate=number_slider_34, ZCoordinate=number_slider_34)  # disabled
number_slider_50 = Slider(59, range=0..100)  # disabled
number_slider_51 = Slider(54, range=0..100)  # disabled
cylinder_5 = Cylinder(Base=PlaneXY(0, 0, 0), Radius=number_slider_35, Length=number_slider_35)  # disabled
populate_3d_9 = Populate3D(Region={Plane=PlaneXY(0, 0, 0), X=Domain(0, 10), Y=Domain(0, 10), Z=Domain(0, 2)}, Count=100, Seed=1)  # disabled
number_slider_52 = Slider(6, range=0..10)  # disabled
populate_3d_10 = Populate3D(Region={Plane=PlaneXY(0, 0, 0), X=Domain(0, 10), Y=Domain(0, 10), Z=Domain(0, 2)}, Count=number_slider_36, Seed=1)  # disabled
number_slider_53 = Slider(6, range=0..10)  # disabled
populate_geometry_5 = PopulateGeometry(Geometry=cylinder_4, Count=number_slider_38, Seed=1)  # -> graft(Population); disabled
number_slider_54 = Slider(1.398, range=0..10)  # disabled
construct_point_11 = ConstructPoint(XCoordinate=number_slider_37, YCoordinate=number_slider_37, ZCoordinate=number_slider_37)  # disabled
panel_17 = Panel(populate_3d_9)  # disabled
pi_7 = Pi(Factor=number_slider_40)  # disabled
number_slider_55 = Slider(15, range=0..100)  # disabled
deconstruct_2 = Deconstruct(Point=construct_point_10)  # -> XComponent, YComponent, ZComponent; disabled
numbers_to_points_2 = NumbersToPoints(Numbers=[series_6, series_5, series_4], Mask=4)  # disabled
populate_geometry_6 = PopulateGeometry(Geometry=cylinder_5, Count=number_slider_46, Seed=number_slider_39)  # disabled
sphere_3 = Sphere(Base=PlaneXY(0, 0, 0), Radius=number_slider_47)  # disabled
populate_3d_11 = Populate3D(Region={Plane=PlaneXY(0, 0, 0), X=Domain(0, 10), Y=Domain(0, 10), Z=Domain(0, 2)}, Count=number_slider_45, Seed=1)  # disabled
populate_3d_12 = Populate3D(Region={Plane=PlaneXY(0, 0, 0), X=Domain(0, 10), Y=Domain(0, 10), Z=Domain(0, 2)}, Count=number_slider_44, Seed=1)  # disabled
populate_3d_13 = Populate3D(Region={Plane=PlaneXY(0, 0, 0), X=Domain(0, 10), Y=Domain(0, 10), Z=Domain(0, 2)}, Count=number_slider_44, Seed=1)  # disabled
construct_point_12 = ConstructPoint(XCoordinate=number_slider_50, YCoordinate=number_slider_50, ZCoordinate=0)  # disabled
range_5 = Range(Domain=[number_slider_41, number_slider_43], Steps=number_slider_51)  # disabled
list_length_2 = ListLength(List=populate_3d_9)  # disabled
sort_points_2 = SortPoints(Points=populate_3d_9)  # -> Points, Indices; disabled
range_6 = Range(Domain=number_slider_43, Steps=number_slider_51)  # disabled
point_cylindrical_2 = PointCylindrical(BasePlane=PlaneXY(0, 0, 0), Angle=pi_7, Radius=number_slider_49, Elevation=number_slider_48)  # disabled
yz_plane_4 = YZPlane(Origin=Point(0, 0, 0))  # disabled
number_slider_56 = Slider(44, range=0..100)  # disabled
points_to_numbers_2 = PointsToNumbers(Points=populate_geometry_5, Mask=4)  # disabled
divide_surface_2 = DivideSurface(Surface=reparameterize(sphere_3), UCount=number_slider_52, VCount=number_slider_52)  # -> Points, Normals, Parameters; disabled
point_groups_2 = PointGroups(Points=populate_3d_11, Distance=number_slider_54)  # -> Groups, Indices; disabled
panel_18 = Panel(deconstruct_2.XComponent)  # disabled
list_item_5 = ListItem(List=populate_geometry_6, Index=0, Wrap=True)  # -> Item, Item1, Item2; disabled
scale_2 = Scale(Geometry=populate_3d_10, Center=Point(0, 0, 0), Factor=number_slider_53)  # -> Geometry, Transform; disabled
subtraction = Subtraction(A=list_length_2, B=number_slider_55)  # disabled
param_viewer_5 = ParamViewer(deconstruct_2.XComponent)  # disabled
point_10 = Point(populate_3d_12)  # disabled
sphere_4 = Sphere(Base=PlaneXY(0, 0, 0), Radius=1)  # disabled
interpolate_3 = Interpolate(Vertices=divide_surface_2.Points, Degree=3, Periodic=False, KnotStyle=1)  # -> Curve, Length, Domain; disabled
merge_3 = Merge(Data1=populate_3d_13, Data2=populate_3d_12)  # disabled
to_polar_3 = ToPolar(Point=construct_point_12, System=PlaneXY(0, 0, 0))  # -> Phi, Theta, Radius; disabled
to_polar_4 = ToPolar(Point=construct_point_12, System=PlaneXY(0, 0, 0), AnglePoleDown=True)  # -> Phi, Theta, Radius; disabled
pi_8 = Pi(Factor=range_5)  # disabled
param_viewer_6 = ParamViewer(points_to_numbers_2)  # disabled
pi_9 = Pi(Factor=range_6)  # disabled
panel_19 = Panel(sort_points_2.Points)  # disabled
panel_20 = Panel(points_to_numbers_2)  # disabled
random_reduce = RandomReduce(List=populate_3d_9, Reduction=subtraction, Seed=1)  # disabled
panel_21 = Panel(merge_3)  # disabled
geometry_2 = Geometry(point_groups_2.Groups)  # disabled
point_11 = Point(point_groups_2.Groups)  # disabled
negative_2 = Negative(Value=divide_surface_2.Normals)  # disabled
range_7 = Range(Domain=number_slider_56, Steps=number_slider_51)  # disabled
cull_duplicates_2 = CullDuplicates(Points=merge_3, Tolerance=0.1, CullMode=3)  # -> Points, Indices, Valence; disabled
barycentric_3 = Barycentric(PointA=list_item_5.Item, PointB=list_item_5.Item1, PointC=list_item_5.Item2, CoordinateU=1, CoordinateV=1, CoordinateW=1)  # disabled
barycentric_4 = Barycentric(
    PointA=list_item_5.Item,
    PointB=list_item_5.Item1,
    PointC=list_item_5.Item2,
    CoordinateU=list_item_5.Item,
    CoordinateV=list_item_5.Item1,
    CoordinateW=list_item_5.Item2)  # disabled
construct_point_13 = ConstructPoint(XCoordinate=to_polar_4.Phi, YCoordinate=to_polar_4.Theta, ZCoordinate=to_polar_4.Radius)  # disabled
point_oriented_2 = PointOriented(BasePlane=yz_plane_4, UComponent=list_item_5.Item, VComponent=list_item_5.Item1, WComponent=list_item_5.Item2)  # disabled
construct_point_14 = ConstructPoint(XCoordinate=to_polar_3.Phi, YCoordinate=to_polar_3.Theta, ZCoordinate=to_polar_3.Radius)  # disabled
point_polar_2 = PointPolar(BasePlane=PlaneXY(0, 0, 0), XYAngle=pi_8, ZAngle=pi_9, Offset=range_7)  # disabled
pull_point_2 = PullPoint(Point=divide_surface_2.Points, Geometry=sphere_4, ClosestOnly=True)  # -> ClosestPoint, Distance; disabled
panel_22 = Panel(sort_points_2.Indices)  # disabled
param_viewer_7 = ParamViewer(point_groups_2.Groups)  # disabled
param_viewer_8 = ParamViewer(point_groups_2.Groups)  # disabled
point_12 = Point(random_reduce)  # disabled
closest_point_2 = ClosestPoint(Point=construct_point_11, Cloud=scale_2.Geometry)  # -> ClosestPoint, CPIndex, Distance; disabled
closest_points_2 = ClosestPoints(Point=construct_point_11, Cloud=scale_2.Geometry, Count=number_slider_42)  # -> ClosestPoint, CPIndex, Distance; disabled
project_point_2 = ProjectPoint(Point=divide_surface_2.Points, Direction=negative_2, Geometry=sphere_4)  # -> Point, Index; disabled
distance_2 = Distance(PointA=barycentric_3, PointB=barycentric_4)  # disabled
line_9 = Line(StartPoint=barycentric_3, EndPoint=barycentric_4)  # disabled
line_10 = Line(StartPoint=construct_point_14, EndPoint=construct_point_13)  # disabled
line_11 = Line(StartPoint=construct_point_12, EndPoint=construct_point_14)  # disabled
line_12 = Line(StartPoint=construct_point_12, EndPoint=construct_point_13)  # disabled
point_13 = Point(cull_duplicates_2.Points)  # disabled
interpolate_4 = Interpolate(Vertices=random_reduce, Degree=3, Periodic=False, KnotStyle=1)  # -> Curve, Length, Domain; disabled
point_14 = Point(closest_point_2.ClosestPoint)  # disabled
interpolate_5 = Interpolate(Vertices=point_polar_2, Degree=3, Periodic=False, KnotStyle=1)  # -> Curve, Length, Domain; disabled
point_15 = Point(closest_points_2.ClosestPoint)  # disabled
panel_23 = Panel(distance_2)  # disabled
panel_24 = Panel(pull_point_2.ClosestPoint)  # disabled
panel_25 = Panel(pull_point_2.Distance)  # disabled
sort_along_curve_2 = SortAlongCurve(Points=point_12, Curve=interpolate_4.Curve)  # -> Points, Indices; disabled
number_slider_57 = Slider(1, range=0..10)  # disabled
point_16 = Point(sort_along_curve_2.Points)  # disabled
list_item_6 = ListItem(List=point_16, Index=number_slider_57, Wrap=True)  # disabled

number_slider_58 = Slider(0.289, range=0..1)  # disabled

cylinder_6 = Cylinder(Base=point_12, Radius=number_slider_58, Length=number_slider_58)  # disabled

curve_array_2 = CurveArray(Geometry=cylinder_6, Curve=interpolate_4.Curve, Count=number_slider_58)  # -> Geometry, Transform; disabled
